# Grasshopper definition 2018_03_15 - 2.gh (Grasshopper 0.9.76)

xy = XYPlane(Origin=Point(0, 0, 0))
svg_plane_by_page = SVGPlaneByPage(plane=xy, page_size="A3 (P)", scale="1:500", position=Toggle(True))  # -> json_layout, preview
svg_compiler = SVGCompiler(json_layouy=svg_plane_by_page.json_layout)

# ==== cluster SVGCompiler
svg_text = ClusterInput()  # SVG Text
json_layouy = ClusterInput()  # JSON Layout
css_text = ClusterInput()  # CSS Text
css = Data(css_text)
svg_text_2 = Data(svg_text)
python = PythonScript(j=json_layouy)  # -> PLANE, PAGE, SCALE
# ---------- python: Python ----------
import json
import Rhino as r
ob = json.loads(j)
PLANE = [item for sublist in ob['plane'] for item in sublist]
PAGE = ob['page']
SCALE = ob['scale']


lPlane = ob['plane']
lOrigin = r.Geometry.Point3d(lPlane[0][0],lPlane[0][1],lPlane[0][2])
lXAx = r.Geometry.Vector3d(lPlane[1][0],lPlane[1][1],lPlane[1][2])
lYAx = r.Geometry.Vector3d(lPlane[2][0],lPlane[2][1],lPlane[2][2])
PLANE = r.Geometry.Plane(lOrigin,lXAx,lYAx)
# ---------- end python ----------
data = Data("█")
rep = ReplaceText(Text=svg_text_2, Find="zindex=\"", Replace=data, RecursiveReplace=False)
panel = Panel("""<?xml version="1.0" encoding="utf-8"?>
<!-- Generator: Adobe Illustrator 16.0.0, SVG Export Plug-In . SVG Version: 6.00 Build 0)  -->
<!DOCTYPE svg PUBLIC "-//W3C//DTD SVG 1.1//EN" "http://www.w3.org/Graphics/SVG/1.1/DTD/svg11.dtd">
<svg version="1.1" xmlns="http://www.w3.org/2000/svg" xmlns:xlink="http://www.w3.org/1999/xlink" x="0px" y="0px"
width="100%" height="100%" viewBox="0 0 420 297"
xml:space="preserve">
<style type="text/css">""")
panel_2 = Panel(python.PAGE)
split = TextSplit(Text=rep, Separators=data)
dispatch = Dispatch(List=python.PAGE, DispatchPattern=[True, False])  # -> ListA, ListB
item = ListItem(List=reverse(split), Index=0, Wrap=True)
rep_2 = ReplaceText(Text="width=\"`mm\" height=\"~mm\" viewBox=\"0 0 ` ~\"", Find="`", Replace=dispatch.ListA, RecursiveReplace=False)
split_2 = TextSplit(Text=item, Separators="\"")
rep_3 = ReplaceText(Text=rep_2, Find="~", Replace=dispatch.ListB, RecursiveReplace=False)  # -> simplify(Result)
item_2 = ListItem(List=split_2, Index=0, Wrap=True)
merge = Merge(Data1=panel, Data2=css, Data3="</style>")
flatten = FlattenTree(Tree=item_2, Path="{0}")
tmatch = MatchText(Text=merge, RegEx="viewBox", Case=True)
num = Number(flatten)
mindex = MemberIndex(Set=tmatch, Member=Toggle(True))  # -> Index, Count
nullrep = ReplaceNulls(Items=num, Replacements=0)  # -> Items, Count
replace = ReplaceItems(List=merge, Item=rep_3, Indices=mindex.Index, Wrap=False)  # -> simplify(List)
sort = SortList(Keys=nullrep.Items, ValuesA=svg_text_2)  # -> Keys, ValuesA
tstat = TreeStatistics(Tree=flatten(sort.ValuesA))  # -> Paths, Length, Count
viewer = ParamViewer("</svg>")
int = Integer(tstat.Count)
repeat = RepeatData(Data=viewer, Length=int)
branch = TreeBranch(Tree="</svg>", Path=repeat, MaintainPaths=False)
merge_2 = Merge(Data1=flatten(replace), Data2=flatten(sort.ValuesA), Data3=flatten(branch))
svg_text_3 = Text(merge_2)
rep_4 = ReplaceText(Text=svg_text_3, Find=" =\"\" ", Replace=" ", RecursiveReplace=False)
join = TextJoin(Text=rep_4)
svg_content = Text(join)
svg_content_2 = ClusterOutput(svg_content)

# ==== cluster SVGPlaneByPage: Makes a layout json for svg
plane = ClusterInput()  # Orientation and Location of Page
page_size = ClusterInput()  # Size of Page. Input a page size from A5-A0 followed by the orientation (P) or (L), Example: 'A1 (P)'. Alternatively, input dimensions, eg. '500,500'
scale = ClusterInput()  # Scale of Page
position = ClusterInput()  # Position of Plane relative to the page. True = Plane at Centre, False = Plane at Top Left
preset_standard_page_sizes = Panel("""A5 (L),210,148
A5 (P),148,210
A4 (L),297,210
A4 (P),210,297
A3 (L),420,297
A3 (P),297,420
A2 (L),594,420
A2 (P),420,594
A1 (L),841,594
A1 (P),594,841
A0 (L),1189,841
A0 (P),841,1189""")
split = TextSplit(Text=preset_standard_page_sizes, Separators=",")
item = ListItem(List=split, Index=0, Wrap=True)  # -> flatten(Item)

# ---- group: Find which Page Size is being called and pick it from list
mindex = MemberIndex(Set=item, Member=simplify(page_size))  # -> simplify(flatten(Index)), Count
item_2 = ListItem(List=preset_standard_page_sizes, Index=mindex.Index, Wrap=True)  # -> simplify(Item)
merge = Merge(Data1=simplify(item_2), Data2=simplify(page_size))
item_3 = ListItem(List=merge, Index=0, Wrap=True)

# ----
split_2 = TextSplit(Text=scale, Separators=":")
item_4 = ListItem(List=split_2, Index=0, Wrap=True)  # -> Item, Item1
pos = Boolean(position)
num = Number(item_4.Item1)

# ---- group: Choose location of centre
panel = Panel("""1,1
0.5,0.5""")
item_5 = ListItem(List=panel, Index=pos, Wrap=True)

# ---- group: Extract Dimensions
split_3 = TextSplit(Text=item_3, Separators=",")
item_6 = ListItem(List=reverse(split_3), Index=[0, 1], Wrap=True)  # -> reverse(Item)
num_2 = Number(item_6)

# ----
split_4 = TextSplit(Text=item_5, Separators=",")
plane_2 = Data(plane)
dispatch = Dispatch(List=split_4, DispatchPattern=[True, False])  # -> ListA, ListB

# ---- group: Convert to Scale
expression = Expression(x=num_2, y=num, Expression="x*y")

# ----
dispatch_2 = Dispatch(List=expression, DispatchPattern=[True, False])  # -> ListA, ListB

# ---- group: Create domains
dom = ConstructDomain(DomainStart=expr("-x", dispatch_2.ListB), DomainEnd=0)
dom_2 = ConstructDomain(DomainStart=expr("-x", dispatch_2.ListA), DomainEnd=0)

# ---- group: Remap to match centre pt location
remap = RemapNumbers(Value=dispatch.ListB, Source=Domain(0, 1), Target=dom)  # -> Mapped, Clipped
remap_2 = RemapNumbers(Value=dispatch.ListA, Source=Domain(0, 1), Target=dom_2)  # -> Mapped, Clipped

# ---- group: Adjust Centre Plane
pt = PointOriented(BasePlane=plane_2, UComponent=remap_2.Mapped, VComponent=expr("-x", remap.Mapped), WComponent=0)
pl_origin = PlaneOrigin(Base=plane_2, Origin=pt)

# ----
expression_2 = Expression(x=remap_2.Mapped, y=dispatch_2.ListA, Expression="x+y")
expression_3 = Expression(x=remap.Mapped, y=dispatch_2.ListB, Expression="x+y")

# ---- group: Create Adjusted Domain
dom_3 = ConstructDomain(DomainStart=remap_2.Mapped, DomainEnd=expression_2)
dom_4 = ConstructDomain(DomainStart=remap.Mapped, DomainEnd=expression_3)

# ----
x_dim = Domain(dom_4)
y_dim = Domain(dom_3)
plane_3 = Plane(flatten(pl_origin))
scale_2 = Number(flatten(num))
dims = Number(flatten(num_2))
neg = Negative(Value=x_dim)
python = PythonScript(PLANE=plane_3, PAGE=dims, SCALE=scale_2)  # -> JSON; inputs PAGE: list
# ---------- python: Python ----------
import Rhino as r
import rhinoscriptsyntax as rs
import json
p = PLANE
o = {"plane":[[p.Origin[0],p.Origin[1],p.Origin[2]],[p.XAxis[0],p.XAxis[1],p.XAxis[2]],[p.YAxis[0],p.YAxis[1],p.YAxis[2]]], "page":PAGE, "scale":SCALE}
JSON = json.dumps(o)
# ---------- end python ----------

# ---- group: Construct Crv
rectangle = Rectangle(Plane=plane_2, XSize=y_dim, YSize=neg, Radius=0)  # -> Rectangle, Length

# ----
json = Data(python)
preview = ClusterOutput(rectangle.Rectangle)  # Previews the page curve
json_layout = ClusterOutput(json)  # Layout JSON containing Plane, Page, Scale
