# Grasshopper definition 2018_03_15.gh (Grasshopper 0.9.76)
# plug-ins: Human, EleFront, Bifocals

dpipeline = DynamicGeometryPipeline(
    LayerFilter="Option 1::*",
    TypeFilter="Curve",
    NameFilter="*",
    enableFullPath=True,
    GroupByLayer=False,
    GroupByType=False,
    IncludeHidden=True,
    IncludeLocked=True,
    listenToAttributes=True)
rhatt = GetRhinoAttributes(Geometry=dpipeline)  # -> Name, Layer, Color
txt = Text(rhatt.Layer)
txt_2 = Text(rhatt.Name)
panel = Panel(txt)
# Sort names per precinct
bucketsimitems = SRT_bucketSimItems(flatlist=txt, synchronous=txt_2)  # -> buckets_2, simplify(synchbuckets_2)
# Sort curves per precinct
bucketsimitems_2 = SRT_bucketSimItems(flatlist=txt, synchronous=dpipeline)  # -> buckets_2, simplify(synchbuckets_2)
panel_2 = Panel(bucketsimitems.buckets_2)
panel_3 = Panel(bucketsimitems_2.buckets_2)
panel_4 = Panel(bucketsimitems.synchbuckets_2)
panel_5 = Panel(bucketsimitems_2.synchbuckets_2)

# ==== cluster SRT_bucketSimItems: synchronously sorts items using a sorting 'card'
synchronous = ClusterInput()
flatlist = ClusterInput()
synchronous_2 = Data(flatten(synchronous))
flatlist_2 = Data(flatten(flatlist))
data = Data(simplify(graft(synchronous_2)))
data_2 = Data(simplify(graft(flatlist_2)))
cset = CreateSet(List=flatlist_2)  # -> Set, Map
cset_2 = CreateSet(List=flatlist_2)  # -> Set, Map
mindex = MemberIndex(Set=flatlist_2, Member=cset.Set)  # -> Index, Count
mindex_2 = MemberIndex(Set=cset_2.Set, Member=flatlist_2)  # -> Index, Count
viewer = ParamViewer(data_2)
flatten = FlattenTree(Tree=mindex_2.Index, Path="{0}")
item = ListItem(List=synchronous_2, Index=mindex.Index, Wrap=True)  # -> simplify(Item)
replace = ReplacePaths(Data=data, Search=viewer, Replace=flatten)
item_2 = ListItem(List=flatlist_2, Index=mindex.Index, Wrap=True)  # -> simplify(Item)
replace_2 = ReplacePaths(Data=data_2, Search=viewer, Replace=flatten)
buckets = Data(item_2)
synchbuckets = Data(item)
buckets_2 = ClusterOutput(buckets)
synchbuckets_2 = ClusterOutput(synchbuckets)
