# Grasshopper definition Durban GIS- Diagrams All RC.gh (Grasshopper 0.9.76)
# Copyright: Co-de-iT
# plug-ins: Python Interpreter, Anemone, Human, EleFront

# ---- group: Icons
dpipeline = DynamicGeometryPipeline(
    LayerFilter="LIBRARY",
    TypeFilter="Curve",
    NameFilter="*",
    enableFullPath=False,
    GroupByLayer=False,
    GroupByType=False,
    IncludeHidden=True,
    IncludeLocked=True,
    listenToAttriubtes=True)  # -> flatten(GeometryOut)
dpipeline_2 = DynamicGeometryPipeline(
    LayerFilter="HOSPITAL",
    TypeFilter="Curve",
    NameFilter="*",
    enableFullPath=False,
    GroupByLayer=False,
    GroupByType=False,
    IncludeHidden=True,
    IncludeLocked=True,
    listenToAttriubtes=True)  # -> flatten(GeometryOut)
dpipeline_3 = DynamicGeometryPipeline(
    LayerFilter="GARDEN",
    TypeFilter="Curve",
    NameFilter="*",
    enableFullPath=False,
    GroupByLayer=False,
    GroupByType=False,
    IncludeHidden=True,
    IncludeLocked=True,
    listenToAttriubtes=True)  # -> flatten(GeometryOut)
dpipeline_4 = DynamicGeometryPipeline(
    LayerFilter="GOLF",
    TypeFilter="Curve",
    NameFilter="*",
    enableFullPath=False,
    GroupByLayer=False,
    GroupByType=False,
    IncludeHidden=True,
    IncludeLocked=True,
    listenToAttriubtes=True)  # -> flatten(GeometryOut)
dpipeline_5 = DynamicGeometryPipeline(
    LayerFilter="SOCCER",
    TypeFilter="Curve",
    NameFilter="*",
    enableFullPath=False,
    GroupByLayer=False,
    GroupByType=False,
    IncludeHidden=True,
    IncludeLocked=True,
    listenToAttriubtes=True)  # -> flatten(GeometryOut)
dpipeline_6 = DynamicGeometryPipeline(
    LayerFilter="RUGBY",
    TypeFilter="Curve",
    NameFilter="*",
    enableFullPath=False,
    GroupByLayer=False,
    GroupByType=False,
    IncludeHidden=True,
    IncludeLocked=True,
    listenToAttriubtes=True)  # -> flatten(GeometryOut)
dpipeline_7 = DynamicGeometryPipeline(
    LayerFilter="STATION",
    TypeFilter="Curve",
    NameFilter="*",
    enableFullPath=False,
    GroupByLayer=False,
    GroupByType=False,
    IncludeHidden=True,
    IncludeLocked=True,
    listenToAttriubtes=True)  # -> flatten(GeometryOut)
dpipeline_8 = DynamicGeometryPipeline(
    LayerFilter="EDUCATION",
    TypeFilter="Curve",
    NameFilter="*",
    enableFullPath=False,
    GroupByLayer=False,
    GroupByType=False,
    IncludeHidden=True,
    IncludeLocked=True,
    listenToAttriubtes=True)  # -> flatten(GeometryOut)

# ----
merge = Merge()

geo = Geometry()
getuv = GetUserValue(Geometry=geo, Key="Legend")
null = NullItem(Item=getuv)  # -> NullFlags, InvalidFlags, Description
dispatch = Dispatch(List=geo, DispatchPattern=null.NullFlags)  # -> ListA, ListB

# ---- group: Diagram Switcher / Redraw All
button = Button()

# ---- group: Diagram Switcher
panel = Panel("""01_Community Facilities
02_Public Transport
03_Pedestrian Networks
04_Roads and Access
05_Precincts
06_Growth""")
lng = ListLength(List=panel)
loop_start = LoopStart(Repeat=expr("x-1", lng), Trigger=button, Data_0=-1)  # -> port, Counter, Data_0
number_slider = Slider(3, range=0..6)
expression = Expression(x=loop_start.Data_0, Expression="x+1")
loop_end = LoopEnd(port=loop_start.port, Exit=False, Data_0=expression, pausedState=False, state="Constant output")
item = ListItem(List=panel, Index=number_slider, Wrap=True)
panel_2 = Panel(item)

# ----
txt = Text("A")
C = Text("C")
txt_2 = Text("750")
txt_3 = Text("B")
txt_4 = Text("750")
txt_5 = Text("750")
filter = StreamFilter(Gate=number_slider, Stream0=txt, Stream1=txt_3, Stream2=C)
filter_2 = StreamFilter(Gate=number_slider, Stream0=txt_5, Stream1=txt_4, Stream2=txt_2)

panel_3 = Panel("\\sydsrv01\projects\2014\214059.00\11.0 DRAWINGS\11.07 Graphics\SVG\2016\Base_Diagram2.jpg ")

panel_4 = Panel("""* {
fill: none;
stroke: none;
}""")
panel_5 = Panel("""[tag="image"]{
 opacity:0.50;
}""")

rep = ReplaceText(Text="█.svg", Find="█", Replace=item, RecursiveReplace=False)

# ---- group: Page Size
pt = Point(<point referenced from the Rhino model>)
xy = XYPlane(Origin=pt)
paper = Panel("A3 (P)")
scale = Panel("1:20000")
prot = RotatePlane(Plane=xy, Angle=degrees(Slider(0, range=0..180)))
svg_plane_by_page = SVGPlaneByPage(plane=prot, M=paper, T=scale)  # -> R_2, R

# ---- group: Icons
area = Area(Geometry=dpipeline_4)  # -> Area, Centroid
area_2 = Area(Geometry=dpipeline_7)  # -> Area, Centroid
area_3 = Area(Geometry=dpipeline_3)  # -> Area, Centroid
area_4 = Area(Geometry=dpipeline_8)  # -> Area, Centroid
area_5 = Area(Geometry=dpipeline_2)  # -> Area, Centroid
area_6 = Area(Geometry=dpipeline)  # -> Area, Centroid
area_7 = Area(Geometry=dpipeline_5)  # -> Area, Centroid
area_8 = Area(Geometry=dpipeline_6)  # -> Area, Centroid
merge_2 = Merge(
    Data1=area_4.Centroid,
    Data2=area_3.Centroid,
    Data3=area.Centroid,
    Data4=area_5.Centroid,
    Data5=area_6.Centroid,
    Data6=area_8.Centroid,
    Data7=area_7.Centroid,
    Data8=area_2.Centroid)
merge_3 = Merge(
    Data1=dpipeline_8,
    Data2=dpipeline_3,
    Data3=dpipeline_4,
    Data4=dpipeline_2,
    Data5=dpipeline,
    Data6=dpipeline_6,
    Data7=dpipeline_5,
    Data8=dpipeline_7)
objatts = ObjectAttributes(ObjectOrAttributes=merge_3)  # -> Name, LayerName, LayerFullPath, Color, MaterialName, LinetypeName, GroupIndices, PlotWeight
user_text_to_svg = UserTextToSVG(G=merge_3)  # -> attr_string_2, attr_list_2
panel_6 = Panel("""CC-STATION
CC-STATIONLEGEND
CC-GOLF
CC-SOCCER
CC-RUGBY
CC-EDUCATION
CC-LIBRARY
CC-HOSPITAL
CC-SWIMMING
CC-GARDEN""")
int = Integer(75)
panel_7 = Panel("""Train17.svg
Train17.svg
Golf22.svg
Soccer20.svg
Sportsball5.svg
College1.svg
Book265.svg
Pharmacy19.svg
Swimming28.svg
Tree30.svg""")
dom = ConstructDomain(DomainStart=expr("-x/2", int), DomainEnd=expr("x/2", int))
rectangle = Rectangle(Plane=merge_2, XSize=dom, YSize=dom, Radius=0)  # -> Rectangle, Length
rep_2 = ReplaceText(Text="logo=\"True\" █", Find="█", Replace=user_text_to_svg.attr_string_2, RecursiveReplace=False)
replace = ReplaceMembers(Set=objatts.LayerName, Find=panel_6, Replace=panel_7)
rep_3 = ReplaceText(Text="K:\2014\214059.00\11.0 DRAWINGS\11.07 Graphics\SVG\~", Find="~", Replace=replace, RecursiveReplace=False)
svg_image = SVGImage(img_pa=rep_3, rec=rectangle.Rectangle, T=svg_plane_by_page.R_2, attributes=rep_2)

# ---- group: Station Building
dpipeline_9 = DynamicGeometryPipeline(
    LayerFilter="Station_Building",
    TypeFilter="Curve",
    NameFilter="*",
    enableFullPath=False,
    GroupByLayer=False,
    GroupByType=False,
    IncludeHidden=True,
    IncludeLocked=True,
    listenToAttriubtes=True)  # -> flatten(GeometryOut)
rep_4 = ReplaceText(Text="tag=\"█\"", Find="█", Replace="Station_Building", RecursiveReplace=False)  # -> flatten(Result)
svg_polyline = SVGPolyline(crv=flatten(dpipeline_9), layout=svg_plane_by_page.R_2, attributes=rep_4)  # -> svg_2, crv_4

# ---- group: Golf
dpipeline_10 = DynamicGeometryPipeline(
    LayerFilter="Golf",
    TypeFilter="Curve",
    NameFilter="*",
    enableFullPath=False,
    GroupByLayer=False,
    GroupByType=False,
    IncludeHidden=True,
    IncludeLocked=True,
    listenToAttriubtes=True)  # -> flatten(GeometryOut)
rep_5 = ReplaceText(Text="tag=\"█\"", Find="█", Replace="Golf", RecursiveReplace=False)  # -> flatten(Result)
svg_polyline_2 = SVGPolyline(crv=flatten(dpipeline_10), layout=svg_plane_by_page.R_2, attributes=rep_5)  # -> svg_2, crv_4

# ---- group: Beach
dpipeline_11 = DynamicGeometryPipeline(
    LayerFilter="Beach",
    TypeFilter="Curve",
    NameFilter="*",
    enableFullPath=False,
    GroupByLayer=False,
    GroupByType=False,
    IncludeHidden=True,
    IncludeLocked=True,
    listenToAttriubtes=True)  # -> flatten(GeometryOut)
rep_6 = ReplaceText(Text="tag=\"█\"", Find="█", Replace="Beach", RecursiveReplace=False)  # -> flatten(Result)
svg_polyline_3 = SVGPolyline(crv=flatten(dpipeline_11), layout=svg_plane_by_page.R_2, attributes=rep_6)  # -> svg_2, crv_4

# ---- group: Soccer
dpipeline_12 = DynamicGeometryPipeline(
    LayerFilter="Soccer",
    TypeFilter="Curve",
    NameFilter="*",
    enableFullPath=False,
    GroupByLayer=False,
    GroupByType=False,
    IncludeHidden=True,
    IncludeLocked=True,
    listenToAttriubtes=True)  # -> flatten(GeometryOut)
rep_7 = ReplaceText(Text="tag=\"█\"", Find="█", Replace="Soccer", RecursiveReplace=False)  # -> flatten(Result)
svg_polyline_4 = SVGPolyline(crv=flatten(dpipeline_12), layout=svg_plane_by_page.R_2, attributes=rep_7)  # -> svg_2, crv_4

# ---- group: Rugby
dpipeline_13 = DynamicGeometryPipeline(
    LayerFilter="Rugby",
    TypeFilter="Curve",
    NameFilter="*",
    enableFullPath=False,
    GroupByLayer=False,
    GroupByType=False,
    IncludeHidden=True,
    IncludeLocked=True,
    listenToAttriubtes=True)  # -> flatten(GeometryOut)
rep_8 = ReplaceText(Text="tag=\"█\"", Find="█", Replace="Rugby", RecursiveReplace=False)  # -> flatten(Result)
svg_polyline_5 = SVGPolyline(crv=flatten(dpipeline_13), layout=svg_plane_by_page.R_2, attributes=rep_8)  # -> svg_2, crv_4

# ---- group: Garden
dpipeline_14 = DynamicGeometryPipeline(
    LayerFilter="Garden",
    TypeFilter="Curve",
    NameFilter="*",
    enableFullPath=False,
    GroupByLayer=False,
    GroupByType=False,
    IncludeHidden=True,
    IncludeLocked=True,
    listenToAttriubtes=True)  # -> flatten(GeometryOut)
rep_9 = ReplaceText(Text="tag=\"█\"", Find="█", Replace="Garden", RecursiveReplace=False)  # -> flatten(Result)
svg_polyline_6 = SVGPolyline(crv=flatten(dpipeline_14), layout=svg_plane_by_page.R_2, attributes=rep_9)  # -> svg_2, crv_4

# ---- group: Hospital
dpipeline_15 = DynamicGeometryPipeline(
    LayerFilter="Hospital",
    TypeFilter="Curve",
    NameFilter="*",
    enableFullPath=False,
    GroupByLayer=False,
    GroupByType=False,
    IncludeHidden=True,
    IncludeLocked=True,
    listenToAttriubtes=True)  # -> flatten(GeometryOut)
rep_10 = ReplaceText(Text="tag=\"█\"", Find="█", Replace="Hospital", RecursiveReplace=False)  # -> flatten(Result)
svg_polyline_7 = SVGPolyline(crv=flatten(dpipeline_15), layout=svg_plane_by_page.R_2, attributes=rep_10)  # -> svg_2, crv_4

# ---- group: Education
dpipeline_16 = DynamicGeometryPipeline(
    LayerFilter="Education",
    TypeFilter="Curve",
    NameFilter="*",
    enableFullPath=False,
    GroupByLayer=False,
    GroupByType=False,
    IncludeHidden=True,
    IncludeLocked=True,
    listenToAttriubtes=True)  # -> flatten(GeometryOut)
rep_11 = ReplaceText(Text="tag=\"█\"", Find="█", Replace="Education", RecursiveReplace=False)  # -> flatten(Result)
svg_polyline_8 = SVGPolyline(crv=flatten(dpipeline_16), layout=svg_plane_by_page.R_2, attributes=rep_11)  # -> svg_2, crv_4

# ---- group: Library
dpipeline_17 = DynamicGeometryPipeline(
    LayerFilter="Library",
    TypeFilter="Curve",
    NameFilter="*",
    enableFullPath=False,
    GroupByLayer=False,
    GroupByType=False,
    IncludeHidden=True,
    IncludeLocked=True,
    listenToAttriubtes=True)  # -> flatten(GeometryOut)
rep_12 = ReplaceText(Text="tag=\"█\"", Find="█", Replace="Library", RecursiveReplace=False)  # -> flatten(Result)
svg_polyline_9 = SVGPolyline(crv=flatten(dpipeline_17), layout=svg_plane_by_page.R_2, attributes=rep_12)  # -> svg_2, crv_4

# ---- group: Train Station
panel_8 = Panel("Station")
number_slider_2 = Slider(35, range=0..300)
dpipeline_18 = DynamicGeometryPipeline(
    LayerFilter=panel_8,
    TypeFilter="Curve",
    NameFilter="*",
    enableFullPath=False,
    GroupByLayer=False,
    GroupByType=False,
    IncludeHidden=True,
    IncludeLocked=True,
    listenToAttriubtes=True)  # -> flatten(GeometryOut)
area_9 = Area(Geometry=dpipeline_18)  # -> Area, Centroid
circle = CircleCNR(Center=area_9.Centroid, Normal=Vector(0, 0, 1), Radius=number_slider_2)
topoly = CurveToPolyline(Curve=circle, ToleranceDistance=0.1, ToleranceAngle=0)  # -> Polyline, Segments
rep_13 = ReplaceText(Text="tag=\"█\"", Find="█", Replace=panel_8, RecursiveReplace=False)  # -> flatten(Result)
svg_polyline_10 = SVGPolyline(crv=flatten(topoly.Polyline), layout=svg_plane_by_page.R_2, attributes=rep_13)  # -> svg_2, crv_4

# ----
crv = Curve(svg_plane_by_page.R)
svg_image_2 = SVGImage(img_pa=panel_3, rec=crv, T=svg_plane_by_page.R_2, attributes="tag=\"image\"")

# ---- group: FONT
panel_9 = Panel("Futura")

# ---- group: PDF Export
panel_10 = Panel("K:\2014\214059.00\11.0 DRAWINGS\11.07 Graphics\SVG\2016\Diagrams")
python = PythonScript(folder=panel_10, ACTIVATE=Toggle(False))  # -> out, a; inputs ACTIVATE: Boolean
# ---------- python: Python ----------
import os
import time
import subprocess


svgs = []
match = "svg"
svgstemp = []

paths = os.listdir(folder)


for path in paths:
    if match in path:
        svgstemp.append(path)
        
for svg in svgstemp:
    if filter in svg:
        svgs.append(svg)

print svgs
pdfs = [os.path.splitext(x)[0] + '.pdf' for x in svgs]
print pdfs

svgs = [folder+"\\" + x for x in svgs]
pdfs = [folder+"\\" + x for x in pdfs]


for i in range(len(svgs)):
    SVG = svgs[i]
    PDF = pdfs[i]
    cmdString2 = '"T:\Project Temp\AGU\Inkscape\inkscape" "' + SVG + '" --export-pdf="' + PDF + '"'

    if ACTIVATE == True:
        CREATE_NO_WINDOW = 0x08000000
        subprocess.call(cmdString2, creationflags=CREATE_NO_WINDOW)
# ---------- end python ----------

# ---- group: Arrow Line Shorten Distance
panel_11 = Panel("-50")

# ---- group: Medium
panel_12 = Panel("Medium")
dpipeline_19 = DynamicGeometryPipeline(
    LayerFilter=panel_12,
    TypeFilter="Curve",
    NameFilter="*",
    enableFullPath=False,
    GroupByLayer=False,
    GroupByType=False,
    IncludeHidden=True,
    IncludeLocked=True,
    listenToAttriubtes=True)  # -> flatten(GeometryOut)
ext = ExtendCurve(Curve=dpipeline_19, Type=0, Start=panel_11, End=panel_11)
topoly_2 = CurveToPolyline(Curve=ext, ToleranceDistance=90, ToleranceAngle=0, MaxEdge=20)  # -> Polyline, Segments
smoothpline = SmoothPolyline(Polyline=topoly_2.Polyline, Strength="1", Times="200")
rep_14 = ReplaceText(Text="tag=\"█\"", Find="█", Replace=panel_12, RecursiveReplace=False)  # -> flatten(Result)
svg_polyline_11 = SVGPolyline(crv=flatten(smoothpline), layout=svg_plane_by_page.R_2, attributes=rep_14)  # -> svg_2, crv_4

# ---- group: Minor
panel_13 = Panel("Minor")
dpipeline_20 = DynamicGeometryPipeline(
    LayerFilter=panel_13,
    TypeFilter="Curve",
    NameFilter="*",
    enableFullPath=False,
    GroupByLayer=False,
    GroupByType=False,
    IncludeHidden=True,
    IncludeLocked=True,
    listenToAttriubtes=True)  # -> flatten(GeometryOut)
ext_2 = ExtendCurve(Curve=dpipeline_20, Type=0, Start=panel_11, End=panel_11)
topoly_3 = CurveToPolyline(Curve=ext_2, ToleranceDistance=90, ToleranceAngle=0, MaxEdge=20)  # -> Polyline, Segments
smoothpline_2 = SmoothPolyline(Polyline=topoly_3.Polyline, Strength="1", Times="100")
rep_15 = ReplaceText(Text="tag=\"█\"", Find="█", Replace=panel_13, RecursiveReplace=False)  # -> flatten(Result)
svg_polyline_12 = SVGPolyline(crv=flatten(smoothpline_2), layout=svg_plane_by_page.R_2, attributes=rep_15)  # -> svg_2, crv_4

# ---- group: Medium Arrow
data = Data(svg_plane_by_page.R_2)
cluster = Cluster(crv=smoothpline, T=data, C=Toggle(True), size=Slider(1.5, range=0..5), i=0)
crv_2 = Curve(cluster)
rep_16 = ReplaceText(Text="tag=\"█_arrow\"", Find="█", Replace=panel_12, RecursiveReplace=False)  # -> flatten(Result)
svg_polyline_13 = SVGPolyline(crv=flatten(crv_2), layout=svg_plane_by_page.R_2, attributes=rep_16)  # -> svg_2, crv_4

# ---- group: Minor Arrow
data_2 = Data(svg_plane_by_page.R_2)
cluster_2 = Cluster(crv=smoothpline_2, T=data_2, C=Toggle(True), size=Slider(1, range=0..5), i=0)
crv_3 = Curve(cluster_2)
rep_17 = ReplaceText(Text="tag=\"█_arrow\"", Find="█", Replace=panel_13, RecursiveReplace=False)  # -> flatten(Result)
svg_polyline_14 = SVGPolyline(crv=flatten(crv_3), layout=svg_plane_by_page.R_2, attributes=rep_17)  # -> svg_2, crv_4

# ---- group: Arrow Switcher
list = ValueList({"Both": 0, "Start": 1, "End": 2}, selected="Both")

# ---- group: Remove User Text
remut = RemoveUserText(Acivate=Button())  # -> Message, Geometry

# ---- group: Primary
panel_14 = Panel("Primary")
dpipeline_21 = DynamicGeometryPipeline(
    LayerFilter=panel_14,
    TypeFilter="Curve",
    NameFilter="*",
    enableFullPath=False,
    GroupByLayer=False,
    GroupByType=False,
    IncludeHidden=True,
    IncludeLocked=True,
    listenToAttriubtes=True)  # -> flatten(GeometryOut)
ext_3 = ExtendCurve(Curve=dpipeline_21, Type=0, Start=panel_11, End=panel_11)
topoly_4 = CurveToPolyline(Curve=ext_3, ToleranceDistance=90, ToleranceAngle=0, MaxEdge=20)  # -> Polyline, Segments
smoothpline_3 = SmoothPolyline(Polyline=topoly_4.Polyline, Strength="1", Times="100")
rep_18 = ReplaceText(Text="tag=\"█\"", Find="█", Replace=panel_14, RecursiveReplace=False)  # -> flatten(Result)
svg_polyline_15 = SVGPolyline(crv=flatten(smoothpline_3), layout=svg_plane_by_page.R_2, attributes=rep_18)  # -> svg_2, crv_4

# ---- group: Arterial
panel_15 = Panel("Arterial")
dpipeline_22 = DynamicGeometryPipeline(
    LayerFilter=panel_15,
    TypeFilter="Curve",
    NameFilter="*",
    enableFullPath=False,
    GroupByLayer=False,
    GroupByType=False,
    IncludeHidden=True,
    IncludeLocked=True,
    listenToAttriubtes=True)  # -> flatten(GeometryOut)
ext_4 = ExtendCurve(Curve=dpipeline_22, Type=0, Start=panel_11, End=panel_11)
topoly_5 = CurveToPolyline(Curve=ext_4, ToleranceDistance=90, ToleranceAngle=0, MaxEdge=20)  # -> Polyline, Segments
smoothpline_4 = SmoothPolyline(Polyline=topoly_5.Polyline, Strength="1", Times="100")
rep_19 = ReplaceText(Text="tag=\"█\"", Find="█", Replace=panel_15, RecursiveReplace=False)  # -> flatten(Result)
# 04_Roads and Access
svg_polyline_16 = SVGPolyline(crv=flatten(smoothpline_4), layout=svg_plane_by_page.R_2, attributes=rep_19)  # -> svg_2, crv_4

# ----
getuv_2 = GetUserValue(Geometry=dpipeline_22, Key="arrowloc")
nullrep = ReplaceNulls(Items=getuv_2, Replacements=0)  # -> Items, Count

# ---- group: Secondary
panel_16 = Panel("Secondary")
dpipeline_23 = DynamicGeometryPipeline(
    LayerFilter=panel_16,
    TypeFilter="Curve",
    NameFilter="*",
    enableFullPath=False,
    GroupByLayer=False,
    GroupByType=False,
    IncludeHidden=True,
    IncludeLocked=True,
    listenToAttriubtes=True)  # -> flatten(GeometryOut)
ext_5 = ExtendCurve(Curve=dpipeline_23, Type=0, Start=panel_11, End=panel_11)
topoly_6 = CurveToPolyline(Curve=ext_5, ToleranceDistance=90, ToleranceAngle=0, MaxEdge=20)  # -> Polyline, Segments
smoothpline_5 = SmoothPolyline(Polyline=topoly_6.Polyline, Strength="1", Times="100")
rep_20 = ReplaceText(Text="tag=\"█\"", Find="█", Replace=panel_16, RecursiveReplace=False)  # -> flatten(Result)
svg_polyline_17 = SVGPolyline(crv=flatten(smoothpline_5), layout=svg_plane_by_page.R_2, attributes=rep_20)  # -> svg_2, crv_4

# ---- group: Arterial Arrow
data_3 = Data(svg_plane_by_page.R_2)
cluster_3 = Cluster(crv=smoothpline_4, T=data_3, C=Toggle(True), size=Slider(2, range=0..5), i=nullrep.Items)
crv_4 = Curve(cluster_3)
rep_21 = ReplaceText(Text="tag=\"█_arrow\"", Find="█", Replace=panel_15, RecursiveReplace=False)  # -> flatten(Result)
svg_polyline_18 = SVGPolyline(crv=flatten(crv_4), layout=svg_plane_by_page.R_2, attributes=rep_21)  # -> svg_2, crv_4

# ---- group: Primary Arrow
data_4 = Data(svg_plane_by_page.R_2)
cluster_4 = Cluster(crv=smoothpline_3, T=data_4, C=Toggle(True), size=Slider(2, range=0..5), i=0)
crv_5 = Curve(cluster_4)
rep_22 = ReplaceText(Text="tag=\"█_arrow\"", Find="█", Replace=panel_14, RecursiveReplace=False)  # -> flatten(Result)
svg_polyline_19 = SVGPolyline(crv=flatten(crv_5), layout=svg_plane_by_page.R_2, attributes=rep_22)  # -> svg_2, crv_4

# ---- group: Secondary Arrow
data_5 = Data(svg_plane_by_page.R_2)
cluster_5 = Cluster(crv=smoothpline_5, T=data_5, C=Toggle(True), size=Slider(1, range=0..5), i=0)
crv_6 = Curve(cluster_5)
rep_23 = ReplaceText(Text="tag=\"█_arrow\"", Find="█", Replace=panel_16, RecursiveReplace=False)  # -> flatten(Result)
svg_polyline_20 = SVGPolyline(crv=flatten(crv_6), layout=svg_plane_by_page.R_2, attributes=rep_23)  # -> svg_2, crv_4

# ---- group: Diagram Switcher
item_2 = ListItem(List=panel, Index=number_slider, Wrap=True)

# ----
rep_24 = ReplaceText(Text="█_legend.svg", Find="█", Replace=item_2, RecursiveReplace=False)

# ---- group: PDF Export
panel_17 = Panel("K:\2014\214059.00\11.0 DRAWINGS\11.07 Graphics\SVG\2016\Diagrams")
python_2 = PythonScript(folder=panel_17, ACTIVATE=Toggle(False))  # -> out, a; inputs ACTIVATE: Boolean; same code as python

# ---- group: Page Size
pt_2 = Point(<point referenced from the Rhino model>)
xy_2 = XYPlane(Origin=pt_2)
scale_2 = Panel("1:20000")
prot_2 = RotatePlane(Plane=xy_2, Angle=degrees(Slider(0, range=0..180)))
svg_plane_by_page_custom = SVGPlaneByPage_2(plane=prot_2, num="100", M="A3", num_2="100", T=scale_2)  # -> R_2, R

# ----
X = UnitX(Factor=Slider(0, range=-420..0))
pt_3 = Point(<point referenced from the Rhino model>)
Z = UnitZ(Factor=Slider(0, range=-297..0))
move = Move(Geometry=pt_3, Motion=X)  # -> Geometry, Transform
move_2 = Move(Geometry=move.Geometry, Motion=Z)  # -> Geometry, Transform
panel_18 = Panel("""text="█"
text-anchor="left"
""")
rep_25 = ReplaceText(Text=panel_18, Find="█", Replace="01_Heading", RecursiveReplace=False)
svg_text_object = SVGTextObject(
    txt=simplify(graft("Community Facilities")),
    P=simplify(graft(move_2.Geometry)),
    T=svg_plane_by_page_custom.R_2,
    R=rep_25)  # -> R_2, txt_4

panel_19 = Panel("""Train Line
Train Station
Beach/Ocean Swim
Golf Course
Soccer Field
Rugby Stadium
Educational Facilities
Library
Hospital Facilities
Botanical Gardens""")
Y = UnitY(Factor="-150")
lng_2 = ListLength(List=panel_19)
pt_4 = Point(<point referenced from the Rhino model>)
arrlinear = LinearArray(Geometry=pt_4, Direction=Y, Count=lng_2)  # -> simplify(graft(Geometry)), Transform
txt_6 = Text(simplify(graft(panel_19)))
panel_20 = Panel("""text="█"
text-anchor="left"
""")
rep_26 = ReplaceText(Text=panel_20, Find="█", Replace="01_Body", RecursiveReplace=False)
svg_text_object_2 = SVGTextObject(txt=simplify(graft(txt_6)), P=simplify(graft(arrlinear.Geometry)), T=svg_plane_by_page_custom.R_2, R=rep_26)  # -> R_2, txt_4

# ---- group: Train Station
dpipeline_24 = DynamicGeometryPipeline(
    LayerFilter="Station_Legend",
    TypeFilter="Curve",
    NameFilter="*",
    enableFullPath=False,
    GroupByLayer=False,
    GroupByType=False,
    IncludeHidden=True,
    IncludeLocked=True,
    listenToAttriubtes=True)  # -> flatten(GeometryOut)
area_10 = Area(Geometry=dpipeline_24)  # -> Area, Centroid
circle_2 = CircleCNR(Center=area_10.Centroid, Normal=Vector(0, 0, 1), Radius=number_slider_2)
topoly_7 = CurveToPolyline(Curve=circle_2, ToleranceDistance=0.1, ToleranceAngle=0)  # -> Polyline, Segments
rep_27 = ReplaceText(Text="tag=\"█\"", Find="█", Replace=panel_8, RecursiveReplace=False)  # -> flatten(Result)
svg_polyline_21 = SVGPolyline(crv=flatten(topoly_7.Polyline), layout=svg_plane_by_page_custom.R_2, attributes=rep_27)  # -> svg_2, crv_4

# ---- group: Rugby Legend
dpipeline_25 = DynamicGeometryPipeline(
    LayerFilter="Rugby_Legend",
    TypeFilter="Curve",
    NameFilter="*",
    enableFullPath=False,
    GroupByLayer=False,
    GroupByType=False,
    IncludeHidden=True,
    IncludeLocked=True,
    listenToAttriubtes=True)  # -> flatten(GeometryOut)
svg_polyline_22 = SVGPolyline(crv=flatten(dpipeline_25), layout=svg_plane_by_page_custom.R_2, attributes=rep_8)  # -> svg_2, crv_4

# ---- group: Education Legend
dpipeline_26 = DynamicGeometryPipeline(
    LayerFilter="Education_Legend",
    TypeFilter="Curve",
    NameFilter="*",
    enableFullPath=False,
    GroupByLayer=False,
    GroupByType=False,
    IncludeHidden=True,
    IncludeLocked=True,
    listenToAttriubtes=True)  # -> flatten(GeometryOut)
svg_polyline_23 = SVGPolyline(crv=flatten(dpipeline_26), layout=svg_plane_by_page_custom.R_2, attributes=rep_11)  # -> svg_2, crv_4

# ---- group: Hospital Legend
dpipeline_27 = DynamicGeometryPipeline(
    LayerFilter="Hospital_Legend",
    TypeFilter="Curve",
    NameFilter="*",
    enableFullPath=False,
    GroupByLayer=False,
    GroupByType=False,
    IncludeHidden=True,
    IncludeLocked=True,
    listenToAttriubtes=True)  # -> flatten(GeometryOut)
svg_polyline_24 = SVGPolyline(crv=flatten(dpipeline_27), layout=svg_plane_by_page_custom.R_2, attributes=rep_10)  # -> svg_2, crv_4

# ---- group: Soccer Legend
dpipeline_28 = DynamicGeometryPipeline(
    LayerFilter="Soccer_Legend",
    TypeFilter="Curve",
    NameFilter="*",
    enableFullPath=False,
    GroupByLayer=False,
    GroupByType=False,
    IncludeHidden=True,
    IncludeLocked=True,
    listenToAttriubtes=True)  # -> flatten(GeometryOut)
svg_polyline_25 = SVGPolyline(crv=flatten(dpipeline_28), layout=svg_plane_by_page_custom.R_2, attributes=rep_7)  # -> svg_2, crv_4

# ---- group: Beach Legend
dpipeline_29 = DynamicGeometryPipeline(
    LayerFilter="Beach_Legend",
    TypeFilter="Curve",
    NameFilter="*",
    enableFullPath=False,
    GroupByLayer=False,
    GroupByType=False,
    IncludeHidden=True,
    IncludeLocked=True,
    listenToAttriubtes=True)  # -> flatten(GeometryOut)
svg_polyline_26 = SVGPolyline(crv=flatten(dpipeline_29), layout=svg_plane_by_page_custom.R_2, attributes=rep_6)  # -> svg_2, crv_4

# ---- group: Garden Legend
dpipeline_30 = DynamicGeometryPipeline(
    LayerFilter="Garden_Legend",
    TypeFilter="Curve",
    NameFilter="*",
    enableFullPath=False,
    GroupByLayer=False,
    GroupByType=False,
    IncludeHidden=True,
    IncludeLocked=True,
    listenToAttriubtes=True)  # -> flatten(GeometryOut)
svg_polyline_27 = SVGPolyline(crv=flatten(dpipeline_30), layout=svg_plane_by_page_custom.R_2, attributes=rep_9)  # -> svg_2, crv_4

# ---- group: Golf Legend
dpipeline_31 = DynamicGeometryPipeline(
    LayerFilter="Golf_Legend",
    TypeFilter="Curve",
    NameFilter="*",
    enableFullPath=False,
    GroupByLayer=False,
    GroupByType=False,
    IncludeHidden=True,
    IncludeLocked=True,
    listenToAttriubtes=True)  # -> flatten(GeometryOut)
svg_polyline_28 = SVGPolyline(crv=flatten(dpipeline_31), layout=svg_plane_by_page_custom.R_2, attributes=rep_5)  # -> svg_2, crv_4

# ---- group: Library Legend
dpipeline_32 = DynamicGeometryPipeline(
    LayerFilter="Library_Legend",
    TypeFilter="Curve",
    NameFilter="*",
    enableFullPath=False,
    GroupByLayer=False,
    GroupByType=False,
    IncludeHidden=True,
    IncludeLocked=True,
    listenToAttriubtes=True)  # -> flatten(GeometryOut)
svg_polyline_29 = SVGPolyline(crv=flatten(dpipeline_32), layout=svg_plane_by_page_custom.R_2, attributes=rep_12)  # -> svg_2, crv_4

# ---- group: Station Building
dpipeline_33 = DynamicGeometryPipeline(
    LayerFilter="Station_Building_Legend",
    TypeFilter="Curve",
    NameFilter="*",
    enableFullPath=False,
    GroupByLayer=False,
    GroupByType=False,
    IncludeHidden=True,
    IncludeLocked=True,
    listenToAttriubtes=True)  # -> flatten(GeometryOut)
svg_polyline_30 = SVGPolyline(crv=flatten(dpipeline_33), layout=svg_plane_by_page_custom.R_2, attributes=rep_4)  # -> svg_2, crv_4

# ----
X_2 = UnitX(Factor=Slider(0, range=-420..0))
Z_2 = UnitZ(Factor=Slider(0, range=-297..0))
pt_5 = Point(<point referenced from the Rhino model>)
move_3 = Move(Geometry=pt_5, Motion=X_2)  # -> Geometry, Transform
move_4 = Move(Geometry=move_3.Geometry, Motion=Z_2)  # -> Geometry, Transform
panel_21 = Panel("""text="█"
text-anchor="left"
""")
rep_28 = ReplaceText(Text=panel_21, Find="█", Replace="01_Heading", RecursiveReplace=False)
svg_text_object_3 = SVGTextObject(txt=simplify(graft("Public Transport")), P=simplify(graft(move_4.Geometry)), T=svg_plane_by_page_custom.R_2, R=rep_28)  # -> R_2, txt_4

panel_22 = Panel("""Heavy Rail
IRPTN Transport Interchange Stations
Inner City Network
IRPTN""")
Y_2 = UnitY(Factor="-150")
lng_3 = ListLength(List=panel_22)
pt_6 = Point(<point referenced from the Rhino model>)
arrlinear_2 = LinearArray(Geometry=pt_6, Direction=Y_2, Count=lng_3)  # -> simplify(graft(Geometry)), Transform
txt_7 = Text(simplify(graft(panel_22)))
panel_23 = Panel("""text="█"
text-anchor="left"
""")
rep_29 = ReplaceText(Text=panel_23, Find="█", Replace="01_Body", RecursiveReplace=False)
svg_text_object_4 = SVGTextObject(txt=simplify(graft(txt_7)), P=simplify(graft(arrlinear_2.Geometry)), T=svg_plane_by_page_custom.R_2, R=rep_29)  # -> R_2, txt_4

X_3 = UnitX(Factor=Slider(0, range=-420..0))
Z_3 = UnitZ(Factor=Slider(0, range=-297..0))
pt_7 = Point(<point referenced from the Rhino model>)
move_5 = Move(Geometry=pt_7, Motion=X_3)  # -> Geometry, Transform
move_6 = Move(Geometry=move_5.Geometry, Motion=Z_3)  # -> Geometry, Transform
panel_24 = Panel("""text="█"
text-anchor="left"
""")
rep_30 = ReplaceText(Text=panel_24, Find="█", Replace="01_Heading", RecursiveReplace=False)
svg_text_object_5 = SVGTextObject(txt=simplify(graft("Pedestrian Networks")), P=simplify(graft(move_6.Geometry)), T=svg_plane_by_page_custom.R_2, R=rep_30)  # -> R_2, txt_4

panel_25 = Panel("""Train Line
Train Station
Major Pedestrian Route
Medium Pedestrian Route
Minor Pedestrian Route""")
Y_3 = UnitY(Factor="-150")
lng_4 = ListLength(List=panel_25)
pt_8 = Point(<point referenced from the Rhino model>)
arrlinear_3 = LinearArray(Geometry=pt_8, Direction=Y_3, Count=lng_4)  # -> simplify(graft(Geometry)), Transform
txt_8 = Text(simplify(graft(panel_25)))
panel_26 = Panel("""text="█"
text-anchor="left"
""")
rep_31 = ReplaceText(Text=panel_26, Find="█", Replace="01_Body", RecursiveReplace=False)
svg_text_object_6 = SVGTextObject(txt=simplify(graft(txt_8)), P=simplify(graft(arrlinear_3.Geometry)), T=svg_plane_by_page_custom.R_2, R=rep_31)  # -> R_2, txt_4

# ---- group: Minor
dpipeline_34 = DynamicGeometryPipeline(
    LayerFilter="Minor_Legend",
    TypeFilter="Curve",
    NameFilter="*",
    enableFullPath=False,
    GroupByLayer=False,
    GroupByType=False,
    IncludeHidden=True,
    IncludeLocked=True,
    listenToAttriubtes=True)  # -> flatten(GeometryOut)
rep_32 = ReplaceText(Text="tag=\"█\"", Find="█", Replace=panel_13, RecursiveReplace=False)  # -> flatten(Result)
svg_polyline_31 = SVGPolyline(crv=flatten(dpipeline_34), layout=svg_plane_by_page_custom.R_2, attributes=rep_32)  # -> svg_2, crv_4

# ---- group: Medium
dpipeline_35 = DynamicGeometryPipeline(
    LayerFilter="Medium_Legend",
    TypeFilter="Curve",
    NameFilter="*",
    enableFullPath=False,
    GroupByLayer=False,
    GroupByType=False,
    IncludeHidden=True,
    IncludeLocked=True,
    listenToAttriubtes=True)  # -> flatten(GeometryOut)
rep_33 = ReplaceText(Text="tag=\"█\"", Find="█", Replace=panel_12, RecursiveReplace=False)  # -> flatten(Result)
svg_polyline_32 = SVGPolyline(crv=flatten(dpipeline_35), layout=svg_plane_by_page_custom.R_2, attributes=rep_33)  # -> svg_2, crv_4

# ----
X_4 = UnitX(Factor=Slider(0, range=-420..0))
Z_4 = UnitZ(Factor=Slider(0, range=-297..0))
pt_9 = Point(<point referenced from the Rhino model>)
move_7 = Move(Geometry=pt_9, Motion=X_4)  # -> Geometry, Transform
move_8 = Move(Geometry=move_7.Geometry, Motion=Z_4)  # -> Geometry, Transform
panel_27 = Panel("""text="█"
text-anchor="left"
""")
rep_34 = ReplaceText(Text=panel_27, Find="█", Replace="01_Heading", RecursiveReplace=False)
svg_text_object_7 = SVGTextObject(txt=simplify(graft("Roads and Access")), P=simplify(graft(move_8.Geometry)), T=svg_plane_by_page_custom.R_2, R=rep_34)  # -> R_2, txt_4

panel_28 = Panel("""Train Line
Train Station
Arterial Roads
Primary Roads
Secondary Roads
Pedestrian Access""")
Y_4 = UnitY(Factor="-150")
lng_5 = ListLength(List=panel_28)
pt_10 = Point(<point referenced from the Rhino model>)
arrlinear_4 = LinearArray(Geometry=pt_10, Direction=Y_4, Count=lng_5)  # -> simplify(graft(Geometry)), Transform
txt_9 = Text(simplify(graft(panel_28)))
panel_29 = Panel("""text="█"
text-anchor="left"
""")
rep_35 = ReplaceText(Text=panel_29, Find="█", Replace="01_Body", RecursiveReplace=False)
svg_text_object_8 = SVGTextObject(txt=simplify(graft(txt_9)), P=simplify(graft(arrlinear_4.Geometry)), T=svg_plane_by_page_custom.R_2, R=rep_35)  # -> R_2, txt_4

# ---- group: Arterial
dpipeline_36 = DynamicGeometryPipeline(
    LayerFilter="Arterial_Legend",
    TypeFilter="Curve",
    NameFilter="*",
    enableFullPath=False,
    GroupByLayer=False,
    GroupByType=False,
    IncludeHidden=True,
    IncludeLocked=True,
    listenToAttriubtes=True)  # -> flatten(GeometryOut)
rep_36 = ReplaceText(Text="tag=\"█\"", Find="█", Replace=panel_15, RecursiveReplace=False)  # -> flatten(Result)
svg_polyline_33 = SVGPolyline(crv=flatten(dpipeline_36), layout=svg_plane_by_page_custom.R_2, attributes=rep_36)  # -> svg_2, crv_4

# ---- group: Primary
dpipeline_37 = DynamicGeometryPipeline(
    LayerFilter="Primary_Legend",
    TypeFilter="Curve",
    NameFilter="*",
    enableFullPath=False,
    GroupByLayer=False,
    GroupByType=False,
    IncludeHidden=True,
    IncludeLocked=True,
    listenToAttriubtes=True)  # -> flatten(GeometryOut)
rep_37 = ReplaceText(Text="tag=\"█\"", Find="█", Replace=panel_14, RecursiveReplace=False)  # -> flatten(Result)
svg_polyline_34 = SVGPolyline(crv=flatten(dpipeline_37), layout=svg_plane_by_page_custom.R_2, attributes=rep_37)  # -> svg_2, crv_4

# ---- group: Secondary
dpipeline_38 = DynamicGeometryPipeline(
    LayerFilter="Secondary_Legend",
    TypeFilter="Curve",
    NameFilter="*",
    enableFullPath=False,
    GroupByLayer=False,
    GroupByType=False,
    IncludeHidden=True,
    IncludeLocked=True,
    listenToAttriubtes=True)  # -> flatten(GeometryOut)
rep_38 = ReplaceText(Text="tag=\"█\"", Find="█", Replace=panel_16, RecursiveReplace=False)  # -> flatten(Result)
svg_polyline_35 = SVGPolyline(crv=flatten(dpipeline_38), layout=svg_plane_by_page_custom.R_2, attributes=rep_38)  # -> svg_2, crv_4

# ----
X_5 = UnitX(Factor=Slider(0, range=-420..0))
Z_5 = UnitZ(Factor=Slider(0, range=-297..0))
pt_11 = Point(<point referenced from the Rhino model>)
move_9 = Move(Geometry=pt_11, Motion=X_5)  # -> Geometry, Transform
move_10 = Move(Geometry=move_9.Geometry, Motion=Z_5)  # -> Geometry, Transform
panel_30 = Panel("""text="█"
text-anchor="left"
""")
rep_39 = ReplaceText(Text=panel_30, Find="█", Replace="01_Heading", RecursiveReplace=False)
svg_text_object_9 = SVGTextObject(txt=simplify(graft("Precincts")), P=simplify(graft(move_10.Geometry)), T=svg_plane_by_page_custom.R_2, R=rep_39)  # -> R_2, txt_4

panel_31 = Panel("""1. Umgeni
2. Sports
3. Greyvilee
4. Centrum
5. Beach
6. Warwick
7. City Port
8. Point""")
Y_5 = UnitY(Factor="-150")
lng_6 = ListLength(List=panel_31)
pt_12 = Point(<point referenced from the Rhino model>)
arrlinear_5 = LinearArray(Geometry=pt_12, Direction=Y_5, Count=lng_6)  # -> simplify(graft(Geometry)), Transform
txt_10 = Text(simplify(graft(panel_31)))
panel_32 = Panel("""text="█"
text-anchor="left"
""")
rep_40 = ReplaceText(Text=panel_32, Find="█", Replace="01_Body", RecursiveReplace=False)
svg_text_object_10 = SVGTextObject(txt=simplify(graft(txt_10)), P=simplify(graft(arrlinear_5.Geometry)), T=svg_plane_by_page_custom.R_2, R=rep_40)  # -> R_2, txt_4

dpipeline_39 = DynamicGeometryPipeline(
    LayerFilter="P8",
    TypeFilter="Curve",
    NameFilter="*",
    enableFullPath=False,
    GroupByLayer=False,
    GroupByType=False,
    IncludeHidden=True,
    IncludeLocked=True,
    listenToAttriubtes=True)  # -> flatten(GeometryOut)
dpipeline_40 = DynamicGeometryPipeline(
    LayerFilter="P7",
    TypeFilter="Curve",
    NameFilter="*",
    enableFullPath=False,
    GroupByLayer=False,
    GroupByType=False,
    IncludeHidden=True,
    IncludeLocked=True,
    listenToAttriubtes=True)  # -> flatten(GeometryOut)
dpipeline_41 = DynamicGeometryPipeline(
    LayerFilter="P6",
    TypeFilter="Curve",
    NameFilter="*",
    enableFullPath=False,
    GroupByLayer=False,
    GroupByType=False,
    IncludeHidden=True,
    IncludeLocked=True,
    listenToAttriubtes=True)  # -> flatten(GeometryOut)

# ---- group: 1
pt_13 = Point(<point referenced from the Rhino model>)

# ---- group: 2
pt_14 = Point(<point referenced from the Rhino model>)

# ---- group: 5
pt_15 = Point(<point referenced from the Rhino model>)

# ---- group: 6
pt_16 = Point(<point referenced from the Rhino model>)

# ---- group: 3
pt_17 = Point(<point referenced from the Rhino model>)

# ---- group: 4
pt_18 = Point(<point referenced from the Rhino model>)

# ---- group: 7
pt_19 = Point(<point referenced from the Rhino model>)

# ---- group: 8
pt_20 = Point(<point referenced from the Rhino model>)

# ----
dpipeline_42 = DynamicGeometryPipeline(
    LayerFilter="P5",
    TypeFilter="Curve",
    NameFilter="*",
    enableFullPath=False,
    GroupByLayer=False,
    GroupByType=False,
    IncludeHidden=True,
    IncludeLocked=True,
    listenToAttriubtes=True)  # -> flatten(GeometryOut)
dpipeline_43 = DynamicGeometryPipeline(
    LayerFilter="P4",
    TypeFilter="Curve",
    NameFilter="*",
    enableFullPath=False,
    GroupByLayer=False,
    GroupByType=False,
    IncludeHidden=True,
    IncludeLocked=True,
    listenToAttriubtes=True)  # -> flatten(GeometryOut)
dpipeline_44 = DynamicGeometryPipeline(
    LayerFilter="P3",
    TypeFilter="Curve",
    NameFilter="*",
    enableFullPath=False,
    GroupByLayer=False,
    GroupByType=False,
    IncludeHidden=True,
    IncludeLocked=True,
    listenToAttriubtes=True)  # -> flatten(GeometryOut)
dpipeline_45 = DynamicGeometryPipeline(
    LayerFilter="P2",
    TypeFilter="Curve",
    NameFilter="*",
    enableFullPath=False,
    GroupByLayer=False,
    GroupByType=False,
    IncludeHidden=True,
    IncludeLocked=True,
    listenToAttriubtes=True)  # -> flatten(GeometryOut)
dpipeline_46 = DynamicGeometryPipeline(
    LayerFilter="P1",
    TypeFilter="Curve",
    NameFilter="*",
    enableFullPath=False,
    GroupByLayer=False,
    GroupByType=False,
    IncludeHidden=True,
    IncludeLocked=True,
    listenToAttriubtes=True)  # -> flatten(GeometryOut)
rep_41 = ReplaceText(Text="tag=\"█\"", Find="█", Replace="P8", RecursiveReplace=False)  # -> flatten(Result)
merge_4 = Merge(Data1=pt_13, Data2=pt_14, Data3=pt_17, Data4=pt_18, Data5=pt_15, Data6=pt_16, Data7=pt_19, Data8=pt_20)  # -> simplify(graft(Result))
rep_42 = ReplaceText(Text="tag=\"█\"", Find="█", Replace="P7", RecursiveReplace=False)  # -> flatten(Result)
rep_43 = ReplaceText(Text="tag=\"█\"", Find="█", Replace="P6", RecursiveReplace=False)  # -> flatten(Result)
rep_44 = ReplaceText(Text="tag=\"█\"", Find="█", Replace="P5", RecursiveReplace=False)  # -> flatten(Result)

# ---- group: Arterial
dpipeline_47 = DynamicGeometryPipeline(
    LayerFilter="P5_Legend",
    TypeFilter="Curve",
    NameFilter="*",
    enableFullPath=False,
    GroupByLayer=False,
    GroupByType=False,
    IncludeHidden=True,
    IncludeLocked=True,
    listenToAttriubtes=True)  # -> flatten(GeometryOut)
svg_polyline_36 = SVGPolyline(crv=flatten(dpipeline_47), layout=svg_plane_by_page_custom.R_2, attributes=rep_44)  # -> svg_2, crv_4

# ---- group: Primary
dpipeline_48 = DynamicGeometryPipeline(
    LayerFilter="P6_Legend",
    TypeFilter="Curve",
    NameFilter="*",
    enableFullPath=False,
    GroupByLayer=False,
    GroupByType=False,
    IncludeHidden=True,
    IncludeLocked=True,
    listenToAttriubtes=True)  # -> flatten(GeometryOut)
svg_polyline_37 = SVGPolyline(crv=flatten(dpipeline_48), layout=svg_plane_by_page_custom.R_2, attributes=rep_43)  # -> svg_2, crv_4

# ---- group: Pedestrian
dpipeline_49 = DynamicGeometryPipeline(
    LayerFilter="P8_Legend",
    TypeFilter="Curve",
    NameFilter="*",
    enableFullPath=False,
    GroupByLayer=False,
    GroupByType=False,
    IncludeHidden=True,
    IncludeLocked=True,
    listenToAttriubtes=True)  # -> flatten(GeometryOut)
svg_polyline_38 = SVGPolyline(crv=flatten(dpipeline_49), layout=svg_plane_by_page_custom.R_2, attributes=rep_41)  # -> svg_2, crv_4

# ---- group: Secondary
dpipeline_50 = DynamicGeometryPipeline(
    LayerFilter="P7_Legend",
    TypeFilter="Curve",
    NameFilter="*",
    enableFullPath=False,
    GroupByLayer=False,
    GroupByType=False,
    IncludeHidden=True,
    IncludeLocked=True,
    listenToAttriubtes=True)  # -> flatten(GeometryOut)
svg_polyline_39 = SVGPolyline(crv=flatten(dpipeline_50), layout=svg_plane_by_page_custom.R_2, attributes=rep_42)  # -> svg_2, crv_4

# ----
rep_45 = ReplaceText(Text="tag=\"█\"", Find="█", Replace="P4", RecursiveReplace=False)  # -> flatten(Result)

# ---- group: Pedestrian
dpipeline_51 = DynamicGeometryPipeline(
    LayerFilter="P4_Legend",
    TypeFilter="Curve",
    NameFilter="*",
    enableFullPath=False,
    GroupByLayer=False,
    GroupByType=False,
    IncludeHidden=True,
    IncludeLocked=True,
    listenToAttriubtes=True)  # -> flatten(GeometryOut)
svg_polyline_40 = SVGPolyline(crv=flatten(dpipeline_51), layout=svg_plane_by_page_custom.R_2, attributes=rep_45)  # -> svg_2, crv_4

# ----
rep_46 = ReplaceText(Text="tag=\"█\"", Find="█", Replace="P3", RecursiveReplace=False)  # -> flatten(Result)

# ---- group: Secondary
dpipeline_52 = DynamicGeometryPipeline(
    LayerFilter="P3_Legend",
    TypeFilter="Curve",
    NameFilter="*",
    enableFullPath=False,
    GroupByLayer=False,
    GroupByType=False,
    IncludeHidden=True,
    IncludeLocked=True,
    listenToAttriubtes=True)  # -> flatten(GeometryOut)
svg_polyline_41 = SVGPolyline(crv=flatten(dpipeline_52), layout=svg_plane_by_page_custom.R_2, attributes=rep_46)  # -> svg_2, crv_4

# ----
rep_47 = ReplaceText(Text="tag=\"█\"", Find="█", Replace="P2", RecursiveReplace=False)  # -> flatten(Result)

# ---- group: Primary
dpipeline_53 = DynamicGeometryPipeline(
    LayerFilter="P2_Legend",
    TypeFilter="Curve",
    NameFilter="*",
    enableFullPath=False,
    GroupByLayer=False,
    GroupByType=False,
    IncludeHidden=True,
    IncludeLocked=True,
    listenToAttriubtes=True)  # -> flatten(GeometryOut)
svg_polyline_42 = SVGPolyline(crv=flatten(dpipeline_53), layout=svg_plane_by_page_custom.R_2, attributes=rep_47)  # -> svg_2, crv_4

# ----
rep_48 = ReplaceText(Text="tag=\"█\"", Find="█", Replace="P1", RecursiveReplace=False)  # -> flatten(Result)

rep_49 = ReplaceText(Text="█grad", Find="█", Replace="P1", RecursiveReplace=False)  # -> flatten(Result)
rep_50 = ReplaceText(Text="fill:url(#█\");", Find="█", Replace=rep_49, RecursiveReplace=False)  # -> flatten(Result)
rep_51 = ReplaceText(Text="[█]{", Find="█", Replace=rep_48, RecursiveReplace=False)  # -> flatten(Result)
rep_52 = ReplaceText(Text="opacity:█;", Find="█", Replace=Slider(1, range=0..1), RecursiveReplace=False)  # -> flatten(Result)
join = TextJoin(Text=[rep_51, rep_50, rep_52, "}"])  # -> flatten(Result)
panel_33 = Panel(join)

# ---- group: Arterial
dpipeline_54 = DynamicGeometryPipeline(
    LayerFilter="P1_Legend",
    TypeFilter="Curve",
    NameFilter="*",
    enableFullPath=False,
    GroupByLayer=False,
    GroupByType=False,
    IncludeHidden=True,
    IncludeLocked=True,
    listenToAttriubtes=True)  # -> flatten(GeometryOut)
svg_polyline_43 = SVGPolyline(crv=flatten(dpipeline_54), layout=svg_plane_by_page_custom.R_2, attributes=rep_48)  # -> svg_2, crv_4

# ----
svg_polyline_44 = SVGPolyline(crv=flatten(dpipeline_39), layout=svg_plane_by_page.R_2, attributes=rep_41)  # -> svg_2, crv_4
svg_polyline_45 = SVGPolyline(crv=flatten(dpipeline_40), layout=svg_plane_by_page.R_2, attributes=rep_42)  # -> svg_2, crv_4
svg_polyline_46 = SVGPolyline(crv=flatten(dpipeline_41), layout=svg_plane_by_page.R_2, attributes=rep_43)  # -> svg_2, crv_4
svg_polyline_47 = SVGPolyline(crv=flatten(dpipeline_42), layout=svg_plane_by_page.R_2, attributes=rep_44)  # -> svg_2, crv_4
svg_polyline_48 = SVGPolyline(crv=flatten(dpipeline_43), layout=svg_plane_by_page.R_2, attributes=rep_45)  # -> svg_2, crv_4
# 05_Precincts
svg_polyline_49 = SVGPolyline(crv=flatten(dpipeline_46), layout=svg_plane_by_page.R_2, attributes=rep_48)  # -> svg_2, crv_4
svg_polyline_50 = SVGPolyline(crv=flatten(dpipeline_44), layout=svg_plane_by_page.R_2, attributes=rep_46)  # -> svg_2, crv_4
svg_polyline_51 = SVGPolyline(crv=flatten(dpipeline_45), layout=svg_plane_by_page.R_2, attributes=rep_47)  # -> svg_2, crv_4
panel_34 = Panel(""" <defs>
       <linearGradient id="P8grad" x1="0%" y1="0%" x2="0%" y2="100%">
<stop offset="0%" style="stop-color:rgb(250,121,0);stop-opacity:1" />
<stop offset="100%" style="stop-color:rgb(250,162,27);stop-opacity:1" />
     </linearGradient>
      </defs>""")
panel_35 = Panel("""[tag="P8"]{
fill:url(#P8grad);
opacity:0.9;
}""")
panel_36 = Panel(""" <defs>
       <linearGradient id="P7grad" x1="0%" y1="0%" x2="0%" y2="100%">
<stop offset="0%" style="stop-color:rgb(10,140,140);stop-opacity:1" />
<stop offset="100%" style="stop-color:rgb(42,191,191);stop-opacity:1" />
     </linearGradient>
      </defs>""")
panel_37 = Panel("""[tag="P7"]{
fill:url(#P7grad);
opacity:0.9;
}""")
panel_38 = Panel(""" <defs>
       <linearGradient id="P6grad" x1="0%" y1="0%" x2="0%" y2="100%">
<stop offset="0%" style="stop-color:rgb(199,33,8);stop-opacity:1" />
<stop offset="100%" style="stop-color:rgb(199,103,89);stop-opacity:1" />
     </linearGradient>
      </defs>""")
panel_39 = Panel("""[tag="P6"]{
fill:url(#P6grad);
opacity:0.9;
}""")
panel_40 = Panel(""" <defs>
       <linearGradient id="P5grad" x1="0%" y1="0%" x2="0%" y2="100%">
<stop offset="0%" style="stop-color:rgb(188,84,191);stop-opacity:1" />
<stop offset="100%" style="stop-color:rgb(189,140,191);stop-opacity:1" />
     </linearGradient>
      </defs>""")
panel_41 = Panel("""[tag="P5"]{
fill:url(#P5grad);
opacity:0.9;
}""")
panel_42 = Panel(""" <defs>
       <linearGradient id="P4grad" x1="0%" y1="0%" x2="0%" y2="100%">
<stop offset="0%" style="stop-color:rgb(44,58,150;stop-opacity:1" />
<stop offset="100%" style="stop-color:rgb(72,96,250);stop-opacity:1" />
     </linearGradient>
      </defs>""")
panel_43 = Panel("""[tag="P4"]{
fill:url(#P4grad);
opacity:0.9;
}""")
panel_44 = Panel(""" <defs>
       <linearGradient id="P3grad" x1="0%" y1="0%" x2="0%" y2="100%">
<stop offset="0%" style="stop-color:rgb(109,162,27);stop-opacity:1" />
<stop offset="100%" style="stop-color:rgb(166,206,57);stop-opacity:1" />
     </linearGradient>
      </defs>""")
panel_45 = Panel("""[tag="P3"]{
fill:url(#P3grad);
opacity:0.9;
}""")
panel_46 = Panel(""" <defs>
       <linearGradient id="P2grad" x1="0%" y1="0%" x2="0%" y2="100%">
<stop offset="0%" style="stop-color:rgb(248,183,23);stop-opacity:1" />
<stop offset="100%" style="stop-color:rgb(255,222,23);stop-opacity:1" />
     </linearGradient>
      </defs>""")
panel_47 = Panel("""[tag="P2"]{
fill:url(#P2grad);
opacity:0.9;
}""")
panel_48 = Panel("""[tag="P1"]{
fill:url(#P1grad);
opacity:0.9;
}""")
panel_49 = Panel(""" <defs>
       <linearGradient id="P1grad" x1="0%" y1="0%" x2="0%" y2="100%">
<stop offset="0%" style="stop-color:rgb(180,62,128);stop-opacity:1" />
<stop offset="100%" style="stop-color:rgb(236,11,139);stop-opacity:1" />
     </linearGradient>
      </defs>""")
merge_5 = Merge(Data1=svg_polyline_44.svg_2, Data2=panel_34)
merge_6 = Merge(Data1=svg_polyline_47.svg_2, Data2=panel_40)
merge_7 = Merge(Data1=svg_polyline_46.svg_2, Data2=panel_38)
merge_8 = Merge(Data1=svg_polyline_45.svg_2, Data2=panel_36)
merge_9 = Merge(Data1=svg_polyline_51.svg_2, Data2=panel_46)
merge_10 = Merge(Data1=svg_polyline_50.svg_2, Data2=panel_44)
merge_11 = Merge(Data1=svg_polyline_48.svg_2, Data2=panel_42)

# ---- group: SVG
merge_12 = Merge(Data1=panel_49, Data2=svg_polyline_49.svg_2)

merge_13 = Merge(
    Data1=svg_text_object_9.R_2,
    Data2=svg_text_object_10.R_2,
    Data3=svg_polyline_43.svg_2,
    Data4=svg_polyline_42.svg_2,
    Data5=svg_polyline_41.svg_2,
    Data6=svg_polyline_40.svg_2,
    Data7=svg_polyline_36.svg_2,
    Data8=svg_polyline_37.svg_2,
    Data9=svg_polyline_39.svg_2,
    Data10=svg_polyline_38.svg_2,
    Data11=panel_49,
    Data12=panel_46,
    Data13=panel_44,
    Data14=panel_42,
    Data15=panel_40,
    Data16=panel_38,
    Data17=panel_36,
    Data18=panel_34)

# ---- group: Masterplan Greys
swatch = ColourSwatch(SwatchColor=RGB(255, 255, 255))
swatch_2 = ColourSwatch(SwatchColor=RGB(230, 230, 230))
swatch_3 = ColourSwatch(SwatchColor=RGB(168, 170, 173))
swatch_4 = ColourSwatch(SwatchColor=RGB(241, 242, 242))
swatch_5 = ColourSwatch(SwatchColor=RGB(210, 215, 210))
swatch_6 = ColourSwatch(SwatchColor=RGB(209, 211, 212))
swatch_7 = ColourSwatch(SwatchColor=RGB(199, 200, 201))
swatch_8 = ColourSwatch(SwatchColor=RGB(147, 149, 152))
swatch_9 = ColourSwatch(SwatchColor=RGB(13, 13, 13))

# ----
swatch_10 = ColourSwatch(SwatchColor=RGB(199, 33, 8))
swatch_11 = ColourSwatch(SwatchColor=RGB(188, 84, 191))
swatch_12 = ColourSwatch(SwatchColor=RGB(10, 140, 140))
dummy = ColourSwatch(SwatchColor=RGB(255, 255, 255))

col = Colour(swatch_12)
col_2 = Colour(ColourSwatch(SwatchColor=RGB(42, 191, 191)))
col_3 = Colour(swatch_10)
col_4 = Colour(swatch_11)
col_5 = Colour(ColourSwatch(SwatchColor=RGB(72, 96, 250)))
panel_50 = Panel(col)
panel_51 = Panel(col_2)
panel_52 = Panel(col_3)
panel_53 = Panel(col_4)
panel_54 = Panel(col_5)
merge_14 = Merge(
    Data1=merge_12,
    Data2=merge_9,
    Data3=merge_10,
    Data4=merge_11,
    Data5=merge_6,
    Data6=merge_7,
    Data7=merge_8,
    Data8=merge_5)

# ---- group: Diagram Colours
swatch_13 = ColourSwatch(SwatchColor=RGB(130, 54, 140))
swatch_14 = ColourSwatch(SwatchColor=RGB(255, 222, 23))
swatch_15 = ColourSwatch(SwatchColor=RGB(109, 162, 27))
swatch_16 = ColourSwatch(SwatchColor=RGB(189, 140, 191))
swatch_17 = ColourSwatch(SwatchColor=RGB(88, 89, 91))
swatch_18 = ColourSwatch(SwatchColor=RGB(54, 55, 56))
swatch_19 = ColourSwatch(SwatchColor=RGB(180, 62, 128))
swatch_20 = ColourSwatch(SwatchColor=RGB(236, 11, 139))
swatch_21 = ColourSwatch(SwatchColor=RGB(226, 6, 38))
swatch_22 = ColourSwatch(SwatchColor=RGB(236, 65, 54))
swatch_23 = ColourSwatch(SwatchColor=RGB(250, 121, 0))
swatch_24 = ColourSwatch(SwatchColor=RGB(250, 162, 27))
swatch_25 = ColourSwatch(SwatchColor=RGB(109, 207, 246))
swatch_26 = ColourSwatch(SwatchColor=RGB(44, 58, 150))
swatch_27 = ColourSwatch(SwatchColor=RGB(166, 206, 57))
swatch_28 = ColourSwatch(SwatchColor=RGB(81, 173, 113))
swatch_29 = ColourSwatch(SwatchColor=RGB(199, 103, 89))

# ---- group: Station Building
trai = CSSStyleMaker(
    custom_attribute=rep_4,
    stroke_colour=swatch_24,
    stroke_thickness=Slider(0.2, range=0..1),
    dash=Slider(0, range=0..4),
    fill=swatch_24,
    stroke_opacity=Slider(0.8, range=0..1),
    fill_opacity=Slider(0.3, range=0..1),
    opacity=Slider(1, range=0..1))

# ---- group: Rugby
trai_2 = CSSStyleMaker(
    custom_attribute=rep_8,
    stroke_colour=swatch_22,
    stroke_thickness=Slider(0.2, range=0..1),
    dash=Slider(0, range=0..4),
    fill=swatch_23,
    stroke_opacity=Slider(1, range=0..1),
    fill_opacity=Slider(0.7, range=0..1),
    opacity=Slider(1, range=0..1))

# ---- group: Body
rep_53 = ReplaceText(Text="[text=\"█\"] {", Find="█", Replace="01_Body", RecursiveReplace=False)
css_text_style = CSSTextStyle(selector=rep_53, font=panel_9, I=swatch_17, size="0.9mm")

# ---- group: Education
trai_3 = CSSStyleMaker(
    custom_attribute=rep_11,
    stroke_colour=swatch_16,
    stroke_thickness=Slider(0.2, range=0..1),
    dash=Slider(0, range=0..4),
    fill=swatch_16,
    stroke_opacity=Slider(1, range=0..1),
    fill_opacity=Slider(0.6, range=0..1),
    opacity=Slider(1, range=0..1))

# ---- group: Hospital
trai_4 = CSSStyleMaker(
    custom_attribute=rep_10,
    stroke_colour=swatch_19,
    stroke_thickness=Slider(0.2, range=0..1),
    dash=Slider(0, range=0..4),
    fill=swatch_21,
    stroke_opacity=Slider(0.8, range=0..1),
    fill_opacity=Slider(0.5, range=0..1),
    opacity=Slider(1, range=0..1))

# ---- group: Garden
trai_5 = CSSStyleMaker(
    custom_attribute=rep_9,
    stroke_colour=swatch_15,
    stroke_thickness=Slider(0.2, range=0..1),
    dash=Slider(0, range=0..4),
    fill=swatch_27,
    stroke_opacity=Slider(1, range=0..1),
    fill_opacity=Slider(0.5, range=0..1),
    opacity=Slider(1, range=0..1))

# ---- group: Train Station
trai_6 = CSSStyleMaker(
    custom_attribute=rep_13,
    stroke_colour=swatch_9,
    stroke_thickness=Slider(0.5, range=0..1),
    dash=Slider(0, range=0..4),
    fill=swatch_24,
    stroke_opacity=Slider(1, range=0..1),
    fill_opacity=Slider(1, range=0..1),
    opacity=Slider(1, range=0..1))

# ---- group: Heading
rep_54 = ReplaceText(Text="[text=\"█\"] {", Find="█", Replace="01_Heading", RecursiveReplace=False)
css_text_style_2 = CSSTextStyle(selector=rep_54, font=panel_9, I=swatch_17, size="1.5mm")

rep_55 = ReplaceText(Text="[text=\"█\"] {", Find="█", Replace="01_Heading", RecursiveReplace=False)
css_text_style_3 = CSSTextStyle(selector=rep_55, font=panel_9, I=swatch_17, size="1.5mm")

# ---- group: Body
rep_56 = ReplaceText(Text="[text=\"█\"] {", Find="█", Replace="01_Body", RecursiveReplace=False)
css_text_style_4 = CSSTextStyle(selector=rep_56, font=panel_9, I=swatch_17, size="0.9mm")

# ----
rep_57 = ReplaceText(Text="[text=\"█\"] {", Find="█", Replace="01_Heading", RecursiveReplace=False)
css_text_style_5 = CSSTextStyle(selector=rep_57, font=panel_9, I=swatch_17, size="1.5mm")

# ---- group: Medium
number_slider_3 = Slider(2, range=0..5)
trai_7 = CSSStyleMaker(
    custom_attribute=rep_14,
    stroke_colour=swatch_15,
    stroke_thickness=number_slider_3,
    dash=Slider(0, range=0..4),
    line_cap="round",
    fill=dummy,
    stroke_opacity=Slider(1, range=0..1),
    fill_opacity=Slider(0, range=0..1),
    opacity=Slider(1, range=0..1))

# ---- group: Medium Arrow
trai_8 = CSSStyleMaker(
    custom_attribute=rep_16,
    stroke_colour=dummy,
    stroke_thickness=number_slider_3,
    fill=swatch_15,
    stroke_opacity=Slider(0, range=0..1),
    fill_opacity=Slider(1, range=0..1),
    opacity=Slider(1, range=0..1))

# ----
rep_58 = ReplaceText(Text="[text=\"█\"] {", Find="█", Replace="01_Body", RecursiveReplace=False)
css_text_style_6 = CSSTextStyle(selector=rep_58, font=panel_9, I=swatch_17, size="0.9mm")

# ---- group: Minor
number_slider_4 = Slider(1.25, range=0..5)
trai_9 = CSSStyleMaker(
    custom_attribute=rep_15,
    stroke_colour=swatch_27,
    stroke_thickness=number_slider_4,
    dash=Slider(0, range=0..4),
    line_cap="round",
    fill=dummy,
    stroke_opacity=Slider(1, range=0..1),
    fill_opacity=Slider(0, range=0..1),
    opacity=Slider(1, range=0..1))

# ---- group: Minor Arrow
trai_10 = CSSStyleMaker(
    custom_attribute=rep_17,
    stroke_colour=dummy,
    stroke_thickness=number_slider_4,
    fill=swatch_27,
    stroke_opacity=Slider(0, range=0..1),
    fill_opacity=Slider(1, range=0..1),
    opacity=Slider(1, range=0..1))

# ----
panel_55 = Panel("Helvetica")
rep_59 = ReplaceText(Text="[text=\"█\"] {", Find="█", Replace="01_Heading", RecursiveReplace=False)
css_text_style_7 = CSSTextStyle(selector=rep_59, font=panel_9, I=swatch_17, size="1.5mm")

# ---- group: Primary
trai_11 = CSSStyleMaker(
    custom_attribute=rep_18,
    stroke_colour=swatch_21,
    stroke_thickness=Slider(2, range=0..5),
    dash=Slider(0, range=0..4),
    line_cap="round",
    fill=dummy,
    stroke_opacity=Slider(1, range=0..1),
    fill_opacity=Slider(0, range=0..1),
    opacity=Slider(1, range=0..1))

# ---- group: Arterial
trai_12 = CSSStyleMaker(
    custom_attribute=rep_19,
    stroke_colour=swatch_26,
    stroke_thickness=Slider(2, range=0..5),
    dash=Slider(0, range=0..4),
    line_cap="round",
    fill=dummy,
    stroke_opacity=Slider(1, range=0..1),
    fill_opacity=Slider(0, range=0..1),
    opacity=Slider(1, range=0..1))

# ---- group: Arterial Arrow
trai_13 = CSSStyleMaker(
    custom_attribute=rep_21,
    stroke_colour=dummy,
    stroke_thickness=Slider(0, range=0..1),
    fill=swatch_26,
    stroke_opacity=Slider(0, range=0..1),
    fill_opacity=Slider(1, range=0..1),
    opacity=Slider(1, range=0..1))

# ---- group: Primary Arrow
trai_14 = CSSStyleMaker(
    custom_attribute=rep_22,
    stroke_colour=dummy,
    stroke_thickness=Slider(0, range=0..1),
    fill=swatch_21,
    stroke_opacity=Slider(0, range=0..1),
    fill_opacity=Slider(1, range=0..1),
    opacity=Slider(1, range=0..1))

# ----
rep_60 = ReplaceText(Text="[text=\"█\"] {", Find="█", Replace="01_Body", RecursiveReplace=False)
css_text_style_8 = CSSTextStyle(selector=rep_60, font=panel_9, I=swatch_17, size="0.9mm")

# ---- group: Secondary
trai_15 = CSSStyleMaker(
    custom_attribute=rep_20,
    stroke_colour=swatch_24,
    stroke_thickness=Slider(1.5, range=0..5),
    dash=Slider(0, range=0..4),
    line_cap="round",
    fill=dummy,
    stroke_opacity=Slider(1, range=0..1),
    fill_opacity=Slider(0, range=0..1),
    opacity=Slider(1, range=0..1))

# ---- group: Secondary Arrow
trai_16 = CSSStyleMaker(
    custom_attribute=rep_23,
    stroke_colour=dummy,
    stroke_thickness=Slider(0, range=0..1),
    fill=swatch_24,
    stroke_opacity=Slider(0, range=0..1),
    fill_opacity=Slider(1, range=0..1),
    opacity=Slider(1, range=0..1))

# ---- group: 1
number_slider_5 = Slider(1, range=0..5)
trai_17 = CSSStyleMaker(
    custom_attribute=rep_48,
    stroke_colour=swatch_20,
    stroke_thickness=number_slider_5,
    dash=Slider(0, range=0..4),
    fill=dummy,
    stroke_opacity=Slider(1, range=0..1),
    fill_opacity=Slider(0.8, range=0..1),
    opacity=Slider(1, range=0..1))

# ---- group: 8
trai_18 = CSSStyleMaker(
    custom_attribute=rep_41,
    stroke_colour=swatch_23,
    stroke_thickness=number_slider_5,
    dash=Slider(0, range=0..4),
    fill=dummy,
    stroke_opacity=Slider(1, range=0..1),
    fill_opacity=Slider(0.8, range=0..1),
    opacity=Slider(1, range=0..1))

# ---- group: 7
trai_19 = CSSStyleMaker(
    custom_attribute=rep_42,
    stroke_colour=swatch_12,
    stroke_thickness=number_slider_5,
    dash=Slider(0, range=0..4),
    fill=dummy,
    stroke_opacity=Slider(1, range=0..1),
    fill_opacity=Slider(0.8, range=0..1),
    opacity=Slider(1, range=0..1))

# ---- group: 6
number_slider_6 = Slider(2, range=0..5)
trai_20 = CSSStyleMaker(
    custom_attribute=rep_43,
    stroke_colour=swatch_10,
    stroke_thickness=number_slider_5,
    dash=Slider(0, range=0..4),
    fill=dummy,
    stroke_opacity=Slider(1, range=0..1),
    fill_opacity=Slider(0.8, range=0..1),
    opacity=Slider(1, range=0..1))

# ---- group: 5
number_slider_7 = Slider(2, range=0..5)
trai_21 = CSSStyleMaker(
    custom_attribute=rep_44,
    stroke_colour=swatch_11,
    stroke_thickness=number_slider_5,
    dash=Slider(0, range=0..4),
    fill=dummy,
    stroke_opacity=Slider(1, range=0..1),
    fill_opacity=Slider(0.8, range=0..1),
    opacity=Slider(1, range=0..1))

# ---- group: 4
number_slider_8 = Slider(2, range=0..5)
trai_22 = CSSStyleMaker(
    custom_attribute=rep_45,
    stroke_colour=swatch_26,
    stroke_thickness=number_slider_5,
    dash=Slider(0, range=0..4),
    fill=dummy,
    stroke_opacity=Slider(1, range=0..1),
    fill_opacity=Slider(0.8, range=0..1),
    opacity=Slider(1, range=0..1))

# ---- group: 3
number_slider_9 = Slider(2, range=0..5)
trai_23 = CSSStyleMaker(
    custom_attribute=rep_46,
    stroke_colour=swatch_15,
    stroke_thickness=number_slider_5,
    dash=Slider(0, range=0..4),
    fill=dummy,
    stroke_opacity=Slider(1, range=0..1),
    fill_opacity=Slider(0.8, range=0..1),
    opacity=Slider(1, range=0..1))

# ---- group: 2
number_slider_10 = Slider(2, range=0..5)
trai_24 = CSSStyleMaker(
    custom_attribute=rep_47,
    stroke_colour=swatch_14,
    stroke_thickness=number_slider_5,
    dash=Slider(0, range=0..4),
    fill=dummy,
    stroke_opacity=Slider(1, range=0..1),
    fill_opacity=Slider(0.8, range=0..1),
    opacity=Slider(1, range=0..1))

# ----
col_6 = Colour(swatch_13)
rep_61 = ReplaceText(Text="stroke:rgb(█);", Find="█", Replace=col_6, RecursiveReplace=False)

rep_62 = ReplaceText(Text="[text=\"█\"] {", Find="█", Replace="01_Heading", RecursiveReplace=False)
css_text_style_9 = CSSTextStyle(selector=rep_62, font=panel_9, I=swatch_17, size="1.5mm")

rep_63 = ReplaceText(Text="[text=\"█\"] {", Find="█", Replace="01_Body", RecursiveReplace=False)
css_text_style_10 = CSSTextStyle(selector=rep_63, font=panel_9, I=swatch_17, size="0.9mm")

col_7 = Colour(swatch_23)
col_8 = Colour(swatch_24)
col_9 = Colour(swatch_29)
col_10 = Colour(swatch_16)
panel_57 = Panel(col_7)
panel_58 = Panel(col_8)
col_11 = Colour(swatch_26)
col_12 = Colour(swatch_15)
col_13 = Colour(swatch_27)
col_14 = Colour(swatch_14)
col_15 = Colour(swatch_19)
col_16 = Colour(swatch_20)
panel_59 = Panel(col_9)
panel_60 = Panel(col_10)
panel_61 = Panel(col_11)
panel_62 = Panel(col_12)
panel_63 = Panel(col_13)
panel_64 = Panel(col_14)
panel_65 = Panel(col_15)
panel_66 = Panel(col_16)
merge_15 = Merge(Data1=trai_18, Data2=panel_35)
merge_16 = Merge(Data1=trai_21, Data2=panel_41)
merge_17 = Merge(Data1=trai_20, Data2=panel_39)
merge_18 = Merge(Data1=trai_19, Data2=panel_37)
merge_19 = Merge(Data1=trai_24, Data2=panel_47)
merge_20 = Merge(Data1=trai_23, Data2=panel_45)
merge_21 = Merge(Data1=trai_22, Data2=panel_43)

# ---- group: CSS
merge_22 = Merge(Data1=trai_17, Data2=panel_48)

merge_23 = Merge(
    Data1=css_text_style_9,
    Data2=css_text_style_10,
    Data3=merge_22,
    Data4=merge_19,
    Data5=merge_20,
    Data6=merge_21,
    Data7=merge_16,
    Data8=merge_17,
    Data9=merge_18,
    Data10=merge_15)

# ----
merge_24 = Merge(
    Data1=merge_22,
    Data2=merge_19,
    Data3=merge_20,
    Data4=merge_21,
    Data5=merge_16,
    Data6=merge_17,
    Data7=merge_18,
    Data8=merge_15)
join_2 = TextJoin(Text=flatten(merge_13))
join_3 = TextJoin(Text=flatten(merge_23))

# ---- group: Base Plan
swatch_30 = ColourSwatch(SwatchColor=RGB(174, 174, 174))
swatch_31 = ColourSwatch(SwatchColor=RGB(120, 186, 78))
swatch_32 = ColourSwatch(SwatchColor=RGB(230, 231, 232))
swatch_33 = ColourSwatch(SwatchColor=RGB(110, 198, 217))

# ---- group: Masterplan Water
swatch_34 = ColourSwatch(SwatchColor=RGB(110, 198, 217))
swatch_35 = ColourSwatch(SwatchColor=RGB(110, 179, 227))
swatch_36 = ColourSwatch(SwatchColor=RGB(150, 206, 240))
swatch_37 = ColourSwatch(SwatchColor=RGB(134, 205, 227))
swatch_38 = ColourSwatch(SwatchColor=RGB(0, 106, 181))
swatch_39 = ColourSwatch(SwatchColor=RGB(197, 232, 241))
swatch_40 = ColourSwatch(SwatchColor=RGB(173, 225, 250))

# ---- group: Soccer
trai_25 = CSSStyleMaker(
    custom_attribute=rep_7,
    stroke_colour=swatch_38,
    stroke_thickness=Slider(0.2, range=0..1),
    dash=Slider(0, range=0..4),
    fill=swatch_35,
    stroke_opacity=Slider(0.5, range=0..1),
    fill_opacity=Slider(0.95, range=0..1),
    opacity=Slider(1, range=0..1))

# ---- group: Library
trai_26 = CSSStyleMaker(
    custom_attribute=rep_12,
    stroke_colour=swatch_26,
    stroke_thickness=Slider(0.2, range=0..1),
    dash=Slider(0, range=0..4),
    fill=swatch_38,
    stroke_opacity=Slider(1, range=0..1),
    fill_opacity=Slider(0.6, range=0..1),
    opacity=Slider(1, range=0..1))

# ---- group: Masterplan Paving
swatch_41 = ColourSwatch(SwatchColor=RGB(255, 228, 183))
swatch_42 = ColourSwatch(SwatchColor=RGB(227, 182, 157))
swatch_43 = ColourSwatch(SwatchColor=RGB(172, 148, 145))
swatch_44 = ColourSwatch(SwatchColor=RGB(221, 160, 104))
swatch_45 = ColourSwatch(SwatchColor=RGB(170, 134, 59))
swatch_46 = ColourSwatch(SwatchColor=RGB(130, 85, 43))
swatch_47 = ColourSwatch(SwatchColor=RGB(253, 203, 146))
swatch_48 = ColourSwatch(SwatchColor=RGB(248, 183, 23))
swatch_49 = ColourSwatch(SwatchColor=RGB(247, 146, 30))
swatch_50 = ColourSwatch(SwatchColor=RGB(248, 228, 175))
swatch_51 = ColourSwatch(SwatchColor=RGB(233, 203, 134))
swatch_52 = ColourSwatch(SwatchColor=RGB(248, 208, 181))
swatch_53 = ColourSwatch(SwatchColor=RGB(237, 194, 69))
swatch_54 = ColourSwatch(SwatchColor=RGB(243, 177, 136))
swatch_55 = ColourSwatch(SwatchColor=RGB(248, 219, 69))

# ---- group: Beach
trai_27 = CSSStyleMaker(
    custom_attribute=rep_6,
    stroke_colour=swatch_53,
    stroke_thickness=Slider(0.4, range=0..1),
    dash=Slider(0, range=0..4),
    fill=swatch_51,
    stroke_opacity=Slider(1, range=0..1),
    fill_opacity=Slider(1, range=0..1),
    opacity=Slider(1, range=0..1))

# ----
col_17 = Colour(swatch_48)
panel_67 = Panel(col_17)

# ---- group: Masterplan Grass
swatch_56 = ColourSwatch(SwatchColor=RGB(204, 222, 145))
swatch_57 = ColourSwatch(SwatchColor=RGB(188, 209, 124))
swatch_58 = ColourSwatch(SwatchColor=RGB(171, 198, 102))
swatch_59 = ColourSwatch(SwatchColor=RGB(164, 192, 91))
swatch_60 = ColourSwatch(SwatchColor=RGB(140, 170, 69))

# ---- group: Masterplan Trees
swatch_61 = ColourSwatch(SwatchColor=RGB(122, 158, 72))
swatch_62 = ColourSwatch(SwatchColor=RGB(123, 152, 74))
swatch_63 = ColourSwatch(SwatchColor=RGB(163, 170, 69))
swatch_64 = ColourSwatch(SwatchColor=RGB(153, 175, 59))
swatch_65 = ColourSwatch(SwatchColor=RGB(96, 127, 63))
swatch_66 = ColourSwatch(SwatchColor=RGB(128, 195, 79))
swatch_67 = ColourSwatch(SwatchColor=RGB(110, 194, 126))
swatch_68 = ColourSwatch(SwatchColor=RGB(14, 153, 72))
swatch_69 = ColourSwatch(SwatchColor=RGB(173, 197, 82))
swatch_70 = ColourSwatch(SwatchColor=RGB(176, 146, 59))
swatch_71 = ColourSwatch(SwatchColor=RGB(204, 178, 61))
swatch_72 = ColourSwatch(SwatchColor=RGB(69, 184, 63))
swatch_73 = ColourSwatch(SwatchColor=RGB(72, 99, 68))
swatch_74 = ColourSwatch(SwatchColor=RGB(189, 161, 90))

# ---- group: Golf
trai_28 = CSSStyleMaker(
    custom_attribute=rep_5,
    stroke_colour=swatch_15,
    stroke_thickness=Slider(0.2, range=0..1),
    dash=Slider(0, range=0..4),
    fill=swatch_66,
    stroke_opacity=Slider(1, range=0..1),
    fill_opacity=Slider(0.5, range=0..1),
    opacity=Slider(1, range=0..1))

# ----
col_18 = Colour(swatch_65)
col_19 = Colour(swatch_66)

# ---- group: Train Line
dpipeline_55 = DynamicGeometryPipeline(
    LayerFilter="Train_Legend",
    TypeFilter="Curve",
    NameFilter="*",
    enableFullPath=False,
    GroupByLayer=False,
    GroupByType=False,
    IncludeHidden=True,
    IncludeLocked=True,
    listenToAttriubtes=True)  # -> flatten(GeometryOut)

dpipeline_56 = DynamicGeometryPipeline(
    LayerFilter="Train_Legend",
    TypeFilter="Curve",
    NameFilter="*",
    enableFullPath=False,
    GroupByLayer=False,
    GroupByType=False,
    IncludeHidden=True,
    IncludeLocked=True,
    listenToAttriubtes=True)  # -> flatten(GeometryOut)

# ---- group: Train Line Top
panel_68 = Panel("Train")
dpipeline_57 = DynamicGeometryPipeline(
    LayerFilter=panel_68,
    TypeFilter="Curve",
    NameFilter="*",
    enableFullPath=False,
    GroupByLayer=False,
    GroupByType=False,
    IncludeHidden=True,
    IncludeLocked=True,
    listenToAttriubtes=True)  # -> flatten(GeometryOut)
ext_6 = ExtendCurve(Curve=dpipeline_57, Type=0, Start=panel_11, End=panel_11)
# 01_Community Facilities
panel_69 = Panel("tag=\"█\"")
rep_64 = ReplaceText(Text=panel_69, Find="█", Replace=panel_68, RecursiveReplace=False)  # -> flatten(Result)

# ---- group: SMOOTH
topoly_8 = CurveToPolyline(Curve=ext_6, ToleranceDistance=90, ToleranceAngle=0, MaxEdge=20)  # -> Polyline, Segments
smoothpline_6 = SmoothPolyline(Polyline=topoly_8.Polyline, Strength="1", Times="100")

# ---- group: Train Arrow
cluster_6 = Cluster(crv=smoothpline_6, T=svg_plane_by_page.R_2, C=Toggle(True), size=Slider(1.5, range=0..5), i=0)
rep_65 = ReplaceText(Text="tag=\"█_arrow\"", Find="█", Replace=panel_68, RecursiveReplace=False)  # -> flatten(Result)
crv_7 = Curve(cluster_6)
svg_polyline_52 = SVGPolyline(crv=flatten(crv_7), layout=svg_plane_by_page.R_2, attributes=rep_65)  # -> svg_2, crv_4

# ---- group: Train Line Bottom
panel_70 = Panel(rep_64)
join_4 = TextJoin(Text=["DUP", panel_70])
svg_polyline_53 = SVGPolyline(crv=flatten(smoothpline_6), layout=svg_plane_by_page.R_2, attributes=join_4)  # -> svg_2, crv_4

# ---- group: Train Line (continued)
rep_66 = ReplaceText(Text="tag=\"█\"", Find="█", Replace=panel_68, RecursiveReplace=False)  # -> flatten(Result)
svg_polyline_54 = SVGPolyline(crv=flatten(dpipeline_56), layout=svg_plane_by_page_custom.R_2, attributes=rep_66)  # -> svg_2, crv_4

svg_polyline_55 = SVGPolyline(crv=flatten(dpipeline_55), layout=svg_plane_by_page_custom.R_2, attributes=join_4)  # -> svg_2, crv_4

# ---- group: Train Line Top (continued)
svg_polyline_56 = SVGPolyline(crv=flatten(smoothpline_6), layout=svg_plane_by_page.R_2, attributes=rep_64)  # -> svg_2, crv_4

# ---- group: Train Line
trai_29 = CSSStyleMaker(
    custom_attribute=rep_64,
    stroke_colour=swatch_5,
    stroke_thickness=Slider(1, range=0..5),
    dash=Slider(1, range=0..4),
    gap=Slider(1, range=0..4),
    fill=dummy,
    stroke_opacity=Slider(1, range=0..1),
    fill_opacity=Slider(0, range=0..1),
    opacity=Slider(1, range=0..1))

trai_30 = CSSStyleMaker(
    custom_attribute=join_4,
    stroke_colour=swatch_17,
    stroke_thickness=Slider(2, range=0..5),
    fill=dummy,
    stroke_opacity=Slider(1, range=0..1),
    fill_opacity=Slider(0, range=0..1),
    opacity=Slider(1, range=0..1))

# ---- group: Train Arrow
trai_31 = CSSStyleMaker(
    custom_attribute=rep_65,
    stroke_colour=dummy,
    stroke_thickness=Slider(0, range=0..1),
    fill=swatch_18,
    stroke_opacity=Slider(0, range=0..1),
    fill_opacity=Slider(1, range=0..1),
    opacity=Slider(1, range=0..1))

# ---- group: Train CSS
merge_25 = Merge(Data1=trai_29, Data2=trai_30, Data3=trai_6)

# ---- group: CSS
merge_26 = Merge(
    Data1=merge_25,
    Data2=css_text_style_2,
    Data3=css_text_style,
    Data4=trai_3,
    Data5=trai_27,
    Data6=trai_28,
    Data7=trai_25,
    Data8=trai_2,
    Data9=trai_26,
    Data10=trai_4,
    Data11=trai,
    Data12=trai_5)

# ---- group: Train SVG
merge_27 = Merge(Data1=svg_polyline_21.svg_2, Data2=svg_polyline_55.svg_2, Data3=svg_polyline_54.svg_2)

# ---- group: SVG
merge_28 = Merge(
    Data1=svg_polyline_30.svg_2,
    Data2=merge_27,
    Data3=svg_text_object.R_2,
    Data4=svg_text_object_2.R_2,
    Data6=svg_polyline_26.svg_2,
    Data7=svg_polyline_28.svg_2,
    Data8=svg_polyline_25.svg_2,
    Data9=svg_polyline_22.svg_2,
    Data10=svg_polyline_23.svg_2,
    Data11=svg_polyline_29.svg_2,
    Data12=svg_polyline_24.svg_2,
    Data13=svg_polyline_27.svg_2)

# ---- group: SVG Train
merge_29 = Merge(Data1=svg_polyline_53.svg_2, Data2=svg_polyline_56.svg_2, Data3=svg_polyline_10.svg_2, Data4=svg_polyline_52.svg_2)

# ---- group: CSS Train
merge_30 = Merge(Data1=trai_29, Data2=trai_6, Data3=trai_30, Data4=trai_31)

# ----
join_5 = TextJoin(Text=flatten(merge_28))
join_6 = TextJoin(Text=flatten(merge_26))

# ---- group: CSS
merge_31 = Merge(
    Data1=merge_30,
    Data2=trai_3,
    Data3=trai_27,
    Data4=trai_28,
    Data5=trai_25,
    Data6=trai_2,
    Data7=trai_26,
    Data8=trai_4,
    Data9=trai,
    Data10=trai_5)

# ---- group: SVG
merge_32 = Merge(
    Data2=merge_29,
    Data3=svg_polyline_8.svg_2,
    Data4=svg_polyline_3.svg_2,
    Data5=svg_polyline_2.svg_2,
    Data6=svg_polyline_4.svg_2,
    Data7=svg_polyline_5.svg_2,
    Data8=svg_polyline_9.svg_2,
    Data9=svg_polyline_9.svg_2,
    Data10=svg_polyline_7.svg_2,
    Data11=svg_polyline.svg_2,
    Data12=svg_polyline_6.svg_2)

# ----
join_7 = TextJoin(Text=flatten(merge_31))
join_8 = TextJoin(Text=flatten(merge_32))

# ---- group: IRPTN Arrow
data_6 = Data(svg_plane_by_page.R_2)

# ---- group: ICN
panel_71 = Panel("ICN")
dpipeline_58 = DynamicGeometryPipeline(
    LayerFilter=panel_71,
    TypeFilter="Curve",
    NameFilter="*",
    enableFullPath=False,
    GroupByLayer=False,
    GroupByType=False,
    IncludeHidden=True,
    IncludeLocked=True,
    listenToAttriubtes=True)  # -> flatten(GeometryOut)
rep_67 = ReplaceText(Text="tag=\"█\"", Find="█", Replace=panel_71, RecursiveReplace=False)  # -> flatten(Result)
# ---- group: SMOOTH
topoly_9 = CurveToPolyline(Curve=dpipeline_58, ToleranceDistance=90, ToleranceAngle=0, MaxEdge=20)  # -> Polyline, Segments
smoothpline_7 = SmoothPolyline(Polyline=topoly_9.Polyline, Strength="1", Times="100")

# ---- group: ICN
dpipeline_59 = DynamicGeometryPipeline(
    LayerFilter="ICN_Legend",
    TypeFilter="Curve",
    NameFilter="*",
    enableFullPath=False,
    GroupByLayer=False,
    GroupByType=False,
    IncludeHidden=True,
    IncludeLocked=True,
    listenToAttriubtes=True)  # -> flatten(GeometryOut)
rep_68 = ReplaceText(Text="tag=\"█\"", Find="█", Replace=panel_71, RecursiveReplace=False)  # -> flatten(Result)
svg_polyline_57 = SVGPolyline(crv=flatten(dpipeline_59), layout=svg_plane_by_page_custom.R_2, attributes=rep_68)  # -> svg_2, crv_4

svg_polyline_58 = SVGPolyline(crv=flatten(smoothpline_7), layout=svg_plane_by_page.R_2, attributes=rep_67)  # -> svg_2, crv_4

trai_32 = CSSStyleMaker(
    custom_attribute=rep_67,
    stroke_colour=swatch_21,
    stroke_thickness=Slider(1.5, range=0..5),
    dash=Slider(0, range=0..4),
    line_cap="round",
    fill=dummy,
    stroke_opacity=Slider(1, range=0..1),
    fill_opacity=Slider(0, range=0..1),
    opacity=Slider(1, range=0..1))

# ---- group: IRPTN
panel_72 = Panel("IRPTN")
dpipeline_60 = DynamicGeometryPipeline(
    LayerFilter=panel_72,
    TypeFilter="Curve",
    NameFilter="*",
    enableFullPath=False,
    GroupByLayer=False,
    GroupByType=False,
    IncludeHidden=True,
    IncludeLocked=True,
    listenToAttriubtes=True)  # -> flatten(GeometryOut)
ext_7 = ExtendCurve(Curve=dpipeline_60, Type=0, Start=panel_11, End=panel_11)
rep_69 = ReplaceText(Text="tag=\"█\"", Find="█", Replace=panel_72, RecursiveReplace=False)  # -> flatten(Result)

# ----
getuv_3 = GetUserValue(Geometry=dpipeline_60, Key="arrowloc")
nullrep_2 = ReplaceNulls(Items=getuv_3, Replacements=0)  # -> Items, Count

# ---- group: SMOOTH
topoly_10 = CurveToPolyline(Curve=ext_7, ToleranceDistance=90, ToleranceAngle=0, MaxEdge=20)  # -> Polyline, Segments
smoothpline_8 = SmoothPolyline(Polyline=topoly_10.Polyline, Strength="1", Times="100")

# ---- group: IRPTN
dpipeline_61 = DynamicGeometryPipeline(
    LayerFilter="IRPTN_Legend",
    TypeFilter="Curve",
    NameFilter="*",
    enableFullPath=False,
    GroupByLayer=False,
    GroupByType=False,
    IncludeHidden=True,
    IncludeLocked=True,
    listenToAttriubtes=True)  # -> flatten(GeometryOut)
rep_70 = ReplaceText(Text="tag=\"█\"", Find="█", Replace=panel_72, RecursiveReplace=False)  # -> flatten(Result)
svg_polyline_59 = SVGPolyline(crv=flatten(dpipeline_61), layout=svg_plane_by_page_custom.R_2, attributes=rep_70)  # -> svg_2, crv_4

# ---- group: IRPTN Arrow (continued)
cluster_7 = Cluster(crv=smoothpline_8, T=data_6, C=Toggle(True), size=Slider(1.5, range=0..5), i=nullrep_2.Items)
crv_8 = Curve(cluster_7)
rep_71 = ReplaceText(Text="tag=\"█_arrow\"", Find="█", Replace=panel_72, RecursiveReplace=False)  # -> flatten(Result)
svg_polyline_60 = SVGPolyline(crv=flatten(crv_8), layout=svg_plane_by_page.R_2, attributes=rep_71)  # -> svg_2, crv_4

# ----
panel_73 = Panel(rep_69)

# ---- group: IRPTN (continued)
svg_polyline_61 = SVGPolyline(crv=flatten(smoothpline_8), layout=svg_plane_by_page.R_2, attributes=rep_69)  # -> svg_2, crv_4

# 02_Public Transport
trai_33 = CSSStyleMaker(
    custom_attribute=rep_69,
    stroke_colour=swatch_26,
    stroke_thickness=Slider(2, range=0..5),
    dash=Slider(0, range=0..4),
    line_cap="round",
    fill=dummy,
    stroke_opacity=Slider(1, range=0..1),
    fill_opacity=Slider(0, range=0..1),
    opacity=Slider(1, range=0..1))

# ---- group: IRPTN Arrow
trai_34 = CSSStyleMaker(
    custom_attribute=rep_71,
    stroke_colour=dummy,
    stroke_thickness=Slider(0, range=0..1),
    fill=swatch_26,
    stroke_opacity=Slider(0, range=0..1),
    fill_opacity=Slider(1, range=0..1),
    opacity=Slider(1, range=0..1))

# ---- group: SVG
merge_33 = Merge(
    Data1=merge_27,
    Data2=svg_text_object_3.R_2,
    Data3=svg_text_object_4.R_2,
    Data4=svg_polyline_59.svg_2,
    Data5=svg_polyline_57.svg_2)

# ---- group: CSS
merge_34 = Merge(Data1=trai_33, Data2=css_text_style_3, Data3=css_text_style_4, Data4=trai_32, Data5=merge_25)

# ---- group: SVG
merge_35 = Merge(Data1=merge_29, Data2=svg_polyline_61.svg_2, Data3=svg_polyline_60.svg_2, Data4=svg_polyline_58.svg_2)

# ---- group: CSS
merge_36 = Merge(Data1=trai_34, Data2=trai_33, Data3=trai_32, Data4=trai_34, Data5=trai_32, Data6=merge_30)

# ----
join_9 = TextJoin(Text=flatten(merge_33))
join_10 = TextJoin(Text=flatten(merge_34))
join_11 = TextJoin(Text=flatten(merge_35))
join_12 = TextJoin(Text=flatten(merge_36))

# ---- group: Major Arrow
data_7 = Data(svg_plane_by_page.R_2)

data_8 = Data(svg_plane_by_page.R_2)

# ---- group: Major
dpipeline_62 = DynamicGeometryPipeline(
    LayerFilter="Major_Legend",
    TypeFilter="Curve",
    NameFilter="*",
    enableFullPath=False,
    GroupByLayer=False,
    GroupByType=False,
    IncludeHidden=True,
    IncludeLocked=True,
    listenToAttriubtes=True)  # -> flatten(GeometryOut)

# ----
cluster_8 = Cluster_3(crv=dpipeline_62, col_2=swatch_65, col_3=swatch_66)  # -> S, D

# ---- group: Major (continued)
svg_polyline_62 = SVGPolyline(crv=flatten(cluster_8.S), layout=svg_plane_by_page_custom.R_2, attributes=cluster_8.D)  # -> svg_2, crv_4

# ---- group: SVG
merge_37 = Merge(
    Data1=svg_text_object_5.R_2,
    Data2=svg_text_object_6.R_2,
    Data3=svg_polyline_62.svg_2,
    Data4=svg_polyline_32.svg_2,
    Data5=svg_polyline_31.svg_2,
    Data6=merge_27)

# ----
join_13 = TextJoin(Text=flatten(merge_37))

# ---- group: Major
panel_74 = Panel("Major")
dpipeline_63 = DynamicGeometryPipeline(
    LayerFilter=panel_74,
    TypeFilter="Curve",
    NameFilter="*",
    enableFullPath=False,
    GroupByLayer=False,
    GroupByType=False,
    IncludeHidden=True,
    IncludeLocked=True,
    listenToAttriubtes=True)  # -> flatten(GeometryOut)
ext_8 = ExtendCurve(Curve=dpipeline_63, Type=0, Start=panel_11, End=panel_11)
rep_72 = ReplaceText(Text="tag=\"█\"", Find="█", Replace=panel_74, RecursiveReplace=False)  # -> flatten(Result)

# ----
topoly_11 = CurveToPolyline(Curve=ext_8, ToleranceDistance=90, ToleranceAngle=0, MaxEdge=20)  # -> Polyline, Segments
smoothpline_9 = SmoothPolyline(Polyline=topoly_11.Polyline, Strength="1", Times="50")

getuv_4 = GetUserValue(Geometry=smoothpline_9, Key="arrowloc")
nullrep_3 = ReplaceNulls(Items=getuv_4, Replacements=0)  # -> Items, Count

getuv_5 = GetUserValue(Geometry=smoothpline_9, Key="arrowloc")
nullrep_4 = ReplaceNulls(Items=getuv_5, Replacements=0)  # -> Items, Count

# ---- group: Major Arrow (continued)
cluster_9 = Cluster(crv=smoothpline_9, T=data_7, C=Toggle(True), size=Slider(2, range=0..5), i="1")
crv_9 = Curve(cluster_9)
rep_73 = ReplaceText(Text="tag=\"█_arrow\"", Find="█", Replace=panel_74, RecursiveReplace=False)  # -> flatten(Result)
svg_polyline_63 = SVGPolyline(crv=flatten(crv_9), layout=svg_plane_by_page.R_2, attributes=rep_73)  # -> svg_2, crv_4

cluster_10 = Cluster(crv=smoothpline_9, T=data_8, C=Toggle(True), size=Slider(2, range=0..5), i="2")
crv_10 = Curve(cluster_10)
rep_74 = ReplaceText(Text="tag=\"█_arrow2\"", Find="█", Replace=panel_74, RecursiveReplace=False)  # -> flatten(Result)
svg_polyline_64 = SVGPolyline(crv=flatten(crv_10), layout=svg_plane_by_page.R_2, attributes=rep_74)  # -> svg_2, crv_4

# ----
cluster_11 = Cluster_3(crv=smoothpline_9, col_2=col_18, col_3=col_19)  # -> S, D
svg_polyline_65 = SVGPolyline(crv=flatten(cluster_11.S), layout=svg_plane_by_page.R_2, attributes=cluster_11.D)  # -> svg_2, crv_4

# ---- group: Major (continued)
# 03_Pedestrian Networks
svg_polyline_66 = SVGPolyline(crv=flatten(smoothpline_9), layout=svg_plane_by_page.R_2, attributes=rep_72)  # -> svg_2, crv_4; disabled

number_slider_11 = Slider(3, range=0..3)
trai_35 = CSSStyleMaker(
    custom_attribute=rep_72,
    stroke_thickness=number_slider_11,
    dash=Slider(0, range=0..4),
    line_cap="round",
    fill=dummy,
    stroke_opacity=Slider(1, range=0..1),
    fill_opacity=Slider(0, range=0..1),
    opacity=Slider(1, range=0..1))

# ---- group: Major Arrow
trai_36 = CSSStyleMaker(
    custom_attribute=rep_73,
    stroke_colour=dummy,
    stroke_thickness=number_slider_11,
    fill=col_18,
    stroke_opacity=Slider(0, range=0..1),
    fill_opacity=Slider(1, range=0..1),
    opacity=Slider(1, range=0..1))

trai_37 = CSSStyleMaker(
    custom_attribute=rep_74,
    stroke_thickness=number_slider_11,
    fill=col_19,
    stroke_opacity=Slider(0, range=0..1),
    fill_opacity=Slider(1, range=0..1),
    opacity=Slider(1, range=0..1))

# ---- group: CSS
merge_38 = Merge(Data1=css_text_style_5, Data2=css_text_style_6, Data3=trai_35, Data4=trai_7, Data5=trai_9, Data6=merge_25)

# ----
merge_39 = Merge(
    Data1=merge_29,
    Data2=svg_polyline_12.svg_2,
    Data3=svg_polyline_14.svg_2,
    Data4=svg_polyline_11.svg_2,
    Data5=svg_polyline_13.svg_2,
    Data6=svg_polyline_65.svg_2,
    Data7=svg_polyline_63.svg_2,
    Data8=svg_polyline_64.svg_2)
merge_40 = Merge(Data1=merge_30, Data2=trai_35, Data3=trai_36, Data4=trai_7, Data5=trai_8, Data6=trai_9, Data7=trai_10, Data8=trai_37)
join_14 = TextJoin(Text=flatten(merge_38))
join_15 = TextJoin(Text=flatten(merge_39))
join_16 = TextJoin(Text=flatten(merge_40))

# ---- group: Pedestrian
panel_75 = Panel("Pedestrian")
crv_11 = Curve([smoothpline_9, smoothpline])
rep_75 = ReplaceText(Text="tag=\"█\"", Find="█", Replace=panel_75, RecursiveReplace=False)  # -> flatten(Result)
svg_polyline_67 = SVGPolyline(crv=flatten(crv_11), layout=svg_plane_by_page.R_2, attributes=rep_75)  # -> svg_2, crv_4

# ----
data_9 = Data(svg_plane_by_page.R_2)
cluster_12 = Cluster(crv=crv_11, T=data_9, C=Toggle(True), size=Slider(0.75, range=0..5), i=0)
crv_12 = Curve(cluster_12)
rep_76 = ReplaceText(Text="tag=\"█_arrow\"", Find="█", RecursiveReplace=False)  # -> flatten(Result)
svg_polyline_68 = SVGPolyline(crv=flatten(crv_12), layout=svg_plane_by_page.R_2, attributes=rep_76)  # -> svg_2, crv_4

# ---- group: Pedestrian
dpipeline_64 = DynamicGeometryPipeline(
    LayerFilter="Pedestrian_Legend",
    TypeFilter="Curve",
    NameFilter="*",
    enableFullPath=False,
    GroupByLayer=False,
    GroupByType=False,
    IncludeHidden=True,
    IncludeLocked=True,
    listenToAttriubtes=True)  # -> flatten(GeometryOut)
rep_77 = ReplaceText(Text="tag=\"█\"", Find="█", Replace=panel_75, RecursiveReplace=False)  # -> flatten(Result)
svg_polyline_69 = SVGPolyline(crv=flatten(dpipeline_64), layout=svg_plane_by_page_custom.R_2, attributes=rep_77)  # -> svg_2, crv_4

trai_38 = CSSStyleMaker(
    custom_attribute=rep_75,
    stroke_colour=swatch_13,
    stroke_thickness=Slider(0.5, range=0..5),
    dash=Slider(0.5, range=0..4),
    gap=Slider(0.75, range=0..4),
    line_cap="round",
    fill=dummy,
    stroke_opacity=Slider(1, range=0..1),
    fill_opacity=Slider(0, range=0..1),
    opacity=Slider(1, range=0..1))

# ---- group: Pedestrian Arrow
trai_39 = CSSStyleMaker(
    custom_attribute=rep_76,
    stroke_colour=dummy,
    stroke_thickness=Slider(0, range=0..1),
    fill=swatch_13,
    stroke_opacity=Slider(0, range=0..1),
    fill_opacity=Slider(1, range=0..1),
    opacity=Slider(1, range=0..1))

# ----
merge_41 = Merge(
    Data1=merge_30,
    Data2=trai_12,
    Data3=trai_13,
    Data4=trai_11,
    Data5=trai_14,
    Data6=trai_15,
    Data7=trai_16,
    Data8=trai_38,
    Data9=trai_39)
merge_42 = Merge(
    Data1=svg_polyline_67.svg_2,
    Data2=svg_polyline_68.svg_2,
    Data3=svg_polyline_17.svg_2,
    Data4=svg_polyline_20.svg_2,
    Data5=svg_polyline_15.svg_2,
    Data6=svg_polyline_19.svg_2,
    Data7=merge_29,
    Data8=svg_polyline_16.svg_2,
    Data9=svg_polyline_18.svg_2)

# ---- group: SVG
merge_43 = Merge(
    Data1=svg_text_object_7.R_2,
    Data2=svg_text_object_8.R_2,
    Data3=svg_polyline_34.svg_2,
    Data4=svg_polyline_35.svg_2,
    Data5=svg_polyline_69.svg_2,
    Data6=svg_polyline_33.svg_2,
    Data7=merge_27)

# ---- group: CSS
merge_44 = Merge(
    Data1=css_text_style_7,
    Data2=css_text_style_8,
    Data3=trai_12,
    Data4=trai_11,
    Data5=trai_15,
    Data6=trai_38,
    Data7=merge_25)

# ----
join_17 = TextJoin(Text=flatten(merge_43))

# ---- group: Legend SVG
merge_45 = Merge(Data1=join_5, Data2=join_9, Data3=join_13, Data4=join_17, Data5=join_2, Data6=join_2)

# ----
item_3 = ListItem(List=merge_45, Index=number_slider, Wrap=True)
join_18 = TextJoin(Text=flatten(merge_44))

# ---- group: Legend CSS
panel_76 = Panel("""* {
fill: none;
stroke: none;
}""")
merge_46 = Merge(Data1=join_6, Data2=join_10, Data3=join_14, Data4=join_18, Data5=join_3, Data6=join_3)

# ----
item_4 = ListItem(List=merge_46, Index=number_slider, Wrap=True)
merge_47 = Merge(Data1=panel_76, Data2=item_4)

# ---- group: SVG Export
svg_compiler = SVGCompiler(css=merge_47, data=flatten(item_3), T=svg_plane_by_page_custom.R_2)
panel_77 = Panel("K:\2014\214059.00\11.0 DRAWINGS\11.07 Graphics\SVG\2016\Diagrams")
file_write = FileWrite(content=svg_compiler, file_path=panel_77, T=rep_24, activate=Toggle(False))

# ----
join_19 = TextJoin(Text=flatten(merge_41))
join_20 = TextJoin(Text=flatten(merge_42))

# ---- group: SVG Export
panel_78 = Panel("K:\2014\214059.00\11.0 DRAWINGS\11.07 Graphics\SVG\2016\Diagrams")

# ----
panel_79 = Panel("""1. Umgeni
2. Sports
3. Greyvilee
4. Centrum
5. Beach
6. Warwick
7. City Port
8. Point""")
panel_80 = Panel("""text="█"
text-anchor="left"
""")
rep_78 = ReplaceText(Text=panel_80, Find="█", Replace="Precinct", RecursiveReplace=False)

txt_11 = Text(simplify(graft(panel_79)))

svg_text_object_11 = SVGTextObject(txt=simplify(graft(txt_11)), P=simplify(graft(merge_4)), T=svg_plane_by_page.R_2, R=rep_78)  # -> R_2, txt_4

rep_79 = ReplaceText(Text="[text=\"█\"] {", Find="█", Replace="Precinct", RecursiveReplace=False)
css_text_style_11 = CSSTextStyle(selector=rep_79, font=panel_9, I=swatch_17, size="1.5mm")

merge_48 = Merge(Data1=merge_14, Data2=svg_text_object_11.R_2)
merge_49 = Merge(Data1=merge_24, Data2=css_text_style_11)
join_21 = TextJoin(Text=flatten(merge_49))
join_22 = TextJoin(Text=flatten(merge_48))

number_slider_12 = Slider(-120, range=-297..300)
pt_21 = Point(merge_4)
Y_6 = UnitY(Factor=number_slider_12)
panel_82 = Panel("""+5,000 Residents
+15,000 Residents
+25,000 Residents
+10,000 Residents
+10,000 Residents
+9,000 Residents
+1,000 Residents
+15,000 Residents
+15,000 Residents""")
move_11 = Move(Geometry=pt_21, Motion=Y_6)  # -> Geometry, Transform
# 06_Growth
pt_22 = Point(move_11.Geometry)
panel_83 = Panel("""text="█"
text-anchor="left"
""")
rep_80 = ReplaceText(Text=panel_83, Find="█", Replace="Residents", RecursiveReplace=False)

txt_12 = Text(simplify(graft(panel_82)))

svg_text_object_12 = SVGTextObject(txt=simplify(graft(txt_12)), P=simplify(graft(move_11.Geometry)), T=svg_plane_by_page.R_2, R=rep_80)  # -> R_2, txt_4

rep_81 = ReplaceText(Text="[text=\"█\"] {", Find="█", Replace="Residents", RecursiveReplace=False)
css_text_style_12 = CSSTextStyle(selector=rep_81, font=panel_9, I=swatch_17, size="0.75mm")

pt_23 = Point(pt_22)
Y_7 = UnitY(Factor=number_slider_12)
panel_85 = Panel("""+5,000 Residents
+15,000 Residents
+25,000 Residents
+10,000 Residents
+10,000 Residents
+9,000 Residents
+1,000 Residents
+15,000 Residents
+15,000 Residents""")
move_12 = Move(Geometry=pt_23, Motion=Y_7)  # -> Geometry, Transform
pt_24 = Point(move_12.Geometry)
panel_86 = Panel("""text="█"
text-anchor="left"
""")
rep_82 = ReplaceText(Text=panel_86, Find="█", Replace="Jobs", RecursiveReplace=False)

txt_13 = Text(simplify(graft(panel_85)))

svg_text_object_13 = SVGTextObject(txt=simplify(graft(txt_13)), P=simplify(graft(move_12.Geometry)), T=svg_plane_by_page.R_2, R=rep_82)  # -> R_2, txt_4

rep_83 = ReplaceText(Text="[text=\"█\"] {", Find="█", Replace="Jobs", RecursiveReplace=False)
css_text_style_13 = CSSTextStyle(selector=rep_83, font=panel_9, I=swatch_17, size="0.75mm")

merge_50 = Merge(Data1=css_text_style_12, Data2=css_text_style_13, Data3=merge_49)
merge_51 = Merge(Data1=svg_text_object_12.R_2, Data2=svg_text_object_13.R_2, Data3=merge_48)
join_23 = TextJoin(Text=flatten(merge_50))

# ---- group: MERGE CSS
merge_52 = Merge(Data1=join_7, Data2=join_12, Data3=join_16, Data4=join_19, Data5=join_21, Data6=join_23)

# ----
item_5 = ListItem(List=merge_52, Index=number_slider, Wrap=True)
merge_53 = Merge(Data1=panel_4, Data3=panel_5, Data4=item_5)
join_24 = TextJoin(Text=flatten(merge_51))

# ---- group: MERGE SVG
merge_54 = Merge(Data1=join_8, Data2=join_11, Data3=join_15, Data4=join_20, Data5=join_22, Data6=join_24)

# ----
item_6 = ListItem(List=merge_54, Index=number_slider, Wrap=False)
merge_55 = Merge(Data1=svg_image_2, Data2=item_6)

# ---- group: SVG Export (continued)
svg_compiler_2 = SVGCompiler(css=merge_53, data=flatten(merge_55), T=svg_plane_by_page.R_2)
file_write_2 = FileWrite(content=svg_compiler_2, file_path=panel_78, T=rep, activate=Toggle(True))

# ==== cluster Cluster

# ---- group: Shape
number_slider = Slider(-3, range=-10..20.001)
number_slider_2 = Slider(-1.5, range=-10..20.001)

# ----
T = ClusterInput()
crv = ClusterInput()
size = ClusterInput()
laysplit_new = LAYSPLITNEW(T=T)  # -> pl_2, data_3, data_4
crv_2 = Curve(graft(crv))
pt = ConstructPoint(XCoordinate=0, YCoordinate=0, ZCoordinate=0)
pt_2 = ConstructPoint(XCoordinate=number_slider_2, YCoordinate=number_slider, ZCoordinate=0)
C = ClusterInput()
i = ClusterInput()
yz = YZPlane(Origin=pt)
size_2 = Data(size)
panel = Panel("""0,1
0
1""")
data = Data(laysplit_new.data_4)
mirror = Mirror(Geometry=pt_2, Plane=yz)  # -> Geometry, Transform
merge = Merge(Data1=pt_2, Data2=pt, Data3=mirror.Geometry)
item = ListItem(List=panel, Index=i, Wrap=False)
split = TextSplit(Text=item, Separators=",")  # -> simplify(Result)

# ---- group: Positioning from end
len = Length(Curve=crv_2)
expression = Expression(x=size_2, y=len, Expression="(x)/(y/30)+1")
expression_2 = Expression(x=size_2, y=len, Expression="(-x)/(y/30)")

# ----
pline = PolyLine(Vertices=merge, Closed=C)
scale = Scale(Geometry=pline, Center=pt, Factor=data)  # -> Geometry, Transform
scale_2 = Scale(Geometry=scale.Geometry, Center=pt, Factor=size_2)  # -> Geometry, Transform

# ---- group: Start
hframe = HorizontalFrame(Curve=reparameterize(crv_2), Parameter=expression_2)

# ---- group: End
hframe_2 = HorizontalFrame(Curve=reparameterize(crv_2), Parameter=expression)

# ----
xy = XYPlane(Origin=Point(0, 0, 0))
rotate = Rotate(Geometry=scale_2.Geometry, Angle=degrees(90), Plane=xy)  # -> Geometry, Transform
rotate_2 = Rotate(Geometry=scale_2.Geometry, Angle=degrees(-90), Plane=xy)  # -> Geometry, Transform
orient = Orient(Geometry=rotate_2.Geometry, Source=PlaneXY(0, 0, 0), Target=hframe_2)  # -> Geometry, Transform
orient_2 = Orient(Geometry=rotate.Geometry, Source=PlaneXY(0, 0, 0), Target=hframe)  # -> Geometry, Transform
weave = Weave(Pattern=split, Stream0=orient_2.Geometry, Stream1=orient.Geometry, NullGaps=False)  # -> flatten(Weave)
panel_2 = Panel(weave)
crv_3 = Curve(weave)
crv_4 = ClusterOutput(crv_3)

# ==== cluster FileWrite
content = ClusterInput()
file_path = ClusterInput()
activate = ClusterInput()
T = ClusterInput()
content_2 = Data(content)
file_path_2 = Text(file_path)
join = TextJoin(Text=[file_path_2, T], Join="\")
vb = VBScript(path=simplify(join), lines=simplify(content_2), activate=activate)  # -> out, A
# ---------- vb: VB ----------
    If (activate = True)
      
      system.IO.File.WriteAllText(path, lines)
      A = "File written"
    Else
      A = "Not activated"
    End If
# ---------- end vb ----------

# ==== cluster SVGPlaneByPage
M = ClusterInput()
panel = Panel("""A4 (L),297,210
A4 (P),210,297
A3 (L),420,297
A3 (P),297,420
A1 (L),841,594
A1 (P),594,841""")
split = TextSplit(Text=panel, Separators=",")
item = ListItem(List=split, Index=0, Wrap=True)  # -> flatten(Item), flatten(Item1), flatten(Item2)
mindex = MemberIndex(Set=item.Item, Member=simplify(M))  # -> simplify(flatten(Index)), Count
plane = ClusterInput()
item_2 = ListItem(List=panel, Index=mindex.Index, Wrap=True)  # -> simplify(Item)
T = ClusterInput()
merge = Merge(Data1=simplify(item_2), Data2=simplify(M))
split_2 = TextSplit(Text=T, Separators=":")
item_3 = ListItem(List=merge, Index=0, Wrap=True)
item_4 = ListItem(List=split_2, Index=0, Wrap=True)  # -> Item, Item1
unit_checker = PythonScript()  # -> out, a
# ---------- unit_checker: Python ----------
import rhinoscriptsyntax as rs
import scriptcontext as sc

a=sc.doc.ModelUnitSystem
a = str(a)
if a == "Millimeters":
    print 1
elif a == "Meters":
    print 1000
else:
    print "Use the metric system fool"
# ---------- end unit_checker ----------
split_3 = TextSplit(Text=item_3, Separators=",")
division = Division(A=item_4.Item1, B=unit_checker.out)
item_5 = ListItem(List=reverse(split_3), Index=[0, 1], Wrap=True)  # -> reverse(Item)
num = Number(division)
num_2 = Number(item_5)
expression = Expression(x=num_2, y=num, Expression="x*y")
plane_2 = Data(plane)
plane_3 = Plane(flatten(plane_2))
dispatch = Dispatch(List=expression, DispatchPattern=[True, False])  # -> ListA, ListB
deplane = DeconstructPlane(Plane=plane_3)  # -> simplify(Origin), simplify(XAxis), simplify(YAxis), ZAxis
x_dim = Domain(dispatch.ListB)
y_dim = Domain(dispatch.ListA)
dims = Number(flatten(num_2))
pt = Point(deplane.Origin)
pt_2 = Point(deplane.XAxis)
pt_3 = Point(deplane.YAxis)
neg = Negative(Value=x_dim)
merge_2 = Merge(Data1=simplify(pt), Data2=simplify(pt_2), Data3=simplify(pt_3))  # -> simplify(Result)
rectangle = Rectangle(Plane=plane_2, XSize=y_dim, YSize=neg, Radius=0)  # -> Rectangle, Length
scale = Number(flatten(num))
pt2num = PointsToNumbers(Points=merge_2, Mask=4)  # -> simplify(Numbers)
path_mapper = PathMapper(scale, source="{0}", target="{0;2}")
path_mapper_2 = PathMapper(dims, source="{0}", target="{0;1}")
path_mapper_3 = PathMapper(plane_3, source="{0}", target="{0;0}")
join = TextJoin(Text=pt2num, Join=",")  # -> simplify(Result)
join_2 = TextJoin(Text=dims, Join=",")  # -> simplify(Result)
merge_3 = Merge(Data1=path_mapper_3, Data2=path_mapper_2, Data3=path_mapper)  # -> simplify(Result)
rep = ReplaceText(Text="~;", Find="~", Replace=simplify(join_2), RecursiveReplace=False)  # -> simplify(Result)
rep_2 = ReplaceText(Text="~", Find="~", Replace=simplify(scale), RecursiveReplace=False)  # -> simplify(Result)
rep_3 = ReplaceText(Text="~;", Find="~", Replace=simplify(join), RecursiveReplace=False)  # -> simplify(Result)
merge_4 = Merge(Data1=flatten(rep_3), Data2=flatten(rep), Data3=flatten(rep_2))
R = ClusterOutput(rectangle.Rectangle)
join_3 = TextJoin(Text=merge_4)
panel_2 = Panel(join_3)
R_2 = ClusterOutput(join_3)
panel_3 = Panel(merge_3)

# ==== cluster SVGPolyline
crv = ClusterInput()
layout = ClusterInput()
class = ClusterInput()
attributes = ClusterInput()
text = ClusterInput()  # "---------"
class_2 = Text(class)
layout_2 = Data(layout)
attributes_2 = Data(attributes)
concat = Concatenate(FragmentA="class=\"", FragmentB=class_2, FragmentC="\"")
text_2 = Text(text)  # "---------"
laysplit_new = LAYSPLITNEW(T=layout_2)  # -> pl_2, data_3, data_4
concat_2 = Concatenate(FragmentA=concat, FragmentB=" ", FragmentC=attributes_2)
null = NullItem(Item=class_2)  # -> NullFlags, InvalidFlags, Description
filter = StreamFilter(Gate=null.NullFlags, Stream0=concat_2, Stream1=attributes_2)
graft = GraftTree(Tree=filter, IncludeEmptyLists=True, IncludeNullItems=True)  # -> simplify(Tree)
null_2 = NullItem(Item=graft)  # -> NullFlags, InvalidFlags, Description
data = Data(laysplit_new.data_3)
dispatch = Dispatch(List="attributes=\"empty\"", DispatchPattern=null_2.NullFlags)  # -> ListA, ListB
item = ListItem(List=data, Index=0, Wrap=True)  # -> Item, Item1
merge = Merge(Data1=graft, Data2=dispatch.ListA)
null_3 = NullItem(Item=laysplit_new.data_4)  # -> NullFlags, InvalidFlags, Description
dom²num = ConstructDomain²(UMin=0, UMax=item.Item1, VMin=0, VMax=item.Item)
dispatch_2 = Dispatch(List="1", DispatchPattern=null_3.NullFlags)  # -> ListA, ListB
merge_2 = Merge(Data1=laysplit_new.data_4, Data2=dispatch_2.ListA)
crv_2 = Curve(simplify(crv))
num = Number(merge_2)
lng = ListLength(List=laysplit_new.pl_2)
cls = Closed(Curve=crv_2)  # -> Closed, Periodic
repeat = RepeatData(Data=num, Length=lng)
dispatch_3 = Dispatch(List=graft(crv_2), DispatchPattern=graft(cls.Closed))  # -> ListA, ListB
explode = Explode(Curve=dispatch_3.ListA, Recursive=True)  # -> Segments, Vertices
eval = EvaluateLength(Curve=explode.Segments, Length=0, Normalized=True)  # -> simplify(Point), Tangent, Parameter
item_2 = ListItem(List=eval.Point, Index=0, Wrap=True)
merge_3 = Merge(Data1=eval.Point, Data2=item_2)  # -> simplify(Result)
explode_2 = Explode(Curve=dispatch_3.ListB, Recursive=True)  # -> Segments, simplify(Vertices)
weave = Weave(Pattern=graft(cls.Closed), Stream0=explode_2.Vertices, Stream1=merge_3, NullGaps=False)  # -> simplify(Weave)
lng_2 = ListLength(List=crv_2)
repeat_2 = RepeatData(Data=repeat, Length=lng_2)  # -> simplify(graft(Data))
plcoord = PlaneCoordinates(Point=simplify(weave), System=simplify(laysplit_new.pl_2))  # -> XCoordinate, YCoordinate, ZCoordinate
clean = CleanTree(RemoveNulls=True, RemoveInvalid=True, RemoveEmpty=True, Tree=plcoord.YCoordinate)
clean_2 = CleanTree(RemoveNulls=True, RemoveInvalid=True, RemoveEmpty=True, Tree=repeat_2)
clean_3 = CleanTree(RemoveNulls=True, RemoveInvalid=True, RemoveEmpty=True, Tree=merge)
clean_4 = CleanTree(RemoveNulls=True, RemoveInvalid=True, RemoveEmpty=True, Tree=plcoord.XCoordinate)
expression = Expression(x=clean, Expression="-(x)")
expression_2 = Expression(x=clean_4, y=clean_2, Expression="x/y")
expression_3 = Expression(x=expression, y=clean_2, Expression="x/y")
expression_4 = Expression(x=expression_3, Expression="(int(x*1000000))/1000000")
expression_5 = Expression(x=expression_2, Expression="(int(x*1000000))/1000000")
expression_6 = Expression(x=expression_5, y=expression_4, Expression="Format(\"{0},{1}\", x, y)")
null_4 = NullItem(Item=expression_4)  # -> NullFlags, InvalidFlags, Description
bool = Boolean(cls.Closed)
txt = Text("~")
ma = MassAddition(Input=null_4.NullFlags)  # -> Result, PartialResults
dispatch_4 = Dispatch(List=expression_6, DispatchPattern=ma.Result)  # -> ListA, ListB
weave_2 = Weave(Pattern=bool, Stream0="<polyline ` points=\"~\"/>", Stream1="<polygon ` points=\"~\"/>", NullGaps=False)
join = TextJoin(Text=dispatch_4.ListB, Join=" ")
cluster = Cluster_2(data=join)
rep = ReplaceText(Text=weave_2, Find=txt, Replace=cluster, RecursiveReplace=False)  # -> simplify(Result)
txt_2 = Text("`")
rep_2 = ReplaceText(Text=rep, Find=txt_2, Replace=clean_3, RecursiveReplace=False)  # -> simplify(Result)
panel = Panel(rep_2)
flatten = FlattenTree(Tree=rep_2, Path="{0}")
svg = Text(flatten)
crv_3 = Curve(crv_2)
svg_2 = ClusterOutput(svg)
crv_4 = ClusterOutput(crv_3)

# ==== cluster CSSStyleMaker
text = ClusterInput()  # "--------------------------------"
element = ClusterInput()  # Specifies the Element name. The Element name is the overarching title or group for a set of elements.
class = ClusterInput()  # Specifies the Class name. A Class acts as a secondary specification or grouping under Element name.
custom_attribute = ClusterInput()  # Specifies a custom attribute for the element/s. This custom attribute can be useful for assigning specific styles and/or events too.
events = ClusterInput()  # Specifies the Class name. A Class acts as a secondary specification or grouping under Element name.
events_2 = Data(events)
tmatch = MatchText(Text=events_2, RegEx="@keyframes", Case=True)
custom_attribute_2 = Data(custom_attribute)
element_2 = Text(element)  # disabled
text_2 = Text(text)  # "--------------------------------"
class_2 = Data(class)  # disabled
mindex = MemberIndex(Set=tmatch, Member=True)  # -> simplify(flatten(Index)), Count
lng = ListLength(List=events_2)  # -> expr("x-1", flatten(Length))
shift = ShiftList(List=mindex.Index, Shift=1, Wrap=False)
concat = Concatenate(FragmentA=element_2, FragmentB=".", FragmentC=class_2, FragmentE=" {")  # disabled
null = NullItem(Item=custom_attribute_2)  # -> NullFlags, InvalidFlags, Description
subtraction = Subtraction(A=shift, B=1)
merge = Merge(Data1=flatten(subtraction), Data2=flatten(lng))  # -> flatten(Result)
merge_2 = Merge(Data1=simplify(graft(mindex.Index)), Data2=simplify(graft(merge)))
bool = Boolean(invert(null.NullFlags))
rep = ReplaceText(Text="[~]{", Find="~", Replace=custom_attribute_2, RecursiveReplace=False)
item = ListItem(List=merge_2, Index=0, Wrap=True)  # -> Item, Item1
filter = StreamFilter(Gate=bool, Stream0=concat, Stream1=rep)
expression = Expression(x=item.Item1, y=item.Item, Expression="x-y+1")
lng_2 = ListLength(List=flatten(filter))
stroke_colour = ClusterInput()
txt = Text("}")
series = Series(Start=item.Item, Step=1, Count=expression)
text_3 = ClusterInput()  # "--------------------------------"
fill = ClusterInput()
text_4 = ClusterInput()  # "--------------------------------"
stroke_opacity = ClusterInput()
fill_opacity = ClusterInput()
opacity = ClusterInput()
stroke_thickness = ClusterInput()
dash = ClusterInput()
gap = ClusterInput()
line_cap = ClusterInput()
line_join = ClusterInput()
repeat = RepeatData(Data=txt, Length=lng_2)  # -> simplify(graft(Data))
item_2 = ListItem(List=events_2, Index=series, Wrap=True)  # -> simplify(Item)
cull_i = CullIndex(List=item_2, Indices=0, Wrap=True)
split = TextSplit(Text=cull_i, Separators=":")
tmatch_2 = MatchText(Text=fill, Pattern="none", Case=True)
stroke_colour_2 = Colour(stroke_colour)
tstat = TreeStatistics(Tree=repeat)  # -> Paths, Length, Count
argb = SplitARGB(Colour=stroke_colour_2, IntegerChannels=True)  # -> Alpha, Red, Green, Blue
fill_2 = Colour(fill)
dash_2 = Data(dash)
gap_2 = Data(gap)
profile = Duration(L=split, R="profile")
direction = Duration(L=split, R="direction")
iteration = Duration(L=split, R="iteration")
duration = Duration(L=split, R="duration")
item_3 = ListItem(List=item_2, Index=0, Wrap=True)
stroke_thickness_2 = Data(stroke_thickness)
text_5 = Text(text_4)  # "--------------------------------"
stroke_opacity_2 = Number(stroke_opacity)
fill_opacity_2 = Number(fill_opacity)
opacity_2 = Number(opacity)
dpath = DeconstructPath(Branch=tstat.Paths)
line_cap_2 = Text(line_cap)
line_join_2 = Text(line_join)
argb_2 = SplitARGB(Colour=fill_2, IntegerChannels=True)  # -> Alpha, Red, Green, Blue
int = Integer([argb.Red, argb.Green, argb.Blue])
concat_2 = Concatenate(FragmentA=stroke_thickness_2, FragmentB="mm")
join = TextJoin(Text=flatten(profile), Join=", ")
join_2 = TextJoin(Text=flatten(direction), Join=", ")
join_3 = TextJoin(Text=flatten(iteration), Join=", ")
join_4 = TextJoin(Text=flatten(duration), Join=", ")
lng_3 = ListLength(List=dpath)
null_2 = NullItem(Item=flatten(line_cap_2))  # -> NullFlags, InvalidFlags, Description
null_3 = NullItem(Item=stroke_opacity_2)  # -> NullFlags, InvalidFlags, Description
join_5 = TextJoin(Text=int, Join=",")
null_4 = NullItem(Item=fill_opacity_2)  # -> NullFlags, InvalidFlags, Description
null_5 = NullItem(Item=opacity_2)  # -> NullFlags, InvalidFlags, Description
null_6 = NullItem(Item=dash_2)  # -> NullFlags, InvalidFlags, Description
null_7 = NullItem(Item=gap_2)  # -> NullFlags, InvalidFlags, Description
concat_3 = Concatenate(FragmentA=dash_2, FragmentB="mm")
concat_4 = Concatenate(FragmentA=gap_2, FragmentB="mm")
null_8 = NullItem(Item=flatten(line_join_2))  # -> NullFlags, InvalidFlags, Description
int_2 = Integer([argb_2.Red, argb_2.Green, argb_2.Blue])
null_9 = NullItem(Item=stroke_thickness_2)  # -> NullFlags, InvalidFlags, Description
text_6 = Text(text_3)  # "--------------------------------"
panel = Panel(join_3)
panel_2 = Panel(join_4)
panel_3 = Panel(join_2)
panel_4 = Panel(join)
p_n_c = PickNChoose(Pattern=null_3.NullFlags, Stream0=stroke_opacity_2, Stream1="none")
p_n_c_2 = PickNChoose(Pattern=null_4.NullFlags, Stream0=fill_opacity_2, Stream1="none")
ma = MassAddition(Input=null_2.NullFlags)  # -> Result, PartialResults
join_6 = TextJoin(Text=int_2, Join=",")
p_n_c_3 = PickNChoose(Pattern=null_5.NullFlags, Stream0=opacity_2, Stream1="none")
rep_2 = ReplaceText(Text="rgb(*)", Find="*", Replace=join_5, RecursiveReplace=False)
trim = TrimTree(Tree=repeat, Depth=expr("x-1", lng_3))
null_10 = NullItem(Item=join_5)  # -> NullFlags, InvalidFlags, Description
join_7 = TextJoin(Text=[concat_3, concat_4], Join=",")
p_n_c_4 = PickNChoose(Pattern=ma.Result, Stream0=line_cap_2, Stream1="none")
ma_2 = MassAddition(Input=null_8.NullFlags)  # -> Result, PartialResults
or = GateOr(A=null_6.NullFlags, B=null_7.NullFlags)
p_n_c_5 = PickNChoose(Pattern=ma_2.Result, Stream0=line_join_2, Stream1="none")
p_n_c_6 = PickNChoose(Pattern=null_9.NullFlags, Stream0=concat_2, Stream1="none")
split_2 = TextSplit(Text=item_3)
rep_3 = ReplaceText(Text="rgb(*)", Find="*", Replace=join_6, RecursiveReplace=False)
rep_4 = ReplaceText(Text="\tstroke-opacity:*;", Find="*", Replace=p_n_c, RecursiveReplace=False)
p_n_c_7 = PickNChoose(Pattern=null_10.NullFlags, Stream0=rep_2, Stream1="none")
rep_5 = ReplaceText(Text="\tfill-opacity:*;", Find="*", Replace=p_n_c_2, RecursiveReplace=False)
rep_6 = ReplaceText(Text="\topacity:*;", Find="*", Replace=p_n_c_3, RecursiveReplace=False)
rep_7 = ReplaceText(Text="\tstroke-linecap:*;", Find="*", Replace=p_n_c_4, RecursiveReplace=False)
rep_8 = ReplaceText(Text="\tstroke-linejoin:*;", Find="*", Replace=p_n_c_5, RecursiveReplace=False)
rep_9 = ReplaceText(Text="\tstroke-width:*;", Find="*", Replace=p_n_c_6, RecursiveReplace=False)
ma_3 = MassAddition(Input=flatten(null_9.NullFlags))  # -> Result, PartialResults
p_n_c_8 = PickNChoose(Pattern=or, Stream0=join_7, Stream1="none")
item_4 = ListItem(List=split_2, Index=0, Wrap=True)
ma_4 = MassAddition(Input=flatten(null_10.NullFlags))  # -> Result, PartialResults
rep_10 = ReplaceText(Text="\tstroke:~;", Find="~", Replace=p_n_c_7, RecursiveReplace=False)
null_11 = NullItem(Item=fill)  # -> NullFlags, InvalidFlags, Description
gate = StreamGate(Stream=rep_4, Gate=null_3.NullFlags)  # -> Target0, Target1
p_n_c_9 = PickNChoose(Pattern=tmatch_2, Stream0=rep_3, Stream1="none")
gate_2 = StreamGate(Stream=rep_6, Gate=null_5.NullFlags)  # -> Target0, Target1
gate_3 = StreamGate(Stream=rep_5, Gate=null_4.NullFlags)  # -> Target0, Target1
gate_4 = StreamGate(Stream=rep_7, Gate=ma.Result)  # -> Target0, Target1
gate_5 = StreamGate(Stream=rep_8, Gate=ma_2.Result)  # -> Target0, Target1
rep_11 = ReplaceText(Text="\tstroke-dasharray:*;", Find="*", Replace=p_n_c_8, RecursiveReplace=False)
gate_6 = StreamGate(Stream=rep_9, Gate=ma_3.Result)  # -> Target0, Target1
branch = TreeBranch(Tree=item_3, Path="{0}", MaintainPaths=True)
split_3 = TextSplit(Text=item_4, Separators=" ")
rep_12 = ReplaceText(Text="\tfill:~;", Find="~", Replace=p_n_c_9, RecursiveReplace=False)
gate_7 = StreamGate(Stream=rep_10, Gate=ma_4.Result)  # -> Target0, Target1
gate_8 = StreamGate(Stream=rep_11, Gate=or)  # -> Target0, Target1
null_12 = NullItem(Item=branch)  # -> NullFlags, InvalidFlags, Description
item_5 = ListItem(List=split_3, Index=1, Wrap=True)
gate_9 = StreamGate(Stream=rep_12, Gate=null_11.NullFlags)  # -> Target0, Target1
join_8 = TextJoin(Text=flatten(item_5), Join=", ")
rep_13 = ReplaceText(Text="\tanimation-name: *;", Find="*", Replace=join_8, RecursiveReplace=False)  # -> simplify(Result)
rep_14 = ReplaceText(Text="\tanimation-duration: *;", Find="*", Replace=panel_2, RecursiveReplace=False)  # -> simplify(Result)
rep_15 = ReplaceText(Text="\tanimation-iteration-count: *;", Find="*", Replace=panel, RecursiveReplace=False)  # -> simplify(Result)
rep_16 = ReplaceText(Text="\tanimation-direction: *;", Find="*", Replace=panel_3, RecursiveReplace=False)  # -> simplify(Result)
rep_17 = ReplaceText(Text="\tanimation-timing-function: *;", Find="*", Replace=panel_4, RecursiveReplace=False)  # -> simplify(Result)
gate_10 = StreamGate(Stream=rep_13, Gate=null_12.NullFlags)  # -> flatten(Target0), Target1
gate_11 = StreamGate(Stream=rep_14, Gate=null_12.NullFlags)  # -> flatten(Target0), Target1
gate_12 = StreamGate(Stream=rep_15, Gate=null_12.NullFlags)  # -> flatten(Target0), Target1
gate_13 = StreamGate(Stream=rep_16, Gate=null_12.NullFlags)  # -> flatten(Target0), Target1
gate_14 = StreamGate(Stream=rep_17, Gate=null_12.NullFlags)  # -> flatten(Target0), Target1
merge_3 = Merge(Data1=gate_10.Target0, Data2=gate_11.Target0, Data3=gate_12.Target0, Data4=gate_13.Target0, Data5=gate_14.Target0)  # -> flatten(Result)
merge_4 = Merge(
    Data1=gate_7.Target0,
    Data2=gate_6.Target0,
    Data3=gate_8.Target0,
    Data4=gate_4.Target0,
    Data5=gate_5.Target0,
    Data6=gate_9.Target0,
    Data7=gate.Target0,
    Data8=gate_3.Target0,
    Data9=gate_2.Target0)  # -> flatten(Result)
merge_5 = Merge(Data1=filter, Data2=merge_4, Data3=merge_3, Data4=trim)
join_9 = TextJoin(Text=merge_5)
merge_6 = Merge(Data1=flatten(item_3), Data2=flatten(join_9))
rep_18 = ReplaceText(Text=merge_6, Find="mm", RecursiveReplace=False)
css = Data(rep_18)
css_2 = ClusterOutput(css)

# ==== cluster CSSTextStyle
I = ClusterInput()
style = ClusterInput()
font = ClusterInput()
selector = ClusterInput()
size = ClusterInput()
opacity = ClusterInput()
opacity_2 = ClusterInput()
stroke_colour = Colour(I)
argb = SplitARGB(Colour=stroke_colour, IntegerChannels=True)  # -> Alpha, Red, Green, Blue
selector_2 = Text(selector)
font_2 = Text(font)
style_2 = Text(style)
size_2 = Text(size)
opacity_3 = Text(opacity)
opacity_4 = Text(opacity_2)
null = NullItem(Item=I)  # -> NullFlags, InvalidFlags, Description
null_2 = NullItem(Item=style_2)  # -> NullFlags, InvalidFlags, Description
null_3 = NullItem(Item=selector_2)  # -> NullFlags, InvalidFlags, Description
int = Integer([argb.Red, argb.Green, argb.Blue])
null_4 = NullItem(Item=opacity_3)  # -> NullFlags, InvalidFlags, Description
null_5 = NullItem(Item=opacity_4)  # -> NullFlags, InvalidFlags, Description
join = TextJoin(Text=int, Join=",")
filter = StreamFilter(Gate=null_3.NullFlags, Stream0=selector_2, Stream1=".text {")
rep = ReplaceText(Text="rgb(*)", Find="*", Replace=join, RecursiveReplace=False)
null_6 = NullItem(Item=join)  # -> NullFlags, InvalidFlags, Description
p_n_c = PickNChoose(Pattern=null_6.NullFlags, Stream0=rep, Stream1="none")
rep_2 = ReplaceText(Text="\tfont-family:\"*\";", Find="*", Replace=font_2, RecursiveReplace=False)
rep_3 = ReplaceText(Text="\tfont-style:*;", Find="*", Replace=style_2, RecursiveReplace=False)
rep_4 = ReplaceText(Text="\tfont-size:*;", Find="*", Replace=size_2, RecursiveReplace=False)
rep_5 = ReplaceText(Text="\topacity:*;", Find="*", Replace=opacity_3, RecursiveReplace=False)
rep_6 = ReplaceText(Text="\tfont-weight:*;", Find="*", Replace=opacity_4, RecursiveReplace=False)
txt = Text(filter)
txt_2 = Text("}")
ma = MassAddition(Input=flatten(null_6.NullFlags))  # -> Result, PartialResults
rep_7 = ReplaceText(Text="\tfill:~;", Find="~", Replace=p_n_c, RecursiveReplace=False)
gate = StreamGate(Stream=rep_3, Gate=null_2.NullFlags)  # -> Target0, Target1
gate_2 = StreamGate(Stream=rep_5, Gate=null_4.NullFlags)  # -> Target0, Target1
gate_3 = StreamGate(Stream=rep_6, Gate=null_5.NullFlags)  # -> Target0, Target1
gate_4 = StreamGate(Stream=rep_7, Gate=ma.Result)  # -> Target0, Target1
gate_5 = StreamGate(Stream=gate_4.Target0, Gate=null.NullFlags)  # -> Target0, Target1
merge = Merge(Data1=txt, Data2=rep_2, Data3=gate.Target0, Data4=gate_5.Target0, Data5=rep_4, Data6=gate_2.Target0, Data8=txt_2)
join_2 = TextJoin(Text=merge)
data = Data(join_2)
data_2 = ClusterOutput(data)

# ==== cluster SVGImage
img_pa = ClusterInput()  # IMG PA
rec = ClusterInput()
T = ClusterInput()
laysplit_new = LAYSPLITNEW(T=T)  # -> pl_2, data_3, data_4
txt = Text(img_pa)
rec_2 = Rectangle(rec)
lng = ListLength(List=rec_2)
null = NullItem(Item=laysplit_new.data_4)  # -> NullFlags, InvalidFlags, Description
repeat = RepeatData(Data=txt, Length=lng)
dispatch = Dispatch(List="1", DispatchPattern=null.NullFlags)  # -> ListA, ListB
drec = DeconstuctRectangle(Rectangle=rec_2)  # -> BasePlane, XInterval, YInterval
panel = Panel(repeat)
merge = Merge(Data1=laysplit_new.data_4, Data2=dispatch.ListA)
dedomain = DeconstructDomain(Domain=drec.XInterval)  # -> Start, End
dedomain_2 = DeconstructDomain(Domain=drec.YInterval)  # -> Start, End
num = Number(merge)
lng_2 = ListLength(List=laysplit_new.pl_2)
expression = Expression(x=dedomain.Start, y=dedomain.End, Expression="y-x")
expression_2 = Expression(x=dedomain_2.Start, y=dedomain_2.End, Expression="y-x")
dedomain_3 = DeconstructDomain(Domain=expression_2)  # -> Start, End
repeat_2 = RepeatData(Data=num, Length=lng_2)
dom = ConstructDomain(DomainStart=dedomain_3.Start, DomainEnd=expr("-x", dedomain_3.End))
xy = XYPlane(Origin=Point(0, 0, 0))
expression_3 = Expression(x=repeat_2, Expression="1/x")
rectangle = Rectangle(Plane=laysplit_new.pl_2, XSize=expression, YSize=dom, Radius=0)  # -> Rectangle, Length
scale = Scale(Geometry=rectangle.Rectangle, Center=laysplit_new.pl_2, Factor=expression_3)  # -> Geometry, Transform
scale_2 = Scale(Geometry=rec_2, Center=laysplit_new.pl_2, Factor=expression_3)  # -> Geometry, Transform
orient = Orient(Geometry=scale.Geometry, Source=laysplit_new.pl_2, Target=xy)  # -> Geometry, Transform
orient_2 = Orient(Geometry=scale_2.Geometry, Source=laysplit_new.pl_2, Target=xy)  # -> Geometry, Transform
attributes = ClusterInput()
attributes_2 = Data(attributes)
explode = Explode(Curve=orient_2.Geometry, Recursive=True)  # -> Segments, Vertices
explode_2 = Explode(Curve=orient.Geometry, Recursive=True)  # -> Segments, Vertices
graft = GraftTree(Tree=attributes_2, IncludeEmptyLists=True, IncludeNullItems=True)  # -> simplify(Tree)
null_2 = NullItem(Item=graft)  # -> NullFlags, InvalidFlags, Description
dispatch_2 = Dispatch(List="attributes=\"empty\"", DispatchPattern=null_2.NullFlags)  # -> ListA, ListB
item = ListItem(List=explode.Vertices, Index=-2, Wrap=True)
xy_2 = XYPlane(Origin=item)
item_2 = ListItem(List=explode.Vertices, Index=-3, Wrap=True)
item_3 = ListItem(List=explode_2.Vertices, Index=-2, Wrap=True)
xy_3 = XYPlane(Origin=item_3)
dedomain_4 = DeconstructDomain(Domain=drec.YInterval)  # -> Start, End
item_4 = ListItem(List=explode_2.Vertices, Index=-3, Wrap=True)
dedomain_5 = DeconstructDomain(Domain=drec.XInterval)  # -> Start, End
merge_2 = Merge(Data1=graft, Data2=dispatch_2.ListA)  # -> flatten(Result)
expression_4 = Expression(x=dedomain_5.Start, y=dedomain_5.End, Expression="abs(y-x)")
expression_5 = Expression(x=dedomain_4.Start, y=dedomain_4.End, Expression="abs(y-x)")
vec2pt = Vector2Pt(PointA=item_3, PointB=item_4, Unitize=False)  # -> Vector, Length
align = AlignPlane(Plane=xy_3, Direction=vec2pt.Vector)  # -> Plane, Angle
vec2pt_2 = Vector2Pt(PointA=item, PointB=item_2, Unitize=False)  # -> Vector, Length
align_2 = AlignPlane(Plane=xy_2, Direction=vec2pt_2.Vector)  # -> Plane, Angle
orient_3 = Orient(Geometry=orient.Geometry, Source=flatten(align.Plane), Target=flatten(align_2.Plane))  # -> Geometry, simplify(Transform)
panel_2 = Panel(merge_2)
orient_4 = OrientDirection(
    Geometry=orient.Geometry,
    PointA=flatten(item_3),
    DirectionA=flatten(vec2pt.Vector),
    PointB=flatten(item),
    DirectionB=flatten(vec2pt_2.Vector))  # -> Geometry, simplify(Transform)
expression_6 = Expression(x=expression_5, y=repeat_2, Expression="x/y")
expression_7 = Expression(x=expression_4, y=repeat_2, Expression="x/y")
cull_i = CullIndex(List=explode.Vertices, Indices=0, Wrap=True)
dematrix = DeconstructMatrix(Matrix=orient_3.Transform)  # -> Rows, Columns, simplify(Values)
avr = Average(Input=cull_i)
panel_3 = Panel(dematrix.Values)
plcoord = PlaneCoordinates(Point=simplify(avr), System=simplify(laysplit_new.pl_2))  # -> XCoordinate, YCoordinate, ZCoordinate
panel_4 = Panel("""3
7""")
panel_5 = Panel("""0
1
4
5""")
item_5 = ListItem(List=dematrix.Values, Index=panel_5, Wrap=True)
item_6 = ListItem(List=dematrix.Values, Index=panel_4, Wrap=True)
dedom2 = DeconstructDomain²(Domain=laysplit_new.data_3)  # -> UComponent, VComponent
dispatch_3 = Dispatch(List=item_6, DispatchPattern=[True, False])  # -> ListA, ListB
dedomain_6 = DeconstructDomain(Domain=dedom2.VComponent)  # -> Start, End
dedomain_7 = DeconstructDomain(Domain=dedom2.UComponent)  # -> Start, End
expression_8 = Expression(x=dispatch_3.ListB, Expression="-(x)")
expression_9 = Expression(x=dedomain_6.Start, y=dedomain_6.End, Expression="-((y-x)+((y-x)/3))")
expression_10 = Expression(x=dedomain_7.Start, y=dedomain_7.End, Expression="(y-x)+((y-x)/3)")
expression_11 = Expression(x=dedomain_7.Start, y=dedomain_7.End, Expression="-((y-x)/3)")
expression_12 = Expression(x=dedomain_6.Start, y=dedomain_6.End, Expression="((y-x)/3)")
merge_3 = Merge(Data1=simplify(item_5), Data2=simplify(dispatch_3.ListA), Data3=simplify(expression_8))
join = TextJoin(Text=merge_3, Join=" ")
dom_2 = ConstructDomain(DomainStart=expression_12, DomainEnd=expression_9)
dom_3 = ConstructDomain(DomainStart=expression_11, DomainEnd=expression_10)
rep = ReplaceText(Text="onerror=\"this.src='file:///~'\"", Find="~", Replace=repeat, RecursiveReplace=False)
rep_2 = ReplaceText(Text="xlink:href=\"~\"", Find="~", Replace=repeat, RecursiveReplace=False)
rep_3 = ReplaceText(Text="height=\"~\"", Find="~", Replace=expression_6, RecursiveReplace=False)
rep_4 = ReplaceText(Text="width=\"~\"", Find="~", Replace=expression_7, RecursiveReplace=False)
rep_5 = ReplaceText(Text="transform=\"matrix(~)\"", Find="~", Replace=join, RecursiveReplace=False)
inc = Includes(Value=plcoord.XCoordinate, Domain=dom_3)  # -> Includes, Deviation
inc_2 = Includes(Value=plcoord.YCoordinate, Domain=dom_2)  # -> Includes, Deviation
data = Data(flatten(rep))
data_2 = Data(flatten(rep_2))
data_3 = Data(flatten(rep_3))
data_4 = Data(flatten(rep_4))
data_5 = Data(flatten(rep_5))
ma = MassAddition(Input=inc.Includes)  # -> Result, PartialResults
ma_2 = MassAddition(Input=inc_2.Includes)  # -> Result, PartialResults
bool = Boolean(ma.Result)
bool_2 = Boolean(ma_2.Result)
merge_4 = Merge(
    Data1=simplify(graft(merge_2)),
    Data3=simplify(graft(data_4)),
    Data4=simplify(graft(data_3)),
    Data5=simplify(graft(data_5)),
    Data6=simplify(graft(data_2)),
    Data7=simplify(graft(data)))
and = GateAnd(A=bool, B=bool_2)
or = GateOr(A=and)  # -> flatten(Result)
join_2 = TextJoin(Text=merge_4, Join=" ")  # -> simplify(Result)
rep_6 = ReplaceText(Text="<image ~/>", Find="~", Replace=join_2, RecursiveReplace=False)
data_6 = Data(flatten(rep_6))
dispatch_4 = Dispatch(List=simplify(data_6), DispatchPattern=or)  # -> ListA, ListB
clean = CleanTree(RemoveNulls=True, RemoveInvalid=True, RemoveEmpty=True, Tree=dispatch_4.ListA)
svg = Text(dispatch_4.ListB)
panel_6 = Panel(svg)
svg_2 = ClusterOutput(svg)

# ==== cluster UserTextToSVG
G = ClusterInput()
objatts = ObjectAttributes(ObjectOrAttributes=G)  # -> Name, LayerName, LayerFullPath, Color, MaterialName, LinetypeName, GroupIndices, PlotWeight
getua = GetUserAttributes(Geometry=G)  # -> Keys, Values
graft = GraftTree(Tree=getua.Values, IncludeEmptyLists=True, IncludeNullItems=True)
graft_2 = GraftTree(Tree=getua.Keys, IncludeEmptyLists=True, IncludeNullItems=True)
rep = ReplaceText(Text=objatts.LayerFullPath, Find=" ", RecursiveReplace=False)
expression = Expression(x=graft_2, y=graft, Expression="Format(\"{0}=`{1}`\", x, y)")

# ---- group: ID
id = Guid(G)
txt = Text(id)
graft_3 = GraftTree(Tree=txt, IncludeEmptyLists=True, IncludeNullItems=True)  # -> simplify(Tree)
expression_2 = Expression(x=txt, Expression="Format(\"id=`{0}`\", x)")
null = NullItem(Item=graft_3)  # -> NullFlags, InvalidFlags, Description
graft_4 = GraftTree(Tree=expression_2, IncludeEmptyLists=True, IncludeNullItems=True)  # -> simplify(Tree)
dispatch = Dispatch(List=graft_4, DispatchPattern=null.NullFlags)  # -> ListA, ListB

# ---- group: Name
data = Data("")
txt_2 = Text(objatts.Name)
graft_5 = GraftTree(Tree=txt_2, IncludeEmptyLists=True, IncludeNullItems=True)  # -> simplify(Tree)
expression_3 = Expression(x=txt_2, Expression="Format(\"name=`{0}`\", x)")
expression_4 = Expression(x=graft_5, y=data, Expression="x=y")
graft_6 = GraftTree(Tree=expression_3, IncludeEmptyLists=True, IncludeNullItems=True)  # -> simplify(Tree)
dispatch_2 = Dispatch(List=graft_6, DispatchPattern=expression_4)  # -> ListA, ListB

# ---- group: Layer
data_2 = Data("")
txt_3 = Text(rep)
graft_7 = GraftTree(Tree=txt_3, IncludeEmptyLists=True, IncludeNullItems=True)  # -> simplify(Tree)
expression_5 = Expression(x=txt_3, Expression="Format(\"layer=`{0}`\", x)")
expression_6 = Expression(x=graft_7, y=data_2, Expression="x=y")
graft_8 = GraftTree(Tree=expression_5, IncludeEmptyLists=True, IncludeNullItems=True)  # -> simplify(Tree)
dispatch_3 = Dispatch(List=graft_8, DispatchPattern=expression_6)  # -> ListA, ListB

# ---- group: Colour
data_3 = Data("")
txt_4 = Text(objatts.Color)
graft_9 = GraftTree(Tree=txt_4, IncludeEmptyLists=True, IncludeNullItems=True)  # -> simplify(Tree)
expression_7 = Expression(x=txt_4, Expression="Format(\"colour=`{0}`\", x)")
expression_8 = Expression(x=graft_9, y=data_3, Expression="x=y")
graft_10 = GraftTree(Tree=expression_7, IncludeEmptyLists=True, IncludeNullItems=True)  # -> simplify(Tree)
dispatch_4 = Dispatch(List=graft_10, DispatchPattern=expression_8)  # -> ListA, ListB

# ----
null_2 = NullItem(Item=graft)  # -> NullFlags, InvalidFlags, Description
dispatch_5 = Dispatch(List=expression, DispatchPattern=null_2.NullFlags)  # -> ListA, ListB
trim = TrimTree(Tree=dispatch_5.ListB, Depth=1)  # -> simplify(Tree)
merge = Merge(Data1=dispatch.ListB, Data2=dispatch_3.ListB, Data3=dispatch_2.ListB, Data4=dispatch_4.ListB, Data5=trim)
join = TextJoin(Text=merge, Join=" ")  # -> simplify(Result)
rep_2 = ReplaceText(Text=join, Find="@", Replace="at", RecursiveReplace=False)
rep_3 = ReplaceText(Text=rep_2, Find="`", Replace="\"", RecursiveReplace=False)  # -> simplify(Result)
data_4 = Data(rep_3)
flatten = FlattenTree(Tree=data_4, Path="{0}")
unflatten = UnflattenTree(Tree=flatten, Guide=G)
attr_string = Data(unflatten)
attr_list = Data(merge)
attr_string_2 = ClusterOutput(attr_string)
attr_list_2 = ClusterOutput(attr_list)

# ==== cluster SVGTextObject
text = ClusterInput()  # "-----------------------"
element = ClusterInput()
class = ClusterInput()
R = ClusterInput()
txt = ClusterInput()
P = ClusterInput()
T = ClusterInput()
element_2 = Text(element)
class_2 = Text(class)
text_2 = Text(text)  # "-----------------------"
null = NullItem(Item=element_2)  # -> NullFlags, InvalidFlags, Description
null_2 = NullItem(Item=class_2)  # -> NullFlags, InvalidFlags, Description
laysplit_new = LAYSPLITNEW(T=T)  # -> pl_2, data_3, data_4
and = GateAnd(A=null.NullFlags, B=null_2.NullFlags)
plcoord = PlaneCoordinates(Point=simplify(P), System=simplify(laysplit_new.pl_2))  # -> XCoordinate, YCoordinate, ZCoordinate
bool = Boolean(invert(and))
expression = Expression(x=plcoord.YCoordinate, Expression="abs(x)")
expression_2 = Expression(x=plcoord.XCoordinate, y=laysplit_new.data_4, Expression="x/y")
expression_3 = Expression(x=expression, y=laysplit_new.data_4, Expression="x/y")
rep = ReplaceText(Text="<* + ~>`</*>", Find="*", Replace=element_2, RecursiveReplace=False)
expression_4 = Expression(x=expression_2, y=expression_3, Expression="Format(\"x=~{0}~ y=~{1}~\", x, y)")
filter = StreamFilter(Gate=bool, Stream0="<text + ~>`</text>", Stream1=rep)
rep_2 = ReplaceText(Text=filter, Find="+", Replace=R, RecursiveReplace=False)
rep_3 = ReplaceText(Text=expression_4, Find="~", Replace="\"", RecursiveReplace=False)
txt_2 = Text("~")
rep_4 = ReplaceText(Text=rep_2, Find=txt_2, Replace=rep_3, RecursiveReplace=False)  # -> simplify(Result)
txt_3 = Text(txt)
rep_5 = ReplaceText(Text=rep_4, Find="`", Replace=txt_3, RecursiveReplace=False)  # -> simplify(Result)
R_2 = ClusterOutput(rep_5)
txt_4 = ClusterOutput(txt_3)

# ==== cluster SVGCompiler
data = ClusterInput()
T = ClusterInput()
panel = Panel("""<?xml version="1.0" encoding="utf-8"?>
<!-- Generator: Adobe Illustrator 16.0.0, SVG Export Plug-In . SVG Version: 6.00 Build 0)  -->
<!DOCTYPE svg PUBLIC "-//W3C//DTD SVG 1.1//EN" "http://www.w3.org/Graphics/SVG/1.1/DTD/svg11.dtd">
<svg version="1.1" xmlns="http://www.w3.org/2000/svg" xmlns:xlink="http://www.w3.org/1999/xlink" x="0px" y="0px"
width="100%" height="100%" viewBox="0 0 420 297"
xml:space="preserve">
<style type="text/css">""")
css = ClusterInput()
laysplit_new = LAYSPLITNEW(T=T)  # -> pl_2, data_3, data_4
css_2 = Data(css)
data_2 = Data(data)
dispatch = Dispatch(List=laysplit_new.data_3, DispatchPattern=[True, False])  # -> ListA, ListB
rep = ReplaceText(Text="width=\"`mm\" height=\"~mm\" viewBox=\"0 0 ` ~\"", Find="`", Replace=dispatch.ListA, RecursiveReplace=False)
tstat = TreeStatistics(Tree=flatten(data_2))  # -> Paths, Length, Count
rep_2 = ReplaceText(Text=rep, Find="~", Replace=dispatch.ListB, RecursiveReplace=False)  # -> simplify(Result)
viewer = ParamViewer("</svg>")
int = Integer(tstat.Count)
merge = Merge(Data1=panel, Data2=css_2, Data3="</style>")
repeat = RepeatData(Data=viewer, Length=int)
branch = TreeBranch(Tree="</svg>", Path=repeat, MaintainPaths=False)
tmatch = MatchText(Text=merge, RegEx="viewBox", Case=True)
mindex = MemberIndex(Set=tmatch, Member=Toggle(True))  # -> Index, Count
replace = ReplaceItems(List=merge, Item=rep_2, Indices=mindex.Index, Wrap=False)  # -> simplify(List)
merge_2 = Merge(Data1=flatten(replace), Data2=flatten(data_2), Data3=flatten(branch))
svg_text = Text(merge_2)
rep_3 = ReplaceText(Text=svg_text, Find=" =\"\" ", Replace=" ", RecursiveReplace=False)
join = TextJoin(Text=rep_3)
svg_content = Text(join)
svg_content_2 = ClusterOutput(svg_content)

# ==== cluster SVGPlaneByPage_2
M = ClusterInput()
panel = Panel("""A4 (L),297,210
A4 (P),210,297
A3 (L),420,297
A3 (P),297,420
A1 (L),841,594
A1 (P),594,841""")
split = TextSplit(Text=panel, Separators=",")
item = ListItem(List=split, Index=0, Wrap=True)  # -> flatten(Item), flatten(Item1), flatten(Item2)
num = ClusterInput()
num_2 = ClusterInput()
mindex = MemberIndex(Set=item.Item, Member=simplify(M))  # -> simplify(flatten(Index)), Count
plane = ClusterInput()
item_2 = ListItem(List=panel, Index=mindex.Index, Wrap=True)  # -> simplify(Item)
T = ClusterInput()
merge = Merge(Data1=simplify(item_2), Data2=simplify(M))
split_2 = TextSplit(Text=T, Separators=":")
item_3 = ListItem(List=merge, Index=0, Wrap=True)
item_4 = ListItem(List=split_2, Index=0, Wrap=True)  # -> Item, Item1
unit_checker = PythonScript()  # -> out, a; same code as unit_checker
split_3 = TextSplit(Text=item_3, Separators=",")
division = Division(A=item_4.Item1, B=unit_checker.out)
item_5 = ListItem(List=reverse(split_3), Index=[0, 1], Wrap=True)  # -> reverse(Item)
num_3 = Number(division)
num_4 = Number([num_2, num])
expression = Expression(x=num_4, y=num_3, Expression="x*y")
plane_2 = Data(plane)
plane_3 = Plane(flatten(plane_2))
dispatch = Dispatch(List=expression, DispatchPattern=[True, False])  # -> ListA, ListB
deplane = DeconstructPlane(Plane=plane_3)  # -> simplify(Origin), simplify(XAxis), simplify(YAxis), ZAxis
x_dim = Domain(dispatch.ListB)
y_dim = Domain(dispatch.ListA)
dims = Number(flatten(num_4))
pt = Point(deplane.Origin)
pt_2 = Point(deplane.XAxis)
pt_3 = Point(deplane.YAxis)
neg = Negative(Value=x_dim)
merge_2 = Merge(Data1=simplify(pt), Data2=simplify(pt_2), Data3=simplify(pt_3))  # -> simplify(Result)
rectangle = Rectangle(Plane=plane_2, XSize=y_dim, YSize=neg, Radius=0)  # -> Rectangle, Length
scale = Number(flatten(num_3))
pt2num = PointsToNumbers(Points=merge_2, Mask=4)  # -> simplify(Numbers)
path_mapper = PathMapper(scale, source="{0}", target="{0;2}")
path_mapper_2 = PathMapper(dims, source="{0}", target="{0;1}")
path_mapper_3 = PathMapper(plane_3, source="{0}", target="{0;0}")
join = TextJoin(Text=pt2num, Join=",")  # -> simplify(Result)
join_2 = TextJoin(Text=dims, Join=",")  # -> simplify(Result)
merge_3 = Merge(Data1=path_mapper_3, Data2=path_mapper_2, Data3=path_mapper)  # -> simplify(Result)
rep = ReplaceText(Text="~;", Find="~", Replace=simplify(join_2), RecursiveReplace=False)  # -> simplify(Result)
rep_2 = ReplaceText(Text="~", Find="~", Replace=simplify(scale), RecursiveReplace=False)  # -> simplify(Result)
rep_3 = ReplaceText(Text="~;", Find="~", Replace=simplify(join), RecursiveReplace=False)  # -> simplify(Result)
merge_4 = Merge(Data1=flatten(rep_3), Data2=flatten(rep), Data3=flatten(rep_2))
R = ClusterOutput(rectangle.Rectangle)
join_3 = TextJoin(Text=merge_4)
panel_2 = Panel(join_3)
R_2 = ClusterOutput(join_3)
panel_3 = Panel(merge_3)

# ==== cluster Cluster_3
col = ClusterInput()
col_2 = ClusterInput()
col_3 = ClusterInput()
col_4 = Colour(col)
col_5 = Colour(col_2)
col_6 = Colour(col_3)
argb = SplitARGB(Colour=col_4, IntegerChannels=True)  # -> Alpha, Red, Green, Blue
argb_2 = SplitARGB(Colour=col_5, IntegerChannels=True)  # -> Alpha, Red, Green, Blue
argb_3 = SplitARGB(Colour=col_6, IntegerChannels=True)  # -> Alpha, Red, Green, Blue
pt = ConstructPoint(XCoordinate=argb_3.Red, YCoordinate=argb_3.Green, ZCoordinate=argb_3.Blue)
pt_2 = ConstructPoint(XCoordinate=argb.Red, YCoordinate=argb.Green, ZCoordinate=argb.Blue)
pt_3 = ConstructPoint(XCoordinate=argb_2.Red, YCoordinate=argb_2.Green, ZCoordinate=argb_2.Blue)
ln = Line(StartPoint=pt_3, EndPoint=pt)
divide = DivideCurve(Curve=ln, Count=65025, Kinks=False)  # -> Points, Tangents, Parameters
merge = Merge(Data1=pt_2, Data2=pt_3, Data3=pt)
pdecon = Deconstruct(Point=divide.Points)  # -> XComponent, YComponent, ZComponent
intcrv = Interpolate(Vertices=merge, Degree=3, Periodic=False, KnotStyle=1)  # -> Curve, Length, Domain
int = Integer(pdecon.XComponent)
int_2 = Integer(pdecon.YComponent)
int_3 = Integer(pdecon.ZComponent)
pt_4 = ConstructPoint(XCoordinate=int, YCoordinate=int_2, ZCoordinate=int_3)
cset = CreateSet(List=pt_4)  # -> Set, Map
pdecon_2 = Deconstruct(Point=cset.Set)  # -> XComponent, YComponent, ZComponent
int_4 = Integer(pdecon_2.XComponent)
int_5 = Integer(pdecon_2.YComponent)
int_6 = Integer(pdecon_2.ZComponent)
rep = ReplaceText(Text="style=\"stroke:rgb(█,▄,▌)\" tag=\"Major\"", Find="█", Replace=int_4, RecursiveReplace=False)
crv_cp = CurveClosestPoint(Point=cset.Set, Curve=reparameterize(ln))  # -> Point, Parameter, Distance
rep_2 = ReplaceText(Text=rep, Find="▄", Replace=int_5, RecursiveReplace=False)
crv = ClusterInput()
remap = RemapNumbers(Value=crv_cp.Parameter, Source=Domain(0, 1), Target=Domain(0.01, 1))  # -> Mapped, Clipped
rep_3 = ReplaceText(Text=rep_2, Find="▌", Replace=int_6, RecursiveReplace=False)
crv_2 = Curve(crv)
shatter = Shatter(Curve=reparameterize(crv_2), Parameters=remap.Mapped)  # -> flatten(Segments)
lng = ListLength(List=shatter)
repeat = RepeatData(Data=rep_3, Length=lng)
S = ClusterOutput(shatter)
D = ClusterOutput(repeat)

# ==== cluster LAYSPLITNEW
T = ClusterInput()
split = TextSplit(Text=T, Separators=";")
split_2 = TextSplit(Text=split, Separators=",")
partition = PartitionList(List=split_2, Size=[9, 2, 1])  # -> simplify(Chunks)
branch = TreeBranch(Tree=partition, Path="{0}", MaintainPaths=True)
branch_2 = TreeBranch(Tree=partition, Path="{1}", MaintainPaths=True)
branch_3 = TreeBranch(Tree=partition, Path="{2}", MaintainPaths=True)
item = ListItem(List=branch, Index=0, Wrap=True)  # -> Item, Item1, Item2
item_2 = ListItem(List=branch, Index=3, Wrap=True)  # -> Item, Item1, Item2
item_3 = ListItem(List=branch, Index=6, Wrap=True)  # -> Item, Item1, Item2
pt = ConstructPoint(XCoordinate=item.Item, YCoordinate=item.Item1, ZCoordinate=item.Item2)
vec = VectorXYZ(XComponent=item_2.Item, YComponent=item_2.Item1, ZComponent=item_2.Item2)  # -> Vector, Length
vec_2 = VectorXYZ(XComponent=item_3.Item, YComponent=item_3.Item1, ZComponent=item_3.Item2)  # -> Vector, Length
pl = ConstructPlane(Origin=pt, XAxis=vec.Vector, YAxis=vec_2.Vector)
data = Data(branch_3)
data_2 = Data(branch_2)
data_3 = ClusterOutput(data_2)
data_4 = ClusterOutput(data)
pl_2 = ClusterOutput(pl)

# ==== cluster Cluster_2
data = ClusterInput()
data_2 = Data(data)
trim = TrimTree(Tree=data_2, Depth=1)
null = NullItem(Item=trim)  # -> NullFlags, InvalidFlags, Description
ma = MassAddition(Input=null.NullFlags)  # -> Result, PartialResults
bool = Boolean(invert(ma.Result))
trim_2 = TrimTree(Tree=data_2, Depth=bool)
data_3 = Data(trim_2)
data_4 = ClusterOutput(data_3)

# ==== cluster Duration
L = ClusterInput()
R = ClusterInput()
item = ListItem(List=L, Index=0, Wrap=True)
tmatch = MatchText(Text=item, RegEx=R, Case=True)
tstat = TreeStatistics(Tree=L)  # -> Paths, Length, Count
trim = TrimTree(Tree=tmatch, Depth=1)
dispatch = Dispatch(List=tstat.Paths, DispatchPattern=flatten(tmatch))  # -> ListA, ListB
ma = MassAddition(Input=trim)  # -> Result, PartialResults
equals = Equality(FirstNumber=ma.Result, SecondNumber=0)  # -> flatten(Equality), Inequality
branch = TreeBranch(Tree=L, Path=dispatch.ListA, MaintainPaths=True)  # -> simplify(Branch)
mindex = MemberIndex(Set=equals.Equality, Member=True)  # -> Index, Count
item_2 = ListItem(List=branch, Index=1, Wrap=True)  # -> simplify(flatten(Item))
lng = ListLength(List=mindex.Index)
lng_2 = ListLength(List=mindex.Index)  # -> expr("x-1", Length)
item_3 = ListItem(List=mindex.Index, Index=0, Wrap=True)
cull_i = CullIndex(List=mindex.Index, Indices=0, Wrap=True)
repeat = RepeatData(Data=" ", Length=lng)  # -> flatten(Data)
series = Series(Start=1, Step=1, Count=lng_2)
subtraction = Subtraction(A=cull_i, B=series)
merge = Merge(Data1=flatten(item_3), Data2=flatten(subtraction))
ins = InsertItems(List=item_2, Item=repeat, Indices=merge, Wrap=False)
clean = CleanTree(RemoveNulls=True, RemoveInvalid=True, RemoveEmpty=False, Tree=ins)
T = ClusterOutput(clean)
