# Grasshopper definition Exporters.gh (Grasshopper 0.9.76)
# Copyright: Co-de-iT
# plug-ins: Python Interpreter

# ---- group: JSON VERSION
paper = Panel("A3 (L)")
scale = Panel("1:4000")
toggle = BooleanToggle(False)
xy = XYPlane(Origin=Point(0, 0, 0))

# ----
svg_plane_by_page = SVGPlaneByPage(plane=xy, M=paper, T=scale)  # -> R_2, R

# ---- group: SVG EXPORT NORMAL VERSION
svg_compiler = SVGCompiler(T=svg_plane_by_page.R_2)
panel = Panel("█")
rep = ReplaceText(Text="█.svg", Find=panel, Replace="FILE NAME", RecursiveReplace=False)  # -> flatten(Result)
file_write = FileWrite(content=svg_compiler, file_path="FOLDER LOCATION", T=rep)

# ---- group: HTML EXPORT NORMAL VERSION
html_compiler = HTMLCompiler(layout=svg_plane_by_page.R_2)
rep_2 = ReplaceText(Text="█.html", Find=panel, Replace="FILE NAME", RecursiveReplace=False)  # -> flatten(Result)
file_write_2 = FileWrite(content=html_compiler, file_path="FOLDER LOCATION", T=rep_2)

# ----
data = Data("FOLDER LOCATION")

page_dimension_ratio = Panel("1")
layout_split = LayoutSplit(T=svg_plane_by_page.R_2)  # -> pl_2, data_3, data_4
panel_2 = Panel(layout_split.data_3)
expression = Expression(x=layout_split.data_3, y=page_dimension_ratio, Expression="x*y")
dpi = Panel("150")
expression_2 = Expression(x=expression, Expression="x/25.4")
expression_3 = Expression(x=expression_2, y=dpi, Expression="ceiling(x*y)")
item = ListItem(List=expression_3, Index=0, Wrap=True)  # -> Item, Item1
int = Integer(item.Item1)
int_2 = Integer(item.Item)
txt = Text(int_2)
txt_2 = Text(int)
html_to_jpeg = COX_HTMLToJPEG(folder=data, height=txt_2, width=txt, ACTIVATE=Button())
# ---------- html_to_jpeg: Python ----------
import os 
import time 


svgs = [] 
match = "html" 

paths = os.listdir(folder) 


for path in paths: 
    if match in path: 
        svgs.append(path) 

print svgs 
jpgs = [os.path.splitext(x)[0] + '.png' for x in svgs] 
print jpgs 

svgs = [folder+"\\" + x for x in svgs] 
jpgs = [folder+"\\" + x for x in jpgs] 


for i in range(len(svgs)): 
    HTML = svgs[i] 
    JPG = jpgs[i] 
    cmdString2 = 'X:\\wkhtmltopdf\\bin\\wkhtmltoimage --transparent --height '+height+' --width '+width+'  "file:///' + HTML + '" "' + JPG + '"' 
    print cmdString2
    if ACTIVATE == True: 
        os.system(cmdString2)
# ---------- end html_to_jpeg ----------

# ==== cluster LayoutSplit: Splits the layout into plane, page and scale
T = ClusterInput()
split = TextSplit(Text=T, Separators=";")
split_2 = TextSplit(Text=split, Separators=",")
partition = PartitionList(List=split_2, Size=[9, 2, 1])  # -> simplify(Chunks)
branch = TreeBranch(Tree=partition, Path="{0}", MaintainPaths=True)
branch_2 = TreeBranch(Tree=partition, Path="{1}", MaintainPaths=True)
branch_3 = TreeBranch(Tree=partition, Path="{2}", MaintainPaths=True)
item = ListItem(List=branch, Index=0, Wrap=True)  # -> Item, Item1, Item2
item_2 = ListItem(List=branch, Index=3, Wrap=True)  # -> Item, Item1, Item2
item_3 = ListItem(List=branch, Index=6, Wrap=True)  # -> Item, Item1, Item2
pt = ConstructPoint(XCoordinate=item.Item, YCoordinate=item.Item1, ZCoordinate=item.Item2)
vec = VectorXYZ(XComponent=item_2.Item, YComponent=item_2.Item1, ZComponent=item_2.Item2)  # -> Vector, Length
vec_2 = VectorXYZ(XComponent=item_3.Item, YComponent=item_3.Item1, ZComponent=item_3.Item2)  # -> Vector, Length
pl = ConstructPlane(Origin=pt, XAxis=vec.Vector, YAxis=vec_2.Vector)
data = Data(branch_3)
data_2 = Data(branch_2)
data_3 = ClusterOutput(data_2)
data_4 = ClusterOutput(data)
pl_2 = ClusterOutput(pl)

# ==== cluster SVGCompiler
data = ClusterInput()
T = ClusterInput()
panel = Panel("""<?xml version="1.0" encoding="utf-8"?>
<!-- Generator: Adobe Illustrator 16.0.0, SVG Export Plug-In . SVG Version: 6.00 Build 0)  -->
<!DOCTYPE svg PUBLIC "-//W3C//DTD SVG 1.1//EN" "http://www.w3.org/Graphics/SVG/1.1/DTD/svg11.dtd">
<svg version="1.1" xmlns="http://www.w3.org/2000/svg" xmlns:xlink="http://www.w3.org/1999/xlink" x="0px" y="0px"
width="100%" height="100%" viewBox="0 0 420 297"
xml:space="preserve">
<style type="text/css">""")
css = ClusterInput()
laysplit_new = LayoutSplit(T=T)  # -> pl_2, data_3, data_4
css_2 = Data(css)
data_2 = Data(data)
dispatch = Dispatch(List=laysplit_new.data_3, DispatchPattern=[True, False])  # -> ListA, ListB
rep = ReplaceText(Text="width=\"`mm\" height=\"~mm\" viewBox=\"0 0 ` ~\"", Find="`", Replace=dispatch.ListA, RecursiveReplace=False)
tstat = TreeStatistics(Tree=flatten(data_2))  # -> Paths, Length, Count
rep_2 = ReplaceText(Text=rep, Find="~", Replace=dispatch.ListB, RecursiveReplace=False)  # -> simplify(Result)
viewer = ParamViewer("</svg>")
int = Integer(tstat.Count)
merge = Merge(Data1=panel, Data2=css_2, Data3="</style>")
repeat = RepeatData(Data=viewer, Length=int)
branch = TreeBranch(Tree="</svg>", Path=repeat, MaintainPaths=False)
tmatch = MatchText(Text=merge, RegEx="viewBox", Case=True)
mindex = MemberIndex(Set=tmatch, Member=Toggle(True))  # -> Index, Count
replace = ReplaceItems(List=merge, Item=rep_2, Indices=mindex.Index, Wrap=False)  # -> simplify(List)
merge_2 = Merge(Data1=flatten(replace), Data2=flatten(data_2), Data3=flatten(branch))
svg_text = Text(merge_2)
rep_3 = ReplaceText(Text=svg_text, Find=" =\"\" ", Replace=" ", RecursiveReplace=False)
join = TextJoin(Text=rep_3)
svg_content = Text(join)
svg_content_2 = ClusterOutput(svg_content)

# ==== cluster FileWrite
content = ClusterInput()
file_path = ClusterInput()
activate = ClusterInput()
T = ClusterInput()
content_2 = Data(content)
file_path_2 = Text(file_path)
join = TextJoin(Text=[file_path_2, T], Join="\")
vb = VBScript(path=simplify(join), lines=simplify(content_2), activate=activate)  # -> out, A
# ---------- vb: VB ----------
    If (activate = True)
      
      system.IO.File.WriteAllText(path, lines)
      A = "File written"
    Else
      A = "Not activated"
    End If
# ---------- end vb ----------

# ==== cluster HTMLCompiler
data = Data("█")
panel = Panel("""<html>
<body>
<head>
</head>
<body>
<svg version="1.1" xmlns="http://www.w3.org/2000/svg" xmlns:xlink="http://www.w3.org/1999/xlink" x="0px" y="0px"
width="100%" height="100%" viewBox="0 0 420 297"
xml:space="preserve">
<style type="text/css">""")
svg_text = ClusterInput()
layout = ClusterInput()
css = ClusterInput()
layout_split = LayoutSplit(T=layout)  # -> pl_2, data_3, data_4
svg_text_2 = Data(svg_text)
rep = ReplaceText(Text=svg_text_2, Find="zindex=\"", Replace=data, RecursiveReplace=False)
split = TextSplit(Text=rep, Separators=data)
item = ListItem(List=reverse(split), Index=0, Wrap=True)
split_2 = TextSplit(Text=item, Separators="\"")
css_2 = Data(css)
item_2 = ListItem(List=split_2, Index=0, Wrap=True)
flatten = FlattenTree(Tree=item_2, Path="{0}")
num = Number(flatten)
nullrep = ReplaceNulls(Items=num, Replacements=0)  # -> Items, Count
dispatch = Dispatch(List=layout_split.data_3, DispatchPattern=[True, False])  # -> ListA, ListB
rep_2 = ReplaceText(Text="width=\"100%\" height=\"100%\" viewBox=\"0 0 ` ~\"", Find="`", Replace=dispatch.ListA, RecursiveReplace=False)
sort = SortList(Keys=nullrep.Items, ValuesA=svg_text_2)  # -> Keys, ValuesA
tstat = TreeStatistics(Tree=flatten(sort.ValuesA))  # -> Paths, Length, Count
panel_2 = Panel(nullrep.Items)
rep_3 = ReplaceText(Text=rep_2, Find="~", Replace=dispatch.ListB, RecursiveReplace=False)  # -> simplify(Result)
panel_3 = Panel(rep_3)
viewer = ParamViewer("</svg>")
int = Integer(tstat.Count)
merge = Merge(Data2=panel, Data3=css_2, Data4="</style>")
repeat = RepeatData(Data=viewer, Length=int)
panel_4 = Panel("""</body>
</html>""")
branch = TreeBranch(Tree="</svg>", Path=repeat, MaintainPaths=False)
tmatch = MatchText(Text=merge, RegEx="viewBox", Case=True)
mindex = MemberIndex(Set=tmatch, Member=Toggle(True))  # -> Index, Count
replace = ReplaceItems(List=merge, Item=rep_3, Indices=mindex.Index, Wrap=False)  # -> simplify(List)
merge_2 = Merge(Data1=flatten(replace), Data2=flatten(sort.ValuesA), Data3=flatten(branch), Data4=flatten(panel_4))
svg_text_3 = Text(merge_2)
rep_4 = ReplaceText(Text=svg_text_3, Find=" =\"\" ", Replace=" ", RecursiveReplace=False)
join = TextJoin(Text=rep_4)
html_content = Text(join)
html_content_2 = ClusterOutput(html_content)

# ==== cluster SVGPlaneByPage
M = ClusterInput()
panel = Panel("""A4 (L),297,210
A4 (P),210,297
A3 (L),420,297
A3 (P),297,420
A1 (L),841,594
A1 (P),594,841""")
split = TextSplit(Text=panel, Separators=",")
item = ListItem(List=split, Index=0, Wrap=True)  # -> flatten(Item), flatten(Item1), flatten(Item2)
mindex = MemberIndex(Set=item.Item, Member=simplify(M))  # -> simplify(flatten(Index)), Count
plane = ClusterInput()
item_2 = ListItem(List=panel, Index=mindex.Index, Wrap=True)  # -> simplify(Item)
T = ClusterInput()
merge = Merge(Data1=simplify(item_2), Data2=simplify(M))
split_2 = TextSplit(Text=T, Separators=":")
item_3 = ListItem(List=merge, Index=0, Wrap=True)
item_4 = ListItem(List=split_2, Index=0, Wrap=True)  # -> Item, Item1
unit_checker = PythonScript()  # -> out, a
# ---------- unit_checker: Python ----------
import rhinoscriptsyntax as rs
import scriptcontext as sc

a=sc.doc.ModelUnitSystem
a = str(a)
if a == "Millimeters":
    print 1
elif a == "Meters":
    print 1000
else:
    print "Use the metric system fool"
# ---------- end unit_checker ----------
split_3 = TextSplit(Text=item_3, Separators=",")
division = Division(A=item_4.Item1, B=unit_checker.out)
item_5 = ListItem(List=reverse(split_3), Index=[0, 1], Wrap=True)  # -> reverse(Item)
num = Number(division)
num_2 = Number(item_5)
expression = Expression(x=num_2, y=num, Expression="x*y")
plane_2 = Data(plane)
plane_3 = Plane(flatten(plane_2))
dispatch = Dispatch(List=expression, DispatchPattern=[True, False])  # -> ListA, ListB
deplane = DeconstructPlane(Plane=plane_3)  # -> simplify(Origin), simplify(XAxis), simplify(YAxis), ZAxis
x_dim = Domain(dispatch.ListB)
y_dim = Domain(dispatch.ListA)
dims = Number(flatten(num_2))
pt = Point(deplane.Origin)
pt_2 = Point(deplane.XAxis)
pt_3 = Point(deplane.YAxis)
neg = Negative(Value=x_dim)
merge_2 = Merge(Data1=simplify(pt), Data2=simplify(pt_2), Data3=simplify(pt_3))  # -> simplify(Result)
rectangle = Rectangle(Plane=plane_2, XSize=y_dim, YSize=neg, Radius=0)  # -> Rectangle, Length
scale = Number(flatten(num))
pt2num = PointsToNumbers(Points=merge_2, Mask=4)  # -> simplify(Numbers)
path_mapper = PathMapper(scale, source="{0}", target="{0;2}")
path_mapper_2 = PathMapper(dims, source="{0}", target="{0;1}")
path_mapper_3 = PathMapper(plane_3, source="{0}", target="{0;0}")
join = TextJoin(Text=pt2num, Join=",")  # -> simplify(Result)
join_2 = TextJoin(Text=dims, Join=",")  # -> simplify(Result)
merge_3 = Merge(Data1=path_mapper_3, Data2=path_mapper_2, Data3=path_mapper)  # -> simplify(Result)
rep = ReplaceText(Text="~;", Find="~", Replace=simplify(join_2), RecursiveReplace=False)  # -> simplify(Result)
rep_2 = ReplaceText(Text="~", Find="~", Replace=simplify(scale), RecursiveReplace=False)  # -> simplify(Result)
rep_3 = ReplaceText(Text="~;", Find="~", Replace=simplify(join), RecursiveReplace=False)  # -> simplify(Result)
merge_4 = Merge(Data1=flatten(rep_3), Data2=flatten(rep), Data3=flatten(rep_2))
R = ClusterOutput(rectangle.Rectangle)
join_3 = TextJoin(Text=merge_4)
panel_2 = Panel(join_3)
R_2 = ClusterOutput(join_3)
panel_3 = Panel(merge_3)
