# Grasshopper definition 01 Road Offsets (training file).gh (Grasshopper 0.9.76)
# plug-ins: ClipperComponents, Human, EleFront

# ----
# PARENT LAYER FOR ALL CENTRELINES
# M A I N   R E F    L A Y E R
# CENTRELINE SUBLAYERS
panel = Panel("01 Road Centrelines")
concat = Concatenate(FragmentA=panel, FragmentC="::")

# ----
# S T E P  1
# R E F E R E N C I N G
# U N I T S
mm_true = BooleanToggle(False)

layer_name = Panel("01 Expressway")
layer_name_2 = Panel("02 Major")
layer_name_3 = Panel("03 Minor")
layer_name_4 = Panel("04 Local")
concat_2 = Concatenate(FragmentA=concat, FragmentB=layer_name)
concat_3 = Concatenate(FragmentA=concat, FragmentB=layer_name_2)
concat_4 = Concatenate(FragmentA=concat, FragmentB=layer_name_3)
concat_5 = Concatenate(FragmentA=concat, FragmentB=layer_name_4)

# ----
# S T E P  2
# R O A D    S E C T I O N
# NOTE!: CANNOT BE 0 OR DELETED, NEEDS TO BE 0.01
offset_order = Panel("""Total Carriageway
Green Buffer
Footpath""")
# OFFSETS FOR
# EACH ROAD TYPE
width = Panel("""24
2
0.01""")
width_2 = Panel("""12
2
2.1""")
width_3 = Panel("""7
2.15
1.5""")
width_4 = Panel("""5
2.15
1.5""")

# ---- group: ALL DISTANCES
merge = Merge(Data1=graft(width), Data2=graft(width_2), Data3=graft(width_3), Data4=graft(width_4))  # -> simplify(Result)

# ----
cluster = Cluster_2(layer=concat_2, m_mm=mm_true, offsets=width)  # -> total_width_2, _0_2, _1_2, _2_2, _3_2, _4_2, _5_2
cluster_2 = Cluster_2(layer=concat_3, m_mm=mm_true, offsets=width_2)  # -> total_width_2, _0_2, _1_2, _2_2, _3_2, _4_2, _5_2
cluster_3 = Cluster_2(layer=concat_4, m_mm=mm_true, offsets=width_3)  # -> total_width_2, _0_2, _1_2, _2_2, _3_2, _4_2, _5_2
cluster_4 = Cluster_2(layer=concat_5, m_mm=mm_true, offsets=width_4)  # -> total_width_2, _0_2, _1_2, _2_2, _3_2, _4_2, _5_2

# ----
# 2
merge_2 = Merge(Data1=cluster._2_2, Data2=cluster_2._2_2, Data3=cluster_3._2_2, Data4=cluster_4._2_2)  # -> simplify(Result)

# ----
# 0
merge_3 = Merge(Data1=cluster._0_2, Data2=cluster_2._0_2, Data3=cluster_3._0_2, Data4=cluster_4._0_2)  # -> simplify(Result)

# ----
# 1
merge_4 = Merge(Data1=cluster._1_2, Data2=cluster_2._1_2, Data3=cluster_3._1_2, Data4=cluster_4._1_2)  # -> simplify(Result)

# ---- group: TYPE 0 SETTINGS
fillet_radius = Slider(10, range=0..10)
# S T E P  3
# S T Y L E
branch = TreeBranch(Tree=merge, Path="0", MaintainPaths=True)
division = Division(A=branch, B=2)
cluster_5 = Cluster_3(distances=division, G=merge_3, m_mm=mm_true, fillet_f_chamfer_t=Toggle(False), radius=fillet_radius)  # -> clean_curve_2, curve_3
# CHANGE RADIUS +
#  FILLET/CHAMFER
data = Data(flatten(cluster_5.curve_3))

# ---- group: TYPE 1 SETTINGS
fillet_radius_2 = Slider(8, range=0..10)
branch_2 = TreeBranch(Tree=merge, Path="1", MaintainPaths=True)
cluster_6 = Cluster_3(distances=branch_2, G=merge_4, m_mm=mm_true, fillet_f_chamfer_t=Toggle(False), radius=fillet_radius_2)  # -> clean_curve_2, curve_3
data_2 = Data(flatten(cluster_6.curve_3))

# ---- group: TYPE 2 SETTINGS
fillet_radius_3 = Slider(6, range=0..10)
branch_3 = TreeBranch(Tree=merge, Path="2", MaintainPaths=True)
cluster_7 = Cluster_3(distances=branch_3, G=merge_2, m_mm=mm_true, fillet_f_chamfer_t=Toggle(False), radius=fillet_radius_3)  # -> clean_curve_2, curve_3
data_3 = Data(flatten(cluster_7.curve_3))

# ----
# NOTE!: HALF OF THE GREEN AREA WIDTH TO CREATE A CENTRE LINE FOR TREES
division_2 = Division(A=branch_2, B=2)  # -> simplify(graft(Result))

# ----
# S T E P  4
# T R E E S
# TREES
# NOTE!: THIS NEEDS TO BE THE TYPE ON THE INNER SIDE OF THE GREEN AREA
ungroup = Ungroup(Group=merge_3)  # -> simplify(Objects)

# ----
# T R E E   L I N E
polyoffset = PolylineOffsetSETTINGS(
    Polylines=ungroup,
    Distance=division_2,
    Plane=Plane(origin=(0, 0, 0), x=(0, 0, 0), y=(0, 0, 0)),
    Tolerance=0.001,
    ClosedFillet=2,
    OpenFillet=2,
    Miter=0)  # -> Contour, Holes
crv = Curve(polyoffset.Contour)
cluster_8 = Cluster_4(G=crv, m_mm=mm_true, fillet_f_chamfer_t=Toggle(False), radius=Slider(2, range=0..10))  # -> clean_curve_2, curve_3
data_4 = Data(cluster_8.clean_curve_2)
ungroup_2 = Ungroup(Group=data_4)  # -> simplify(Objects)

# ---- group: PATH OFFSETS
# S T E P  5
# P A T H S
layer_name_5 = Panel("Paths")
width_5 = Panel("1.5")
concat_6 = Concatenate(FragmentA=concat, FragmentB=layer_name_5)

# ---- group: tree size
# T R E E   R A D I U S
r_a_d_i_u_s = Slider(6, range=0..10)

# T R E E   R A D I U S
r_a_d_i_u_s_2 = Slider(4, range=0..10)

# ----
cluster_9 = Cluster_2(layer=concat_6, m_mm=mm_true, offsets=width_5)  # -> total_width_2, _0_2, _1_2, _2_2, _3_2, _4_2, _5_2

# ---- group: ORIGIN
pt = Point(Point(0, 0, 0))

pt_2 = Point(Point(0, 0, 0))

# ----
# B A S E    T R E E   2
circle = CircleCNR(Center=pt, Normal=Vector(0, 0, 1), Radius=r_a_d_i_u_s)

# ----
# B A S E    T R E E  1
circle_2 = CircleCNR(Center=pt_2, Normal=Vector(0, 0, 1), Radius=r_a_d_i_u_s_2)

# ----
# T R E E   S P A C I N G
s_p_a_c_i_n_g = Slider(15, range=0..100)
divdist = DivideDistance(Curve=ungroup_2, Distance=s_p_a_c_i_n_g)  # -> simplify(Points), Tangents, Parameters

# ---- group: PEDESTRIAN SETTINGS
cluster_10 = Cluster_3(G=cluster_9._0_2, m_mm=mm_true, fillet_f_chamfer_t=Toggle(False), radius=Slider(2, range=0..10))  # -> clean_curve_2, curve_3
data_5 = Data(cluster_10.curve_3)

# ---- group: CREATE BASE BLOCK AT ORIGIN
merge_5 = Merge(Data1=pt, Data2=circle)
block = CreateBlock(Geometry=merge_5, BlockName="Tree", BasePlane=pt)

merge_6 = Merge(Data1=pt_2, Data2=circle_2)
block_2 = CreateBlock(Geometry=merge_6, BlockName="Tree", BasePlane=pt_2)

# ---- group: ALL ROADS JOINED
# C O M B I N E D
merge_7 = Merge(Data2=data, Data3=data_2, Data4=data_3)  # -> simplify(graft(Result))
panel_2 = Panel(merge_7)
ungroup_3 = Ungroup(Group=merge_7)  # -> simplify(Objects)

# ---- group: MOVE TO POINTS
# ONLY 1 SIZE
orient = Orient(Geometry=block_2, Source=pt_2, Target=divdist.Points)  # -> Geometry, Transform

# ----
# S T E P  6
# B A K E
panel_3 = Panel("Bake::")

# ---- group: FINAL TREES
# NOTE!: CONNECT "BOTH TREES" INTO THE FINAL TREES IF USING THE 2 SIZE METHOD
data_6 = Data(orient.Geometry)

# ---- group: LAYER COLOUR
# OBJECT COLOURS
swatch = ColourSwatch(SwatchColor=RGB(23, 161, 8))  # disabled
merge_8 = Merge(
    Data1=ColourSwatch(SwatchColor=RGB(0, 0, 0)),
    Data2=ColourSwatch(SwatchColor=RGB(8, 95, 161)),
    Data3=ColourSwatch(SwatchColor=RGB(117, 8, 161)),
    Data4=swatch)  # -> simplify(graft(Result))

# ----
# B A K E - T R E E S
panel_4 = Panel("Trees::")
concat_7 = Concatenate(FragmentA=panel_3, FragmentB=panel_4)
attributes = ObjectAttributes(Layer=concat_7, Color=ColourSwatch(SwatchColor=RGB(23, 161, 8)))

# ----
# B A K E - P A T H S
panel_5 = Panel("Paths::")
concat_8 = Concatenate(FragmentA=panel_3, FragmentB=panel_5)
attributes_2 = ObjectAttributes(Layer=concat_8, Color=ColourSwatch(SwatchColor=RGB(161, 8, 8)))

# ---- group: BAKE - TREES
# BAKE TREES
bake = BakeObjects(Geometry=data_6, Attributes=attributes, Bake=False)

# ---- group: BAKE - PATHS
# BAKE PATHS
bake_2 = BakeObjects(Geometry=data_5, Attributes=attributes_2, Bake=False)

# ---- group: PREVIEW
# P R E V I E W
number_slider = Slider(1, range=0..1)
move = Move(Geometry=data_5, Motion=Vector(0, 0, 3))  # -> Geometry, Transform
move_2 = Move(Geometry=data, Motion=Vector(0, 0, 5))  # -> Geometry, Transform
move_3 = Move(Geometry=data_2, Motion=Vector(0, 0, 4))  # -> Geometry, Transform
move_4 = Move(Geometry=data_3, Motion=Vector(0, 0, 3))  # -> Geometry, Transform
move_5 = Move(Geometry=data_6, Motion=Vector(0, 0, 3))  # -> Geometry, Transform
previewlw = CustomPreviewLineweights(Geometry=move_5.Geometry, Shader=ColourSwatch(SwatchColor=RGB(23, 161, 8)), Thickness=number_slider, Absolute=False)
# PREVIEW
previewlw_2 = CustomPreviewLineweights(Geometry=move_2.Geometry, Shader=ColourSwatch(SwatchColor=RGB(0, 0, 0)), Thickness=number_slider, Absolute=False)
previewlw_3 = CustomPreviewLineweights(Geometry=move_3.Geometry, Shader=ColourSwatch(SwatchColor=RGB(8, 95, 161)), Thickness=number_slider, Absolute=False)
previewlw_4 = CustomPreviewLineweights(Geometry=move_4.Geometry, Shader=ColourSwatch(SwatchColor=RGB(117, 8, 161)), Thickness=number_slider, Absolute=False)
previewlw_5 = CustomPreviewLineweights(Geometry=move.Geometry, Shader=ColourSwatch(SwatchColor=RGB(161, 8, 8)), Thickness=number_slider, Absolute=False)

# ----
number_slider_2 = Slider(1000, range=0..1000)
dpipeline = DynamicGeometryPipeline(
    LayerFilter="ADJUSTED::JF SKETCH 2::TRACE",
    TypeFilter="Curve",
    NameFilter="*",
    enableFullPath=True,
    GroupByLayer=False,
    GroupByType=False,
    IncludeHidden=True,
    IncludeLocked=True,
    listenToAttriubtes=True)
division_3 = Division(A=Slider(11000, range=0..100000), B=number_slider_2)
offset = Offset(Curve=dpipeline, Distance=division_3, Plane=PlaneXY(0, 0, 0), Corners=1)
simplify = SimplifyCurve(Curve=offset)  # -> Curve, Simplified
explode = Explode(Curve=simplify.Curve, Recursive=True)  # -> graft(Segments), Vertices
len = Length(Curve=explode.Segments)
division_4 = Division(A=Slider(40000, range=0..100000), B=number_slider_2)
division_5 = Division(A=Slider(22000, range=0..100000), B=number_slider_2)
division_6 = Division(A=Slider(2000, range=0..100000), B=number_slider_2)
expression = Expression(x=len, Expression="floor(x/45)")
int = Integer(1)
dom = ConstructDomain(DomainStart=expr("-x/2", division_6), DomainEnd=expr("x/2", division_6))
dom_2 = ConstructDomain(DomainStart=expr("-x/2", division_5), DomainEnd=expr("x/2", division_5))
dom_3 = ConstructDomain(DomainStart=expr("-x/2", division_4), DomainEnd=expr("x/2", division_4))
max = Maximum(A=expression, B=int)
rectangle = Rectangle(Plane=PlaneXY(0, 0, 0), XSize=Domain(-1, 1), YSize=dom, Radius=0)  # -> Rectangle, Length
rectangle_2 = Rectangle(Plane=PlaneXY(0, 0, 0), XSize=dom_3, YSize=dom_2, Radius=0)  # -> Rectangle, Length
graft = GraftTree(Tree=explode.Segments, IncludeEmptyLists=True, IncludeNullItems=True)
range = Range(Domain=Domain(0, 1), Steps=max)
shatter = Shatter(Curve=reparameterize(graft), Parameters=range)
area = Area(Geometry=rectangle_2.Rectangle)  # -> Area, Centroid
area_2 = Area(Geometry=rectangle.Rectangle)  # -> Area, Centroid
boundary = BoundarySurfaces(Edges=rectangle_2.Rectangle)
hframe = HorizontalFrame(Curve=reparameterize(shatter), Parameter=0.5)
xy = XYPlane(Origin=area.Centroid)
expression_2 = Expression(x=area.Area, y=area_2.Area, Expression="x/(y+x)")
panel_6 = Panel(expression_2)
orient_2 = Orient(Geometry=boundary, Source=xy, Target=hframe)  # -> Geometry, Transform
lng = ListLength(List=orient_2.Geometry)
num = Number("5.77777777777778")
expression_3 = Expression(x="13", Expression="x*3000")
expression_4 = Expression(x=num, y=lng, z="13", Expression="x*y*z")
Z = UnitZ(Factor=expression_3)
ma = MassAddition(Input=flatten(expression_4))  # -> Result, PartialResults
panel_7 = Panel(ma.Result)

# ----
# 2 SIZED TREES
panel_8 = Panel("""True
False""")
dispatch = Dispatch(List=divdist.Points, DispatchPattern=panel_8)  # -> PointsForTree1, PointsForTree2

# ---- group: MOVE TO POINTS
orient_3 = Orient(Geometry=block, Source=pt, Target=dispatch.PointsForTree2)  # -> Geometry, Transform

orient_4 = Orient(Geometry=block_2, Source=pt_2, Target=dispatch.PointsForTree1)  # -> Geometry, Transform

# ----
merge_9 = Merge(Data1=orient_3.Geometry, Data2=orient_4.Geometry)

# ---- group: BAKE LAYER NAME
panel_9 = Panel("Roads::")
item = ListItem(List=offset_order, Index=0, Wrap=False)  # -> Item, Item1, Item2, Item3, Item4, Item5

# ----
concat_9 = Concatenate(FragmentA=panel_3, FragmentB=panel_9)

# ---- group: BAKE LAYER NAME (continued)
concat_10 = Concatenate(FragmentA=concat_9, FragmentB=item.Item)
concat_11 = Concatenate(FragmentA=concat_9, FragmentB=item.Item1)
concat_12 = Concatenate(FragmentA=concat_9, FragmentB=item.Item2)
# BAKE LAYERS
merge_10 = Merge(Data1=concat_10, Data2=concat_11, Data3=concat_12)  # -> simplify(graft(Result))

# ----
# B A K E - R O A D S
panel_10 = Panel(merge_10)
attributes_3 = ObjectAttributes(Layer=panel_10, Color=merge_8)

panel_11 = Panel(attributes_3)

# ---- group: BAKE - ROADS
# BAKE ROADS
# Dont forget to bake the trees (above) and the paths (below)!
bake_3 = BakeObjects(Geometry=ungroup_3, Attributes=panel_11, Bake=False)

# ==== cluster Cluster_2
layer = ClusterInput()
offsets = ClusterInput()
turning_diameter = Data()
layer_2 = Data(layer)
dpipeline = DynamicGeometryPipeline(
    LayerFilter=layer_2,
    TypeFilter="curve",
    NameFilter="*",
    enableFullPath=True,
    GroupByLayer=False,
    GroupByType=False,
    IncludeHidden=True,
    IncludeLocked=True,
    listenToAttriubtes=True)
panel = Panel(dpipeline)
m_mm = ClusterInput()
cluster = Cluster(layer=layer, diameter=turning_diameter)  # -> pt_2, inner_2, outer_2
centre_line = Data(dpipeline)
m_mm_2 = Data(m_mm)
offsets_2 = Data(offsets)
crv_cp = CurveClosestPoint(Point=flatten(cluster.pt_2), Curve=graft(centre_line))  # -> Point, Parameter, Distance
item = ListItem(List=offsets_2, Index=0, Wrap=False)  # -> Item, Item1, Item2, Item3, Item4, Item5
sort = SortList(Keys=crv_cp.Distance, ValuesA=crv_cp.Point, ValuesB=crv_cp.Parameter)  # -> Keys, ValuesA, ValuesB
division = Division(A=item.Item, B=2)
graft = GraftTree(Tree=centre_line, IncludeEmptyLists=True, IncludeNullItems=True)  # -> simplify(Tree)
division_2 = Division(A=turning_diameter, B=2)
smaller = SmallerThan(FirstNumber=sort.Keys, SecondNumber=Slider(1, range=0..1))  # -> SmallerThan, OrEqualTo
dispatch = Dispatch(List=sort.ValuesA, DispatchPattern=smaller.SmallerThan)  # -> ListA, ListB
item_2 = ListItem(List=dispatch.ListA, Index=0, Wrap=True)
circle = CircleCNR(Center=item_2, Normal=Vector(0, 0, 1), Radius=division_2)  # -> simplify(Circle)
clean = CleanTree(RemoveNulls=True, RemoveInvalid=True, RemoveEmpty=True, Tree=circle)
number_slider = Slider(2, range=0..10)
number_slider_2 = Slider(0, range=0..100)
number_slider_3 = Slider(2, range=0..10)
multiplication = Multiplication(A=item.Item3, _1000=1000)
multiplication_2 = Multiplication(A=item.Item5, _1000=1000)
multiplication_3 = Multiplication(A=division, _1000=1000)
multiplication_4 = Multiplication(A=item.Item1, _1000=1000)
multiplication_5 = Multiplication(A=item.Item2, _1000=1000)
multiplication_6 = Multiplication(A=item.Item4, _1000=1000)
merge = Merge(Data1=division, Data2=item.Item1, Data3=item.Item2, Data4=item.Item3, Data5=item.Item4, Data6=item.Item5)
filter = StreamFilter(Gate=m_mm_2, Stream0=item.Item3, Stream1=multiplication)
filter_2 = StreamFilter(Gate=m_mm_2, Stream0=item.Item5, Stream1=multiplication_2)
filter_3 = StreamFilter(Gate=m_mm_2, Stream0=division, Stream1=multiplication_3)
filter_4 = StreamFilter(Gate=m_mm_2, Stream0=item.Item1, Stream1=multiplication_4)
filter_5 = StreamFilter(Gate=m_mm_2, Stream0=item.Item2, Stream1=multiplication_5)
filter_6 = StreamFilter(Gate=m_mm_2, Stream0=item.Item4, Stream1=multiplication_6)
clean_2 = CleanTree(RemoveNulls=True, RemoveInvalid=True, RemoveEmpty=False, Tree=merge)
ma = MassAddition(Input=clean_2)  # -> Result, PartialResults
polyoffset = PolylineOffset(
    Polylines=graft,
    Distance=filter_3,
    Plane=Plane(origin=(0, 0, 0), x=(0, 0, 0), y=(0, 0, 0)),
    Tolerance=0.01,
    ClosedFillet=number_slider_3,
    OpenFillet=number_slider,
    Miter=number_slider_2)  # -> Contour, Holes
multiplication_7 = Multiplication(A=ma.Result, B=2)
crv = Curve([polyoffset.Contour, clean])
polyoffset_2 = PolylineOffset(
    Polylines=crv,
    Distance=filter_4,
    Plane=Plane(origin=(0, 0, 0), x=(0, 0, 0), y=(0, 0, 0)),
    Tolerance=0.01,
    ClosedFillet=number_slider_3,
    OpenFillet=number_slider,
    Miter=number_slider_2)  # -> Contour, Holes
crv_2 = Curve(polyoffset_2.Contour)
polyoffset_3 = PolylineOffset(
    Polylines=crv_2,
    Distance=filter_5,
    Plane=Plane(origin=(0, 0, 0), x=(0, 0, 0), y=(0, 0, 0)),
    Tolerance=0.01,
    ClosedFillet=number_slider_3,
    OpenFillet=number_slider,
    Miter=number_slider_2)  # -> Contour, Holes
crv_3 = Curve(polyoffset_3.Contour)
polyoffset_4 = PolylineOffset(
    Polylines=crv_3,
    Distance=filter,
    Plane=Plane(origin=(0, 0, 0), x=(0, 0, 0), y=(0, 0, 0)),
    Tolerance=0.01,
    ClosedFillet=number_slider_3,
    OpenFillet=number_slider,
    Miter=number_slider_2)  # -> Contour, Holes
crv_4 = Curve(polyoffset_4.Contour)
polyoffset_5 = PolylineOffset(
    Polylines=crv_4,
    Distance=filter_6,
    Plane=Plane(origin=(0, 0, 0), x=(0, 0, 0), y=(0, 0, 0)),
    Tolerance=0.01,
    ClosedFillet=number_slider_3,
    OpenFillet=number_slider,
    Miter=number_slider_2)  # -> Contour, Holes
crv_5 = Curve(polyoffset_5.Contour)
polyoffset_6 = PolylineOffset(
    Polylines=crv_5,
    Distance=filter_2,
    Plane=Plane(origin=(0, 0, 0), x=(0, 0, 0), y=(0, 0, 0)),
    Tolerance=0.01,
    ClosedFillet=number_slider_3,
    OpenFillet=number_slider,
    Miter=number_slider_2)  # -> Contour, Holes
crv_6 = Curve(polyoffset_6.Contour)
group = Group(Objects=flatten(crv_6))
group_2 = Group(Objects=flatten(crv_5))
group_3 = Group(Objects=flatten(crv_4))
group_4 = Group(Objects=flatten(crv_3))
group_5 = Group(Objects=flatten(crv_2))
group_6 = Group(Objects=flatten(crv))
_3 = Data(flatten(group_3))
_5 = Data(flatten(group))
_1 = Data(flatten(group_5))
_2 = Data(flatten(group_4))
_4 = Data(flatten(group_2))
total_width = Data(multiplication_7)
_0 = Data(group_6)
panel_2 = Panel(_0)
_2_2 = ClusterOutput(_2)
_3_2 = ClusterOutput(_3)
_5_2 = ClusterOutput(_5)
total_width_2 = ClusterOutput(total_width)
_0_2 = ClusterOutput(_0)
_1_2 = ClusterOutput(_1)
_4_2 = ClusterOutput(_4)

# ==== cluster Cluster_3
number_slider = Slider(0.3, range=0..1)
G = ClusterInput()
number_slider_2 = Slider(0.01, range=0..0.01)
radius = ClusterInput()
geo = ClusterInput()
distances = ClusterInput()
ungroup = Ungroup(Group=G)
m_mm = ClusterInput()
fillet_f_chamfer_t = ClusterInput()
distances_2 = Data(distances)
radius_2 = Data(radius)
m_mm_2 = Data(m_mm)
curve = Data(flatten(ungroup))
multiplication = Multiplication(A=number_slider_2, _1000=1000)
null = NullItem(Item=radius_2)  # -> NullFlags, InvalidFlags, Description
fillet_f_chamfer_t_2 = Data(fillet_f_chamfer_t)
radius_3 = Data(fillet_f_chamfer_t_2)
filter = StreamFilter(Gate=m_mm_2, Stream0=number_slider_2, Stream1=multiplication)
filter_2 = StreamFilter(Gate=null.NullFlags, Stream0=radius_2, Stream1=Slider(0, range=0..100))
null_2 = NullItem(Item=radius_3)  # -> NullFlags, InvalidFlags, Description
sort = SortList(Keys=distances_2)  # -> Keys, ValuesA
filter_3 = StreamFilter(Gate=null_2.NullFlags, Stream0=fillet_f_chamfer_t_2, Stream1=Toggle(False))
multiplication_2 = Multiplication(A=number_slider, _1000=1000)
mesh = Mesh(curve)
multiplication_3 = Multiplication(A=sort.Keys, B=Slider(5, range=0..10))
polyoffset = PolylineOffset(
    Polylines=flatten(curve),
    Distance=filter,
    Plane=Plane(origin=(0, 0, 0), x=(0, 0, 0), y=(0, 0, 0)),
    Tolerance=0.01,
    ClosedFillet=Slider(1, range=0..10),
    OpenFillet=Slider(1, range=0..1),
    Miter=Slider(0, range=0..100))  # -> Contour, Holes
mjoin = MeshJoin(Meshes=mesh)
item = ListItem(List=multiplication_3, Index=0, Wrap=True)  # -> Item1, Item
filter_4 = StreamFilter(Gate=m_mm_2, Stream0=number_slider, Stream1=multiplication_2)
panel = Panel(filter_3)
crv = Curve(simplify(graft(polyoffset.Holes)))
polyoffset_2 = PolylineOffsetSETTINGS(
    Polylines=crv,
    Distance=filter_4,
    Plane=Plane(origin=(0, 0, 0), x=(0, 0, 0), y=(0, 0, 0)),
    Tolerance=0.001,
    ClosedFillet=2,
    OpenFillet=2,
    Miter=0)  # -> Contour, simplify(Holes)
subtraction = Subtraction(A=item.Item, B=0.5)
crv_2 = Curve(polyoffset_2.Holes)
eval = EvaluateCurve(Curve=reparameterize(crv_2), Parameter=0)  # -> Point, Tangent, Angle
flatten = FlattenTree(Tree=crv, Path="{0}")
number_slider_3 = Slider(999, range=0..1000)
neg = Negative(Value=number_slider_3)
Z = UnitZ(Factor=number_slider_3)
Z_2 = UnitZ(Factor=neg)
move = Move(Geometry=eval.Point, Motion=Z)  # -> Geometry, Transform
meshray = MeshRay(Mesh=mjoin, Point=move.Geometry, Direction=Z_2)  # -> Point, Hit
null_3 = NullItem(Item=meshray.Point)  # -> NullFlags, InvalidFlags, Description
number_slider_4 = Slider(4, range=0..10)
item_2 = ListItem(List=null_3.NullFlags, Index=0, Wrap=True)  # -> flatten(Item)
dispatch = Dispatch(List=flatten, DispatchPattern=item_2)  # -> ListA, ListB
number_slider_5 = Slider(10, range=0..10)
crv_3 = Curve(dispatch.ListA)

# ---- group: outer curve
crv_4 = Curve(polyoffset.Contour)

# ----
explode = Explode(Curve=crv_4, Recursive=True)  # -> Segments, Vertices
len = Length(Curve=explode.Segments)
larger = LargerThan(FirstNumber=len, SecondNumber=subtraction)  # -> LargerThan, OrEqualTo
dispatch_2 = Dispatch(List=explode.Segments, DispatchPattern=larger.OrEqualTo)  # -> ListA, ListB
crv_5 = Curve(dispatch_2.ListA)
end = EndPoints(Curve=crv_5)  # -> Start, End
ext = ExtendCurve(Curve=crv_5, Type=0, Start=number_slider_5, End=number_slider_5)
pt = Point(simplify(graft(end.Start)))
mcx = MultipleCurves(Curves=ext)  # -> Points, IndexA, IndexB, ParamA, ParamB
pull = PullPoint(Point=pt, Geometry=mcx.Points, ClosestOnly=True)  # -> ClosestPoint, Distance
sort_2 = SortList(Keys=pull.Distance, ValuesA=pull.ClosestPoint)  # -> simplify(Keys), simplify(ValuesA)
graft = GraftTree(Tree=end.End, IncludeEmptyLists=True, IncludeNullItems=True)  # -> simplify(Tree)
item_3 = ListItem(List=sort_2.ValuesA, Index=0, Wrap=True)
ln = Line(StartPoint=item_3, EndPoint=graft)  # -> flatten(Line)
merge = Merge(Data1=flatten(crv_4), Data2=flatten(crv_3))
end_2 = EndPoints(Curve=ln)  # -> Start, End
pt_2 = Point(simplify(graft(end_2.End)))
pull_2 = PullPoint(Point=pt_2, Geometry=mcx.Points, ClosestOnly=True)  # -> ClosestPoint, Distance
simplify = SimplifyCurve(Curve=merge)  # -> Curve, Simplified
sort_3 = SortList(Keys=pull_2.Distance, ValuesA=pull_2.ClosestPoint)  # -> simplify(Keys), simplify(ValuesA)
graft_2 = GraftTree(Tree=end_2.Start, IncludeEmptyLists=True, IncludeNullItems=True)  # -> simplify(Tree)
redpline = Reduce(Polyline=simplify.Curve, Tolerance=Slider(0.01, range=0..0.01))  # -> Polyline, Reduction
geo_2 = Geometry(geo)
item_4 = ListItem(List=sort_3.ValuesA, Index=0, Wrap=True)
ln_2 = Line(StartPoint=item_4, EndPoint=graft_2)  # -> flatten(Line)
ungroup_2 = Ungroup(Group=geo_2)
join = JoinCurves(Curves=ln_2, Preserve=False)
brep = Brep(ungroup_2)
crv_6 = Curve(ungroup_2)
clean = CleanTree(RemoveNulls=True, RemoveInvalid=True, RemoveEmpty=True, Tree=crv_6)  # -> simplify(graft(Tree))
clean_2 = CleanTree(RemoveNulls=True, RemoveInvalid=True, RemoveEmpty=True, Tree=brep)  # -> simplify(Tree)
debrep = DeconstructBrep(Brep=clean_2)  # -> simplify(Faces), Edges, Vertices
area = Area(Geometry=debrep.Faces)  # -> Area, Centroid
pdecon = Deconstruct(Point=area.Centroid)  # -> XComponent, YComponent, ZComponent
sort_4 = SortList(Keys=pdecon.ZComponent, ValuesA=debrep.Faces)  # -> Keys, ValuesA
item_5 = ListItem(List=sort_4.ValuesA, Index=0, Wrap=True)
debrep_2 = DeconstructBrep(Brep=item_5)  # -> Faces, Edges, Vertices
join_2 = JoinCurves(Curves=debrep_2.Edges, Preserve=False)  # -> simplify(flatten(Curves))
project = Project(Geometry=clean, Plane=PlaneXY(0, 0, 0))  # -> Geometry, Transform
trim = TrimWithRegions(Curve=redpline.Polyline, Regions=join_2)  # -> Inside, simplify(Outside)
crv_7 = Curve(flatten(trim.Outside))
ccx = CurveCurve(CurveA=simplify(project.Geometry), CurveB=simplify(crv_7))  # -> Points, ParamsA, ParamsB
crv_8 = Curve(trim.Inside)
trim_2 = TrimTree(Tree=ccx.ParamsA, Depth=1)
shatter = Shatter(Curve=project.Geometry, Parameters=trim_2)
trim_3 = TrimTree(Tree=shatter, Depth=1)
item_6 = ListItem(List=trim_3, Index=Slider(1, range=0..1), Wrap=True)  # -> flatten(Item)
join_3 = JoinCurves(Curves=[item_6, crv_7], Preserve=False)
null_4 = NullItem(Item=join_3)  # -> NullFlags, InvalidFlags, Description
group = Group(Objects=join_3)
multiplication_4 = Multiplication(A=filter_2, _1000=1000)
filter_5 = StreamFilter(Gate=null_4.NullFlags, Stream0=join_3, Stream1=redpline.Polyline)
multiplication_5 = Multiplication(A=filter_2, _1000=1000)
filter_6 = StreamFilter(Gate=m_mm_2, Stream0=filter_2, Stream1=multiplication_4)
explode_2 = Explode(Curve=filter_5, Recursive=True)  # -> Segments, Vertices
clean_curve = Data(filter_5)
filter_7 = StreamFilter(Gate=m_mm_2, Stream0=filter_2, Stream1=multiplication_5)
clean_curve_2 = ClusterOutput(clean_curve)
fillet = Fillet(Curve=filter_5, Radius=filter_6)
neg_2 = Negative(Value=filter_7)
group_2 = Group(Objects=fillet)
ext_2 = ExtendCurve(Curve=explode_2.Segments, Type=0, Start=neg_2, End=neg_2)
end_3 = EndPoints(Curve=ext_2)  # -> simplify(graft(Start)), End
pt_3 = Point(flatten(end_3.End))
pt_4 = Point(simplify(end_3.Start))
pull_3 = PullPoint(Point=pt_4, Geometry=pt_3, ClosestOnly=True)  # -> ClosestPoint, Distance
sort_5 = SortList(Keys=pull_3.Distance, ValuesA=pull_3.ClosestPoint)  # -> Keys, ValuesA
item_7 = ListItem(List=sort_5.ValuesA, Index=0, Wrap=True)  # -> simplify(Item)
ln_3 = Line(StartPoint=pt_4, EndPoint=item_7)
merge_2 = Merge(Data1=flatten(ln_3), Data2=flatten(ext_2))
join_4 = JoinCurves(Curves=merge_2, Preserve=False)  # -> flatten(Curves)
group_3 = Group(Objects=join_4)
filter_8 = StreamFilter(Gate=filter_3, Stream0=group_2, Stream1=group_3)
curve_2 = Data(filter_8)
curve_3 = ClusterOutput(curve_2)

# ==== cluster Cluster_4
number_slider = Slider(0.2, range=0..1)
G = ClusterInput()
number_slider_2 = Slider(0.01, range=0..0.01)
radius = ClusterInput()
ungroup = Ungroup(Group=G)
m_mm = ClusterInput()
fillet_f_chamfer_t = ClusterInput()
radius_2 = Data(radius)
curve = Data(flatten(ungroup))
m_mm_2 = Data(m_mm)
multiplication = Multiplication(A=number_slider_2, _1000=1000)
null = NullItem(Item=radius_2)  # -> NullFlags, InvalidFlags, Description
fillet_f_chamfer_t_2 = Data(fillet_f_chamfer_t)
radius_3 = Data(fillet_f_chamfer_t_2)
filter = StreamFilter(Gate=m_mm_2, Stream0=number_slider_2, Stream1=multiplication)
filter_2 = StreamFilter(Gate=null.NullFlags, Stream0=radius_2, Stream1=Slider(0, range=0..100))
null_2 = NullItem(Item=radius_3)  # -> NullFlags, InvalidFlags, Description
filter_3 = StreamFilter(Gate=null_2.NullFlags, Stream0=fillet_f_chamfer_t_2, Stream1=Toggle(False))
multiplication_2 = Multiplication(A=number_slider, _1000=1000)
mesh = Mesh(curve)
polyoffset = PolylineOffset(
    Polylines=flatten(curve),
    Distance=filter,
    Plane=Plane(origin=(0, 0, 0), x=(0, 0, 0), y=(0, 0, 0)),
    Tolerance=0.01,
    ClosedFillet=Slider(1, range=0..10),
    OpenFillet=Slider(1, range=0..1),
    Miter=Slider(0, range=0..100))  # -> Contour, Holes
mjoin = MeshJoin(Meshes=mesh)
filter_4 = StreamFilter(Gate=m_mm_2, Stream0=number_slider, Stream1=multiplication_2)
panel = Panel(filter_3)
crv = Curve(simplify(graft(polyoffset.Holes)))
polyoffset_2 = PolylineOffsetSETTINGS(
    Polylines=crv,
    Distance=filter_4,
    Plane=Plane(origin=(0, 0, 0), x=(0, 0, 0), y=(0, 0, 0)),
    Tolerance=0.001,
    ClosedFillet=2,
    OpenFillet=2,
    Miter=0)  # -> Contour, simplify(Holes)
crv_2 = Curve(polyoffset_2.Holes)
eval = EvaluateCurve(Curve=reparameterize(crv_2), Parameter=0)  # -> Point, Tangent, Angle
flatten = FlattenTree(Tree=crv, Path="{0}")
number_slider_3 = Slider(999, range=0..1000)
neg = Negative(Value=number_slider_3)
Z = UnitZ(Factor=number_slider_3)
Z_2 = UnitZ(Factor=neg)
move = Move(Geometry=eval.Point, Motion=Z)  # -> Geometry, Transform
meshray = MeshRay(Mesh=mjoin, Point=move.Geometry, Direction=Z_2)  # -> Point, Hit
null_3 = NullItem(Item=meshray.Point)  # -> NullFlags, InvalidFlags, Description
item = ListItem(List=null_3.NullFlags, Index=0, Wrap=True)  # -> flatten(Item)
dispatch = Dispatch(List=flatten, DispatchPattern=item)  # -> ListA, ListB

# ---- group: outer curve
crv_3 = Curve(polyoffset.Contour)

# ----
crv_4 = Curve(dispatch.ListA)
merge = Merge(Data1=flatten(crv_3), Data2=flatten(crv_4))
simplify = SimplifyCurve(Curve=merge)  # -> Curve, Simplified
multiplication_3 = Multiplication(A=filter_2, _1000=1000)
multiplication_4 = Multiplication(A=filter_2, _1000=1000)
filter_5 = StreamFilter(Gate=m_mm_2, Stream0=filter_2, Stream1=multiplication_3)
filter_6 = StreamFilter(Gate=m_mm_2, Stream0=filter_2, Stream1=multiplication_4)
fillet = Fillet(Curve=simplify.Curve, Radius=filter_5)
explode = Explode(Curve=simplify.Curve, Recursive=True)  # -> Segments, Vertices
neg_2 = Negative(Value=filter_6)
group = Group(Objects=fillet)
ext = ExtendCurve(Curve=explode.Segments, Type=0, Start=neg_2, End=neg_2)
group_2 = Group(Objects=simplify.Curve)
clean_curve = Data(group_2)
end = EndPoints(Curve=ext)  # -> simplify(graft(Start)), End
clean_curve_2 = ClusterOutput(clean_curve)
pt = Point(flatten(end.End))
pt_2 = Point(simplify(end.Start))
pull = PullPoint(Point=pt_2, Geometry=pt, ClosestOnly=True)  # -> ClosestPoint, Distance
sort = SortList(Keys=pull.Distance, ValuesA=pull.ClosestPoint)  # -> Keys, ValuesA
item_2 = ListItem(List=sort.ValuesA, Index=0, Wrap=True)  # -> simplify(Item)
ln = Line(StartPoint=pt_2, EndPoint=item_2)
merge_2 = Merge(Data1=flatten(ln), Data2=flatten(ext))
join = JoinCurves(Curves=merge_2, Preserve=False)  # -> flatten(Curves)
group_3 = Group(Objects=join)
filter_7 = StreamFilter(Gate=filter_3, Stream0=group, Stream1=group_3)
curve_2 = Data(filter_7)
curve_3 = ClusterOutput(curve_2)

# ==== cluster Cluster
diameter = ClusterInput()
inner_diameter = ClusterInput()
layer = ClusterInput()
diameter_2 = Data(diameter)
inner_diameter_2 = Data(inner_diameter)
layer_2 = Data(layer)
split = TextSplit(Text=layer_2, Separators="::")
dispatch = Dispatch(List=split, DispatchPattern=[True, False])  # -> ListA, ListB
cull_i = CullIndex(List=dispatch.ListA, Indices="-1", Wrap=True)
dpipeline = DynamicGeometryPipeline(
    LayerFilter=layer_2,
    TypeFilter="curve",
    NameFilter="*",
    enableFullPath=True,
    GroupByLayer=False,
    GroupByType=False,
    IncludeHidden=True,
    IncludeLocked=True,
    listenToAttriubtes=True)
join = TextJoin(Text=cull_i, Join="::")
concat = Concatenate(FragmentA=join, FragmentB="::Roundabout")
division = Division(A=diameter_2, B=2)
dpipeline_2 = DynamicGeometryPipeline(
    LayerFilter=concat,
    TypeFilter="point",
    NameFilter="*",
    enableFullPath=True,
    GroupByLayer=False,
    GroupByType=False,
    IncludeHidden=True,
    IncludeLocked=True,
    listenToAttriubtes=True)
circle = CircleCNR(Center=dpipeline_2, Normal=Vector(0, 0, 1), Radius=inner_diameter_2)
circle_2 = CircleCNR(Center=dpipeline_2, Normal=Vector(0, 0, 1), Radius=division)
pt = Data(dpipeline_2)
outer = Data(circle)
inner = Data(circle_2)
inner_2 = ClusterOutput(inner)
pt_2 = ClusterOutput(pt)
outer_2 = ClusterOutput(outer)
