# Grasshopper definition 02 Topography (training file).gh (Grasshopper 0.9.76)
# plug-ins: Python Interpreter, Human, EleFront

python = PythonScript()  # -> a
# ---------- python: Python ----------
import Grasshopper as gh
import Rhino
import rhinoscriptsyntax as rs


GH = str(ghenv.Component.Attributes.Owner.OnPingDocument().FilePath)
a = GH
# ---------- end python ----------
file = ReadFile(F=python, PerLineParse=False)  # -> C
#   port F: Uri of file to read
# ---------- file: VB line parser ----------
    action = GH_LineParserAction.Include
    Return line

    'Parse the line and return some data that represents the line.
    'If the line cannot be parsed, you can return Nothing and
    'assign a different action.
    'The default implementation is to just return the line itself.
    'If you return types that implement IGH_Goo, this component
    'will work substantially faster.
# ---------- end file ----------
python_2 = PythonScript(log=file)
# ---------- python_2: Python ----------
import Grasshopper as gh
import Rhino
import rhinoscriptsyntax as rs
import scriptcontext as sc
import getpass
import datetime
if log:
    User = str(getpass.getuser())
    GHS = str(ghenv.Component.Attributes.Owner.OnPingDocument().FilePath)
    Description = str(ghenv.Component.Attributes.Owner.OnPingDocument().Properties.Description)
    Author = str(gh.CentralSettings.AuthorName)
    dateCreated = str(ghenv.Component.Attributes.Owner.OnPingDocument().Properties.Date)
    Revision = str(ghenv.Component.Attributes.Owner.OnPingDocument().Properties.Revisions.Count)
    Version = str(gh.Versioning.Version)
    GHL = GHS.split("\\")
    del GHL[-1]
    GHL = "\\".join(GHL)
    sc.doc = Rhino.RhinoDoc.ActiveDoc
    RhinoS = rs.DocumentPath()
    RHL = RhinoS.split("\\")
    del RHL[-1]
    RHL = "\\".join(RHL)
    
    
    timeNow = str(datetime.datetime.now())
    log = timeNow + '\t' + User + '\t' + RhinoS + '\t' + GHS + '\t' + Description + '\t' + Author + '\t' + Revision + '\t' + Version + '\r\n'
    open(GHL + '\\log.log', 'a').close()
    with open(GHL + '\\log.log', 'ab') as myfile:
        myfile.write(log)
    open(RHL + '\\log.log', 'a').close()
    with open(RHL + '\\log.log', 'ab') as myfile:
        myfile.write(log)
# ---------- end python_2 ----------

# ----
# H A R D   S C A P E
panel = Panel("02 Topography::Hardscape")
dpipeline = DynamicGeometryPipeline(
    LayerFilter=panel,
    TypeFilter="Curve",
    NameFilter="*",
    enableFullPath=True,
    GroupByLayer=False,
    GroupByType=False,
    IncludeHidden=True,
    IncludeLocked=True,
    listenToAttriubtes=True)

# ----
# S T E P  1
# R E F E R E N C E    G E O M E T R Y
# C O N T O U R S
panel_2 = Panel("02 Topography::Contours")
dpipeline_2 = DynamicGeometryPipeline(
    LayerFilter=panel_2,
    TypeFilter="Curve",
    NameFilter="*",
    enableFullPath=True,
    GroupByLayer=False,
    GroupByType=False,
    IncludeHidden=True,
    IncludeLocked=True,
    listenToAttriubtes=True)

# ----
# S P O T   H E I G H T S
panel_3 = Panel("02 Topography::Spot Height")
dpipeline_3 = DynamicGeometryPipeline(
    LayerFilter=panel_3,
    TypeFilter="Point",
    NameFilter="*",
    enableFullPath=True,
    GroupByLayer=False,
    GroupByType=False,
    IncludeHidden=True,
    IncludeLocked=True,
    listenToAttriubtes=True)

rhatt = GetRhinoAttributes(Geometry=dpipeline_3)  # -> Name, Layer, Colour
# S T E P  2
# R E A D   H E I G H T
rhatt_2 = GetRhinoAttributes(Geometry=dpipeline_2)  # -> Name, Layer, Colour
adjust_units = Panel("1")
read_height_text = Panel(rhatt.Name)
read_height_text_2 = Panel(rhatt_2.Name)
multiplication = Multiplication(A=rhatt.Name, B=adjust_units)
multiplication_2 = Multiplication(A=rhatt_2.Name, B=adjust_units)
# S T E P  3
# M O V E   G E O M E T R Y
project = Project(Geometry=dpipeline_2, Plane=PlaneXY(0, 0, 0))  # -> Geometry, Transform
project_2 = Project(Geometry=dpipeline_3, Plane=PlaneXY(0, 0, 0))  # -> Geometry, Transform

# ---- group: Move Points to Correct Height
Z = UnitZ(Factor=multiplication)
move = Move(Geometry=project_2.Geometry, Motion=Z)  # -> Geometry, Transform

# ---- group: Move Curves to Correct Height
Z_2 = UnitZ(Factor=multiplication_2)
move_2 = Move(Geometry=project.Geometry, Motion=Z_2)  # -> Geometry, Transform

# ---- group: Divide Curves by factor of lenght to create points
divdist = DivideDistance(Curve=dpipeline, Distance=Slider(10, range=0..1000))  # -> flatten(Points), Tangents, Parameters

# ---- group: Divide Curves by length
# S T E P  4
# C R E A T E   P O I N T S
number_slider = Slider(30, range=0..1000)
divdist_2 = DivideDistance(Curve=move_2.Geometry, Distance=number_slider)  # -> flatten(Points), Tangents, Parameters

# ---- group: POINTS AT CORRECT HEIGHT
# A L L   P O I N T S
merge = Merge(Data2=divdist_2.Points, Data3=move.Geometry, Data4=divdist.Points)  # -> flatten(Result)

# ----
# S T E P  5
# M E S H
# M E S H
del = DelaunayMesh(Points=flatten(merge), Plane=PlaneXY(0, 0, 0))

# ---- group: SIMPLIFY MESH
msmooth = SmoothMesh(Mesh=del, Strength=Slider(0, range=0..1), SkipNaked=True, Iterations=Slider(1, range=0..10))

# ---- group: OBJECT COLOUR
# BAKE LAYERS
swatch = ColourSwatch(SwatchColor=RGB(0, 0, 0))

# ----
# S T E P  6
# B A K E
# B A K E - M E S H
panel_4 = Panel("Bake::TopoMesh")
attributes = ObjectAttributes(Layer=panel_4, Color=swatch)

# ---- group: BAKE - ROADS
# BAKE
bake = BakeObjects(Geometry=msmooth, Attributes=attributes, Bake=False)
