# Grasshopper definition 03 Massing (training file).gh (Grasshopper 0.9.76)
# plug-ins: Human, EleFront

# ----
# S T E P  1
# R E F E R E N C E    G E O M E T R Y
# F O O T  P R I N T S
panel = Panel("03 Buildings::Footprint")
# H E I G H T
dpipeline = DynamicGeometryPipeline(
    LayerFilter=panel,
    TypeFilter="curve",
    NameFilter="*",
    enableFullPath=True,
    GroupByLayer=False,
    GroupByType=False,
    IncludeHidden=True,
    IncludeLocked=True,
    listenToAttriubtes=True)

# ----
# T O P O G R A P H Y
panel_2 = Panel("Bake::TopoMesh")
dpipeline_2 = DynamicGeometryPipeline(
    LayerFilter=panel_2,
    TypeFilter="mesh",
    NameFilter="*",
    enableFullPath=True,
    GroupByLayer=False,
    GroupByType=False,
    IncludeHidden=True,
    IncludeLocked=True,
    listenToAttriubtes=True)

# ---- group: Number of Storeys
rhatt = GetRhinoAttributes(Geometry=dpipeline)  # -> Name, Layer, Colour

# ---- group: STOREY PREVIEW
# S T E P  2
number_slider = Slider(10, range=0..10)
area = Area(Geometry=dpipeline)  # -> Area, Centroid
text = CreateText(Text=rhatt.Name, Plane=area.Centroid, Size=number_slider, Font="Arial", JustificationMode=65537)

# ----
null = NullItem(Item=rhatt.Name)  # -> NullFlags, InvalidFlags, Description
dispatch = Dispatch(List=rhatt.Name, DispatchPattern=null.NullFlags)  # -> ListA, ListB
dispatch_2 = Dispatch(List=dpipeline, DispatchPattern=null.NullFlags)  # -> ListA, ListB

# ---- group: STOREYS
num = Number(dispatch.ListB)

# ---- group: FOOTPRINT
crv = Curve(dispatch_2.ListB)

# ---- group: FLOOR TO FLOOR HEIGHT
number_slider_2 = Slider(3, range=0..10)

# ----
# S T E P  3
# E X T R U D E
multiplication = Multiplication(A=num, B=number_slider_2)

# ---- group: MASSING DISPLAY
transprency = Transprency(A=Slider(98, range=0..255), C=ColourSwatch(SwatchColor=RGB(255, 0, 0)))

# ----
Z = UnitZ(Factor=multiplication)

# ----
# M A S S I N G - M E S H
polymeshextrudedirection = Rob_SuperMesh(vector=simplify(graft(Z)), crv=simplify(graft(crv)))  # -> flatten(M)
preview = CustomPreview(Geometry=polymeshextrudedirection, Shader=transprency)

# ----
# M A S S I N G - POLYSRF
extr = Extrude(Base=crv, Direction=Z)
cap = CapHoles(Brep=extr)
preview_2 = CustomPreview(Geometry=cap, Shader=transprency)

# ----
# NOTE!: PROJECT BUILDING CENTRE POINTS REALLY HIGH THEN SHOOT THEM BACK DOWN ONTO THE MESH TO FIND THE INTERSECTIONS, THEN MOVE THE BUILDINGS INTO THE INTERSECTION POINT
number_slider_3 = Slider(5, range=0..10)
# S T E P  4
# T O P O
number_slider_4 = Slider(9999, range=0..10000)

# ---- group: CENTRE POINTS
area_2 = Area(Geometry=crv)  # -> Area, Centroid

# ----
multiplication_2 = Multiplication(A=number_slider_4, B=number_slider_3)
Z_2 = UnitZ(Factor=multiplication_2)

# ---- group: MOVE VERY HIGH
move = Move(Geometry=area_2.Centroid, Motion=Z_2)  # -> Geometry, Transform

# ---- group: SHOOT BACK DOWN TO GET MESH INTERSECTIONS
neg = Negative(Value=Z_2)
meshray = MeshRay(Mesh=dpipeline_2, Point=move.Geometry, Direction=neg)  # -> Point, Hit

# ----
# M A S S    O N     T O P O
orient = Orient(Geometry=polymeshextrudedirection, Source=area_2.Centroid, Target=meshray.Point)  # -> Geometry, Transform
preview_3 = CustomPreview(Geometry=orient.Geometry, Shader=transprency)

# ----
# S T E P  5
# B A K E
panel_3 = Panel("Bake::Buildings")

# ---- group: OBJECT COLOUR
swatch = ColourSwatch(SwatchColor=RGB(8, 95, 161))

# ----
# B A K E - M A S S I N G
panel_4 = Panel(panel_3)
attributes = ObjectAttributes(Layer=panel_4, Color=swatch)

# ---- group: BAKE - BUILDINGS
# BAKE
bake = BakeObjects(Geometry=orient.Geometry, Attributes=attributes, Bake=False)

# ==== cluster Rob_SuperMesh: must be grafted list
crv = ClusterInput()
vector = ClusterInput()
crv_2 = Curve(crv)
vector_2 = Data(vector)
pt = Point(Point(0.5, 0.5, 0))
evalsrf = EvaluateSurface(Surface=crv_2, Point=pt)  # -> Point, Normal, Frame
angle = Angle(VectorA=vector_2, VectorB=evalsrf.Normal)  # -> Angle, Reflex
deg = Degrees(Radians=angle.Angle)
larger = LargerThan(FirstNumber=deg, SecondNumber=Slider(179, range=0..1000))  # -> LargerThan, OrEqualTo
dispatch = Dispatch(List=crv_2, DispatchPattern=larger.LargerThan)  # -> ListA, ListB
flip = FlipCurve(Curve=dispatch.ListB)  # -> Curve, Flag
weave = Weave(Pattern=larger.LargerThan, Stream0=flip.Curve, Stream1=dispatch.ListA, NullGaps=False)
move = Move(Geometry=weave, Motion=vector_2)  # -> graft(Geometry), Transform
flip_2 = FlipCurve(Curve=move.Geometry)  # -> Curve, Flag
explode = Explode(Curve=weave, Recursive=True)  # -> Segments, simplify(Vertices)
explode_2 = Explode(Curve=move.Geometry, Recursive=True)  # -> Segments, simplify(Vertices)
shift = ShiftList(List=explode.Vertices, Shift=1, Wrap=True)  # -> simplify(graft(List))
graft = GraftTree(Tree=explode_2.Vertices, IncludeEmptyLists=True, IncludeNullItems=True)  # -> simplify(Tree)
graft_2 = GraftTree(Tree=explode.Vertices, IncludeEmptyLists=True, IncludeNullItems=True)  # -> simplify(Tree)
shift_2 = ShiftList(List=explode_2.Vertices, Shift=1, Wrap=True)  # -> simplify(graft(List))
boundary = BoundarySurfaces(Edges=weave)
boundary_2 = BoundarySurfaces(Edges=flip_2.Curve)
mesh = Mesh(simplify(graft(boundary_2)))
mesh_2 = Mesh(simplify(graft(boundary)))
merge = Merge(Data1=graft_2, Data2=shift, Data3=shift_2, Data4=graft)  # -> reverse(Result)
conmesh = ConstructMesh(Vertices=merge, Faces={A=0, B=1, C=2, D=3})
shiftorflatten = ShiftorFlatten(data=conmesh)
mjoin = MeshJoin(Meshes=shiftorflatten)
mesh_3 = Mesh(simplify(graft(mjoin)))
mesh_4 = Mesh(simplify(graft(mjoin)))
tstat = TreeStatistics(Tree=shiftorflatten)  # -> Paths, Length, Count
lng = ListLength(List=tstat.Paths)
mesh_5 = Mesh(flatten([mesh, mesh_3, mesh_2]))
mesh_6 = Mesh([mesh, mesh_3, mesh_2])
smaller = SmallerThan(FirstNumber=lng, SecondNumber=Slider(1, range=0..1))  # -> SmallerThan, OrEqualTo
filter = StreamFilter(Gate=smaller.OrEqualTo, Stream0=mesh_6, Stream1=mesh_5)
mjoin_2 = MeshJoin(Meshes=simplify(filter))
M = ClusterOutput(mjoin_2)

# ==== cluster Transprency: Transprency
C = ClusterInput()
argb = SplitARGB(Colour=C, IntegerChannels=True)  # -> Alpha, Red, Green, Blue
A = ClusterInput()
rgb = ColourRGB(Alpha=A, Red=argb.Red, Green=argb.Green, Blue=argb.Blue)
C_2 = ClusterOutput(rgb)

# ==== cluster ShiftorFlatten
data = ClusterInput()
data_2 = Data(data)
pshift = ShiftPaths(Data=data_2, Offset=-1)
flatten = FlattenTree(Tree=data_2, Path="{0}")
null = NullItem(Item=pshift)  # -> NullFlags, InvalidFlags, Description
flatten_2 = FlattenTree(Tree=null.NullFlags, Path="{0}")
bnd = Bounds(Numbers=flatten_2)
dedomain = DeconstructDomain(Domain=bnd)  # -> Start, End
filter = StreamFilter(Gate=dedomain.Start, Stream0=pshift, Stream1=flatten)
s_0 = ClusterOutput(filter)
