# Grasshopper definition 05 GH to InDesign (training file).gh (Grasshopper 0.9.76)

# ---- group: Body List
join = TextJoin(Join="*")  # -> flatten(Result)

# ---- group: Heading List
join_2 = TextJoin(Join="*")  # -> flatten(Result)

# ---- group: FILE NAME (CURRENT OPTION)
concat = Concatenate(FragmentB=".txt")  # -> flatten(Result)

# ----
# E X P O R T   T O    I N D E S I G N
# NOTE!: Column Width needs to listed for each column, any columns not specified will have the last specified column width
merge = Merge(Data1=join_2, Data2=join)
split = TextSplit(Text=merge, Separators="*")  # -> simplify(Result)
flip = FlipMatrix(Data=split)
branch = TreeBranch(Tree=flip, Path=Slider(0, range=0..100), MaintainPaths=True)
lng = ListLength(List=branch)
subtraction = Subtraction(A=lng, B=Slider(2, range=0..10))
dup = DuplicateData(Data="Body", Number=subtraction, Order=True)  # -> flatten(Data)
dup_2 = DuplicateData(Data="Body", Number=subtraction, Order=True)  # -> flatten(Data)
merge_2 = Merge(Data1="Header", Data2=dup_2, Data3="Total")  # -> simplify(graft(Result))
merge_3 = Merge(Data1="Header", Data2=dup, Data3="Total")  # -> simplify(graft(Result))
nullrep = ReplaceNulls(Items=split, Replacements="<0x200A>")  # -> simplify(Items), Count
cluster = Cluster(cell_content=nullrep.Items, paragraph_style=merge_3, cell_style=merge_2)
column_width = Panel("100")
cluster_2 = Cluster_2(table_contents=cluster, table_style="Table", col_width=column_width)
file_path = Panel("R:\Planning\Scripts\Grasshopper\Planning_Clean\TXT Exports")
cluster_3 = Cluster_4(data=cluster_2)
file_write = FileWrite(content=cluster_3, file_path=file_path, T=concat, activate=Toggle(False))

toggle = BooleanToggle(False)  # disabled
panel = Panel("Column, Row")  # disabled
panel_2 = Panel("1,1")  # disabled
panel_3 = Panel("8,1")  # disabled
cluster_4 = Cluster_3(on_off=toggle, table_content=cluster, cell_position=panel_2, merge=panel_3)  # -> simplify(s_0); disabled

# ==== cluster Cluster
cell_content = ClusterInput()  # Cell Content for the table
paragraph_style = ClusterInput()  # Input of the Paragraph Style,
cell_style = ClusterInput()  # Input of the Cell Style,

# ---- group: Wrap <CELL>
panel = Panel("<CellStyle:█!cell_style!█><StylePriority:0><CellStart:1,1><ParaStyle:█!Paragraph_Style!█>█!cell_content!█<CellEnd:>")
null = NullItem(Item=cell_style)  # -> NullFlags, InvalidFlags, Description
ma = MassAddition(Input=null.NullFlags)  # -> Result, PartialResults
filter = StreamFilter(Gate=ma.Result, Stream0=cell_style, Stream1="\[None\]")
null_2 = NullItem(Item=paragraph_style)  # -> NullFlags, InvalidFlags, Description
rep = ReplaceText(Text=panel, Find="█!cell_style!█", Replace=filter, RecursiveReplace=False)
ma_2 = MassAddition(Input=null_2.NullFlags)  # -> Result, PartialResults
filter_2 = StreamFilter(Gate=ma_2.Result, Stream0=paragraph_style, Stream1="NormalParagraphStyle")
panel_2 = Panel("█!cell_content!█")
rep_2 = ReplaceText(Text=rep, Find="█!Paragraph_Style!█", Replace=filter_2, RecursiveReplace=False)
rep_3 = ReplaceText(Text=rep_2, Find=panel_2, Replace=cell_content, RecursiveReplace=False)

# ----
panel_3 = Panel("""<CellStyle:\[None\]><StylePriority:0><CellStart:1,1><ParaStyle:NormalParagraphStyle>█!cell_content!█<CellEnd:>
<CellStyle:\[None\]><StylePriority:0><CellStart:1,1><ParaStyle:NormalParagraphStyle><CellEnd:>
<CellStyle:\[None\]><StylePriority:0><CellStart:1,1><ParaStyle:NormalParagraphStyle>█!cell_content!█<CellEnd:>""")
panel_4 = Panel(cell_content)
# the question is how to delete the content in the cells below the merged cell
# 
# If the merging is set up before the content is added it may be easier becasue you can remove the █!cell_content!█ from the line in the matrix
rep_4 = ReplaceText(Text=panel_3, Find=panel_2, Replace=cell_content, RecursiveReplace=False)
R = ClusterOutput(rep_3)
panel_5 = Panel(rep_4)

# ==== cluster Cluster_2
row_height = ClusterInput()  # Hieght of the Row, Defaluts to 17.66 if no input
table_contents = ClusterInput()

flip = FlipMatrix(Data=table_contents)
lng = ListLength(List=flip)  # -> flatten(Length)
sort = SortList(Keys=lng)  # -> Keys, ValuesA
rev = ReverseList(List=sort.Keys)
item = ListItem(List=rev, Index=0, Wrap=True)

# ---- group: Count Columns
lng_2 = ListLength(List=flip)  # -> flatten(Length)
lng_3 = ListLength(List=lng_2)

# ----
col_width = ClusterInput()

# ----
# Columns
# Rows
panel = Panel(lng_3)
panel_2 = Panel(item)

series = Series(Start=0, Step=1, Count=panel_2)
table_style = ClusterInput()

# ---- group: Wrap <ROW>
panel_3 = Panel("<RowStart:<tRowAttrHeight:█!row_height!█><tRowAttrMinRowSize:█!row_height!█>>█!row_content!█<RowEnd:>")
null = NullItem(Item=row_height)  # -> NullFlags, InvalidFlags, Description
ma = MassAddition(Input=flatten(null.NullFlags))  # -> Result, PartialResults
filter = StreamFilter(Gate=ma.Result, Stream0=row_height, Stream1="17.66")
join = TextJoin(Text=table_contents)  # -> flatten(Result)

# ----
long = LongestList(ListA=filter, ListB=series, PaddingMode=2)  # -> ListA, ListB

# ---- group: Wrap <ROW> (continued)
rep = ReplaceText(Text=panel_3, Find="█!row_height!█", Replace=long.ListA, RecursiveReplace=False)  # -> flatten(Result)
rep_2 = ReplaceText(Text=rep, Find="█!row_content!█", Replace=join, RecursiveReplace=False)
join_2 = TextJoin(Text=rep_2)

# ---- group: Wrap <Column>
null_2 = NullItem(Item=col_width)  # -> NullFlags, InvalidFlags, Description
ma_2 = MassAddition(Input=flatten(null_2.NullFlags))  # -> Result, PartialResults
filter_2 = StreamFilter(Gate=ma_2.Result, Stream0=col_width, Stream1="130.8")

series_2 = Series(Start=0, Step=1, Count=panel)
long_2 = LongestList(ListA=filter_2, ListB=series_2, PaddingMode=2)  # -> ListA, ListB

rep_3 = ReplaceText(Text="<ColStart:<tColAttrWidth:█!col_width!█>>", Find="█!col_width!█", Replace=long_2.ListA, RecursiveReplace=False)  # -> flatten(Result)
merge = Merge(Data1=simplify(rep_3), Data2=simplify(join_2))
join_3 = TextJoin(Text=merge)

# ----
panel_4 = Panel(join_3)

# ---- group: Wrap <TABLE>
null_3 = NullItem(Item=table_style)  # -> NullFlags, InvalidFlags, Description
panel_5 = Panel("<TableStyle:█!table_style!█><TableStart:█!num_rows!█,█!num_cols!█:0:0<tCellDefaultCellType:Text>>█!table_content!█<TableEnd:>")
ma_3 = MassAddition(Input=null_3.NullFlags)  # -> Result, PartialResults
filter_3 = StreamFilter(Gate=ma_3.Result, Stream0=table_style, Stream1="\[Basic Table\]")

# ----
rep_4 = ReplaceText(Text=panel_5, Find="█!table_style!█", Replace=filter_3, RecursiveReplace=False)

# ---- group: Wrap <TABLE> (continued)
rep_5 = ReplaceText(Text=rep_4, Find="█!num_rows!█", Replace=panel_2, RecursiveReplace=False)
rep_6 = ReplaceText(Text=rep_5, Find="█!num_cols!█", Replace=panel, RecursiveReplace=False)
rep_7 = ReplaceText(Text=rep_6, Find="█!table_content!█", Replace=join_3, RecursiveReplace=False)
R = ClusterOutput(rep_7)

# ==== cluster Cluster_3
table_content = ClusterInput()
cell_position = ClusterInput()
merge = ClusterInput()
on_off = ClusterInput()

# ---- group: Bring in position, convert to matrix index
cell_position_2 = Text(cell_position)
split = TextSplit(Text=cell_position_2, Separators=",")
expression = Expression(x=split, Expression="ceiling(x-1)")
item = ListItem(List=expression, Index=0, Wrap=True)  # -> simplify(Item), simplify(Item1)

# ----
merge_2 = Text(merge)
split_2 = TextSplit(Text=merge_2, Separators=",")
item_2 = ListItem(List=split_2, Index=0, Wrap=True)  # -> Item, Item1

# ---- group: Columns_Location
columns = Data(item.Item)

# ---- group: Rows_Location
rows = Data(item.Item1)

# ----
number_of_columns_merged = Data(item_2.Item)
number_of_rows_merged = Data(item_2.Item1)
panel = Panel(cell_position_2)

# ----
# For each column location, create a list with index of columns impacted, *that starts at the column location*
# 
# Do again for each row location
series = Series(Start=rows, Step=1, Count=number_of_rows_merged)
series_2 = Series(Start=columns, Step=1, Count=number_of_columns_merged)
int = Integer(series_2)
int_2 = Integer(series)

# ----
# If you cross reference the cells impacted by the merging, you are left with the cordinates of all the cells that will need to be editted,
# 
# Use "expression" to put the cordinates back together
# 
# The cross reference takes advantage that the first set of xreferenced cells is the cell that IS NOT delete, we can cull this from the list,
crossref = CrossReference(ListA=int, ListB=int_2, CrossMode=1)  # -> ListA, ListB
expression_2 = Expression(x=crossref.ListA, y=crossref.ListB, Expression="Format(\"{0},{1}\", x, y)")
cull_i = CullIndex(List=expression_2, Indices=0, Wrap=True)  # -> simplify(flatten(List))

# ---- group: Find Location of Cells that will be merged
# Create a tree structure for the data that can be used (each branch named with a single index):
# 
# {0;0} > {0}
# {0;1} > {1}
# etc
viewer = ParamViewer(table_content)
branch = TreeBranch(Tree=table_content, Path=viewer, MaintainPaths=False)

# ---- group: Reverse the column,rows to input into code
expression_3 = Expression(x=number_of_rows_merged, y=number_of_columns_merged, Expression="Format(\"{0},{1}\", x, y)")  # -> flatten(R)

# ---- group: Find Location of Cells that will be merged
# Find the path of each Column
viewer_2 = ParamViewer(columns)

# Construct paths that tell which branch has the row information,
path = ConstructPath(Indices=rows)  # -> flatten(Branch)

# Create a tree structure with the same structure as the input data
# 
# Use <null>, and then remove the nulls so you have an empty tree
expression_4 = Expression(Expression="x/0")
long = LongestList(ListA=branch, ListB=expression_4, PaddingMode=2)  # -> ListA, ListB
clean = CleanTree(RemoveNulls=True, RemoveInvalid=True, RemoveEmpty=False, Tree=long.ListB)

# Need to find the row (branch) and the column that needs to be replaced (line),
# 
# The index for the branches will now reflect which Row the data is in, the listed number represents the column index
replace = ReplacePaths(Data=columns, Search=viewer_2, Replace=path)

# ----
# Create a set of index that show the {row} and column of each line that needs to be replaced
panel_2 = Panel(",")
split_3 = TextSplit(Text=cull_i, Separators=panel_2)
item_3 = ListItem(List=split_3, Index=0, Wrap=True)  # -> simplify(Item), simplify(Item1)
viewer_3 = ParamViewer(item_3.Item)
path_2 = ConstructPath(Indices=item_3.Item1)  # -> flatten(Branch)
replace_2 = ReplacePaths(Data=item_3.Item, Search=viewer_3, Replace=path_2)

# ---- group: Create Data Structure
graft = GraftTree(Tree=expression_3, IncludeEmptyLists=True, IncludeNullItems=True)  # -> simplify(Tree)
viewer_4 = ParamViewer(graft)
replace_3 = ReplacePaths(Data=graft, Search=viewer_4, Replace=path)
merge_3 = Merge(Data1=clean, Data2=replace_3)

# ---- group: Find Location of Cells that will be merged
# Put the row,column indexing back in to the tree structure, {row location}
# 
# column is the number (which is the line in that branch)
merge_4 = Merge(Data1=clean, Data2=replace)

# using the paths created, search each {row} and find each index (column)
item_4 = ListItem(List=branch, Index=merge_4, Wrap=True)

# ----
# Find and replace the text in the cell lines
expression_5 = Expression(x=merge_3, Expression="Format(\"<CellStart:{0}>\", x)")
null = NullItem(Item=merge_3)  # -> NullFlags, InvalidFlags, Description
dispatch = Dispatch(List=expression_5, DispatchPattern=null.NullFlags)  # -> ListA, ListB
rep = ReplaceText(Text=item_4, Find="<CellStart:1,1>", Replace=dispatch.ListB, RecursiveReplace=False)

# ----
# merge back in to orginal data structure
merge_5 = Merge(Data1=clean, Data2=replace_2)

panel_3 = Panel("<CellStyle:\[None\]><StylePriority:0><CellStart:1,1><CellEnd:>")
replace_4 = ReplaceItems(List=branch, Item=rep, Indices=merge_4, Wrap=False)

# ----
# islatte the lines to be removed, based on the indice of the cells to be deleted
item_5 = ListItem(List=replace_4, Index=merge_5, Wrap=True)

long_2 = LongestList(ListA=item_5, ListB=panel_3, PaddingMode=2)  # -> ListA, ListB
replace_5 = ReplaceItems(List=replace_4, Item=panel_3, Indices=merge_5, Wrap=False)
on_off_2 = Data(on_off)
equals = Equality(FirstNumber=on_off_2, SecondNumber="True")  # -> Equality, Inequality
filter = StreamFilter(Gate=equals.Equality, Stream0=table_content, Stream1=replace_5)
s_0 = ClusterOutput(filter)

# ==== cluster Cluster_4
data = ClusterInput()
data_2 = Data(data)
panel = Panel("""<ASCII-WIN>
<Version:12.1><FeatureSet:InDesign-Roman><ColorTable:=<Black:COLOR:CMYK:Process:0,0,0,1><Paper:COLOR:CMYK:Process:0,0,0,0>><DefineParaStyle:NormalParagraphStyle=<Nextstyle:NormalParagraphStyle>><DefineTableStyle:\[Basic Table\]=><ParaStyle:NormalParagraphStyle>""")
merge = Merge(Data1=panel, Data2=data_2)
join = TextJoin(Text=merge)
rep = ReplaceText(Text=join, Find="<br>", RecursiveReplace=False)
data_3 = Data(rep)
data_4 = ClusterOutput(data_3)

# ==== cluster FileWrite
content = ClusterInput()
file_path = ClusterInput()
activate = ClusterInput()
T = ClusterInput()
content_2 = Data(content)
file_path_2 = Text(file_path)
join = TextJoin(Text=[file_path_2, T], Join="\")
vb = VBScript(path=simplify(join), lines=simplify(content_2), activate=activate)  # -> out, A
# ---------- vb: VB ----------
    If (activate = True)
      
      system.IO.File.WriteAllText(path, lines)
      A = "File written"
    Else
      A = "Not activated"
    End If
# ---------- end vb ----------
