# Grasshopper definition 06 Screenshot (training file).gh (Grasshopper 0.9.76)
# plug-ins: Python Interpreter, Anemone

# ---- group: Resolution
number_slider = Slider(9, range=0..10)

# ---- group: CHANGE RESOLUTION
high_res = BooleanToggle(False)

# ---- group: TAKE SCREENSHOT
toggle = BooleanToggle(False)

# ---- group: Current Option
data = Data()

# ----
# S C R E E N  S H O T
named_views = Panel("""View1
View2""")
filter = StreamFilter(Gate=high_res, Stream0=1, Stream1=number_slider)
file_path = Panel("R:\Planning\Scripts\Grasshopper\Planning_Clean\Screenshots")
multiplication = Multiplication(A="1854", B=filter)
multiplication_2 = Multiplication(A="784", B=filter)
filter_2 = StreamFilter(Gate=high_res, Stream0="_LR", Stream1="_HR")
concat = Concatenate(FragmentA=data, FragmentB=filter_2)

# ---- group: LOOP THROUGH VIEWS
lng = ListLength(List=named_views)
loop_start = LoopStart(Repeat=expr("x-1", lng), Trigger=toggle, Data=-1)  # -> port, Counter, Data
expression = Expression(x=loop_start.Data, Expression="x+1")
loop_end = LoopEnd(port=loop_start.port, Exit=False, Data=expression, pausedState=False, state="Constant output", TimeOutVal=0)

# ----
item = ListItem(List=named_views, Index=loop_end, Wrap=True)

captureview = Ladybug_CaptureView(
    fileName=concat,
    folder=file_path,
    viewNames=item,
    imageWidth=multiplication,
    imageHeight=multiplication_2,
    displayMode="Ghosted",
    capture=toggle)  # -> imagePath; plug-in component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
