# Grasshopper definition 07 Rendered Trees (training file).gh (Grasshopper 0.9.76)
# Copyright: Co-de-iT
# plug-ins: Python Interpreter, Human

# Parent::Child::Another Child
layer_references = Panel("TREE::Swale*")

# ---- group: PNG EXPORT
dpi = Panel("300")
button = Button()

# ---- group: HTML FILE
file_name = Panel("Tree-Export-Option1.html")
file_path = Panel("K:\2017\217011.00\11.0 DRAWINGS\11.04 Rhino\TREE RENDER FILES\Export")
toggle = BooleanToggle(False)

# ---- group: Set Page Size
drawing_scale = Panel("1:4110")
pt = Point(Point(-1688.631885, 657.36305, 0))
paper = Panel("A1 (L)")
list = ValueList({"By Point": False, "By Rectangle": True}, selected="By Point")
rec = Rectangle({Plane=PlaneXY(-1688.631885, -1786.914156, 0), Size=Domain2(u=0..3456.772602, v=0..2444.277206)})

# ---- group: Shadow Direction
knob = ControlKnob(Decimals=2, Limit=True, Maximum=360, Minimum=0, Range=360, Value=134.2)

# ----
layer_references_2 = Panel("TREE::*")
layer_references_3 = Panel("Block")
dpipeline = DynamicGeometryPipeline(
    LayerFilter=layer_references_2,
    TypeFilter=layer_references_3,
    NameFilter="*",
    enableFullPath=True,
    GroupByLayer=False,
    GroupByType=False,
    IncludeHidden=True,
    IncludeLocked=True,
    listenToAttriubtes=True)  # -> flatten(GeometryOut)

# ---- group: Assigning Types
tree_reference_folder = Panel("""AM-58-041
AM
AM-52-025
AM-42-004""")
panel = Panel("""Tree 1
Tree 2
Tree 3
Tree 4""")

# ----
collects_trees = Panel("blocks")

layer_references_4 = Panel("Trees::*")
layer_references_5 = Panel("Curve")
dpipeline_2 = DynamicGeometryPipeline(
    LayerFilter=layer_references_4,
    TypeFilter=layer_references_5,
    NameFilter="*",
    enableFullPath=True,
    GroupByLayer=False,
    GroupByType=False,
    IncludeHidden=True,
    IncludeLocked=True,
    listenToAttriubtes=True)  # -> flatten(GeometryOut)

collects_trees_2 = Panel("curves")
tree_scale_factor = Slider(3.8, range=1..5)
list_2 = ValueList({"Blocks": False, "Curves": True}, selected="Curves")
blockexplode = ExplodeBlocks(BlockObjects=dpipeline, explodeGeom=True)  # -> Geometry, Attributes, BlockName, BoundingBox, BlockTransform
data = Data(dpipeline_2)
data_2 = Data(dpipeline)
item = ListItem(List=blockexplode.Geometry, Index=0, Wrap=True)  # -> flatten(Item)
weave = Weave(Pattern=list_2, Stream0=data_2, Stream1=data, NullGaps=False)
data_3 = Data(item)
data_4 = Data(dpipeline_2)
weave_2 = Weave(Pattern=list_2, Stream0=data_3, Stream1=data_4, NullGaps=False)
tree_reference_firefox = Panel("K:\Computational Design Group\03_Resources\Rendering\Trees\LIBRARY\`\TREEBeauty~.png")
objatts = ObjectAttributes(ObjectOrAttributes=weave)  # -> Name, LayerName, LayerFullPath, Color, MaterialName, LinetypeName, GroupIndices, PlotWeight, UserDataKeys, UserDataValues
cset = CreateSet(List=objatts.LayerName)  # -> Set, Map
panel_2 = Panel(cset.Set)
panel_3 = Panel("X:\03_Resources\Rendering\Trees\LIBRARY")
crv = Curve([<curve referenced from the Rhino model> x313])
bbox = BoundingBox(Content=crv, Plane=PlaneXY(0, 0, 0))  # -> Box, Box_2
series = Series(Start=0, Step=10, Count=36)
int = Integer(series)
box = EvaluateBox(
    Box=[{Plane=PlaneXY(0, 0, 0), X=Domain(83022.30029, 83029.29923), Y=Domain(69696.92392, 69703.90686), Z=Domain(0, 0)}, {Plane=PlaneXY(0, 0, 0), X=Domain(83032.05753, 83039.05646), Y=Domain(69695.47632, 69702.45926), Z=Domain(0, 0)}, {Plane=PlaneXY(0, 0, 0), X=Domain(83041.77306, 83048.77199), Y=Domain(69694.19019, 69701.17314), Z=Domain(0, 0)}, {Plane=PlaneXY(0, 0, 0), X=Domain(83051.22435, 83058.22328), Y=Domain(69692.20975, 69699.19269), Z=Domain(0, 0)}, {Plane=PlaneXY(0, 0, 0), X=Domain(83059.60855, 83066.60749), Y=Domain(69691.60038, 69698.58333), Z=Domain(0, 0)}, {Plane=PlaneXY(0, 0, 0), X=Domain(83069.05984, 83076.05877), Y=Domain(69690.22927, 69697.21221), Z=Domain(0, 0)}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],
    UParameter=0.5,
    VParameter=0.5,
    WParameter=0.5)  # -> Plane, Point, Include
debox = DeconstructBox(Box=[{Plane=PlaneXY(0, 0, 0), X=Domain(83022.30029, 83029.29923), Y=Domain(69696.92392, 69703.90686), Z=Domain(0, 0)}, {Plane=PlaneXY(0, 0, 0), X=Domain(83032.05753, 83039.05646), Y=Domain(69695.47632, 69702.45926), Z=Domain(0, 0)}, {Plane=PlaneXY(0, 0, 0), X=Domain(83041.77306, 83048.77199), Y=Domain(69694.19019, 69701.17314), Z=Domain(0, 0)}, {Plane=PlaneXY(0, 0, 0), X=Domain(83051.22435, 83058.22328), Y=Domain(69692.20975, 69699.19269), Z=Domain(0, 0)}, {Plane=PlaneXY(0, 0, 0), X=Domain(83059.60855, 83066.60749), Y=Domain(69691.60038, 69698.58333), Z=Domain(0, 0)}, {Plane=PlaneXY(0, 0, 0), X=Domain(83069.05984, 83076.05877), Y=Domain(69690.22927, 69697.21221), Z=Domain(0, 0)}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])  # -> Plane, X, Y, Z
expression = Expression(x=int, Expression="Format(\"000{0}\", x)")
bbox_2 = BoundingBox(Content=weave_2, Plane=PlaneXY(0, 0, 0))  # -> Box, Box_2
dedomain = DeconstructDomain(Domain=debox.X)  # -> Start, End
box_2 = EvaluateBox(Box=bbox_2.Box, UParameter=0.5, VParameter=0.5, WParameter=0.5)  # -> Plane, Point, Include
expression_2 = Expression(x=dedomain.Start, y=dedomain.End, Expression="y-x")
debox_2 = DeconstructBox(Box=bbox_2.Box)  # -> Plane, X, Y, Z
chars = Characters(Text=expression)  # -> reverse(Result), Unicode
lng = ListLength(List=weave_2)
circle = CircleCNR(Center=box.Point, Normal=Vector(0, 0, 1), Radius=expression_2)
dedomain_2 = DeconstructDomain(Domain=debox_2.X)  # -> Start, End
random = Random(Range=Domain(0, 36), Number=lng, Seed=6845)
item_2 = ListItem(List=chars.Result, Index=[0, 1, 2, 3], Wrap=True)  # -> reverse(Item)
long = LongestList(ListA=panel, ListB=tree_reference_folder, PaddingMode=2)  # -> ListA, ListB
expression_3 = Expression(x=dedomain_2.Start, y=dedomain_2.End, Expression="y-x")
int_2 = Integer(random)
join = TextJoin(Text=item_2)  # -> flatten(Result)
circle_2 = CircleCNR(Center=box_2.Point, Normal=Vector(0, 0, 1), Radius=expr("x/2", expression_3))
darc = DeconstructArc(Arc=circle_2)  # -> BasePlane, Radius, Angle
pt_2 = Point(darc.BasePlane)
circle_3 = CircleCNR(Center=pt_2, Normal=Vector(0, 0, 1), Radius=darc.Radius)
bbox_3 = BoundingBox(Content=circle_3, Plane=PlaneXY(0, 0, 0))  # -> Box, Box_2
expression_4 = Expression(x=int_2, Expression="x*10")
debox_3 = DeconstructBox(Box=bbox_3.Box)  # -> Plane, X, Y, Z
rep = ReplaceText(Text=tree_reference_firefox, Find="~", Replace=join, RecursiveReplace=False)  # -> flatten(Result)
expression_5 = Expression(x=knob, y=expression_4, Expression="((360-x)-y)/10")
replace = ReplaceMembers(Set=objatts.LayerName, Find=long.ListA, Replace=long.ListB)
item_3 = ListItem(List=rep, Index=expression_5, Wrap=True)
cset_2 = CreateSet(List=replace)  # -> Set, Map
long_2 = LongestList(ListA=item_3, ListB=replace, PaddingMode=4)  # -> ListA, ListB
rep_2 = ReplaceText(Text=long_2.ListA, Find="`", Replace=long_2.ListB, RecursiveReplace=False)  # -> flatten(Result)
xy = XYPlane(Origin=pt)
neg = Negative(Value=Slider(0, range=0..100))
panel_4 = Panel(cset_2.Set)
rad = Radians(Degrees=neg)
svg_plane_by_rectangle = SVGPlaneByRectangle(R=rec)
rotate = Rotate(Geometry=xy, Angle=rad, Plane=xy)  # -> Geometry, Transform
svg_plane_by_page = SVGPlaneByPage(plane=rotate.Geometry, M=paper, T=drawing_scale, pos=False)  # -> R_2, R
rectangle = Rectangle(Plane=debox_3.Plane, XSize=debox_3.X, YSize=debox_3.Y, Radius=0)  # -> Rectangle, Length
data_5 = Data(svg_plane_by_rectangle)
data_6 = Data(svg_plane_by_page.R_2)
rep_3 = ReplaceText(Text=rep_2, Find="TREE", Replace="SHADOW", RecursiveReplace=False)
geo = Geometry(svg_plane_by_page.R)
area = Area(Geometry=rectangle.Rectangle)  # -> Area, Centroid
crv_2 = Curve(svg_plane_by_page.R)
weave_3 = Weave(Pattern=list, Stream0=data_6, Stream1=data_5, NullGaps=False)
rotate_2 = Rotate(Geometry=rectangle.Rectangle, Angle=degrees(expression_4), Plane=area.Centroid)  # -> Geometry, Transform
scale = Scale(Geometry=rotate_2.Geometry, Center=area.Centroid, Factor=tree_scale_factor)  # -> Geometry, Transform
svg_image = SVGImage(img_pa=rep_2, rec=scale.Geometry, data=weave_3)
svg_image_2 = SVGImage(img_pa=rep_3, rec=scale.Geometry, data=weave_3)
join_2 = TextJoin(Text=svg_image_2)
rep_4 = ReplaceText(Text="<g opacity=\"1\">~</g>", Find="~", Replace=join_2, RecursiveReplace=False)
page_dimension_ratio = Panel("1")
svg = Text(svg_image)
svg_2 = Text(rep_4)
layout_split = LayoutSplit(T=weave_3)  # -> pl_2, data_3, data_4
merge = Merge(Data2=svg)
expression_6 = Expression(x=layout_split.data_3, y=page_dimension_ratio, Expression="x*y")
html_compiler = HTMLCompiler(svg_text=merge, layout=weave_3)
html_compiler_2 = HTMLCompiler(svg_text=svg_2, layout=weave_3)
panel_5 = Panel(layout_split.data_3)
dpi_2 = Panel("150")
expression_7 = Expression(x=expression_6, Expression="x/25.4")
expression_8 = Expression(x=expression_7, y=dpi_2, Expression="ceiling(x*y)")
item_4 = ListItem(List=expression_8, Index=0, Wrap=True)  # -> Item, Item1
int_3 = Integer(item_4.Item1)
int_4 = Integer(item_4.Item)
txt = Text(int_4)
txt_2 = Text(int_3)
rep_5 = ReplaceText(Text=file_name, Find=".html", Replace="_SHAD.html", RecursiveReplace=False)
html_to_jpeg = COX_HTMLToJPEG(folder=file_path, height=txt_2, width=txt, ACTIVATE=button)
# ---------- html_to_jpeg: Python ----------
import os 
import time 


svgs = [] 
match = "html" 

paths = os.listdir(folder) 


for path in paths: 
    if match in path: 
        svgs.append(path) 

print svgs 
jpgs = [os.path.splitext(x)[0] + '.png' for x in svgs] 
print jpgs 

svgs = [folder+"\\" + x for x in svgs] 
jpgs = [folder+"\\" + x for x in jpgs] 


for i in range(len(svgs)): 
    HTML = svgs[i] 
    JPG = jpgs[i] 
    cmdString2 = 'X:\\wkhtmltopdf\\bin\\wkhtmltoimage --transparent --height '+height+' --width '+width+'  "file:///' + HTML + '" "' + JPG + '"' 
    print cmdString2
    if ACTIVATE == True: 
        os.system(cmdString2)
# ---------- end html_to_jpeg ----------
file_write = FileWrite(content=html_compiler_2, file_path=file_path, T=rep_5, activate=toggle)
file_write_2 = FileWrite(content=html_compiler, file_path=file_path, T=file_name, activate=toggle)

# ==== cluster SVGImage
img_pa = ClusterInput()  # IMG PA
rec = ClusterInput()
data = ClusterInput()
data_2 = Data(data)
layout_split = LayoutSplit(T=data)  # -> pl_2, data_3, data_4
txt = Text(img_pa)
rec_2 = Rectangle(rec)
lng = ListLength(List=rec_2)
null = NullItem(Item=layout_split.data_4)  # -> NullFlags, InvalidFlags, Description
repeat = RepeatData(Data=txt, Length=lng)
dispatch = Dispatch(List="1", DispatchPattern=null.NullFlags)  # -> ListA, ListB
drec = DeconstuctRectangle(Rectangle=rec_2)  # -> BasePlane, XInterval, YInterval
panel = Panel(repeat)
merge = Merge(Data1=layout_split.data_4, Data2=dispatch.ListA)
dedomain = DeconstructDomain(Domain=drec.XInterval)  # -> Start, End
dedomain_2 = DeconstructDomain(Domain=drec.YInterval)  # -> Start, End
num = Number(merge)
lng_2 = ListLength(List=layout_split.pl_2)
expression = Expression(x=dedomain.Start, y=dedomain.End, Expression="y-x")
expression_2 = Expression(x=dedomain_2.Start, y=dedomain_2.End, Expression="y-x")
dedomain_3 = DeconstructDomain(Domain=expression_2)  # -> Start, End
repeat_2 = RepeatData(Data=num, Length=lng_2)
dom = ConstructDomain(DomainStart=dedomain_3.Start, DomainEnd=expr("-x", dedomain_3.End))
xy = XYPlane(Origin=Point(0, 0, 0))
expression_3 = Expression(x=repeat_2, Expression="1/x")
rectangle = Rectangle(Plane=layout_split.pl_2, XSize=expression, YSize=dom, Radius=0)  # -> Rectangle, Length
scale = Scale(Geometry=rectangle.Rectangle, Center=layout_split.pl_2, Factor=expression_3)  # -> Geometry, Transform
scale_2 = Scale(Geometry=rec_2, Center=layout_split.pl_2, Factor=expression_3)  # -> Geometry, Transform
orient = Orient(Geometry=scale.Geometry, Source=layout_split.pl_2, Target=xy)  # -> Geometry, Transform
orient_2 = Orient(Geometry=scale_2.Geometry, Source=layout_split.pl_2, Target=xy)  # -> Geometry, Transform
attributes = ClusterInput()
dims = Domain²(layout_split.data_3)
attributes_2 = Data(attributes)
explode = Explode(Curve=orient_2.Geometry, Recursive=True)  # -> Segments, Vertices
explode_2 = Explode(Curve=orient.Geometry, Recursive=True)  # -> Segments, Vertices
graft = GraftTree(Tree=attributes_2, IncludeEmptyLists=True, IncludeNullItems=True)  # -> simplify(Tree)
null_2 = NullItem(Item=graft)  # -> NullFlags, InvalidFlags, Description
dispatch_2 = Dispatch(List="attributes=\"empty\"", DispatchPattern=null_2.NullFlags)  # -> ListA, ListB
item = ListItem(List=explode.Vertices, Index=-2, Wrap=True)
xy_2 = XYPlane(Origin=item)
item_2 = ListItem(List=explode.Vertices, Index=-3, Wrap=True)
item_3 = ListItem(List=explode_2.Vertices, Index=-2, Wrap=True)
xy_3 = XYPlane(Origin=item_3)
dedomain_4 = DeconstructDomain(Domain=drec.YInterval)  # -> Start, End
item_4 = ListItem(List=explode_2.Vertices, Index=-3, Wrap=True)
dedomain_5 = DeconstructDomain(Domain=drec.XInterval)  # -> Start, End
merge_2 = Merge(Data1=graft, Data2=dispatch_2.ListA)  # -> flatten(Result)
expression_4 = Expression(x=dedomain_5.Start, y=dedomain_5.End, Expression="abs(y-x)")
expression_5 = Expression(x=dedomain_4.Start, y=dedomain_4.End, Expression="abs(y-x)")
vec2pt = Vector2Pt(PointA=item_3, PointB=item_4, Unitize=False)  # -> Vector, Length
align = AlignPlane(Plane=xy_3, Direction=vec2pt.Vector)  # -> Plane, Angle
vec2pt_2 = Vector2Pt(PointA=item, PointB=item_2, Unitize=False)  # -> Vector, Length
align_2 = AlignPlane(Plane=xy_2, Direction=vec2pt_2.Vector)  # -> Plane, Angle
orient_3 = Orient(Geometry=orient.Geometry, Source=flatten(align.Plane), Target=flatten(align_2.Plane))  # -> Geometry, simplify(Transform)
panel_2 = Panel(merge_2)
orient_4 = OrientDirection(
    Geometry=orient.Geometry,
    PointA=flatten(item_3),
    DirectionA=flatten(vec2pt.Vector),
    PointB=flatten(item),
    DirectionB=flatten(vec2pt_2.Vector))  # -> Geometry, simplify(Transform)
expression_6 = Expression(x=expression_5, y=repeat_2, Expression="x/y")
expression_7 = Expression(x=expression_4, y=repeat_2, Expression="x/y")
cull_i = CullIndex(List=explode.Vertices, Indices=0, Wrap=True)
dematrix = DeconstructMatrix(Matrix=orient_3.Transform)  # -> Rows, Columns, simplify(Values)
avr = Average(Input=cull_i)
panel_3 = Panel(dematrix.Values)
plcoord = PlaneCoordinates(Point=simplify(avr), System=simplify(layout_split.pl_2))  # -> XCoordinate, YCoordinate, ZCoordinate
panel_4 = Panel("""3
7""")
panel_5 = Panel("""0
1
4
5""")
item_5 = ListItem(List=dematrix.Values, Index=panel_5, Wrap=True)
item_6 = ListItem(List=dematrix.Values, Index=panel_4, Wrap=True)
dedom2 = DeconstructDomain²(Domain=dims)  # -> UComponent, VComponent
dispatch_3 = Dispatch(List=item_6, DispatchPattern=[True, False])  # -> ListA, ListB
dedomain_6 = DeconstructDomain(Domain=dedom2.VComponent)  # -> Start, End
dedomain_7 = DeconstructDomain(Domain=dedom2.UComponent)  # -> Start, End
expression_8 = Expression(x=dispatch_3.ListB, Expression="-(x)")
expression_9 = Expression(x=dedomain_6.Start, y=dedomain_6.End, Expression="-((y-x)+((y-x)/3))")
expression_10 = Expression(x=dedomain_7.Start, y=dedomain_7.End, Expression="(y-x)+((y-x)/3)")
expression_11 = Expression(x=dedomain_7.Start, y=dedomain_7.End, Expression="-((y-x)/3)")
expression_12 = Expression(x=dedomain_6.Start, y=dedomain_6.End, Expression="((y-x)/3)")
merge_3 = Merge(Data1=simplify(item_5), Data2=simplify(dispatch_3.ListA), Data3=simplify(expression_8))
join = TextJoin(Text=merge_3, Join=" ")
dom_2 = ConstructDomain(DomainStart=expression_12, DomainEnd=expression_9)
dom_3 = ConstructDomain(DomainStart=expression_11, DomainEnd=expression_10)
rep = ReplaceText(Text="onerror=\"this.src='file:///~'\"", Find="~", Replace=repeat, RecursiveReplace=False)
rep_2 = ReplaceText(Text="xlink:href=\"~\"", Find="~", Replace=repeat, RecursiveReplace=False)
rep_3 = ReplaceText(Text="height=\"~\"", Find="~", Replace=expression_6, RecursiveReplace=False)
rep_4 = ReplaceText(Text="width=\"~\"", Find="~", Replace=expression_7, RecursiveReplace=False)
rep_5 = ReplaceText(Text="transform=\"matrix(~)\"", Find="~", Replace=join, RecursiveReplace=False)
inc = Includes(Value=plcoord.XCoordinate, Domain=dom_3)  # -> Includes, Deviation
inc_2 = Includes(Value=plcoord.YCoordinate, Domain=dom_2)  # -> Includes, Deviation
data_3 = Data(flatten(rep))
data_4 = Data(flatten(rep_2))
data_5 = Data(flatten(rep_3))
data_6 = Data(flatten(rep_4))
data_7 = Data(flatten(rep_5))
ma = MassAddition(Input=inc.Includes)  # -> Result, PartialResults
ma_2 = MassAddition(Input=inc_2.Includes)  # -> Result, PartialResults
bool = Boolean(ma.Result)
bool_2 = Boolean(ma_2.Result)
merge_4 = Merge(
    Data1=simplify(graft(merge_2)),
    Data3=simplify(graft(data_6)),
    Data4=simplify(graft(data_5)),
    Data5=simplify(graft(data_7)),
    Data6=simplify(graft(data_4)),
    Data7=simplify(graft(data_3)))
and = GateAnd(A=bool, B=bool_2)
or = GateOr(A=and)  # -> flatten(Result)
join_2 = TextJoin(Text=merge_4, Join=" ")  # -> simplify(Result)
rep_6 = ReplaceText(Text="<image ~/>", Find="~", Replace=join_2, RecursiveReplace=False)
data_8 = Data(flatten(rep_6))
dispatch_4 = Dispatch(List=simplify(data_8), DispatchPattern=or)  # -> ListA, ListB
clean = CleanTree(RemoveNulls=True, RemoveInvalid=True, RemoveEmpty=True, Tree=dispatch_4.ListA)
svg = Text(dispatch_4.ListB)
panel_6 = Panel(svg)
svg_2 = ClusterOutput(svg)

# ==== cluster FileWrite
content = ClusterInput()
file_path = ClusterInput()
activate = ClusterInput()
T = ClusterInput()
content_2 = Data(content)
file_path_2 = Text(file_path)
join = TextJoin(Text=[file_path_2, T], Join="\")
vb = VBScript(path=simplify(join), lines=simplify(content_2), activate=activate)  # -> out, A
# ---------- vb: VB ----------
    If (activate = True)
      
      system.IO.File.WriteAllText(path, lines)
      A = "File written"
    Else
      A = "Not activated"
    End If
# ---------- end vb ----------

# ==== cluster SVGPlaneByPage
panel = Panel("""A4 (L),297,210
A4 (P),210,297
A3 (L),420,297
A3 (P),297,420
A2 (P),420,594
A2 (L),594,420
A1 (L),841,594
A1 (P),594,841
A0 (L),1189,841
A0 (P),841,1189""")
M = ClusterInput()
split = TextSplit(Text=panel, Separators=",")
item = ListItem(List=split, Index=0, Wrap=True)  # -> flatten(Item), flatten(Item1), flatten(Item2)
T = ClusterInput()
mindex = MemberIndex(Set=item.Item, Member=simplify(M))  # -> simplify(flatten(Index)), Count
split_2 = TextSplit(Text=T, Separators=":")
plane = ClusterInput()
item_2 = ListItem(List=panel, Index=mindex.Index, Wrap=True)  # -> simplify(Item)
pos = ClusterInput()
panel_2 = Panel("""1,1
0.5,0.5""")
merge = Merge(Data1=simplify(item_2), Data2=simplify(M))
item_3 = ListItem(List=split_2, Index=0, Wrap=True)  # -> Item, Item1
expression = Expression(x=item_3.Item1, Expression="Format(\"{0}mm\", x)")
pos_2 = Boolean(pos)
item_4 = ListItem(List=merge, Index=0, Wrap=True)
docunits = ConvertToDocumentUnits(ValueString=expression)
item_5 = ListItem(List=panel_2, Index=pos_2, Wrap=True)
split_3 = TextSplit(Text=item_4, Separators=",")
split_4 = TextSplit(Text=item_5, Separators=",")
item_6 = ListItem(List=reverse(split_3), Index=[0, 1], Wrap=True)  # -> reverse(Item)
num = Number(docunits)
dispatch = Dispatch(List=split_4, DispatchPattern=[True, False])  # -> ListA, ListB
num_2 = Number(item_6)
plane_2 = Data(plane)
expression_2 = Expression(x=num_2, y=num, Expression="x*y")
dispatch_2 = Dispatch(List=expression_2, DispatchPattern=[True, False])  # -> ListA, ListB
dom = ConstructDomain(DomainStart=expr("-x", dispatch_2.ListA), DomainEnd=0)
dom_2 = ConstructDomain(DomainStart=expr("-x", dispatch_2.ListB), DomainEnd=0)
remap = RemapNumbers(Value=dispatch.ListA, Source=Domain(0, 1), Target=dom)  # -> Mapped, Clipped
remap_2 = RemapNumbers(Value=dispatch.ListB, Source=Domain(0, 1), Target=dom_2)  # -> Mapped, Clipped
pt = PointOriented(BasePlane=plane_2, UComponent=remap.Mapped, VComponent=expr("-x", remap_2.Mapped), WComponent=0)
pl_origin = PlaneOrigin(Base=plane_2, Origin=pt)
plane_3 = Plane(flatten(pl_origin))
deplane = DeconstructPlane(Plane=plane_3)  # -> simplify(Origin), simplify(XAxis), simplify(YAxis), ZAxis
expression_3 = Expression(x=remap_2.Mapped, y=dispatch_2.ListB, Expression="x+y")
expression_4 = Expression(x=remap.Mapped, y=dispatch_2.ListA, Expression="x+y")
dims = Number(flatten(num_2))
pt_2 = Point(deplane.Origin)
pt_3 = Point(deplane.XAxis)
pt_4 = Point(deplane.YAxis)
dom_3 = ConstructDomain(DomainStart=remap.Mapped, DomainEnd=expression_4)
y_dim = Domain(dom_3)
dom_4 = ConstructDomain(DomainStart=remap_2.Mapped, DomainEnd=expression_3)
x_dim = Domain(dom_4)
neg = Negative(Value=x_dim)
merge_2 = Merge(Data1=simplify(pt_2), Data2=simplify(pt_3), Data3=simplify(pt_4))  # -> simplify(Result)
rectangle = Rectangle(Plane=plane_2, XSize=y_dim, YSize=neg, Radius=0)  # -> Rectangle, Length
scale = Number(flatten(num))
pt2num = PointsToNumbers(Points=merge_2, Mask=4)  # -> simplify(Numbers)
path_mapper = PathMapper(scale, source="{0}", target="{0;2}")
path_mapper_2 = PathMapper(dims, source="{0}", target="{0;1}")
path_mapper_3 = PathMapper(plane_3, source="{0}", target="{0;0}")
join = TextJoin(Text=pt2num, Join=",")  # -> simplify(Result)
join_2 = TextJoin(Text=dims, Join=",")  # -> simplify(Result)
merge_3 = Merge(Data1=path_mapper_3, Data2=path_mapper_2, Data3=path_mapper)  # -> simplify(Result)
rep = ReplaceText(Text="~;", Find="~", Replace=simplify(join_2), RecursiveReplace=False)  # -> simplify(Result)
rep_2 = ReplaceText(Text="~", Find="~", Replace=simplify(scale), RecursiveReplace=False)  # -> simplify(Result)
rep_3 = ReplaceText(Text="~;", Find="~", Replace=simplify(join), RecursiveReplace=False)  # -> simplify(Result)
merge_4 = Merge(Data1=flatten(rep_3), Data2=flatten(rep), Data3=flatten(rep_2))
R = ClusterOutput(rectangle.Rectangle)
join_3 = TextJoin(Text=merge_4)
panel_3 = Panel(join_3)
R_2 = ClusterOutput(join_3)
panel_4 = Panel(merge_3)

# ==== cluster SVGPlaneByRectangle
R = ClusterInput()
drec = DeconstuctRectangle(Rectangle=R)  # -> BasePlane, XInterval, YInterval
split = TextSplit(Text="1:1", Separators=":")
dedomain = DeconstructDomain(Domain=drec.YInterval)  # -> Start, flatten(End)
dedomain_2 = DeconstructDomain(Domain=drec.XInterval)  # -> Start, flatten(End)
item = ListItem(List=split, Index=0, Wrap=True)  # -> Item, Item1
expression = Expression(x=item.Item1, Expression="Format(\"{0}mm\", x)")
pln = Plane(drec.BasePlane)
merge = Merge(Data1=dedomain_2.End, Data2=dedomain.End)
deplane = DeconstructPlane(Plane=pln)  # -> Origin, XAxis, YAxis, ZAxis
amp = Amplitude(Vector=deplane.YAxis, Amplitude=dedomain.End)
Y = UnitY(Factor=dedomain.End)
pt = Point(drec.BasePlane)
move = Move(Geometry=pt, Motion=amp)  # -> Geometry, Transform
item_2 = ListItem(List=merge, Index=0, Wrap=True)  # -> Item, Item1
num = Number(merge)
docunits = ConvertToDocumentUnits(ValueString=expression)
num_2 = Number(docunits)
pl_origin = PlaneOrigin(Base=drec.BasePlane, Origin=move.Geometry)
plane = Data(pl_origin)
expression_2 = Expression(x=num, y=num_2, Expression="x*y")
dispatch = Dispatch(List=expression_2, DispatchPattern=[True, False])  # -> ListA, ListB
y_dim = Domain(dispatch.ListA)
x_dim = Domain(dispatch.ListB)
plane_2 = Plane(flatten(plane))
dims = Number(flatten(num))
neg = Negative(Value=x_dim)
rectangle = Rectangle(Plane=plane, XSize=y_dim, YSize=neg, Radius=0)  # -> Rectangle, Length
scale = Number(flatten(num_2))
path_mapper = PathMapper(scale, source="{0}", target="{0;2}")
path_mapper_2 = PathMapper(dims, source="{0}", target="{0;1}")
path_mapper_3 = PathMapper(plane_2, source="{0}", target="{0;0}")
deplane_2 = DeconstructPlane(Plane=path_mapper_3)  # -> Origin, XAxis, YAxis, ZAxis
pdecon = Deconstruct(Point=deplane_2.Origin)  # -> XComponent, YComponent, ZComponent
devec = DeconstructVector(Vector=deplane_2.XAxis)  # -> XComponent, YComponent, ZComponent
devec_2 = DeconstructVector(Vector=deplane_2.YAxis)  # -> XComponent, YComponent, ZComponent
merge_2 = Merge(
    Data1=pdecon.XComponent,
    Data2=pdecon.YComponent,
    Data3=pdecon.ZComponent,
    Data4=devec.XComponent,
    Data5=devec.YComponent,
    Data6=devec.ZComponent,
    Data7=devec_2.XComponent,
    Data8=devec_2.YComponent,
    Data9=devec_2.ZComponent)
join = TextJoin(Text=path_mapper_2, Join=",")
join_2 = TextJoin(Text=merge_2, Join=",")
txt = Text(path_mapper)
merge_3 = Merge(Data1=join_2, Data2=join, Data3=txt)  # -> simplify(flatten(Result))
join_3 = TextJoin(Text=merge_3, Join=",")
R_2 = ClusterOutput(join_3)

# ==== cluster HTMLCompiler
data = Data("█")
panel = Panel("""<html>
<style>
*{margin:0;}
</style>
<body>
<head>
</head>
<body>
<svg version="1.1" xmlns="http://www.w3.org/2000/svg" xmlns:xlink="http://www.w3.org/1999/xlink" x="0px" y="0px"
width="100%" height="100%" viewBox="0 0 420 297"
xml:space="preserve">
<style type="text/css">""")
svg_text = ClusterInput()
layout = ClusterInput()
css = ClusterInput()
layout_split = LayoutSplit(T=layout)  # -> pl_2, data_3, data_4
svg_text_2 = Data(svg_text)
rep = ReplaceText(Text=svg_text_2, Find="zindex=\"", Replace=data, RecursiveReplace=False)
split = TextSplit(Text=rep, Separators=data)
item = ListItem(List=reverse(split), Index=0, Wrap=True)
split_2 = TextSplit(Text=item, Separators="\"")
css_2 = Data(css)
item_2 = ListItem(List=split_2, Index=0, Wrap=True)
flatten = FlattenTree(Tree=item_2, Path="{0}")
num = Number(flatten)
nullrep = ReplaceNulls(Items=num, Replacements=0)  # -> Items, Count
dispatch = Dispatch(List=layout_split.data_3, DispatchPattern=[True, False])  # -> ListA, ListB
rep_2 = ReplaceText(Text="width=\"100%\" height=\"100%\" viewBox=\"0 0 ` ~\"", Find="`", Replace=dispatch.ListA, RecursiveReplace=False)
sort = SortList(Keys=nullrep.Items, ValuesA=svg_text_2)  # -> Keys, ValuesA
tstat = TreeStatistics(Tree=flatten(sort.ValuesA))  # -> Paths, Length, Count
rep_3 = ReplaceText(Text=rep_2, Find="~", Replace=dispatch.ListB, RecursiveReplace=False)  # -> simplify(Result)
viewer = ParamViewer("</svg>")
int = Integer(tstat.Count)
merge = Merge(Data2=panel, Data3=css_2, Data4="</style>")
repeat = RepeatData(Data=viewer, Length=int)
panel_2 = Panel(rep_3)
panel_3 = Panel("""</body>
</html>""")
branch = TreeBranch(Tree="</svg>", Path=repeat, MaintainPaths=False)
tmatch = MatchText(Text=merge, RegEx="viewBox", Case=True)
mindex = MemberIndex(Set=tmatch, Member=Toggle(True))  # -> Index, Count
replace = ReplaceItems(List=merge, Item=rep_3, Indices=mindex.Index, Wrap=False)  # -> simplify(List)
merge_2 = Merge(Data1=flatten(replace), Data2=flatten(sort.ValuesA), Data3=flatten(branch), Data4=flatten(panel_3))
svg_text_3 = Text(merge_2)
panel_4 = Panel(nullrep.Items)
rep_4 = ReplaceText(Text=svg_text_3, Find=" =\"\" ", Replace=" ", RecursiveReplace=False)
join = TextJoin(Text=rep_4)
html_content = Text(join)
html_content_2 = ClusterOutput(html_content)

# ==== cluster LayoutSplit: Splits the layout into plane, page and scale
T = ClusterInput()
split = TextSplit(Text=T, Separators=";")
split_2 = TextSplit(Text=split, Separators=",")
partition = PartitionList(List=split_2, Size=[9, 2, 1])  # -> simplify(Chunks)
branch = TreeBranch(Tree=partition, Path="{0}", MaintainPaths=True)
branch_2 = TreeBranch(Tree=partition, Path="{1}", MaintainPaths=True)
branch_3 = TreeBranch(Tree=partition, Path="{2}", MaintainPaths=True)
item = ListItem(List=branch, Index=0, Wrap=True)  # -> Item, Item1, Item2
item_2 = ListItem(List=branch, Index=3, Wrap=True)  # -> Item, Item1, Item2
item_3 = ListItem(List=branch, Index=6, Wrap=True)  # -> Item, Item1, Item2
pt = ConstructPoint(XCoordinate=item.Item, YCoordinate=item.Item1, ZCoordinate=item.Item2)
vec = VectorXYZ(XComponent=item_2.Item, YComponent=item_2.Item1, ZComponent=item_2.Item2)  # -> Vector, Length
vec_2 = VectorXYZ(XComponent=item_3.Item, YComponent=item_3.Item1, ZComponent=item_3.Item2)  # -> Vector, Length
pl = ConstructPlane(Origin=pt, XAxis=vec.Vector, YAxis=vec_2.Vector)
data = Data(branch_3)
data_2 = Data(branch_2)
data_3 = ClusterOutput(data_2)
data_4 = ClusterOutput(data)
pl_2 = ClusterOutput(pl)
