# Grasshopper definition 08 Shadows (training file).gh (Grasshopper 0.9.76)
# plug-ins: Python Interpreter, Human, EleFront

# S T E P  3
# S U N
server_location = Panel("T:\Personal Temp\s-rcollins\AUS_NSW.Sydney.947670_IWEC.epw")
# Find other locations here: https://www.energyplus.net/weather
web_location = Panel("https://energyplus.net/weather-download/southwest_pacific_wmo_region_5/AUS//AUS_NSW.Sydney.947670_IWEC/all")

# ----
# S T E P  1
# R E F E R E N C E    G E O M E T R Y
# M A I N   R E F    L A Y E R
panel = Panel("Bake")
concat = Concatenate(FragmentA=panel, FragmentC="::")

open_epw_stat = Ladybug_OpenEPWAndSTATWeatherFiles(weatherFileURL=web_location)  # -> epwFile, statFile; plug-in component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

layer_name = Panel("Resi")
concat_2 = Concatenate(FragmentA=concat, FragmentB=layer_name)
# add more buildings here
dpipeline = DynamicGeometryPipeline(
    LayerFilter=concat_2,
    TypeFilter="Mesh",
    NameFilter="*",
    enableFullPath=True,
    GroupByLayer=False,
    GroupByType=False,
    IncludeHidden=True,
    IncludeLocked=True,
    listenToAttriubtes=True)

# ---- group: CONNECT ONE OF THESE
data = Data(open_epw_stat.epwFile)
path = FilePath(server_location)

# ----
importepw = Ladybug_ImportEpw(epwFile=path)  # -> readMe, latitude, location, dryBulbTemperature, dewPointTemperature, relativeHumidity, windSpeed, windDirection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; plug-in component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
ladybug = Ladybug_Ladybug()  # -> Vviiiiiiiiiizzz; plug-in component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

# ---- group: time period
# T I M E    P E R I O D
number_slider = Slider(9, range=0..10)
number_slider_2 = Slider(6, range=0..10)
number_slider_3 = Slider(21, range=0..100)
analysisperiod = Ladybug_AnalysisPeriod(
    fromMonth=number_slider_2,
    fromDay=number_slider_3,
    fromHour=number_slider,
    toMonth=number_slider_2,
    toDay=number_slider_3,
    toHour=Slider(15, range=0..100))  # -> readMe, analysisPeriod; plug-in component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

# ----
merge = Merge(Data1=dpipeline)  # -> simplify(Result)
area = Area(Geometry=merge)  # -> Area, Centroid

# ---- group: NORTH!
vec = Vector(Vector(0, 191.4785182, 0))

# ----
item = ListItem(List=area.Centroid, Index=0, Wrap=True)
pt = Point(item)

# ---- group: REFERENCE POINT
# S T E P  2
# B A S E   P O I N T
demesh = DeconstructMesh(Mesh=graft(merge))  # -> simplify(Vertices), Faces, Colours, Normals
sort_by_height = SortByHeight(pt=demesh.Vertices)  # -> height, point_2
item_2 = ListItem(List=sort_by_height.point_2, Index=0, Wrap=True)

# ----
sunpath = Ladybug_SunPath(
    north=vec,
    location=importepw.location,
    hour=12,
    day=21,
    month=12,
    timeStep=1,
    analysisPeriod=analysisperiod.analysisPeriod,
    centerPt=pt,
    sunPathScale=Slider(2, range=0..10),
    dailyOrAnnualSunPath=True)  # -> readMe, sunVectors, sunAltitudes, sunAzimuths, port, sunSpheresMesh, sunPathCrvs, legend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; plug-in component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

# ---- group: BASE POINT OF EACH BUILDINGS
xy = XYPlane(Origin=item_2)

# ---- group: EACH BUILDING
graft = GraftTree(Tree=merge, IncludeEmptyLists=True, IncludeNullItems=True)  # -> simplify(Tree)

# ----
sun_vectors = Panel(sunpath.sunVectors)
time_of_day = Panel(sunpath.sunPositionsInfo)

# ---- group: SUN VECTOR
# S T E P  4
# S H A D O W
lng = ListLength(List=sun_vectors)

# ----
graft_2 = GraftTree(Tree=time_of_day, IncludeEmptyLists=True, IncludeNullItems=True)  # -> simplify(Tree)

# ---- group: DUPLICATE BUILDINGS FOR EACH SUN VECTOR
dup = DuplicateData(Data=graft, Number=lng, Order=True)  # -> simplify(Data)

# ---- group: DUPLICATED BASE POINT FOR EACH SUN VECTOR
dup_2 = DuplicateData(Data=xy, Number=lng, Order=True)  # -> simplify(Data)

# ---- group: create shadows
mshadow = MeshShadow(Mesh=dup, SunRays=sun_vectors, Plane=dup_2)  # -> simplify(Outlines)

# ----
# S T E P  4
# B A K E
panel_2 = Panel("Bake::")
group = Group(Objects=mshadow)
trim = TrimTree(Tree=group, Depth=1)
flip = FlipMatrix(Data=trim)
data_2 = Data(flip)

# ---- group: LAYER COLOUR
merge_2 = Merge(
    Data1=ColourSwatch(SwatchColor=RGB(0, 0, 0)),
    Data2=ColourSwatch(SwatchColor=RGB(8, 95, 161)),
    Data3=ColourSwatch(SwatchColor=RGB(117, 8, 161)),
    Data4=ColourSwatch(SwatchColor=RGB(23, 161, 8)),
    Data5=ColourSwatch(SwatchColor=RGB(161, 107, 8)),
    Data6=ColourSwatch(SwatchColor=RGB(161, 8, 8)))  # -> simplify(graft(Result))

# ----
group_2 = Group(Objects=data_2)

# ---- group: PREVIEW
preview = CustomPreview(Geometry=group_2, Shader=merge_2)

# ---- group: BAKE LAYER NAME
panel_3 = Panel("Shadows::")

# ----
concat_3 = Concatenate(FragmentA=panel_2, FragmentB=panel_3)

# ---- group: BAKE LAYER NAME (continued)
concat_4 = Concatenate(FragmentA=concat_3, FragmentB=graft_2)

# ----
panel_4 = Panel(concat_4)
attributes = ObjectAttributes(Layer=panel_4, Color=merge_2)

# ---- group: BAKE - ROADS
# BAKE
bake = BakeObjects(Geometry=group_2, Attributes=attributes, Bake=False)

# ==== cluster SortByHeight: Sort By Height
pt = ClusterInput()  # Pt
pt_2 = Point(pt)
pdecon = Deconstruct(Point=pt_2)  # -> XComponent, YComponent, ZComponent
sort = SortList(Keys=pdecon.ZComponent, ValuesA=pt_2)  # -> Keys, ValuesA
point = Data(sort.ValuesA)
height = ClusterOutput(sort.Keys)
point_2 = ClusterOutput(point)
