# Grasshopper definition 09 SVG Example.gh (Grasshopper 0.9.76)
# Copyright: Co-de-iT
# plug-ins: Python Interpreter, ClipperComponents, Human, EleFront

colours = DIS_Colours()
# GROUND
# TOPOGRAPHY
panel = Panel("09 Masterplan::Topo::Contours")
# ROADS
panel_2 = Panel("09 Masterplan::Roads::Total Carriageway")
# BUILDINGS
panel_3 = Panel("09 Masterplan::Buildings")
# LAYOUT
number_slider = Slider(-4612, range=-200000..200000)
dpipeline = DynamicGeometryPipeline(
    LayerFilter=panel,
    TypeFilter="Curve",
    NameFilter="*",
    enableFullPath=True,
    GroupByLayer=False,
    GroupByType=False,
    IncludeHidden=True,
    IncludeLocked=True,
    listenToAttributes=True)
dpipeline_2 = DynamicGeometryPipeline(
    LayerFilter=panel_3,
    TypeFilter="Curve",
    NameFilter="*",
    enableFullPath=True,
    GroupByLayer=False,
    GroupByType=False,
    IncludeHidden=True,
    IncludeLocked=True,
    listenToAttributes=True)
dpipeline_3 = DynamicGeometryPipeline(
    LayerFilter=panel_2,
    TypeFilter="Curve",
    NameFilter="*",
    enableFullPath=True,
    GroupByLayer=False,
    GroupByType=False,
    IncludeHidden=True,
    IncludeLocked=True,
    listenToAttributes=True)
dpipeline_4 = DynamicGeometryPipeline(
    LayerFilter="09 Masterplan::Roads::Green Buffer",
    TypeFilter="Curve",
    NameFilter="*",
    enableFullPath=True,
    GroupByLayer=False,
    GroupByType=False,
    IncludeHidden=True,
    IncludeLocked=True,
    listenToAttributes=True)
dpipeline_5 = DynamicGeometryPipeline(
    LayerFilter="09 Masterplan::Roads::Footpath",
    TypeFilter="Curve",
    NameFilter="*",
    enableFullPath=True,
    GroupByLayer=False,
    GroupByType=False,
    IncludeHidden=True,
    IncludeLocked=True,
    listenToAttributes=True)
dpipeline_6 = DynamicGeometryPipeline(
    LayerFilter="09 Masterplan::Vegetation::Trees",
    TypeFilter="Curve",
    NameFilter="*",
    enableFullPath=True,
    GroupByLayer=False,
    GroupByType=False,
    IncludeHidden=True,
    IncludeLocked=True,
    listenToAttributes=True)
dpipeline_7 = DynamicGeometryPipeline(
    LayerFilter="09 Masterplan::Water",
    TypeFilter="Curve",
    NameFilter="*",
    enableFullPath=True,
    GroupByLayer=False,
    GroupByType=False,
    IncludeHidden=True,
    IncludeLocked=True,
    listenToAttributes=True)
dpipeline_8 = DynamicGeometryPipeline(
    LayerFilter="09 Masterplan::Vegetation::Open Space",
    TypeFilter="Curve",
    NameFilter="*",
    enableFullPath=True,
    GroupByLayer=False,
    GroupByType=False,
    IncludeHidden=True,
    IncludeLocked=True,
    listenToAttributes=True)  # -> simplify(GeometryOut)

eval = EvaluateCurve(Curve=reparameterize(dpipeline_8), Parameter=0.5)  # -> Point, Tangent, Angle
incurve = PointInCurve(Point=eval.Point, Curve=graft(dpipeline_8))  # -> Relationship, Point
equals = Equality(FirstNumber=incurve.Relationship, SecondNumber="2")  # -> simplify(Equality), Inequality
equals_2 = Equality(FirstNumber=incurve.Relationship, SecondNumber="1")  # -> simplify(Equality), Inequality
dispatch = Dispatch(List=dpipeline_8, DispatchPattern=equals_2.Equality)  # -> simplify(ListA), ListB
dispatch_2 = Dispatch(List=dpipeline_8, DispatchPattern=equals.Equality)  # -> simplify(ListA), ListB
geo = Geometry(dispatch.ListA)
merge = Merge(Data1=geo, Data2=dispatch_2.ListA)

pt = ConstructPoint(XCoordinate=number_slider, YCoordinate=Slider(105890, range=-200000..200000), ZCoordinate=0)
pt_2 = Point(pt)

# ---- group: THICK WALLS
data = Data()

# ---- group: Page Size
xy = XYPlane(Origin=pt_2)
paper = Panel("A3 (L)")
scale = Panel("1:1000")
prot = RotatePlane(Plane=xy, Angle=degrees(Slider(0, range=0..180)))
svg_plane_by_page = SVGPlaneByPage_2(plane=prot, M=paper, T=scale)  # -> R_2, R

# ---- group: Scalebar
number_slider_2 = Slider(1, range=0..100)  # disabled
number_slider_3 = Slider(2, range=0..10)  # disabled
number_slider_4 = Slider(5, range=0..10)  # disabled
# SCALEBAR
number_slider_5 = Slider(70, range=0..420)  # disabled
number_slider_6 = Slider(25, range=0..420)  # disabled
cluster = Cluster_2(
    data=svg_plane_by_page.R_2,
    x_shift=number_slider_5,
    y_shift=number_slider_6,
    num=number_slider_4,
    A=number_slider_2,
    x=number_slider_3)  # -> P, text_location_2, text_2; disabled
panel_4 = Panel("""text="█"
text-anchor="center"
""")  # disabled
panel_5 = Panel("ScaleBar")  # disabled
panel_6 = Panel("█")  # disabled
panel_7 = Panel("scalebar")  # disabled
rep = ReplaceText(Text=panel_4, Find=panel_6, Replace=panel_5, RecursiveReplace=False)  # disabled
svg_text_object = SVGTextObject(txt=simplify(graft(cluster.text_2)), P=simplify(graft(cluster.text_location_2)), T=svg_plane_by_page.R_2, R=rep)  # -> R_2, txt_4; disabled
svg_polyline = SVGPolyline(crv=cluster.P, layout=svg_plane_by_page.R_2, class=panel_7)  # -> svg_2, crv_4; disabled
merge_2 = Merge(Data1=svg_polyline.svg_2, Data2=svg_text_object.R_2)  # -> flatten(Result); disabled

# ----
svg_donut = COX_SVGDonut(crv=flatten(data), layout=svg_plane_by_page.R_2, class="INNER_DETAIL_walls", z_index=200)  # -> svg_2, crv_4

# ---- group: Road Drop Shadow
panel_8 = Panel("tag=\"buildingdropshadows\"")
data_2 = Data()
svg_path = COX_SVGPath_2(crv=flatten(data_2), layout=svg_plane_by_page.R_2, attributes=panel_8)  # -> svg_2, crv_4

# ----
lng = ListLength(List=merge)
larger = LargerThan(FirstNumber=lng, SecondNumber=1)  # -> LargerThan, OrEqualTo
dispatch_3 = Dispatch(List=merge, DispatchPattern=larger.LargerThan)  # -> ListA, Regular

paper_2 = Panel("A3 (L)")
scale_2 = Panel("1:4000")
xy_2 = XYPlane(Origin=Point(0, 0, 0))

# ---- group: Body
panel_9 = Panel("[text=\"█\"] {")  # disabled
panel_10 = Panel("█")  # disabled
panel_11 = Panel("Arial Narrow")  # disabled
panel_12 = Panel("0.9mm")  # disabled
rep_2 = ReplaceText(Text=panel_9, Find=panel_10, Replace=panel_5, RecursiveReplace=False)  # disabled
css_text_style = CSSTextStyle(selector=rep_2, font=panel_11, size=panel_12)  # disabled

# ----
svg_plane_by_page_2 = RDB_SVGPlaneByPage(plane=xy_2, page_size=paper_2, scale=scale_2, position=Toggle(False))  # -> json_layout, preview

# ---- group: Drop Shadow
panel_13 = Panel("""[█]{
filter:url(#f0.5);
stroke: rgb(0,0,0);
opacity:0.2;
}""")
rep_3 = ReplaceText(Text=panel_13, Find="█", Replace=panel_8, RecursiveReplace=False)

# ----
data_3 = Data()

# ---- group: Masterplan Greys
swatch = ColourSwatch(SwatchColor=RGBA(13, 13, 13, 0))
swatch_2 = ColourSwatch(SwatchColor=RGB(255, 255, 255))
swatch_3 = ColourSwatch(SwatchColor=RGB(241, 242, 242))
swatch_4 = ColourSwatch(SwatchColor=RGB(230, 230, 230))
swatch_5 = ColourSwatch(SwatchColor=RGB(210, 215, 210))
swatch_6 = ColourSwatch(SwatchColor=RGB(209, 211, 212))
swatch_7 = ColourSwatch(SwatchColor=RGB(199, 200, 201))
swatch_8 = ColourSwatch(SwatchColor=RGB(147, 149, 152))
swatch_9 = ColourSwatch(SwatchColor=RGB(13, 13, 13))

# ----
crv = Curve(svg_plane_by_page_2.preview)
panel_14 = Panel("""attribute:veg_trees
z index: 1""")
panel_15 = Panel("""attribute:water
z index: 1""")
panel_16 = Panel("""attribute:roads_green
z index: 2""")
panel_17 = Panel("""attribute:veg_openspace
z index: 1""")
panel_18 = Panel("""attribute:roads_footpath
z index: 1""")
panel_19 = Panel("""attribute:roads_carriageway
z index: 3""")
panel_20 = Panel("""attribute:buildings
z index: 3""")

# ---- group: Diagram Colours
swatch_10 = ColourSwatch(SwatchColor=RGB(130, 54, 140))
swatch_11 = ColourSwatch(SwatchColor=RGB(180, 62, 128))
swatch_12 = ColourSwatch(SwatchColor=RGB(226, 6, 38))
swatch_13 = ColourSwatch(SwatchColor=RGB(236, 65, 54))
swatch_14 = ColourSwatch(SwatchColor=RGB(250, 162, 27))
swatch_15 = ColourSwatch(SwatchColor=RGB(255, 222, 23))
swatch_16 = ColourSwatch(SwatchColor=RGB(109, 207, 246))
swatch_17 = ColourSwatch(SwatchColor=RGB(44, 58, 150))
swatch_18 = ColourSwatch(SwatchColor=RGB(109, 162, 27))
swatch_19 = ColourSwatch(SwatchColor=RGB(166, 206, 57))
swatch_20 = ColourSwatch(SwatchColor=RGB(81, 173, 113))
swatch_21 = ColourSwatch(SwatchColor=RGB(189, 140, 191))
swatch_22 = ColourSwatch(SwatchColor=RGB(199, 103, 89))
swatch_23 = ColourSwatch(SwatchColor=RGB(88, 89, 91))
swatch_24 = ColourSwatch(SwatchColor=RGB(236, 11, 139))

# ----
polygon = POLYGON(
    class="INNER_DETAIL_walls",
    stroke=swatch_9,
    stroke_width=Slider(0.005, range=0..0.1),
    fill=swatch_23,
    fill_opacity=Slider(0.75, range=0..1),
    rule="evenodd")

svg_polyline_2 = SVGPolyline_2(crv=dpipeline_2, layout=svg_plane_by_page_2.json_layout, D="Buildings", z_index=10)  # -> svg_2, crv_4

geo_2 = Geometry(dpipeline_6)
geo_3 = Geometry(dpipeline_7)
geo_4 = Geometry(dpipeline_4)

svg_polyline_3 = SVGPolyline_2(crv=dpipeline, layout=svg_plane_by_page_2.json_layout, D="Topography", z_index=10)  # -> svg_2, crv_4

geo_5 = Geometry(dpipeline_8)
geo_6 = Geometry(dpipeline_5)
geo_7 = Geometry(dpipeline_3)
panel_21 = Panel("""attribute: topography
z index: 0""")
geo_8 = Geometry(dpipeline_2)
geo_9 = Geometry(dpipeline)

# ---- group: Base Plan
swatch_25 = ColourSwatch(SwatchColor=RGB(230, 231, 232))
swatch_26 = ColourSwatch(SwatchColor=RGB(110, 198, 217))
swatch_27 = ColourSwatch(SwatchColor=RGB(120, 186, 78))
swatch_28 = ColourSwatch(SwatchColor=RGB(174, 174, 174))

# ----
geo2archijson = Geo2ArchiJSON(geometry=geo_3, properties=panel_15, output_type=Toggle(False))
geo2archijson_2 = Geo2ArchiJSON(geometry=geo_2, properties=panel_14, output_type=Toggle(False))
geo2archijson_3 = Geo2ArchiJSON(geometry=geo_4, properties=panel_16, output_type=Toggle(False))
geo2archijson_4 = Geo2ArchiJSON(geometry=geo_5, properties=panel_17, output_type=Toggle(False))
geo2archijson_5 = Geo2ArchiJSON(geometry=geo_6, properties=panel_18, output_type=Toggle(False))
geo2archijson_6 = Geo2ArchiJSON(geometry=geo_7, properties=panel_19, output_type=Toggle(False))
geo2archijson_7 = Geo2ArchiJSON(geometry=geo_9, properties=panel_21, output_type=Toggle(False))
geo2archijson_8 = Geo2ArchiJSON(geometry=geo_8, properties=panel_20, output_type=Toggle(False))

# ---- group: Masterplan Water
swatch_29 = ColourSwatch(SwatchColor=RGB(197, 232, 241))
swatch_30 = ColourSwatch(SwatchColor=RGB(173, 225, 250))
swatch_31 = ColourSwatch(SwatchColor=RGB(150, 206, 240))
swatch_32 = ColourSwatch(SwatchColor=RGB(134, 205, 227))
swatch_33 = ColourSwatch(SwatchColor=RGB(110, 198, 217))
swatch_34 = ColourSwatch(SwatchColor=RGB(110, 179, 227))
swatch_35 = ColourSwatch(SwatchColor=RGB(0, 106, 181))

# ----
draw = DrawSVG(objects=geo2archijson, layout=svg_plane_by_page_2.json_layout)
draw_2 = DrawSVG(objects=geo2archijson_2, layout=svg_plane_by_page_2.json_layout)
draw_3 = DrawSVG(objects=geo2archijson_3, layout=svg_plane_by_page_2.json_layout)
draw_4 = DrawSVG(objects=geo2archijson_4, layout=svg_plane_by_page_2.json_layout)
draw_5 = DrawSVG(objects=geo2archijson_5, layout=svg_plane_by_page_2.json_layout)
draw_6 = DrawSVG(objects=geo2archijson_6, layout=svg_plane_by_page_2.json_layout)
draw_7 = DrawSVG(objects=geo2archijson_8, layout=svg_plane_by_page_2.json_layout)
draw_8 = DrawSVG(objects=geo2archijson_7, layout=svg_plane_by_page_2.json_layout)
panel_22 = Panel(geo2archijson_7)

# ---- group: Masterplan Paving
swatch_36 = ColourSwatch(SwatchColor=RGB(248, 183, 23))
swatch_37 = ColourSwatch(SwatchColor=RGB(255, 228, 183))
swatch_38 = ColourSwatch(SwatchColor=RGB(227, 182, 157))
swatch_39 = ColourSwatch(SwatchColor=RGB(172, 148, 145))
swatch_40 = ColourSwatch(SwatchColor=RGB(130, 85, 43))
swatch_41 = ColourSwatch(SwatchColor=RGB(248, 208, 181))
swatch_42 = ColourSwatch(SwatchColor=RGB(243, 177, 136))
swatch_43 = ColourSwatch(SwatchColor=RGB(221, 160, 104))
swatch_44 = ColourSwatch(SwatchColor=RGB(253, 203, 146))
swatch_45 = ColourSwatch(SwatchColor=RGB(247, 146, 30))
swatch_46 = ColourSwatch(SwatchColor=RGB(170, 134, 59))
swatch_47 = ColourSwatch(SwatchColor=RGB(248, 228, 175))
swatch_48 = ColourSwatch(SwatchColor=RGB(233, 203, 134))
swatch_49 = ColourSwatch(SwatchColor=RGB(237, 194, 69))
swatch_50 = ColourSwatch(SwatchColor=RGB(248, 219, 69))

# ----
polygon_2 = POLYGON(
    class="Topography",
    stroke=swatch_9,
    stroke_width=Slider(0.02, range=0..5),
    fill="none",
    fill_opacity=Slider(0, range=0..5))

polygon_3 = POLYGON(
    class="Buildings",
    stroke=swatch_9,
    stroke_width=Slider(0.1, range=0..1),
    fill=swatch_5,
    fill_opacity=Slider(1, range=0..5))

# ---- group: Masterplan Grass
swatch_51 = ColourSwatch(SwatchColor=RGB(204, 222, 145))
swatch_52 = ColourSwatch(SwatchColor=RGB(188, 209, 124))
swatch_53 = ColourSwatch(SwatchColor=RGB(171, 198, 102))
swatch_54 = ColourSwatch(SwatchColor=RGB(164, 192, 91))
swatch_55 = ColourSwatch(SwatchColor=RGB(140, 170, 69))

# ----
panel_23 = Panel(geo2archijson_6)
panel_24 = Panel(geo2archijson_2)
panel_25 = Panel(geo2archijson)
panel_26 = Panel(geo2archijson_3)
panel_27 = Panel(geo2archijson_8)
panel_28 = Panel(geo2archijson_4)
panel_29 = Panel(geo2archijson_5)

# ---- group: Masterplan Trees
swatch_56 = ColourSwatch(SwatchColor=RGB(72, 99, 68))
swatch_57 = ColourSwatch(SwatchColor=RGB(163, 170, 69))
swatch_58 = ColourSwatch(SwatchColor=RGB(173, 197, 82))
swatch_59 = ColourSwatch(SwatchColor=RGB(153, 175, 59))
swatch_60 = ColourSwatch(SwatchColor=RGB(123, 152, 74))
swatch_61 = ColourSwatch(SwatchColor=RGB(96, 127, 63))
swatch_62 = ColourSwatch(SwatchColor=RGB(128, 195, 79))
swatch_63 = ColourSwatch(SwatchColor=RGB(176, 146, 59))
swatch_64 = ColourSwatch(SwatchColor=RGB(189, 161, 90))
swatch_65 = ColourSwatch(SwatchColor=RGB(204, 178, 61))
swatch_66 = ColourSwatch(SwatchColor=RGB(110, 194, 126))
swatch_67 = ColourSwatch(SwatchColor=RGB(69, 184, 63))
swatch_68 = ColourSwatch(SwatchColor=RGB(14, 153, 72))
swatch_69 = ColourSwatch(SwatchColor=RGB(122, 158, 72))

# ----
merge_3 = Merge(Data1=draw_7, Data2=draw_8, Data3=draw_6, Data4=draw_3, Data5=draw_5)
svg_compiler = RDB_SVGCompiler(json_layouy=svg_plane_by_page_2.json_layout, svg_text=merge_3)

# ---- group: SVG SITE
merge_4 = Merge(Data3=svg_polyline_3.svg_2, Data4=svg_polyline_2.svg_2)

# ---- group: CSS SITE
merge_5 = Merge(Data3=polygon_2, Data4=polygon_3)

# ---- group: SVG BASE LAYER
merge_6 = Merge(Data1=merge_4)

# ---- group: SVG BUILDINGS TYPICAL
merge_7 = Merge()

# ----
# PARENT LAYER FOR ALL CENTRELINES
# M A I N   R E F    L A Y E R
# CENTRELINE SUBLAYERS
panel_30 = Panel("09 Masterplan::Road Centrelines")  # disabled
concat = Concatenate(FragmentA=panel_30, FragmentC="::")  # disabled

# ----
# S T E P  1
# R E F E R E N C I N G
# U N I T S
mm_true = BooleanToggle(False)  # disabled

layer_name = Panel("1. Major")  # disabled
layer_name_2 = Panel("2. Minor")  # disabled
layer_name_3 = Panel("3. Local")  # disabled
layer_name_4 = Panel("04 Local")  # disabled
concat_2 = Concatenate(FragmentA=concat, FragmentB=layer_name)  # disabled
concat_3 = Concatenate(FragmentA=concat, FragmentB=layer_name_2)  # disabled
concat_4 = Concatenate(FragmentA=concat, FragmentB=layer_name_3)  # disabled
concat_5 = Concatenate(FragmentA=concat, FragmentB=layer_name_4)  # disabled

# ----
# S T E P  2
# R O A D    S E C T I O N
# NOTE!: CANNOT BE 0 OR DELETED, NEEDS TO BE 0.01
offset_order = Panel("""Total Carriageway
Green Buffer
Footpath""")  # disabled
# OFFSETS FOR
# EACH ROAD TYPE
width = Panel("""24
2
0.01""")  # disabled
width_2 = Panel("""10
2
2.1""")  # disabled
toggle = BooleanToggle(True)
width_3 = Panel("""7
2.15
1.5""")  # disabled
width_4 = Panel("""5
2.15
1.5""")  # disabled
rep_4 = ReplaceText(RecursiveReplace=False)
merge_8 = Merge()
merge_9 = Merge()
data_4 = Data(svg_plane_by_page.R_2)
data_5 = Data("-4612.0,105890.0,0.0,1.0,0.0,0.0,0.0,1.0,0.0;420.0,297.0;1000.0")

# ---- group: ALL DISTANCES
merge_10 = Merge(Data1=graft(width), Data2=graft(width_2), Data3=graft(width_3), Data4=graft(width_4))  # -> simplify(Result); disabled

# ----
cluster_2 = Cluster_4(layer=concat_2, m_mm=mm_true, offsets=width)  # -> total_width_2, _0_2, _1_2, _2_2, _3_2, _4_2, _5_2; disabled
cluster_3 = Cluster_4(layer=concat_3, m_mm=mm_true, offsets=width_2)  # -> total_width_2, _0_2, _1_2, _2_2, _3_2, _4_2, _5_2; disabled
cluster_4 = Cluster_4(layer=concat_4, m_mm=mm_true, offsets=width_3)  # -> total_width_2, _0_2, _1_2, _2_2, _3_2, _4_2, _5_2; disabled
cluster_5 = Cluster_4(layer=concat_5, m_mm=mm_true, offsets=width_4)  # -> total_width_2, _0_2, _1_2, _2_2, _3_2, _4_2, _5_2; disabled

panel_31 = Panel("K:\2016\316060.01\11.0 DRAWINGS\11.04 Rhino\Illustrative Masterplan\store html")

# ----
# 2
merge_11 = Merge(Data1=cluster_2._2_2, Data2=cluster_3._2_2, Data3=cluster_4._2_2, Data4=cluster_5._2_2)  # -> simplify(Result); disabled

# ----
# 0
merge_12 = Merge(Data1=cluster_2._0_2, Data2=cluster_3._0_2, Data3=cluster_4._0_2, Data4=cluster_5._0_2)  # -> simplify(Result); disabled

# ----
# 1
merge_13 = Merge(Data1=cluster_2._1_2, Data2=cluster_3._1_2, Data3=cluster_4._1_2, Data4=cluster_5._1_2)  # -> simplify(Result); disabled

# ---- group: TYPE 0 SETTINGS
panel_32 = Panel("0")  # disabled
fillet_radius = Slider(10, range=0..10)  # disabled
# S T E P  3
# S T Y L E
branch = TreeBranch(Tree=merge_10, Path=panel_32, MaintainPaths=True)  # disabled
toggle_2 = BooleanToggle(False)  # disabled
division = Division(A=branch, B=2)  # disabled
cluster_6 = Cluster_5(distances=division, G=merge_12, m_mm=mm_true, fillet_f_chamfer_t=toggle_2, radius=fillet_radius)  # -> clean_curve_2, curve_3; disabled
# CHANGE RADIUS +
#  FILLET/CHAMFER
data_6 = Data(flatten(cluster_6.curve_3))  # disabled

# ---- group: TYPE 1 SETTINGS
fillet_radius_2 = Slider(8, range=0..10)  # disabled
panel_33 = Panel("1")  # disabled
branch_2 = TreeBranch(Tree=merge_10, Path=panel_33, MaintainPaths=True)  # disabled
toggle_3 = BooleanToggle(False)  # disabled
cluster_7 = Cluster_5(distances=branch_2, G=merge_13, m_mm=mm_true, fillet_f_chamfer_t=toggle_3, radius=fillet_radius_2)  # -> clean_curve_2, curve_3; disabled
data_7 = Data(flatten(cluster_7.curve_3))  # disabled

# ---- group: TYPE 2 SETTINGS
fillet_radius_3 = Slider(6, range=0..10)  # disabled
panel_34 = Panel("2")  # disabled
branch_3 = TreeBranch(Tree=merge_10, Path=panel_34, MaintainPaths=True)  # disabled
toggle_4 = BooleanToggle(False)  # disabled
cluster_8 = Cluster_5(distances=branch_3, G=merge_11, m_mm=mm_true, fillet_f_chamfer_t=toggle_4, radius=fillet_radius_3)  # -> clean_curve_2, curve_3; disabled
data_8 = Data(flatten(cluster_8.curve_3))  # disabled

# ----
# NOTE!: HALF OF THE GREEN AREA WIDTH TO CREATE A CENTRE LINE FOR TREES
division_2 = Division(A=branch_2, B=2)  # -> simplify(graft(Result)); disabled

# ----
# S T E P  4
# T R E E S
# TREES
# NOTE!: THIS NEEDS TO BE THE TYPE ON THE INNER SIDE OF THE GREEN AREA
ungroup = Ungroup(Group=merge_12)  # -> simplify(Objects); disabled

# ----
# T R E E   L I N E
polyoffset = PolylineOffsetSETTINGS(
    Polylines=ungroup,
    Distance=division_2,
    Plane=Plane(origin=(0, 0, 0), x=(0, 0, 0), y=(0, 0, 0)),
    Tolerance=0.001,
    ClosedFillet=2,
    OpenFillet=2,
    Miter=0)  # -> Contour, Holes; disabled
number_slider_7 = Slider(2, range=0..10)  # disabled
toggle_5 = BooleanToggle(False)  # disabled
crv_2 = Curve(polyoffset.Contour)  # disabled
cluster_9 = Cluster_6(G=crv_2, m_mm=mm_true, fillet_f_chamfer_t=toggle_5, radius=number_slider_7)  # -> clean_curve_2, curve_3; disabled
data_9 = Data(cluster_9.clean_curve_2)  # disabled
ungroup_2 = Ungroup(Group=data_9)  # -> simplify(Objects); disabled

# ---- group: tree size
# T R E E   R A D I U S
r_a_d_i_u_s = Slider(6, range=0..10)  # disabled

# T R E E   R A D I U S
r_a_d_i_u_s_2 = Slider(4, range=0..10)  # disabled

# ---- group: ORIGIN
pt_3 = Point(Point(0, 0, 0))  # disabled

pt_4 = Point(Point(0, 0, 0))  # disabled

# ----
# B A S E    T R E E   2
circle = CircleCNR(Center=pt_3, Normal=Vector(0, 0, 1), Radius=r_a_d_i_u_s)  # disabled

# ----
# B A S E    T R E E  1
circle_2 = CircleCNR(Center=pt_4, Normal=Vector(0, 0, 1), Radius=r_a_d_i_u_s_2)  # disabled

# ----
# T R E E   S P A C I N G
s_p_a_c_i_n_g = Slider(15, range=0..100)  # disabled
divdist = DivideDistance(Curve=ungroup_2, Distance=s_p_a_c_i_n_g)  # -> simplify(Points), Tangents, Parameters; disabled

# ---- group: CREATE BASE BLOCK AT ORIGIN
panel_35 = Panel("Tree")  # disabled
merge_14 = Merge(Data1=pt_3, Data2=circle)  # disabled
block = CreateBlock(Geometry=merge_14, BlockName=panel_35, BasePlane=pt_3)  # disabled

panel_36 = Panel("Tree")  # disabled
merge_15 = Merge(Data1=pt_4, Data2=circle_2)  # disabled
block_2 = CreateBlock(Geometry=merge_15, BlockName=panel_36, BasePlane=pt_4)  # disabled

# ---- group: MOVE TO POINTS
# ONLY 1 SIZE
orient = Orient(Geometry=merge_15, Source=pt_4, Target=divdist.Points)  # -> Geometry, Transform; disabled

# ---- group: POS
panel_37 = Panel("Land Uses_ Proposed 22000 1")
dpipeline_9 = DynamicGeometryPipeline(
    LayerFilter=panel_37,
    TypeFilter="Curve",
    NameFilter="*",
    enableFullPath=False,
    GroupByLayer=False,
    GroupByType=False,
    IncludeHidden=True,
    IncludeLocked=True,
    listenToAttributes=True)  # -> flatten(GeometryOut)
rep_5 = ReplaceText(Text="tag=\"█\"", Find="█", Replace=panel_37, RecursiveReplace=False)  # -> flatten(Result)
topoly = CurveToPolyline(Curve=dpipeline_9, ToleranceDistance=0.1, ToleranceAngle=0)  # -> Polyline, Segments
svg_line = SVGLine_2(curve=topoly.Polyline, attributes=rep_5)  # -> svg_2, crv_3
rep_6 = ReplaceText(Text="<g id=\"█Group\">", Find="█", Replace=panel_37, RecursiveReplace=False)
merge_16 = Merge(Data1=flatten(rep_6), Data2=flatten(svg_line.svg_2), Data3=flatten("</g>"))

# ----
# B A K E - T R E E S
panel_38 = Panel("Trees::")  # disabled
swatch_70 = ColourSwatch(SwatchColor=RGB(23, 161, 8))  # disabled
concat_6 = Concatenate(FragmentB=panel_38)  # disabled
attributes = ObjectAttributes(Layer=concat_6, Color=swatch_70)  # disabled

# ---- group: POS
css_style_maker = CSSStyleMaker_2(
    custom_attribute=rep_5,
    stroke_thickness=Slider(0, range=0..5),
    stroke_opacity=Slider(0, range=0..1),
    fill_opacity=Slider(0.6, range=0..1),
    opacity=Slider(1, range=0..1))

# ----
pt_5 = Point(<point referenced from the Rhino model>)
xy_3 = XYPlane(Origin=Point(0, 0, 0))

css_style_maker_2 = CSSStyleMaker()
cluster_10 = Cluster_2()  # -> P, text_location_2, text_2
svg_polyline_4 = SVGPolyline()  # -> svg_2, crv_4
svg_line_2 = SVGLine(z_index=0)  # -> svg_2, crv_3
css_text_style_2 = CSSTextStyle()
svg_image = SVGImage(rec={Plane=PlaneXY(354.1569973, -673.6102569, 0), Size=Domain2(u=0..263.1598074, v=0..173.300361)})
svg_text_object_2 = SVGTextObject()  # -> R_2, txt_4
svg_plane_by_page_3 = SVGPlaneByPage_3(M="A3")  # -> R_2, R
svg_compiler_2 = SVGCompiler()
laysplit_new = LAYSPLITNEW()  # -> pl_2, data_3, data_4

svg_plane_by_page_4 = SVGPlaneByPage(plane=xy_3, M="A3 (L)", T="1:1000")  # -> R_2, R

dpipeline_10 = DynamicGeometryPipeline(
    LayerFilter="Geo",
    TypeFilter="Curve",
    NameFilter="*",
    enableFullPath=False,
    GroupByLayer=False,
    GroupByType=False,
    IncludeHidden=True,
    IncludeLocked=True,
    listenToAttributes=True)
svg_path_2 = COX_SVGPath(crv=dpipeline_10, layout=svg_plane_by_page_4.R_2, class="test")  # -> svg_2, crv_4

# ----
# CSS Supported Fonts: Arial Rounded MT Bold
# Abel
# Arial Narrow
# Arial Black
# Arial
# Andale Mono
# Avant Garde
# Book Antiqua
# Big Calson
# Bodoni MT
# Courier New
# Century Gothic
# Cambria
# Calibri
# Candara
# Calisto MT
# Consolas
# Didot
# Franklin Gothic Medium
# Futura
# Georgia
# Garamond
# Gill Sans
# Geneva
# Helvetica
# Inconsolata
# Impact
# Lucinda Bright
# Lucida Sans Typewriter
# Lucida Console
# Lucinda Grande
# Lobster
# Lora
# Noto Serif
# Optima
# Open Sans Condensed
# Open Sans
# Perpetua
# Palatino
# Slabo 27px
# Segoe UI
# Trebuchet MS
# Tahoma
# Times New Roman
# Verdana
svg_text_object_3 = SVGTextObject(txt="Hello", P=pt_5, T=svg_plane_by_page_4.R_2, class="test2")  # -> R_2, txt_4

css_style_maker_3 = CSSStyleMaker(
    class="test",
    stroke_colour=ColourSwatch(SwatchColor=RGB(119, 0, 255)),
    stroke_thickness=Slider(0.1, range=0..0.1),
    fill=ColourSwatch(SwatchColor=RGB(201, 236, 255)),
    fill_opacity=Slider(0.5, range=0..1))

panel_39 = Panel(svg_plane_by_page_4.R_2)
panel_40 = Panel("\\sydsrv01\projects\2014\214059.00\11.0 DRAWINGS\11.07 Graphics\SVG\2016\Base_Diagram2.jpg ")
css_text_style_3 = CSSTextStyle(font="Arial", I=ColourSwatch(SwatchColor=RGB(0, 0, 0)), size=Slider(3, range=0..10))
preview = CustomPreview(Shader={ambient=RGB(0, 0, 0), diffuse=RGB(255, 105, 180), emission=RGB(76, 32, 54), shine=0.5, specular=RGB(255, 255, 255), transparency=0})
panel_41 = Panel(css_style_maker_3)
join = TextJoin(Text=flatten(css_style_maker_3))

panel_42 = Panel("""* {
fill: none;
stroke: none;
}""")
panel_43 = Panel("""[tag="image"]{
 opacity:0.50;
}""")

crv_3 = Curve()
svg_image_2 = SVGImage(img_pa=panel_40, rec=crv_3, attributes="tag=\"image\"")
svg_compiler_3 = SVGCompiler(css=join, data=svg_path_2.svg_2, T=svg_plane_by_page_4.R_2)
join_2 = TextJoin(Text=flatten(css_style_maker_3))
merge_17 = Merge(Data1=panel_42, Data3=panel_43)

# ---- group: SVG Export
file_location = Panel("T:\Personal Temp\s-rcollins")
file_write = FileWrite(content=svg_compiler_3, file_path=file_location, T="Test.svg", activate=Toggle(False))

# ----
bbox = BoundingBox(Content=cluster.P, Plane=PlaneXY(0, 0, 0), UnionBox=True)  # -> Box, Box_2; disabled
area = Area(Geometry=bbox.Box)  # -> Area, Centroid; disabled
number_slider_8 = Slider(2000, range=0..10000)  # disabled
number_slider_9 = Slider(1.3, range=0..10)  # disabled
number_slider_10 = Slider(3, range=0..10)  # disabled
number_slider_11 = Slider(1000, range=0..1000)  # disabled
scale_nu = ScaleNU(Geometry=bbox.Box, Plane=area.Centroid, ScaleX=number_slider_9, ScaleY=number_slider_10, ScaleZ=1)  # -> Geometry, Transform; disabled
Y = UnitY(Factor=number_slider_8)  # disabled
X = UnitX(Factor=number_slider_11)  # disabled
move = Move(Geometry=scale_nu.Geometry, Motion=Y)  # -> Geometry, Transform; disabled
move_2 = Move(Geometry=move.Geometry, Motion=X)  # -> Geometry, Transform; disabled
number_slider_12 = Slider(0.03, range=0..0.1)  # disabled
number_slider_13 = Slider(1, range=0..1)  # disabled
polygon_4 = POLYGON(class=panel_7, stroke=swatch_9, stroke_width=number_slider_12, fill=swatch_2, fill_opacity=number_slider_13)  # disabled

panel_44 = Panel("ScaleBarBox")  # disabled
svg_polyline_5 = SVGPolyline_2(crv=move_2.Geometry, layout=svg_plane_by_page.R_2, D=panel_44, z_index=10)  # -> svg_2, crv_4; disabled

number_slider_14 = Slider(0.05, range=0..5)  # disabled
number_slider_15 = Slider(0.8, range=0..5)  # disabled
polygon_5 = POLYGON(class=panel_44, stroke=swatch_56, stroke_width=number_slider_14, fill=swatch_2, fill_opacity=number_slider_15)  # disabled

merge_18 = Merge(Data1=polygon_4, Data2=css_text_style, Data3=polygon_5)  # disabled
merge_19 = Merge(Data2=svg_polyline_5.svg_2, Data3=merge_2)  # disabled

# ---- group: SVG TOP LAYER
merge_20 = Merge(Data13=merge_19)

# ---- group: SVG BASE LAYER
merge_21 = Merge(Data1=merge_4, Data13=merge_19)

# ---- group: ALL
merge_22 = Merge(Data1=merge_6, Data2=merge_20, Data3=merge_7)
panel_45 = Panel("")
join_3 = TextJoin(Text=flatten(merge_22), Join=panel_45)

# ----
join_4 = TextJoin(Text=flatten(merge_6), Join=panel_45)
join_5 = TextJoin(Text=flatten(merge_20), Join=panel_45)
merge_23 = Merge(Data2=join_5)
merge_24 = Merge(Data2=join_4)
merge_25 = Merge(Data2=join_3)

# ---- group: svg export
panel_46 = Panel("MasterplanGround")
panel_47 = Panel("K:\2016\316060.01\11.0 DRAWINGS\11.04 Rhino\Illustrative Masterplan")
svg_compiler_4 = SVGCompiler(data=flatten(merge_25), T=svg_plane_by_page.R_2)
panel_48 = Panel("█")
rep_7 = ReplaceText(Text="█.svg", Find=panel_48, Replace=panel_46, RecursiveReplace=False)  # -> flatten(Result)
file_write_2 = FileWrite(content=svg_compiler_4, file_path=panel_47, T=rep_7, activate=toggle)

panel_49 = Panel("K:\2016\316060.01\11.0 DRAWINGS\11.04 Rhino\Illustrative Masterplan")
concat_7 = Concatenate(FragmentA=panel_46, FragmentB="BUILDINGS-", FragmentC=rep_4)
svg_compiler_5 = SVGCompiler(data=flatten(merge_8), T=svg_plane_by_page.R_2)
panel_50 = Panel("█")
rep_8 = ReplaceText(Text="█.svg", Find=panel_50, Replace=concat_7, RecursiveReplace=False)  # -> flatten(Result)
file_write_3 = FileWrite(content=svg_compiler_5, file_path=panel_49, T=rep_8, activate=toggle)

panel_51 = Panel("K:\2016\316060.01\11.0 DRAWINGS\11.04 Rhino\Illustrative Masterplan")
concat_8 = Concatenate(FragmentA=panel_46, FragmentB="BASE")
svg_compiler_6 = SVGCompiler(data=flatten(merge_24), T=svg_plane_by_page.R_2)
panel_52 = Panel("█")
rep_9 = ReplaceText(Text="█.svg", Find=panel_52, Replace=concat_8, RecursiveReplace=False)  # -> flatten(Result)
file_write_4 = FileWrite(content=svg_compiler_6, file_path=panel_51, T=rep_9, activate=toggle)

panel_53 = Panel("K:\2016\316060.01\11.0 DRAWINGS\11.04 Rhino\Illustrative Masterplan")
concat_9 = Concatenate(FragmentA=panel_46, FragmentB="TOP")
svg_compiler_7 = SVGCompiler(data=flatten(merge_23), T=svg_plane_by_page.R_2)
panel_54 = Panel("█")
rep_10 = ReplaceText(Text="█.svg", Find=panel_54, Replace=concat_9, RecursiveReplace=False)  # -> flatten(Result)
file_write_5 = FileWrite(content=svg_compiler_7, file_path=panel_53, T=rep_10, activate=toggle)

panel_55 = Panel("K:\2016\316060.01\11.0 DRAWINGS\11.04 Rhino\Illustrative Masterplan")
concat_10 = Concatenate(FragmentA=panel_46, FragmentB="ROOF")
svg_compiler_8 = SVGCompiler(data=flatten(merge_9), T=svg_plane_by_page.R_2)
panel_56 = Panel("█")
rep_11 = ReplaceText(Text="█.svg", Find=panel_56, Replace=concat_10, RecursiveReplace=False)  # -> flatten(Result)
file_write_6 = FileWrite(content=svg_compiler_8, file_path=panel_55, T=rep_11, activate=toggle)

# ----
panel_57 = Panel(concat_7)

# ---- group: HTML Export
html_compiler = HTMLCompiler(svg_text=merge_8, layout=svg_plane_by_page.R_2)
rep_12 = ReplaceText(Text="█.html", Find=panel_50, Replace=concat_7, RecursiveReplace=False)  # -> flatten(Result)
file_write_7 = FileWrite(content=html_compiler, file_path=panel_49, T=rep_12, activate=toggle)

html_compiler_2 = HTMLCompiler(svg_text=merge_24, layout=svg_plane_by_page.R_2)
rep_13 = ReplaceText(Text="█.html", Find=panel_52, Replace=concat_8, RecursiveReplace=False)  # -> flatten(Result)
file_write_8 = FileWrite(content=html_compiler_2, file_path=panel_51, T=rep_13, activate=toggle)

html_compiler_3 = HTMLCompiler(svg_text=merge_23, layout=svg_plane_by_page.R_2)
rep_14 = ReplaceText(Text="█.html", Find=panel_54, Replace=concat_9, RecursiveReplace=False)  # -> flatten(Result)
file_write_9 = FileWrite(content=html_compiler_3, file_path=panel_53, T=rep_14, activate=toggle)

html_compiler_4 = HTMLCompiler(svg_text=merge_9, layout=svg_plane_by_page.R_2)
rep_15 = ReplaceText(Text="█.html", Find=panel_56, Replace=concat_10, RecursiveReplace=False)  # -> flatten(Result)
file_write_10 = FileWrite(content=html_compiler_4, file_path=panel_55, T=rep_15, activate=toggle)

html_compiler_5 = HTMLCompiler(svg_text=merge_25, layout=svg_plane_by_page.R_2)
rep_16 = ReplaceText(Text="█.html", Find=panel_48, Replace=panel_46, RecursiveReplace=False)  # -> flatten(Result)
file_write_11 = FileWrite(content=html_compiler_5, file_path=panel_31, T=rep_16, activate=toggle)

# ----
page_dimension_ratio = Panel("1")
layout_split = LAYSPLITNEW(T=data_5)  # -> pl_2, data_3, data_4
expression = Expression(x=layout_split.data_3, y=page_dimension_ratio, Expression="x*y")
panel_58 = Panel(layout_split.data_3)
dpi = Panel("150")
expression_2 = Expression(x=expression, Expression="x/25.4")
expression_3 = Expression(x=expression_2, y=dpi, Expression="ceiling(x*y)")
item = ListItem(List=expression_3, Index=0, Wrap=True)  # -> Item, Item1
int = Integer(item.Item1)
int_2 = Integer(item.Item)
txt = Text(int_2)
txt_2 = Text(int)

data_10 = Data("H:\RemoteWork_Melbourne\SVG\ImageExports")

html_to_jpeg = COX_HTMLToJPEG(folder=data_10, height=txt_2, width=txt, ACTIVATE=Button())
# ---------- html_to_jpeg: Python ----------
import os 
import time 


svgs = [] 
match = "html" 

paths = os.listdir(folder) 


for path in paths: 
    if match in path: 
        svgs.append(path) 

print svgs 
jpgs = [os.path.splitext(x)[0] + '.png' for x in svgs] 
print jpgs 

svgs = [folder+"\\" + x for x in svgs] 
jpgs = [folder+"\\" + x for x in jpgs] 


for i in range(len(svgs)): 
    HTML = svgs[i] 
    JPG = jpgs[i] 
    cmdString2 = 'X:\\wkhtmltopdf\\bin\\wkhtmltoimage --transparent --height '+height+' --width '+width+'  "file:///' + HTML + '" "' + JPG + '"' 
    print cmdString2
    if ACTIVATE == True: 
        os.system(cmdString2)
# ---------- end html_to_jpeg ----------

# ----
# 2 SIZED TREES
panel_59 = Panel("""True
False""")  # disabled
dispatch_4 = Dispatch(List=divdist.Points, DispatchPattern=panel_59)  # -> PointsForTree1, PointsForTree2; disabled

# ---- group: MOVE TO POINTS
orient_2 = Orient(Geometry=merge_15, Source=pt_4, Target=dispatch_4.PointsForTree1)  # -> Geometry, Transform; disabled

orient_3 = Orient(Geometry=merge_14, Source=pt_3, Target=dispatch_4.PointsForTree2)  # -> Geometry, Transform; disabled

# ----
merge_26 = Merge(Data1=orient_3.Geometry, Data2=orient_2.Geometry)  # disabled

# ---- group: FINAL TREES
# NOTE!: CONNECT "BOTH TREES" INTO THE FINAL TREES IF USING THE 2 SIZE METHOD
data_11 = Data(merge_26)  # disabled

# ---- group: BAKE - TREES
# BAKE TREES
bake = BakeObjects(Geometry=data_11, Attributes=attributes, Bake=False)  # disabled

# ==== cluster SVGCompiler
data = ClusterInput()
T = ClusterInput()
panel = Panel("""<?xml version="1.0" encoding="utf-8"?>
<!-- Generator: Adobe Illustrator 16.0.0, SVG Export Plug-In . SVG Version: 6.00 Build 0)  -->
<!DOCTYPE svg PUBLIC "-//W3C//DTD SVG 1.1//EN" "http://www.w3.org/Graphics/SVG/1.1/DTD/svg11.dtd">
<svg version="1.1" xmlns="http://www.w3.org/2000/svg" xmlns:xlink="http://www.w3.org/1999/xlink" x="0px" y="0px"
width="100%" height="100%" viewBox="0 0 420 297"
xml:space="preserve">
<style type="text/css">""")
css = ClusterInput()
laysplit_new = LAYSPLITNEW(T=T)  # -> pl_2, data_3, data_4
css_2 = Data(css)
data_2 = Data(data)
dispatch = Dispatch(List=laysplit_new.data_3, DispatchPattern=[True, False])  # -> ListA, ListB
rep = ReplaceText(Text="width=\"`mm\" height=\"~mm\" viewBox=\"0 0 ` ~\"", Find="`", Replace=dispatch.ListA, RecursiveReplace=False)
tstat = TreeStatistics(Tree=flatten(data_2))  # -> Paths, Length, Count
rep_2 = ReplaceText(Text=rep, Find="~", Replace=dispatch.ListB, RecursiveReplace=False)  # -> simplify(Result)
viewer = ParamViewer("</svg>")
int = Integer(tstat.Count)
merge = Merge(Data1=panel, Data2=css_2, Data3="</style>")
repeat = RepeatData(Data=viewer, Length=int)
branch = TreeBranch(Tree="</svg>", Path=repeat, MaintainPaths=False)
tmatch = MatchText(Text=merge, RegEx="viewBox", Case=True)
mindex = MemberIndex(Set=tmatch, Member=Toggle(True))  # -> Index, Count
replace = ReplaceItems(List=merge, Item=rep_2, Indices=mindex.Index, Wrap=False)  # -> simplify(List)
merge_2 = Merge(Data1=flatten(replace), Data2=flatten(data_2), Data3=flatten(branch))
svg_text = Text(merge_2)
rep_3 = ReplaceText(Text=svg_text, Find=" =\"\" ", Replace=" ", RecursiveReplace=False)
join = TextJoin(Text=rep_3)
svg_content = Text(join)
svg_content_2 = ClusterOutput(svg_content)

# ==== cluster FileWrite
content = ClusterInput()
file_path = ClusterInput()
activate = ClusterInput()
T = ClusterInput()
content_2 = Data(content)
file_path_2 = Text(file_path)
join = TextJoin(Text=[file_path_2, T], Join="\")
vb = VBScript(path=simplify(join), lines=simplify(content_2), activate=activate)  # -> out, A
# ---------- vb: VB ----------
    If (activate = True)
      
      system.IO.File.WriteAllText(path, lines)
      A = "File written"
    Else
      A = "Not activated"
    End If
# ---------- end vb ----------

# ==== cluster SVGPlaneByPage
panel = Panel("""A4 (L),297,210
A4 (P),210,297
A3 (L),420,297
A3 (P),297,420
A1 (L),841,594
A1 (P),594,841""")
split = TextSplit(Text=panel, Separators=",")
item = ListItem(List=split, Index=0, Wrap=True)  # -> flatten(Item), flatten(Item1), flatten(Item2)
plane = ClusterInput()
M = ClusterInput()
mindex = MemberIndex(Set=item.Item, Member=simplify(M))  # -> simplify(flatten(Index)), Count
item_2 = ListItem(List=panel, Index=mindex.Index, Wrap=True)  # -> simplify(Item)
T = ClusterInput()
merge = Merge(Data1=simplify(item_2), Data2=simplify(M))
split_2 = TextSplit(Text=T, Separators=":")
item_3 = ListItem(List=merge, Index=0, Wrap=True)
item_4 = ListItem(List=split_2, Index=0, Wrap=True)  # -> Item, Item1
split_3 = TextSplit(Text=item_3, Separators=",")
item_5 = ListItem(List=reverse(split_3), Index=[0, 1], Wrap=True)  # -> reverse(Item)
num = Number(item_4.Item1)
num_2 = Number(item_5)
expression = Expression(x=num_2, y=num, Expression="x*y")
plane_2 = Data(plane)
plane_3 = Plane(flatten(plane_2))
dispatch = Dispatch(List=expression, DispatchPattern=[True, False])  # -> ListA, ListB
deplane = DeconstructPlane(Plane=plane_3)  # -> simplify(Origin), simplify(XAxis), simplify(YAxis), ZAxis
x_dim = Domain(dispatch.ListB)
y_dim = Domain(dispatch.ListA)
dims = Number(flatten(num_2))
pt = Point(deplane.Origin)
pt_2 = Point(deplane.XAxis)
pt_3 = Point(deplane.YAxis)
neg = Negative(Value=x_dim)
merge_2 = Merge(Data1=simplify(pt), Data2=simplify(pt_2), Data3=simplify(pt_3))  # -> simplify(Result)
rectangle = Rectangle(Plane=plane_2, XSize=y_dim, YSize=neg, Radius=0)  # -> Rectangle, Length
scale = Number(flatten(num))
pt2num = PointsToNumbers(Points=merge_2, Mask=4)  # -> simplify(Numbers)
path_mapper = PathMapper(scale, source="{0}", target="{0;2}")
path_mapper_2 = PathMapper(dims, source="{0}", target="{0;1}")
path_mapper_3 = PathMapper(plane_3, source="{0}", target="{0;0}")
join = TextJoin(Text=pt2num, Join=",")  # -> simplify(Result)
join_2 = TextJoin(Text=dims, Join=",")  # -> simplify(Result)
merge_3 = Merge(Data1=path_mapper_3, Data2=path_mapper_2, Data3=path_mapper)  # -> simplify(Result)
rep = ReplaceText(Text="~;", Find="~", Replace=simplify(join_2), RecursiveReplace=False)  # -> simplify(Result)
rep_2 = ReplaceText(Text="~", Find="~", Replace=simplify(scale), RecursiveReplace=False)  # -> simplify(Result)
rep_3 = ReplaceText(Text="~;", Find="~", Replace=simplify(join), RecursiveReplace=False)  # -> simplify(Result)
merge_4 = Merge(Data1=flatten(rep_3), Data2=flatten(rep), Data3=flatten(rep_2))
R = ClusterOutput(rectangle.Rectangle)
join_3 = TextJoin(Text=merge_4)
panel_2 = Panel(join_3)
R_2 = ClusterOutput(join_3)
panel_3 = Panel(merge_3)

# ==== cluster COX_SVGPath
text = ClusterInput()  # "---------"
crv = ClusterInput()
layout = ClusterInput()
class = ClusterInput()
attributes = ClusterInput()
text_2 = ClusterInput()  # "---------"
class_2 = Text(class)
layout_2 = Data(layout)
attributes_2 = Data(attributes)
concat = Concatenate(FragmentA="class=\"", FragmentB=class_2, FragmentC="\"")
text_3 = Text(text)  # "---------"
text_4 = Text(text_2)  # "---------"
laysplit_new = LAYSPLITNEW(T=layout_2)  # -> pl_2, data_3, data_4
concat_2 = Concatenate(FragmentA=concat, FragmentB=" ", FragmentC=attributes_2)
null = NullItem(Item=class_2)  # -> NullFlags, InvalidFlags, Description
filter = StreamFilter(Gate=null.NullFlags, Stream0=concat_2, Stream1=attributes_2)
graft = GraftTree(Tree=filter, IncludeEmptyLists=True, IncludeNullItems=True)  # -> simplify(Tree)
null_2 = NullItem(Item=graft)  # -> NullFlags, InvalidFlags, Description
data = Data(laysplit_new.data_3)
dispatch = Dispatch(List="attributes=\"empty\"", DispatchPattern=null_2.NullFlags)  # -> ListA, ListB
item = ListItem(List=data, Index=0, Wrap=True)  # -> Item, Item1
merge = Merge(Data1=graft, Data2=dispatch.ListA)
null_3 = NullItem(Item=laysplit_new.data_4)  # -> NullFlags, InvalidFlags, Description
dom²num = ConstructDomain²(UMin=0, UMax=item.Item1, VMin=0, VMax=item.Item)
dispatch_2 = Dispatch(List="1", DispatchPattern=null_3.NullFlags)  # -> ListA, ListB
crv_2 = Curve(simplify(crv))
merge_2 = Merge(Data1=laysplit_new.data_4, Data2=dispatch_2.ListA)
num = Number(merge_2)
lng = ListLength(List=laysplit_new.pl_2)
cls = Closed(Curve=crv_2)  # -> Closed, Periodic
panel = Panel(crv_2)
repeat = RepeatData(Data=num, Length=lng)
dispatch_3 = Dispatch(List=graft(crv_2), DispatchPattern=graft(cls.Closed))  # -> ListA, ListB
explode = Explode(Curve=dispatch_3.ListA, Recursive=True)  # -> Segments, Vertices
eval = EvaluateLength(Curve=explode.Segments, Length=0, Normalized=True)  # -> simplify(Point), Tangent, Parameter
item_2 = ListItem(List=eval.Point, Index=0, Wrap=True)
merge_3 = Merge(Data1=eval.Point, Data2=item_2)  # -> simplify(Result)
explode_2 = Explode(Curve=dispatch_3.ListB, Recursive=True)  # -> Segments, simplify(Vertices)
weave = Weave(Pattern=graft(cls.Closed), Stream0=explode_2.Vertices, Stream1=merge_3, NullGaps=False)  # -> simplify(Weave)
lng_2 = ListLength(List=crv_2)
repeat_2 = RepeatData(Data=repeat, Length=lng_2)  # -> simplify(graft(Data))
plcoord = PlaneCoordinates(Point=simplify(weave), System=simplify(laysplit_new.pl_2))  # -> XCoordinate, YCoordinate, ZCoordinate
clean = CleanTree(RemoveNulls=True, RemoveInvalid=True, RemoveEmpty=True, Tree=plcoord.YCoordinate)
clean_2 = CleanTree(RemoveNulls=True, RemoveInvalid=True, RemoveEmpty=True, Tree=repeat_2)
clean_3 = CleanTree(RemoveNulls=True, RemoveInvalid=True, RemoveEmpty=True, Tree=merge)
clean_4 = CleanTree(RemoveNulls=True, RemoveInvalid=True, RemoveEmpty=True, Tree=plcoord.XCoordinate)
expression = Expression(x=clean, Expression="-(x)")
expression_2 = Expression(x=clean_4, y=clean_2, Expression="x/y")
expression_3 = Expression(x=expression, y=clean_2, Expression="x/y")
expression_4 = Expression(x=expression_2, Expression="(int(x*1000000))/1000000")
expression_5 = Expression(x=expression_3, Expression="(int(x*1000000))/1000000")
expression_6 = Expression(x=expression_5, Expression="round(x,2)")
expression_7 = Expression(x=expression_4, Expression="round(x,2)")
expression_8 = Expression(x=expression_7, y=expression_6, Expression="Format(\"{0} {1}\", x, y)")
null_4 = NullItem(Item=expression_6)  # -> NullFlags, InvalidFlags, Description
txt = Text("~")
ma = MassAddition(Input=null_4.NullFlags)  # -> Result, PartialResults
dispatch_4 = Dispatch(List=expression_8, DispatchPattern=ma.Result)  # -> ListA, ListB
join = TextJoin(Text=dispatch_4.ListB, Join=" L")
cluster = Cluster(data=join)
expression_9 = Expression(x=cluster, Expression="Format(\"M{0}Z\", x)")
txt_2 = Text("  ")
txt_3 = Text(" ")
join_2 = TextJoin(Text=expression_9, Join=" ")
rep = ReplaceText(Text="<path ` d=\"~\"/>", Find=txt, Replace=join_2, RecursiveReplace=False)  # -> simplify(Result)
txt_4 = Text("`")
rep_2 = ReplaceText(Text=rep, Find=txt_4, Replace=clean_3, RecursiveReplace=False)  # -> simplify(Result)
rep_3 = ReplaceText(Text=rep_2, Find=txt_2, Replace=txt_3, RecursiveReplace=False)  # -> simplify(Result)
panel_2 = Panel(rep_3)
flatten = FlattenTree(Tree=rep_3, Path="{0}")
svg = Text(flatten)
crv_3 = Curve(crv_2)
svg_2 = ClusterOutput(svg)
crv_4 = ClusterOutput(crv_3)

# ==== cluster CSSStyleMaker
text = ClusterInput()  # "--------------------------------"
element = ClusterInput()  # Specifies the Element name. The Element name is the overarching title or group for a set of elements.
class = ClusterInput()  # Specifies the Class name. A Class acts as a secondary specification or grouping under Element name.
custom_attribute = ClusterInput()  # Specifies a custom attribute for the element/s. This custom attribute can be useful for assigning specific styles and/or events too.
events = ClusterInput()  # Specifies the Class name. A Class acts as a secondary specification or grouping under Element name.
events_2 = Data(events)
tmatch = MatchText(Text=events_2, RegEx="@keyframes", Case=True)
custom_attribute_2 = Data(custom_attribute)
element_2 = Text(element)
text_2 = Text(text)  # "--------------------------------"
class_2 = Data(class)
mindex = MemberIndex(Set=tmatch, Member=True)  # -> simplify(flatten(Index)), Count
lng = ListLength(List=events_2)  # -> expr("x-1", flatten(Length))
shift = ShiftList(List=mindex.Index, Shift=1, Wrap=False)
concat = Concatenate(FragmentA=element_2, FragmentB=".", FragmentC=class_2, FragmentE=" {")
null = NullItem(Item=custom_attribute_2)  # -> NullFlags, InvalidFlags, Description
subtraction = Subtraction(A=shift, B=1)
merge = Merge(Data1=flatten(subtraction), Data2=flatten(lng))  # -> flatten(Result)
merge_2 = Merge(Data1=simplify(graft(mindex.Index)), Data2=simplify(graft(merge)))
bool = Boolean(invert(null.NullFlags))
rep = ReplaceText(Text="[~]{", Find="~", Replace=custom_attribute_2, RecursiveReplace=False)
item = ListItem(List=merge_2, Index=0, Wrap=True)  # -> Item, Item1
filter = StreamFilter(Gate=bool, Stream0=concat, Stream1=rep)
expression = Expression(x=item.Item1, y=item.Item, Expression="x-y+1")
lng_2 = ListLength(List=flatten(filter))
stroke_colour = ClusterInput()
txt = Text("}")
series = Series(Start=item.Item, Step=1, Count=expression)
text_3 = ClusterInput()  # "--------------------------------"
fill = ClusterInput()
text_4 = ClusterInput()  # "--------------------------------"
stroke_opacity = ClusterInput()
fill_opacity = ClusterInput()
opacity = ClusterInput()
stroke_thickness = ClusterInput()
dash = ClusterInput()
gap = ClusterInput()
line_cap = ClusterInput()
line_join = ClusterInput()
repeat = RepeatData(Data=txt, Length=lng_2)  # -> simplify(graft(Data))
item_2 = ListItem(List=events_2, Index=series, Wrap=True)  # -> simplify(Item)
cull_i = CullIndex(List=item_2, Indices=0, Wrap=True)
split = TextSplit(Text=cull_i, Separators=":")
tmatch_2 = MatchText(Text=fill, Pattern="none", Case=True)
stroke_colour_2 = Colour(stroke_colour)
tstat = TreeStatistics(Tree=repeat)  # -> Paths, Length, Count
argb = SplitARGB(Colour=stroke_colour_2, IntegerChannels=True)  # -> Alpha, Red, Green, Blue
fill_2 = Colour(fill)
dash_2 = Data(dash)
gap_2 = Data(gap)
profile = Duration(L=split, R="profile")
direction = Duration(L=split, R="direction")
iteration = Duration(L=split, R="iteration")
duration = Duration(L=split, R="duration")
item_3 = ListItem(List=item_2, Index=0, Wrap=True)
stroke_thickness_2 = Data(stroke_thickness)
text_5 = Text(text_4)  # "--------------------------------"
stroke_opacity_2 = Number(stroke_opacity)
fill_opacity_2 = Number(fill_opacity)
opacity_2 = Number(opacity)
dpath = DeconstructPath(Branch=tstat.Paths)
line_cap_2 = Text(line_cap)
line_join_2 = Text(line_join)
argb_2 = SplitARGB(Colour=fill_2, IntegerChannels=True)  # -> Alpha, Red, Green, Blue
int = Integer([argb.Red, argb.Green, argb.Blue])
concat_2 = Concatenate(FragmentA=stroke_thickness_2, FragmentB="mm")
join = TextJoin(Text=flatten(profile), Join=", ")
join_2 = TextJoin(Text=flatten(direction), Join=", ")
join_3 = TextJoin(Text=flatten(iteration), Join=", ")
join_4 = TextJoin(Text=flatten(duration), Join=", ")
lng_3 = ListLength(List=dpath)
null_2 = NullItem(Item=flatten(line_cap_2))  # -> NullFlags, InvalidFlags, Description
null_3 = NullItem(Item=stroke_opacity_2)  # -> NullFlags, InvalidFlags, Description
join_5 = TextJoin(Text=int, Join=",")
null_4 = NullItem(Item=fill_opacity_2)  # -> NullFlags, InvalidFlags, Description
null_5 = NullItem(Item=opacity_2)  # -> NullFlags, InvalidFlags, Description
null_6 = NullItem(Item=dash_2)  # -> NullFlags, InvalidFlags, Description
null_7 = NullItem(Item=gap_2)  # -> NullFlags, InvalidFlags, Description
concat_3 = Concatenate(FragmentA=dash_2, FragmentB="mm")
concat_4 = Concatenate(FragmentA=gap_2, FragmentB="mm")
null_8 = NullItem(Item=flatten(line_join_2))  # -> NullFlags, InvalidFlags, Description
int_2 = Integer([argb_2.Red, argb_2.Green, argb_2.Blue])
null_9 = NullItem(Item=stroke_thickness_2)  # -> NullFlags, InvalidFlags, Description
text_6 = Text(text_3)  # "--------------------------------"
panel = Panel(join_3)
panel_2 = Panel(join_4)
panel_3 = Panel(join_2)
panel_4 = Panel(join)
p_n_c = PickNChoose(Pattern=null_3.NullFlags, Stream0=stroke_opacity_2, Stream1="none")
p_n_c_2 = PickNChoose(Pattern=null_4.NullFlags, Stream0=fill_opacity_2, Stream1="none")
ma = MassAddition(Input=null_2.NullFlags)  # -> Result, PartialResults
join_6 = TextJoin(Text=int_2, Join=",")
p_n_c_3 = PickNChoose(Pattern=null_5.NullFlags, Stream0=opacity_2, Stream1="none")
rep_2 = ReplaceText(Text="rgb(*)", Find="*", Replace=join_5, RecursiveReplace=False)
trim = TrimTree(Tree=repeat, Depth=expr("x-1", lng_3))
null_10 = NullItem(Item=join_5)  # -> NullFlags, InvalidFlags, Description
join_7 = TextJoin(Text=[concat_3, concat_4], Join=",")
p_n_c_4 = PickNChoose(Pattern=ma.Result, Stream0=line_cap_2, Stream1="none")
ma_2 = MassAddition(Input=null_8.NullFlags)  # -> Result, PartialResults
or = GateOr(A=null_6.NullFlags, B=null_7.NullFlags)
p_n_c_5 = PickNChoose(Pattern=ma_2.Result, Stream0=line_join_2, Stream1="none")
p_n_c_6 = PickNChoose(Pattern=null_9.NullFlags, Stream0=concat_2, Stream1="none")
split_2 = TextSplit(Text=item_3)
rep_3 = ReplaceText(Text="rgb(*)", Find="*", Replace=join_6, RecursiveReplace=False)
rep_4 = ReplaceText(Text="\tstroke-opacity:*;", Find="*", Replace=p_n_c, RecursiveReplace=False)
p_n_c_7 = PickNChoose(Pattern=null_10.NullFlags, Stream0=rep_2, Stream1="none")
rep_5 = ReplaceText(Text="\tfill-opacity:*;", Find="*", Replace=p_n_c_2, RecursiveReplace=False)
rep_6 = ReplaceText(Text="\topacity:*;", Find="*", Replace=p_n_c_3, RecursiveReplace=False)
rep_7 = ReplaceText(Text="\tstroke-linecap:*;", Find="*", Replace=p_n_c_4, RecursiveReplace=False)
rep_8 = ReplaceText(Text="\tstroke-linejoin:*;", Find="*", Replace=p_n_c_5, RecursiveReplace=False)
rep_9 = ReplaceText(Text="\tstroke-width:*;", Find="*", Replace=p_n_c_6, RecursiveReplace=False)
ma_3 = MassAddition(Input=flatten(null_9.NullFlags))  # -> Result, PartialResults
p_n_c_8 = PickNChoose(Pattern=or, Stream0=join_7, Stream1="none")
item_4 = ListItem(List=split_2, Index=0, Wrap=True)
ma_4 = MassAddition(Input=flatten(null_10.NullFlags))  # -> Result, PartialResults
rep_10 = ReplaceText(Text="\tstroke:~;", Find="~", Replace=p_n_c_7, RecursiveReplace=False)
null_11 = NullItem(Item=fill)  # -> NullFlags, InvalidFlags, Description
gate = StreamGate(Stream=rep_4, Gate=null_3.NullFlags)  # -> Target0, Target1
p_n_c_9 = PickNChoose(Pattern=tmatch_2, Stream0=rep_3, Stream1="none")
gate_2 = StreamGate(Stream=rep_6, Gate=null_5.NullFlags)  # -> Target0, Target1
gate_3 = StreamGate(Stream=rep_5, Gate=null_4.NullFlags)  # -> Target0, Target1
gate_4 = StreamGate(Stream=rep_7, Gate=ma.Result)  # -> Target0, Target1
gate_5 = StreamGate(Stream=rep_8, Gate=ma_2.Result)  # -> Target0, Target1
rep_11 = ReplaceText(Text="\tstroke-dasharray:*;", Find="*", Replace=p_n_c_8, RecursiveReplace=False)
gate_6 = StreamGate(Stream=rep_9, Gate=ma_3.Result)  # -> Target0, Target1
branch = TreeBranch(Tree=item_3, Path="{0}", MaintainPaths=True)
split_3 = TextSplit(Text=item_4, Separators=" ")
rep_12 = ReplaceText(Text="\tfill:~;", Find="~", Replace=p_n_c_9, RecursiveReplace=False)
gate_7 = StreamGate(Stream=rep_10, Gate=ma_4.Result)  # -> Target0, Target1
gate_8 = StreamGate(Stream=rep_11, Gate=or)  # -> Target0, Target1
null_12 = NullItem(Item=branch)  # -> NullFlags, InvalidFlags, Description
item_5 = ListItem(List=split_3, Index=1, Wrap=True)
gate_9 = StreamGate(Stream=rep_12, Gate=null_11.NullFlags)  # -> Target0, Target1
join_8 = TextJoin(Text=flatten(item_5), Join=", ")
rep_13 = ReplaceText(Text="\tanimation-name: *;", Find="*", Replace=join_8, RecursiveReplace=False)  # -> simplify(Result)
rep_14 = ReplaceText(Text="\tanimation-duration: *;", Find="*", Replace=panel_2, RecursiveReplace=False)  # -> simplify(Result)
rep_15 = ReplaceText(Text="\tanimation-iteration-count: *;", Find="*", Replace=panel, RecursiveReplace=False)  # -> simplify(Result)
rep_16 = ReplaceText(Text="\tanimation-direction: *;", Find="*", Replace=panel_3, RecursiveReplace=False)  # -> simplify(Result)
rep_17 = ReplaceText(Text="\tanimation-timing-function: *;", Find="*", Replace=panel_4, RecursiveReplace=False)  # -> simplify(Result)
gate_10 = StreamGate(Stream=rep_13, Gate=null_12.NullFlags)  # -> flatten(Target0), Target1
gate_11 = StreamGate(Stream=rep_14, Gate=null_12.NullFlags)  # -> flatten(Target0), Target1
gate_12 = StreamGate(Stream=rep_15, Gate=null_12.NullFlags)  # -> flatten(Target0), Target1
gate_13 = StreamGate(Stream=rep_16, Gate=null_12.NullFlags)  # -> flatten(Target0), Target1
gate_14 = StreamGate(Stream=rep_17, Gate=null_12.NullFlags)  # -> flatten(Target0), Target1
merge_3 = Merge(Data1=gate_10.Target0, Data2=gate_11.Target0, Data3=gate_12.Target0, Data4=gate_13.Target0, Data5=gate_14.Target0)  # -> flatten(Result)
merge_4 = Merge(
    Data1=gate_7.Target0,
    Data2=gate_6.Target0,
    Data3=gate_8.Target0,
    Data4=gate_4.Target0,
    Data5=gate_5.Target0,
    Data6=gate_9.Target0,
    Data7=gate.Target0,
    Data8=gate_3.Target0,
    Data9=gate_2.Target0)  # -> flatten(Result)
merge_5 = Merge(Data1=filter, Data2=merge_4, Data3=merge_3, Data4=trim)
join_9 = TextJoin(Text=merge_5)
merge_6 = Merge(Data1=flatten(item_3), Data2=flatten(join_9))
css = Data(merge_6)
css_2 = ClusterOutput(css)

# ==== cluster SVGTextObject
text = ClusterInput()  # "-----------------------"
element = ClusterInput()
class = ClusterInput()
R = ClusterInput()
txt = ClusterInput()
P = ClusterInput()
T = ClusterInput()
element_2 = Text(element)
class_2 = Text(class)
text_2 = Text(text)  # "-----------------------"
null = NullItem(Item=element_2)  # -> NullFlags, InvalidFlags, Description
null_2 = NullItem(Item=class_2)  # -> NullFlags, InvalidFlags, Description
laysplit_new = LAYSPLITNEW(T=T)  # -> pl_2, data_3, data_4
and = GateAnd(A=null.NullFlags, B=null_2.NullFlags)
plcoord = PlaneCoordinates(Point=simplify(P), System=simplify(laysplit_new.pl_2))  # -> XCoordinate, YCoordinate, ZCoordinate
bool = Boolean(invert(and))
expression = Expression(x=plcoord.YCoordinate, Expression="abs(x)")
expression_2 = Expression(x=plcoord.XCoordinate, y=laysplit_new.data_4, Expression="x/y")
expression_3 = Expression(x=expression, y=laysplit_new.data_4, Expression="x/y")
rep = ReplaceText(Text="<* + ~>`</*>", Find="*", Replace=element_2, RecursiveReplace=False)
expression_4 = Expression(x=expression_2, y=expression_3, Expression="Format(\"x=~{0}~ y=~{1}~\", x, y)")
filter = StreamFilter(Gate=bool, Stream0="<text + ~>`</text>", Stream1=rep)
rep_2 = ReplaceText(Text=filter, Find="+", Replace=R, RecursiveReplace=False)
rep_3 = ReplaceText(Text=expression_4, Find="~", Replace="\"", RecursiveReplace=False)
txt_2 = Text("~")
rep_4 = ReplaceText(Text=rep_2, Find=txt_2, Replace=rep_3, RecursiveReplace=False)  # -> simplify(Result)
txt_3 = Text(txt)
rep_5 = ReplaceText(Text=rep_4, Find="`", Replace=txt_3, RecursiveReplace=False)  # -> simplify(Result)
R_2 = ClusterOutput(rep_5)
txt_4 = ClusterOutput(txt_3)

# ==== cluster CSSTextStyle
I = ClusterInput()
style = ClusterInput()
font = ClusterInput()
selector = ClusterInput()
size = ClusterInput()
opacity = ClusterInput()
opacity_2 = ClusterInput()
stroke_colour = Colour(I)
argb = SplitARGB(Colour=stroke_colour, IntegerChannels=True)  # -> Alpha, Red, Green, Blue
selector_2 = Text(selector)
font_2 = Text(font)
style_2 = Text(style)
size_2 = Text(size)
opacity_3 = Text(opacity)
opacity_4 = Text(opacity_2)
null = NullItem(Item=I)  # -> NullFlags, InvalidFlags, Description
null_2 = NullItem(Item=style_2)  # -> NullFlags, InvalidFlags, Description
null_3 = NullItem(Item=selector_2)  # -> NullFlags, InvalidFlags, Description
int = Integer([argb.Red, argb.Green, argb.Blue])
null_4 = NullItem(Item=opacity_3)  # -> NullFlags, InvalidFlags, Description
null_5 = NullItem(Item=opacity_4)  # -> NullFlags, InvalidFlags, Description
join = TextJoin(Text=int, Join=",")
filter = StreamFilter(Gate=null_3.NullFlags, Stream0=selector_2, Stream1=".text {")
rep = ReplaceText(Text="rgb(*)", Find="*", Replace=join, RecursiveReplace=False)
null_6 = NullItem(Item=join)  # -> NullFlags, InvalidFlags, Description
p_n_c = PickNChoose(Pattern=null_6.NullFlags, Stream0=rep, Stream1="none")
rep_2 = ReplaceText(Text="\tfont-family:\"*\";", Find="*", Replace=font_2, RecursiveReplace=False)
rep_3 = ReplaceText(Text="\tfont-style:*;", Find="*", Replace=style_2, RecursiveReplace=False)
rep_4 = ReplaceText(Text="\tfont-size:*;", Find="*", Replace=size_2, RecursiveReplace=False)
rep_5 = ReplaceText(Text="\topacity:*;", Find="*", Replace=opacity_3, RecursiveReplace=False)
rep_6 = ReplaceText(Text="\tfont-weight:*;", Find="*", Replace=opacity_4, RecursiveReplace=False)
txt = Text(filter)
txt_2 = Text("}")
ma = MassAddition(Input=flatten(null_6.NullFlags))  # -> Result, PartialResults
rep_7 = ReplaceText(Text="\tfill:~;", Find="~", Replace=p_n_c, RecursiveReplace=False)
gate = StreamGate(Stream=rep_3, Gate=null_2.NullFlags)  # -> Target0, Target1
gate_2 = StreamGate(Stream=rep_5, Gate=null_4.NullFlags)  # -> Target0, Target1
gate_3 = StreamGate(Stream=rep_6, Gate=null_5.NullFlags)  # -> Target0, Target1
gate_4 = StreamGate(Stream=rep_7, Gate=ma.Result)  # -> Target0, Target1
gate_5 = StreamGate(Stream=gate_4.Target0, Gate=null.NullFlags)  # -> Target0, Target1
merge = Merge(Data1=txt, Data2=rep_2, Data3=gate.Target0, Data4=gate_5.Target0, Data5=rep_4, Data6=gate_2.Target0, Data8=txt_2)
join_2 = TextJoin(Text=merge)
data = Data(join_2)
data_2 = ClusterOutput(data)

# ==== cluster SVGPlaneByPage_2
M = ClusterInput()
panel = Panel("""A4 (L),297,210
A4 (P),210,297
A3 (L),420,297
A3 (P),297,420
A1 (L),841,594
A1 (P),594,841""")
split = TextSplit(Text=panel, Separators=",")
item = ListItem(List=split, Index=0, Wrap=True)  # -> flatten(Item), flatten(Item1), flatten(Item2)
mindex = MemberIndex(Set=item.Item, Member=simplify(M))  # -> simplify(flatten(Index)), Count
plane = ClusterInput()
item_2 = ListItem(List=panel, Index=mindex.Index, Wrap=True)  # -> simplify(Item)
T = ClusterInput()
merge = Merge(Data1=simplify(item_2), Data2=simplify(M))
split_2 = TextSplit(Text=T, Separators=":")
item_3 = ListItem(List=merge, Index=0, Wrap=True)
item_4 = ListItem(List=split_2, Index=0, Wrap=True)  # -> Item, Item1
unit_checker = PythonScript()  # -> out, a
# ---------- unit_checker: Python ----------
import rhinoscriptsyntax as rs
import scriptcontext as sc

a=sc.doc.ModelUnitSystem
a = str(a)
if a == "Millimeters":
    print 1
elif a == "Meters":
    print 1000
else:
    print "Use the metric system fool"
# ---------- end unit_checker ----------
split_3 = TextSplit(Text=item_3, Separators=",")
division = Division(A=item_4.Item1, B=unit_checker.out)
item_5 = ListItem(List=reverse(split_3), Index=[0, 1], Wrap=True)  # -> reverse(Item)
num = Number(division)
num_2 = Number(item_5)
expression = Expression(x=num_2, y=num, Expression="x*y")
plane_2 = Data(plane)
plane_3 = Plane(flatten(plane_2))
dispatch = Dispatch(List=expression, DispatchPattern=[True, False])  # -> ListA, ListB
deplane = DeconstructPlane(Plane=plane_3)  # -> simplify(Origin), simplify(XAxis), simplify(YAxis), ZAxis
x_dim = Domain(dispatch.ListB)
y_dim = Domain(dispatch.ListA)
dims = Number(flatten(num_2))
pt = Point(deplane.Origin)
pt_2 = Point(deplane.XAxis)
pt_3 = Point(deplane.YAxis)
neg = Negative(Value=x_dim)
merge_2 = Merge(Data1=simplify(pt), Data2=simplify(pt_2), Data3=simplify(pt_3))  # -> simplify(Result)
rectangle = Rectangle(Plane=plane_2, XSize=y_dim, YSize=neg, Radius=0)  # -> Rectangle, Length
scale = Number(flatten(num))
pt2num = PointsToNumbers(Points=merge_2, Mask=4)  # -> simplify(Numbers)
path_mapper = PathMapper(scale, source="{0}", target="{0;2}")
path_mapper_2 = PathMapper(dims, source="{0}", target="{0;1}")
path_mapper_3 = PathMapper(plane_3, source="{0}", target="{0;0}")
join = TextJoin(Text=pt2num, Join=",")  # -> simplify(Result)
join_2 = TextJoin(Text=dims, Join=",")  # -> simplify(Result)
merge_3 = Merge(Data1=path_mapper_3, Data2=path_mapper_2, Data3=path_mapper)  # -> simplify(Result)
rep = ReplaceText(Text="~;", Find="~", Replace=simplify(join_2), RecursiveReplace=False)  # -> simplify(Result)
rep_2 = ReplaceText(Text="~", Find="~", Replace=simplify(scale), RecursiveReplace=False)  # -> simplify(Result)
rep_3 = ReplaceText(Text="~;", Find="~", Replace=simplify(join), RecursiveReplace=False)  # -> simplify(Result)
merge_4 = Merge(Data1=flatten(rep_3), Data2=flatten(rep), Data3=flatten(rep_2))
R = ClusterOutput(rectangle.Rectangle)
join_3 = TextJoin(Text=merge_4)
panel_2 = Panel(join_3)
R_2 = ClusterOutput(join_3)
panel_3 = Panel(merge_3)

# ==== cluster SVGImage
img_pa = ClusterInput()  # IMG PA
rec = ClusterInput()
T = ClusterInput()
laysplit_new = LAYSPLITNEW(T=T)  # -> pl_2, data_3, data_4
txt = Text(img_pa)
rec_2 = Rectangle(rec)
lng = ListLength(List=rec_2)
null = NullItem(Item=laysplit_new.data_4)  # -> NullFlags, InvalidFlags, Description
repeat = RepeatData(Data=txt, Length=lng)
dispatch = Dispatch(List="1", DispatchPattern=null.NullFlags)  # -> ListA, ListB
drec = DeconstuctRectangle(Rectangle=rec_2)  # -> BasePlane, XInterval, YInterval
panel = Panel(repeat)
merge = Merge(Data1=laysplit_new.data_4, Data2=dispatch.ListA)
dedomain = DeconstructDomain(Domain=drec.XInterval)  # -> Start, End
dedomain_2 = DeconstructDomain(Domain=drec.YInterval)  # -> Start, End
num = Number(merge)
lng_2 = ListLength(List=laysplit_new.pl_2)
expression = Expression(x=dedomain.Start, y=dedomain.End, Expression="y-x")
expression_2 = Expression(x=dedomain_2.Start, y=dedomain_2.End, Expression="y-x")
dedomain_3 = DeconstructDomain(Domain=expression_2)  # -> Start, End
repeat_2 = RepeatData(Data=num, Length=lng_2)
dom = ConstructDomain(DomainStart=dedomain_3.Start, DomainEnd=expr("-x", dedomain_3.End))
xy = XYPlane(Origin=Point(0, 0, 0))
expression_3 = Expression(x=repeat_2, Expression="1/x")
rectangle = Rectangle(Plane=laysplit_new.pl_2, XSize=expression, YSize=dom, Radius=0)  # -> Rectangle, Length
scale = Scale(Geometry=rectangle.Rectangle, Center=laysplit_new.pl_2, Factor=expression_3)  # -> Geometry, Transform
scale_2 = Scale(Geometry=rec_2, Center=laysplit_new.pl_2, Factor=expression_3)  # -> Geometry, Transform
orient = Orient(Geometry=scale.Geometry, Source=laysplit_new.pl_2, Target=xy)  # -> Geometry, Transform
orient_2 = Orient(Geometry=scale_2.Geometry, Source=laysplit_new.pl_2, Target=xy)  # -> Geometry, Transform
attributes = ClusterInput()
attributes_2 = Data(attributes)
explode = Explode(Curve=orient_2.Geometry, Recursive=True)  # -> Segments, Vertices
explode_2 = Explode(Curve=orient.Geometry, Recursive=True)  # -> Segments, Vertices
graft = GraftTree(Tree=attributes_2, IncludeEmptyLists=True, IncludeNullItems=True)  # -> simplify(Tree)
null_2 = NullItem(Item=graft)  # -> NullFlags, InvalidFlags, Description
dispatch_2 = Dispatch(List="attributes=\"empty\"", DispatchPattern=null_2.NullFlags)  # -> ListA, ListB
item = ListItem(List=explode.Vertices, Index=-2, Wrap=True)
xy_2 = XYPlane(Origin=item)
item_2 = ListItem(List=explode.Vertices, Index=-3, Wrap=True)
item_3 = ListItem(List=explode_2.Vertices, Index=-2, Wrap=True)
xy_3 = XYPlane(Origin=item_3)
dedomain_4 = DeconstructDomain(Domain=drec.YInterval)  # -> Start, End
item_4 = ListItem(List=explode_2.Vertices, Index=-3, Wrap=True)
dedomain_5 = DeconstructDomain(Domain=drec.XInterval)  # -> Start, End
merge_2 = Merge(Data1=graft, Data2=dispatch_2.ListA)  # -> flatten(Result)
expression_4 = Expression(x=dedomain_5.Start, y=dedomain_5.End, Expression="abs(y-x)")
expression_5 = Expression(x=dedomain_4.Start, y=dedomain_4.End, Expression="abs(y-x)")
vec2pt = Vector2Pt(PointA=item_3, PointB=item_4, Unitize=False)  # -> Vector, Length
align = AlignPlane(Plane=xy_3, Direction=vec2pt.Vector)  # -> Plane, Angle
vec2pt_2 = Vector2Pt(PointA=item, PointB=item_2, Unitize=False)  # -> Vector, Length
align_2 = AlignPlane(Plane=xy_2, Direction=vec2pt_2.Vector)  # -> Plane, Angle
orient_3 = Orient(Geometry=orient.Geometry, Source=flatten(align.Plane), Target=flatten(align_2.Plane))  # -> Geometry, simplify(Transform)
panel_2 = Panel(merge_2)
orient_4 = OrientDirection(
    Geometry=orient.Geometry,
    PointA=flatten(item_3),
    DirectionA=flatten(vec2pt.Vector),
    PointB=flatten(item),
    DirectionB=flatten(vec2pt_2.Vector))  # -> Geometry, simplify(Transform)
expression_6 = Expression(x=expression_5, y=repeat_2, Expression="x/y")
expression_7 = Expression(x=expression_4, y=repeat_2, Expression="x/y")
cull_i = CullIndex(List=explode.Vertices, Indices=0, Wrap=True)
dematrix = DeconstructMatrix(Matrix=orient_3.Transform)  # -> Rows, Columns, simplify(Values)
avr = Average(Input=cull_i)
panel_3 = Panel(dematrix.Values)
plcoord = PlaneCoordinates(Point=simplify(avr), System=simplify(laysplit_new.pl_2))  # -> XCoordinate, YCoordinate, ZCoordinate
panel_4 = Panel("""3
7""")
panel_5 = Panel("""0
1
4
5""")
item_5 = ListItem(List=dematrix.Values, Index=panel_5, Wrap=True)
item_6 = ListItem(List=dematrix.Values, Index=panel_4, Wrap=True)
dedom2 = DeconstructDomain²(Domain=laysplit_new.data_3)  # -> UComponent, VComponent
dispatch_3 = Dispatch(List=item_6, DispatchPattern=[True, False])  # -> ListA, ListB
dedomain_6 = DeconstructDomain(Domain=dedom2.VComponent)  # -> Start, End
dedomain_7 = DeconstructDomain(Domain=dedom2.UComponent)  # -> Start, End
expression_8 = Expression(x=dispatch_3.ListB, Expression="-(x)")
expression_9 = Expression(x=dedomain_6.Start, y=dedomain_6.End, Expression="-((y-x)+((y-x)/3))")
expression_10 = Expression(x=dedomain_7.Start, y=dedomain_7.End, Expression="(y-x)+((y-x)/3)")
expression_11 = Expression(x=dedomain_7.Start, y=dedomain_7.End, Expression="-((y-x)/3)")
expression_12 = Expression(x=dedomain_6.Start, y=dedomain_6.End, Expression="((y-x)/3)")
merge_3 = Merge(Data1=simplify(item_5), Data2=simplify(dispatch_3.ListA), Data3=simplify(expression_8))
join = TextJoin(Text=merge_3, Join=" ")
dom_2 = ConstructDomain(DomainStart=expression_12, DomainEnd=expression_9)
dom_3 = ConstructDomain(DomainStart=expression_11, DomainEnd=expression_10)
rep = ReplaceText(Text="onerror=\"this.src='file:///~'\"", Find="~", Replace=repeat, RecursiveReplace=False)
rep_2 = ReplaceText(Text="xlink:href=\"~\"", Find="~", Replace=repeat, RecursiveReplace=False)
rep_3 = ReplaceText(Text="height=\"~\"", Find="~", Replace=expression_6, RecursiveReplace=False)
rep_4 = ReplaceText(Text="width=\"~\"", Find="~", Replace=expression_7, RecursiveReplace=False)
rep_5 = ReplaceText(Text="transform=\"matrix(~)\"", Find="~", Replace=join, RecursiveReplace=False)
inc = Includes(Value=plcoord.XCoordinate, Domain=dom_3)  # -> Includes, Deviation
inc_2 = Includes(Value=plcoord.YCoordinate, Domain=dom_2)  # -> Includes, Deviation
data = Data(flatten(rep))
data_2 = Data(flatten(rep_2))
data_3 = Data(flatten(rep_3))
data_4 = Data(flatten(rep_4))
data_5 = Data(flatten(rep_5))
ma = MassAddition(Input=inc.Includes)  # -> Result, PartialResults
ma_2 = MassAddition(Input=inc_2.Includes)  # -> Result, PartialResults
bool = Boolean(ma.Result)
bool_2 = Boolean(ma_2.Result)
merge_4 = Merge(
    Data1=simplify(graft(merge_2)),
    Data3=simplify(graft(data_4)),
    Data4=simplify(graft(data_3)),
    Data5=simplify(graft(data_5)),
    Data6=simplify(graft(data_2)),
    Data7=simplify(graft(data)))
and = GateAnd(A=bool, B=bool_2)
or = GateOr(A=and)  # -> flatten(Result)
join_2 = TextJoin(Text=merge_4, Join=" ")  # -> simplify(Result)
rep_6 = ReplaceText(Text="<image ~/>", Find="~", Replace=join_2, RecursiveReplace=False)
data_6 = Data(flatten(rep_6))
dispatch_4 = Dispatch(List=simplify(data_6), DispatchPattern=or)  # -> ListA, ListB
clean = CleanTree(RemoveNulls=True, RemoveInvalid=True, RemoveEmpty=True, Tree=dispatch_4.ListA)
svg = Text(dispatch_4.ListB)
panel_6 = Panel(svg)
svg_2 = ClusterOutput(svg)

# ==== cluster SVGPolyline
crv = ClusterInput()
layout = ClusterInput()
class = ClusterInput()
attributes = ClusterInput()
text = ClusterInput()  # "---------"
class_2 = Text(class)
layout_2 = Data(layout)
attributes_2 = Data(attributes)
concat = Concatenate(FragmentA="class=\"", FragmentB=class_2, FragmentC="\"")
text_2 = Text(text)  # "---------"
laysplit_new = LAYSPLITNEW(T=layout_2)  # -> pl_2, data_3, data_4
concat_2 = Concatenate(FragmentA=concat, FragmentB=" ", FragmentC=attributes_2)
null = NullItem(Item=class_2)  # -> NullFlags, InvalidFlags, Description
filter = StreamFilter(Gate=null.NullFlags, Stream0=concat_2, Stream1=attributes_2)
graft = GraftTree(Tree=filter, IncludeEmptyLists=True, IncludeNullItems=True)  # -> simplify(Tree)
null_2 = NullItem(Item=graft)  # -> NullFlags, InvalidFlags, Description
data = Data(laysplit_new.data_3)
dispatch = Dispatch(List="attributes=\"empty\"", DispatchPattern=null_2.NullFlags)  # -> ListA, ListB
item = ListItem(List=data, Index=0, Wrap=True)  # -> Item, Item1
merge = Merge(Data1=graft, Data2=dispatch.ListA)
null_3 = NullItem(Item=laysplit_new.data_4)  # -> NullFlags, InvalidFlags, Description
dom²num = ConstructDomain²(UMin=0, UMax=item.Item1, VMin=0, VMax=item.Item)
dispatch_2 = Dispatch(List="1", DispatchPattern=null_3.NullFlags)  # -> ListA, ListB
merge_2 = Merge(Data1=laysplit_new.data_4, Data2=dispatch_2.ListA)
crv_2 = Curve(simplify(crv))
num = Number(merge_2)
lng = ListLength(List=laysplit_new.pl_2)
cls = Closed(Curve=crv_2)  # -> Closed, Periodic
repeat = RepeatData(Data=num, Length=lng)
dispatch_3 = Dispatch(List=graft(crv_2), DispatchPattern=graft(cls.Closed))  # -> ListA, ListB
explode = Explode(Curve=dispatch_3.ListA, Recursive=True)  # -> Segments, Vertices
eval = EvaluateLength(Curve=explode.Segments, Length=0, Normalized=True)  # -> simplify(Point), Tangent, Parameter
item_2 = ListItem(List=eval.Point, Index=0, Wrap=True)
merge_3 = Merge(Data1=eval.Point, Data2=item_2)  # -> simplify(Result)
explode_2 = Explode(Curve=dispatch_3.ListB, Recursive=True)  # -> Segments, simplify(Vertices)
weave = Weave(Pattern=graft(cls.Closed), Stream0=explode_2.Vertices, Stream1=merge_3, NullGaps=False)  # -> simplify(Weave)
lng_2 = ListLength(List=crv_2)
repeat_2 = RepeatData(Data=repeat, Length=lng_2)  # -> simplify(graft(Data))
plcoord = PlaneCoordinates(Point=simplify(weave), System=simplify(laysplit_new.pl_2))  # -> XCoordinate, YCoordinate, ZCoordinate
clean = CleanTree(RemoveNulls=True, RemoveInvalid=True, RemoveEmpty=True, Tree=plcoord.YCoordinate)
clean_2 = CleanTree(RemoveNulls=True, RemoveInvalid=True, RemoveEmpty=True, Tree=repeat_2)
clean_3 = CleanTree(RemoveNulls=True, RemoveInvalid=True, RemoveEmpty=True, Tree=merge)
clean_4 = CleanTree(RemoveNulls=True, RemoveInvalid=True, RemoveEmpty=True, Tree=plcoord.XCoordinate)
expression = Expression(x=clean, Expression="-(x)")
expression_2 = Expression(x=clean_4, y=clean_2, Expression="x/y")
expression_3 = Expression(x=expression, y=clean_2, Expression="x/y")
expression_4 = Expression(x=expression_3, Expression="(int(x*1000000))/1000000")
expression_5 = Expression(x=expression_2, Expression="(int(x*1000000))/1000000")
expression_6 = Expression(x=expression_5, y=expression_4, Expression="Format(\"{0},{1}\", x, y)")
null_4 = NullItem(Item=expression_4)  # -> NullFlags, InvalidFlags, Description
bool = Boolean(cls.Closed)
txt = Text("~")
ma = MassAddition(Input=null_4.NullFlags)  # -> Result, PartialResults
dispatch_4 = Dispatch(List=expression_6, DispatchPattern=ma.Result)  # -> ListA, ListB
weave_2 = Weave(Pattern=bool, Stream0="<polyline ` points=\"~\"/>", Stream1="<polygon ` points=\"~\"/>", NullGaps=False)
join = TextJoin(Text=dispatch_4.ListB, Join=" ")
cluster = Cluster(data=join)
rep = ReplaceText(Text=weave_2, Find=txt, Replace=cluster, RecursiveReplace=False)  # -> simplify(Result)
txt_2 = Text("`")
rep_2 = ReplaceText(Text=rep, Find=txt_2, Replace=clean_3, RecursiveReplace=False)  # -> simplify(Result)
panel = Panel(rep_2)
flatten = FlattenTree(Tree=rep_2, Path="{0}")
svg = Text(flatten)
crv_3 = Curve(crv_2)
svg_2 = ClusterOutput(svg)
crv_4 = ClusterOutput(crv_3)

# ==== cluster Cluster_2
num = ClusterInput()
x_shift = ClusterInput()
y_shift = ClusterInput()
A = ClusterInput()
data = ClusterInput()
x = ClusterInput()
data_2 = Data(data)
multiplication = Multiplication(A=A, B=10)
x_shift_2 = Number(x_shift)
y_shift_2 = Number(y_shift)
num_2 = Number(expr("x+1", num))
laysplit_new = LAYSPLITNEW(T=data_2)  # -> pl_2, data_3, data_4
deplane = DeconstructPlane(Plane=laysplit_new.pl_2)  # -> Origin, XAxis, YAxis, ZAxis
item = ListItem(List=laysplit_new.data_3, Index=0, Wrap=True)
item_2 = ListItem(List=laysplit_new.data_3, Index=1, Wrap=True)
expression = Expression(x=item, y=x_shift_2, z=laysplit_new.data_4, Expression="(x-y)*z")
expression_2 = Expression(x=item_2, y=y_shift_2, z=laysplit_new.data_4, Expression="(x-y)*z")
amp = Amplitude(Vector=deplane.YAxis, Amplitude=expr("-x", expression_2))
amp_2 = Amplitude(Vector=deplane.XAxis, Amplitude=expression)
expression_3 = Expression(x=multiplication, y=laysplit_new.data_4, Expression="x*y")
move = Move(Geometry=deplane.Origin, Motion=amp_2)  # -> Geometry, Transform
move_2 = Move(Geometry=move.Geometry, Motion=amp)  # -> Geometry, Transform
series = Series(Start=0, Step=expression_3, Count=num_2)
pt = Point(move_2.Geometry)
amp_3 = Amplitude(Vector=deplane.XAxis, Amplitude=series)
expression_4 = Expression(x=x, y=laysplit_new.data_4, Expression="x*y")
move_3 = Move(Geometry=pt, Motion=amp_3)  # -> Geometry, Transform
amp_4 = Amplitude(Vector=deplane.YAxis, Amplitude=expression_4)
unit_checker = PythonScript()  # -> out, a
# ---------- unit_checker: Python ----------
import rhinoscriptsyntax as rs
import scriptcontext as sc

a=sc.doc.ModelUnitSystem
a = str(a)
if a == "Millimeters":
    print 1000
elif a == "Meters":
    print 1
else:
    print "Use the metric system fool"
# ---------- end unit_checker ----------
rev = Reverse(Vector=amp_4)
move_4 = Move(Geometry=move_3.Geometry, Motion=graft([amp_4, rev]))  # -> Geometry, Transform
expression_5 = Expression(x=expression_4, y=laysplit_new.data_4, z=Slider(1, range=0..3), Expression="x+(z*y)")
bang = ExplodeTree(Data=move_4.Geometry)  # -> Branch0, Branch1
number_slider = Slider(100, range=0..100)
pt_2 = Point(move_3.Geometry)
panel = Panel(bang.Branch1)
division = Division(A=series, B=unit_checker.out)
amp_5 = Amplitude(Vector=deplane.YAxis, Amplitude=expression_5)
pt_3 = Point(move_3.Geometry)
shift = ShiftList(List=pt_2, Shift=1, Wrap=True)
shift_2 = ShiftList(List=bang.Branch1, Shift=1, Wrap=True)
cull_i = CullIndex(List=division, Indices=0, Wrap=True)
partition = PartitionList(List=shift, Size=2)
partition_2 = PartitionList(List=shift_2, Size=2)
move_5 = Move(Geometry=pt_3, Motion=amp_5)  # -> Geometry, Transform
larger = LargerThan(FirstNumber=cull_i, SecondNumber=1)  # -> LargerThan, OrEqualTo
int = Integer(division)
pline = PolyLine(Vertices=partition, Closed=False)  # -> flatten(Polyline)
pline_2 = PolyLine(Vertices=partition_2, Closed=False)  # -> flatten(Polyline)
pt_4 = Point(pline_2)
points = PointList(Points=pt_4, Size=Slider(1000, range=0..1000))
txt = Text(int)
txt_2 = Text(division)
ma = MassAddition(Input=larger.OrEqualTo)  # -> Result, PartialResults
partition_3 = PartitionList(List=bang.Branch0, Size=2)
partition_4 = PartitionList(List=pt_2, Size=2)
larger_2 = LargerThan(FirstNumber=ma.Result, SecondNumber=1)  # -> LargerThan, OrEqualTo
filter = StreamFilter(Gate=larger_2.LargerThan, Stream0=txt_2, Stream1=txt)  # -> flatten(Stream)
cull_i_2 = CullIndex(List=pline, Indices=-1, Wrap=True)  # -> flatten(List)
pline_3 = PolyLine(Vertices=partition_3, Closed=False)  # -> flatten(Polyline)
cull_i_3 = CullIndex(List=pline_2, Indices=-1, Wrap=True)  # -> flatten(List)
pline_4 = PolyLine(Vertices=partition_4, Closed=False)  # -> flatten(Polyline)
points_2 = PointList(Points=partition_2, Size=Slider(15, range=0..100))
graft = GraftTree(Tree=pline_4, IncludeEmptyLists=True, IncludeNullItems=True)  # -> simplify(Tree)
graft_2 = GraftTree(Tree=pline_3, IncludeEmptyLists=True, IncludeNullItems=True)  # -> simplify(Tree)
graft_3 = GraftTree(Tree=cull_i_2, IncludeEmptyLists=True, IncludeNullItems=True)  # -> simplify(Tree)
graft_4 = GraftTree(Tree=cull_i_3, IncludeEmptyLists=True, IncludeNullItems=True)  # -> simplify(Tree)
cull_i_4 = CullIndex(List=filter, Indices=[0, -1], Wrap=True)
item_3 = ListItem(List=filter, Index=0, Wrap=True)  # -> Item1, Item
text_location = Geometry(move_5.Geometry)
concat = Concatenate(FragmentA=simplify(graft([item_3.Item, item_3.Item1])), FragmentB=simplify("m"))  # -> flatten(Result)
text_location_2 = ClusterOutput(text_location)
loft = Loft(
    Curves=[graft, graft_2],
    Options={Adjust=False, Closed=False, LoftEnds=0, LoftSimp=0, LoftType=0, Rebuild=10, Refit=0.01})
loft_2 = Loft(
    Curves=[graft_3, graft_4],
    Options={Adjust=False, Closed=False, LoftEnds=0, LoftSimp=0, LoftType=0, Rebuild=10, Refit=0.01})
curves = Curve(flatten([loft, loft_2]))
item_4 = ListItem(List=concat, Index=0, Wrap=True)  # -> Item, Item1
merge = Merge(Data1=flatten(item_4.Item), Data2=flatten(cull_i_4), Data3=flatten(item_4.Item1))
topoly = CurveToPolyline(Curve=curves, ToleranceDistance=0, ToleranceAngle=0)  # -> Polyline, Segments
text = Text(merge)
P = ClusterOutput(topoly.Polyline)
text_2 = ClusterOutput(text)

# ==== cluster SVGPlaneByPage_3
M = ClusterInput()
panel = Panel("""A4 (L),297,210
A4 (P),210,297
A3 (L),420,297
A3 (P),297,420
A1 (L),841,594
A1 (P),594,841
C (S),1000,1000""")
split = TextSplit(Text=panel, Separators=",")
item = ListItem(List=split, Index=0, Wrap=True)  # -> flatten(Item), flatten(Item1), flatten(Item2)
mindex = MemberIndex(Set=item.Item, Member=simplify(M))  # -> simplify(flatten(Index)), Count
plane = ClusterInput()
item_2 = ListItem(List=panel, Index=mindex.Index, Wrap=True)  # -> simplify(Item)
T = ClusterInput()
merge = Merge(Data1=simplify(item_2), Data2=simplify(M))
split_2 = TextSplit(Text=T, Separators=":")
item_3 = ListItem(List=merge, Index=0, Wrap=True)
item_4 = ListItem(List=split_2, Index=0, Wrap=True)  # -> Item, Item1
unit_checker = PythonScript()  # -> out, a; same code as unit_checker
split_3 = TextSplit(Text=item_3, Separators=",")
division = Division(A=item_4.Item1, B=unit_checker.out)
item_5 = ListItem(List=reverse(split_3), Index=[0, 1], Wrap=True)  # -> reverse(Item)
num = Number(division)
num_2 = Number(item_5)
expression = Expression(x=num_2, y=num, Expression="x*y")
plane_2 = Data(plane)
plane_3 = Plane(flatten(plane_2))
dispatch = Dispatch(List=expression, DispatchPattern=[True, False])  # -> ListA, ListB
deplane = DeconstructPlane(Plane=plane_3)  # -> simplify(Origin), simplify(XAxis), simplify(YAxis), ZAxis
x_dim = Domain(dispatch.ListB)
y_dim = Domain(dispatch.ListA)
dims = Number(flatten(num_2))
pt = Point(deplane.Origin)
pt_2 = Point(deplane.XAxis)
pt_3 = Point(deplane.YAxis)
neg = Negative(Value=x_dim)
merge_2 = Merge(Data1=simplify(pt), Data2=simplify(pt_2), Data3=simplify(pt_3))  # -> simplify(Result)
rectangle = Rectangle(Plane=plane_2, XSize=y_dim, YSize=neg, Radius=0)  # -> Rectangle, Length
scale = Number(flatten(num))
pt2num = PointsToNumbers(Points=merge_2, Mask=4)  # -> simplify(Numbers)
path_mapper = PathMapper(scale, source="{0}", target="{0;2}")
path_mapper_2 = PathMapper(dims, source="{0}", target="{0;1}")
path_mapper_3 = PathMapper(plane_3, source="{0}", target="{0;0}")
join = TextJoin(Text=pt2num, Join=",")  # -> simplify(Result)
join_2 = TextJoin(Text=dims, Join=",")  # -> simplify(Result)
merge_3 = Merge(Data1=path_mapper_3, Data2=path_mapper_2, Data3=path_mapper)  # -> simplify(Result)
rep = ReplaceText(Text="~;", Find="~", Replace=simplify(join_2), RecursiveReplace=False)  # -> simplify(Result)
rep_2 = ReplaceText(Text="~", Find="~", Replace=simplify(scale), RecursiveReplace=False)  # -> simplify(Result)
rep_3 = ReplaceText(Text="~;", Find="~", Replace=simplify(join), RecursiveReplace=False)  # -> simplify(Result)
merge_4 = Merge(Data1=flatten(rep_3), Data2=flatten(rep), Data3=flatten(rep_2))
R = ClusterOutput(rectangle.Rectangle)
join_3 = TextJoin(Text=merge_4)
panel_2 = Panel(join_3)
R_2 = ClusterOutput(join_3)
panel_3 = Panel(merge_3)

# ==== cluster SVGLine
attributes = ClusterInput()  # disabled
layout = ClusterInput()
curve = ClusterInput()
layout_2 = Data(layout)
attributes_2 = Data(attributes)  # disabled
laysplit_new = LAYSPLITNEW(T=layout_2)  # -> pl_2, data_3, data_4
data = Data(laysplit_new.data_3)
curve_2 = Curve(curve)
attributes_3 = ClusterInput()
z_index = ClusterInput()
item = ListItem(List=data, Index=0, Wrap=True)  # -> Item, Item1
class = ClusterInput()
class_2 = Data(class)
panel = Panel("attributes=\"empty\"")  # disabled
graft = GraftTree(Tree=attributes_2, IncludeEmptyLists=True, IncludeNullItems=True)  # -> simplify(Tree); disabled
lng = ListLength(List=curve)
null = NullItem(Item=laysplit_new.data_4)  # -> NullFlags, InvalidFlags, Description
null_2 = NullItem(Item=graft)  # -> NullFlags, InvalidFlags, Description; disabled
dom²num = ConstructDomain²(UMin=0, UMax=item.Item1, VMin=0, VMax=item.Item)
repeat = RepeatData(Data=class_2, Length=lng)
dispatch = Dispatch(List="1", DispatchPattern=null.NullFlags)  # -> ListA, ListB
dispatch_2 = Dispatch(List=panel, DispatchPattern=null_2.NullFlags)  # -> ListA, ListB; disabled
merge = Merge(Data1=laysplit_new.data_4, Data2=dispatch.ListA)
merge_2 = Merge(Data1=graft, Data2=dispatch_2.ListA)  # disabled
crv = Curve(simplify(curve_2))
num = Number(merge)
lng_2 = ListLength(List=laysplit_new.pl_2)
compile_props = COMPILEPROPS(class=repeat, attributes=attributes_3, z_index=z_index)
repeat_2 = RepeatData(Data=num, Length=lng_2)
cls = Closed(Curve=crv)  # -> Closed, Periodic
dispatch_3 = Dispatch(List=graft(crv), DispatchPattern=graft(cls.Closed))  # -> ListA, ListB
panel_2 = Panel(cls.Closed)
explode = Explode(Curve=dispatch_3.ListB, Recursive=True)  # -> Segments, simplify(Vertices)
explode_2 = Explode(Curve=dispatch_3.ListA, Recursive=True)  # -> Segments, Vertices
eval = EvaluateLength(Curve=explode_2.Segments, Length=0, Normalized=True)  # -> simplify(Point), Tangent, Parameter
lng_3 = ListLength(List=crv)
item_2 = ListItem(List=eval.Point, Index=0, Wrap=True)
merge_3 = Merge(Data1=eval.Point, Data2=item_2)  # -> simplify(Result)
weave = Weave(Pattern=graft(cls.Closed), Stream0=explode.Vertices, Stream1=merge_3, NullGaps=False)  # -> simplify(Weave)
repeat_3 = RepeatData(Data=repeat_2, Length=lng_3)  # -> simplify(graft(Data))
plcoord = PlaneCoordinates(Point=simplify(weave), System=simplify(laysplit_new.pl_2))  # -> XCoordinate, YCoordinate, ZCoordinate
clean = CleanTree(RemoveNulls=True, RemoveInvalid=True, RemoveEmpty=True, Tree=merge_2)  # disabled
clean_2 = CleanTree(RemoveNulls=True, RemoveInvalid=True, RemoveEmpty=True, Tree=plcoord.YCoordinate)
clean_3 = CleanTree(RemoveNulls=True, RemoveInvalid=True, RemoveEmpty=True, Tree=repeat_3)
clean_4 = CleanTree(RemoveNulls=True, RemoveInvalid=True, RemoveEmpty=True, Tree=plcoord.XCoordinate)
clean_5 = CleanTree(RemoveNulls=True, RemoveInvalid=True, RemoveEmpty=True, Tree=compile_props)
utrim = UberTrim(data=clean_5)
expression = Expression(x=clean_2, Expression="-(x)")
expression_2 = Expression(x=clean_4, y=clean_3, Expression="x/y")
expression_3 = Expression(x=expression, y=clean_3, Expression="x/y")
null_3 = NullItem(Item=expression_3)  # -> NullFlags, InvalidFlags, Description
expression_4 = Expression(x=expression_2, y=expression_3, Expression="Format(\"{0},{1}\", x, y)")
ma = MassAddition(Input=null_3.NullFlags)  # -> Result, PartialResults
dispatch_4 = Dispatch(List=expression_4, DispatchPattern=ma.Result)  # -> ListA, ListB
txt = Text("~")
filter = StreamFilter(Gate=cls.Closed, Stream0="<polyline ` points=\"~\"/>", Stream1="<polygon ` points=\"~\"/>")
join = TextJoin(Text=dispatch_4.ListB, Join=" ")
cluster = Cluster(data=join)
rep = ReplaceText(Text=filter, Find=txt, Replace=cluster, RecursiveReplace=False)  # -> simplify(Result)
merge_4 = Merge(Data1=rep, Data2=utrim)
txt_2 = Text("`")
join_2 = TextJoin(Text=merge_4, Join=" ")
rep_2 = ReplaceText(Text=rep, Find=txt_2, Replace=join_2, RecursiveReplace=False)  # -> simplify(Result)
flatten = FlattenTree(Tree=rep_2, Path="{0}")
crv_2 = Curve(crv)
svg = Text(flatten)
svg_2 = ClusterOutput(svg)
crv_3 = ClusterOutput(crv_2)

# ==== cluster COX_SVGPath_2
crv = ClusterInput()
layout = ClusterInput()
class = ClusterInput()
attributes = ClusterInput()
text = ClusterInput()  # "---------"
class_2 = Text(class)
layout_2 = Data(layout)
attributes_2 = Data(attributes)
concat = Concatenate(FragmentA="class=\"", FragmentB=class_2, FragmentC="\"")
text_2 = Text(text)  # "---------"
laysplit_new = LAYSPLITNEW(T=layout_2)  # -> pl_2, data_3, data_4
concat_2 = Concatenate(FragmentA=concat, FragmentB=" ", FragmentC=attributes_2)
null = NullItem(Item=class_2)  # -> NullFlags, InvalidFlags, Description
filter = StreamFilter(Gate=null.NullFlags, Stream0=concat_2, Stream1=attributes_2)
graft = GraftTree(Tree=filter, IncludeEmptyLists=True, IncludeNullItems=True)  # -> simplify(Tree)
null_2 = NullItem(Item=graft)  # -> NullFlags, InvalidFlags, Description
data = Data(laysplit_new.data_3)
dispatch = Dispatch(List="attributes=\"empty\"", DispatchPattern=null_2.NullFlags)  # -> ListA, ListB
item = ListItem(List=data, Index=0, Wrap=True)  # -> Item, Item1
merge = Merge(Data1=graft, Data2=dispatch.ListA)
null_3 = NullItem(Item=laysplit_new.data_4)  # -> NullFlags, InvalidFlags, Description
dom²num = ConstructDomain²(UMin=0, UMax=item.Item1, VMin=0, VMax=item.Item)
dispatch_2 = Dispatch(List="1", DispatchPattern=null_3.NullFlags)  # -> ListA, ListB
crv_2 = Curve(simplify(crv))
merge_2 = Merge(Data1=laysplit_new.data_4, Data2=dispatch_2.ListA)
num = Number(merge_2)
lng = ListLength(List=laysplit_new.pl_2)
cls = Closed(Curve=crv_2)  # -> Closed, Periodic
repeat = RepeatData(Data=num, Length=lng)
dispatch_3 = Dispatch(List=graft(crv_2), DispatchPattern=graft(cls.Closed))  # -> ListA, ListB
explode = Explode(Curve=dispatch_3.ListA, Recursive=True)  # -> Segments, Vertices
eval = EvaluateLength(Curve=explode.Segments, Length=0, Normalized=True)  # -> simplify(Point), Tangent, Parameter
item_2 = ListItem(List=eval.Point, Index=0, Wrap=True)
merge_3 = Merge(Data1=eval.Point, Data2=item_2)  # -> simplify(Result)
explode_2 = Explode(Curve=dispatch_3.ListB, Recursive=True)  # -> Segments, simplify(Vertices)
weave = Weave(Pattern=graft(cls.Closed), Stream0=explode_2.Vertices, Stream1=merge_3, NullGaps=False)  # -> simplify(Weave)
lng_2 = ListLength(List=crv_2)
repeat_2 = RepeatData(Data=repeat, Length=lng_2)  # -> simplify(graft(Data))
plcoord = PlaneCoordinates(Point=simplify(weave), System=simplify(laysplit_new.pl_2))  # -> XCoordinate, YCoordinate, ZCoordinate
clean = CleanTree(RemoveNulls=True, RemoveInvalid=True, RemoveEmpty=True, Tree=plcoord.YCoordinate)
clean_2 = CleanTree(RemoveNulls=True, RemoveInvalid=True, RemoveEmpty=True, Tree=repeat_2)
clean_3 = CleanTree(RemoveNulls=True, RemoveInvalid=True, RemoveEmpty=True, Tree=merge)
clean_4 = CleanTree(RemoveNulls=True, RemoveInvalid=True, RemoveEmpty=True, Tree=plcoord.XCoordinate)
panel = Panel(clean_4)
expression = Expression(x=clean, Expression="-(x)")
expression_2 = Expression(x=clean_4, y=clean_2, Expression="x/y")
expression_3 = Expression(x=expression, y=clean_2, Expression="x/y")
expression_4 = Expression(x=expression_2, Expression="(int(x*1000000))/1000000")
expression_5 = Expression(x=expression_3, Expression="(int(x*1000000))/1000000")
expression_6 = Expression(x=expression_5, Expression="round(x,2)")
expression_7 = Expression(x=expression_4, Expression="round(x,2)")
expression_8 = Expression(x=expression_7, y=expression_6, Expression="Format(\"{0} {1}\", x, y)")
null_4 = NullItem(Item=expression_6)  # -> NullFlags, InvalidFlags, Description
txt = Text("~")
ma = MassAddition(Input=null_4.NullFlags)  # -> Result, PartialResults
dispatch_4 = Dispatch(List=expression_8, DispatchPattern=ma.Result)  # -> ListA, ListB
join = TextJoin(Text=dispatch_4.ListB, Join=" L")
cluster = Cluster(data=join)
expression_9 = Expression(x=cluster, Expression="Format(\"M{0}Z\", x)")
join_2 = TextJoin(Text=expression_9, Join=" ")
rep = ReplaceText(Text="<path ` d=\"~\"/>", Find=txt, Replace=join_2, RecursiveReplace=False)  # -> simplify(flatten(Result))
txt_2 = Text("  ")
txt_3 = Text(" ")
txt_4 = Text("`")
rep_2 = ReplaceText(Text=rep, Find=txt_4, Replace=clean_3, RecursiveReplace=False)  # -> simplify(Result)
rep_3 = ReplaceText(Text=rep_2, Find=txt_2, Replace=txt_3, RecursiveReplace=False)  # -> simplify(Result)
panel_2 = Panel(rep)
flatten = FlattenTree(Tree=rep_3, Path="{0}")
svg = Text(flatten)
crv_3 = Curve(crv_2)
svg_2 = ClusterOutput(svg)
crv_4 = ClusterOutput(crv_3)

# ==== cluster SVGLine_2
attributes = ClusterInput()
layout = ClusterInput()
curve = ClusterInput()
layout_2 = Data(layout)
attributes_2 = Data(attributes)
laysplit_new = LAYSPLITNEW(T=layout_2)  # -> pl_2, data_3, data_4
data = Data(laysplit_new.data_3)
curve_2 = Curve(curve)
item = ListItem(List=data, Index=0, Wrap=True)  # -> Item, Item1
graft = GraftTree(Tree=attributes_2, IncludeEmptyLists=True, IncludeNullItems=True)  # -> simplify(Tree)
null = NullItem(Item=laysplit_new.data_4)  # -> NullFlags, InvalidFlags, Description
null_2 = NullItem(Item=graft)  # -> NullFlags, InvalidFlags, Description
dom²num = ConstructDomain²(UMin=0, UMax=item.Item1, VMin=0, VMax=item.Item)
dispatch = Dispatch(List="1", DispatchPattern=null.NullFlags)  # -> ListA, ListB
dispatch_2 = Dispatch(List="attributes=\"empty\"", DispatchPattern=null_2.NullFlags)  # -> ListA, ListB
merge = Merge(Data1=laysplit_new.data_4, Data2=dispatch.ListA)
merge_2 = Merge(Data1=graft, Data2=dispatch_2.ListA)
crv = Curve(simplify(curve_2))
num = Number(merge)
lng = ListLength(List=laysplit_new.pl_2)
repeat = RepeatData(Data=num, Length=lng)
cls = Closed(Curve=crv)  # -> Closed, Periodic
dispatch_3 = Dispatch(List=graft(crv), DispatchPattern=graft(cls.Closed))  # -> ListA, ListB
explode = Explode(Curve=dispatch_3.ListB, Recursive=True)  # -> Segments, simplify(Vertices)
explode_2 = Explode(Curve=dispatch_3.ListA, Recursive=True)  # -> Segments, Vertices
eval = EvaluateLength(Curve=explode_2.Segments, Length=0, Normalized=True)  # -> simplify(Point), Tangent, Parameter
lng_2 = ListLength(List=crv)
item_2 = ListItem(List=eval.Point, Index=0, Wrap=True)
merge_3 = Merge(Data1=eval.Point, Data2=item_2)  # -> simplify(Result)
weave = Weave(Pattern=graft(cls.Closed), Stream0=explode.Vertices, Stream1=merge_3, NullGaps=False)  # -> simplify(Weave)
repeat_2 = RepeatData(Data=repeat, Length=lng_2)  # -> simplify(graft(Data))
plcoord = PlaneCoordinates(Point=simplify(weave), System=simplify(laysplit_new.pl_2))  # -> XCoordinate, YCoordinate, ZCoordinate
clean = CleanTree(RemoveNulls=True, RemoveInvalid=True, RemoveEmpty=True, Tree=merge_2)
clean_2 = CleanTree(RemoveNulls=True, RemoveInvalid=True, RemoveEmpty=True, Tree=plcoord.YCoordinate)
clean_3 = CleanTree(RemoveNulls=True, RemoveInvalid=True, RemoveEmpty=True, Tree=repeat_2)
clean_4 = CleanTree(RemoveNulls=True, RemoveInvalid=True, RemoveEmpty=True, Tree=plcoord.XCoordinate)
expression = Expression(x=clean_2, Expression="-(x)")
expression_2 = Expression(x=clean_4, y=clean_3, Expression="x/y")
expression_3 = Expression(x=expression, y=clean_3, Expression="x/y")
null_3 = NullItem(Item=expression_3)  # -> NullFlags, InvalidFlags, Description
expression_4 = Expression(x=expression_2, y=expression_3, Expression="Format(\"{0},{1}\", x, y)")
ma = MassAddition(Input=null_3.NullFlags)  # -> Result, PartialResults
dispatch_4 = Dispatch(List=expression_4, DispatchPattern=ma.Result)  # -> ListA, ListB
txt = Text("~")
filter = StreamFilter(Gate=cls.Closed, Stream0="<polyline ` points=\"~\"/>", Stream1="<polygon ` points=\"~\"/>")
join = TextJoin(Text=dispatch_4.ListB, Join=" ")
cluster = Cluster(data=join)
rep = ReplaceText(Text=filter, Find=txt, Replace=cluster, RecursiveReplace=False)  # -> simplify(Result)
txt_2 = Text("`")
rep_2 = ReplaceText(Text=rep, Find=txt_2, Replace=clean, RecursiveReplace=False)  # -> simplify(Result)
flatten = FlattenTree(Tree=rep_2, Path="{0}")
crv_2 = Curve(crv)
svg = Text(flatten)
svg_2 = ClusterOutput(svg)
crv_3 = ClusterOutput(crv_2)

# ==== cluster CSSStyleMaker_2
custom_attribute = ClusterInput()  # Specifies a custom attribute for the element/s. This custom attribute can be useful for assigning specific styles and/or events too.
class = ClusterInput()
events = Data()  # disabled
tmatch = MatchText(Text=events, RegEx="@keyframes", Case=True)  # disabled
custom_attribute_2 = Data(custom_attribute)
element = Text()  # disabled
class_2 = Data(class)
mindex = MemberIndex(Set=tmatch, Member=True)  # -> simplify(flatten(Index)), Count; disabled
lng = ListLength(List=events)  # -> expr("x-1", flatten(Length)); disabled
shift = ShiftList(List=mindex.Index, Shift=1, Wrap=False)  # disabled
concat = Concatenate(FragmentA=element, FragmentB=".", FragmentC=class_2, FragmentE=" {")
null = NullItem(Item=custom_attribute_2)  # -> NullFlags, InvalidFlags, Description
subtraction = Subtraction(A=shift, B=1)  # disabled
merge = Merge(Data1=flatten(subtraction), Data2=flatten(lng))  # -> flatten(Result); disabled
merge_2 = Merge(Data1=simplify(graft(mindex.Index)), Data2=simplify(graft(merge)))  # disabled
bool = Boolean(invert(null.NullFlags))
rep = ReplaceText(Text="[~]{", Find="~", Replace=custom_attribute_2, RecursiveReplace=False)
item = ListItem(List=merge_2, Index=0, Wrap=True)  # -> Item, Item1; disabled
filter = StreamFilter(Gate=bool, Stream0=concat, Stream1=rep)
expression = Expression(x=item.Item1, y=item.Item, Expression="x-y+1")  # disabled
lng_2 = ListLength(List=flatten(filter))
stroke_colour = ClusterInput()
txt = Text("}")
series = Series(Start=item.Item, Step=1, Count=expression)  # disabled
text = ClusterInput()  # "--------------------------------"
fill = ClusterInput()
text_2 = ClusterInput()  # "--------------------------------"
stroke_opacity = ClusterInput()
fill_opacity = ClusterInput()
opacity = ClusterInput()
stroke_thickness = ClusterInput()
dash = ClusterInput()
gap = ClusterInput()
txt_2 = ClusterInput()
line_cap = ClusterInput()
line_join = ClusterInput()
repeat = RepeatData(Data=txt, Length=lng_2)  # -> simplify(graft(Data))
item_2 = ListItem(List=events, Index=series, Wrap=True)  # -> simplify(Item); disabled
cull_i = CullIndex(List=item_2, Indices=0, Wrap=True)  # disabled
split = TextSplit(Text=cull_i, Separators=":")  # disabled
tmatch_2 = MatchText(Text=fill, Pattern="none", Case=True)
stroke_colour_2 = Colour(stroke_colour)
tstat = TreeStatistics(Tree=repeat)  # -> Paths, Length, Count
argb = SplitARGB(Colour=stroke_colour_2, IntegerChannels=True)  # -> Alpha, Red, Green, Blue
fill_2 = Colour(fill)
dash_2 = Data(dash)
gap_2 = Data(gap)
profile = Duration(L=split, R="profile")  # disabled
direction = Duration(L=split, R="direction")  # disabled
iteration = Duration(L=split, R="iteration")  # disabled
duration = Duration(L=split, R="duration")  # disabled
item_3 = ListItem(List=item_2, Index=0, Wrap=True)  # disabled
txt_3 = Text(txt_2)
stroke_thickness_2 = Data(stroke_thickness)
text_3 = Text(text_2)  # "--------------------------------"
stroke_opacity_2 = Number(stroke_opacity)
fill_opacity_2 = Number(fill_opacity)
opacity_2 = Number(opacity)
dpath = DeconstructPath(Branch=tstat.Paths)
line_cap_2 = Text(line_cap)
line_join_2 = Text(line_join)
argb_2 = SplitARGB(Colour=fill_2, IntegerChannels=True)  # -> Alpha, Red, Green, Blue
int = Integer([argb.Red, argb.Green, argb.Blue])
concat_2 = Concatenate(FragmentA=stroke_thickness_2, FragmentB="mm")
join = TextJoin(Text=flatten(profile), Join=", ")  # disabled
join_2 = TextJoin(Text=flatten(direction), Join=", ")  # disabled
join_3 = TextJoin(Text=flatten(iteration), Join=", ")  # disabled
join_4 = TextJoin(Text=flatten(duration), Join=", ")  # disabled
lng_3 = ListLength(List=dpath)
null_2 = NullItem(Item=flatten(line_cap_2))  # -> NullFlags, InvalidFlags, Description
null_3 = NullItem(Item=stroke_opacity_2)  # -> NullFlags, InvalidFlags, Description
join_5 = TextJoin(Text=int, Join=",")
null_4 = NullItem(Item=fill_opacity_2)  # -> NullFlags, InvalidFlags, Description
null_5 = NullItem(Item=opacity_2)  # -> NullFlags, InvalidFlags, Description
null_6 = NullItem(Item=txt_3)  # -> NullFlags, InvalidFlags, Description
null_7 = NullItem(Item=dash_2)  # -> NullFlags, InvalidFlags, Description
null_8 = NullItem(Item=gap_2)  # -> NullFlags, InvalidFlags, Description
concat_3 = Concatenate(FragmentA=dash_2, FragmentB="mm")
concat_4 = Concatenate(FragmentA=gap_2, FragmentB="mm")
null_9 = NullItem(Item=flatten(line_join_2))  # -> NullFlags, InvalidFlags, Description
int_2 = Integer([argb_2.Red, argb_2.Green, argb_2.Blue])
null_10 = NullItem(Item=stroke_thickness_2)  # -> NullFlags, InvalidFlags, Description
panel = Panel("")  # disabled
text_4 = Text(text)  # "--------------------------------"
panel_2 = Panel(join_3)  # disabled
panel_3 = Panel(join_4)  # disabled
panel_4 = Panel(join_2)  # disabled
panel_5 = Panel(join)  # disabled
p_n_c = PickNChoose(Pattern=null_3.NullFlags, Stream0=stroke_opacity_2, Stream1="none")
p_n_c_2 = PickNChoose(Pattern=null_4.NullFlags, Stream0=fill_opacity_2, Stream1="none")
ma = MassAddition(Input=null_2.NullFlags)  # -> Result, PartialResults
join_6 = TextJoin(Text=int_2, Join=",")
p_n_c_3 = PickNChoose(Pattern=null_5.NullFlags, Stream0=opacity_2, Stream1="none")
rep_2 = ReplaceText(Text="rgb(*)", Find="*", Replace=join_5, RecursiveReplace=False)
p_n_c_4 = PickNChoose(Pattern=null_6.NullFlags, Stream0=txt_3, Stream1="none")
trim = TrimTree(Tree=repeat, Depth=expr("x-1", lng_3))
null_11 = NullItem(Item=join_5)  # -> NullFlags, InvalidFlags, Description
join_7 = TextJoin(Text=[concat_3, concat_4], Join=",")
p_n_c_5 = PickNChoose(Pattern=ma.Result, Stream0=line_cap_2, Stream1="none")
ma_2 = MassAddition(Input=null_9.NullFlags)  # -> Result, PartialResults
or = GateOr(A=null_7.NullFlags, B=null_8.NullFlags)
p_n_c_6 = PickNChoose(Pattern=ma_2.Result, Stream0=line_join_2, Stream1="none")
p_n_c_7 = PickNChoose(Pattern=null_10.NullFlags, Stream0=concat_2, Stream1="none")
split_2 = TextSplit(Text=item_3, Separators=panel)  # disabled
rep_3 = ReplaceText(Text="rgb(*)", Find="*", Replace=join_6, RecursiveReplace=False)
rep_4 = ReplaceText(Text="\tstroke-opacity:*;", Find="*", Replace=p_n_c, RecursiveReplace=False)
p_n_c_8 = PickNChoose(Pattern=null_11.NullFlags, Stream0=rep_2, Stream1="none")
rep_5 = ReplaceText(Text="\tfill-opacity:*;", Find="*", Replace=p_n_c_2, RecursiveReplace=False)
rep_6 = ReplaceText(Text="\topacity:*;", Find="*", Replace=p_n_c_3, RecursiveReplace=False)
rep_7 = ReplaceText(Text="\tstroke-linecap:*;", Find="*", Replace=p_n_c_5, RecursiveReplace=False)
rep_8 = ReplaceText(Text="\tfill-rule:*;", Find="*", Replace=p_n_c_4, RecursiveReplace=False)
rep_9 = ReplaceText(Text="\tstroke-linejoin:*;", Find="*", Replace=p_n_c_6, RecursiveReplace=False)
rep_10 = ReplaceText(Text="\tstroke-width:*;", Find="*", Replace=p_n_c_7, RecursiveReplace=False)
ma_3 = MassAddition(Input=flatten(null_10.NullFlags))  # -> Result, PartialResults
p_n_c_9 = PickNChoose(Pattern=or, Stream0=join_7, Stream1="none")
item_4 = ListItem(List=split_2, Index=0, Wrap=True)  # disabled
ma_4 = MassAddition(Input=flatten(null_11.NullFlags))  # -> Result, PartialResults
rep_11 = ReplaceText(Text="\tstroke:~;", Find="~", Replace=p_n_c_8, RecursiveReplace=False)
null_12 = NullItem(Item=fill)  # -> NullFlags, InvalidFlags, Description
gate = StreamGate(Stream=rep_4, Gate=null_3.NullFlags)  # -> Target0, Target1
p_n_c_10 = PickNChoose(Pattern=tmatch_2, Stream0=rep_3, Stream1="none")
gate_2 = StreamGate(Stream=rep_6, Gate=null_5.NullFlags)  # -> Target0, Target1
gate_3 = StreamGate(Stream=rep_5, Gate=null_4.NullFlags)  # -> Target0, Target1
panel_6 = Panel("\tanimation-iteration-count: *;")  # disabled
gate_4 = StreamGate(Stream=rep_7, Gate=ma.Result)  # -> Target0, Target1
gate_5 = StreamGate(Stream=rep_9, Gate=ma_2.Result)  # -> Target0, Target1
rep_12 = ReplaceText(Text="\tstroke-dasharray:*;", Find="*", Replace=p_n_c_9, RecursiveReplace=False)
panel_7 = Panel("\tanimation-direction: *;")  # disabled
panel_8 = Panel("\tanimation-timing-function: *;")  # disabled
gate_6 = StreamGate(Stream=rep_10, Gate=ma_3.Result)  # -> Target0, Target1
gate_7 = StreamGate(Stream=rep_8, Gate=null_6.NullFlags)  # -> Target0, Target1
branch = TreeBranch(Tree=item_3, Path="{0}", MaintainPaths=True)  # disabled
split_3 = TextSplit(Text=item_4, Separators=" ")  # disabled
panel_9 = Panel("\tanimation-duration: *;")  # disabled
panel_10 = Panel(rep_8)
panel_11 = Panel("\tanimation-name: *;")  # disabled
rep_13 = ReplaceText(Text="\tfill:~;", Find="~", Replace=p_n_c_10, RecursiveReplace=False)
gate_8 = StreamGate(Stream=rep_11, Gate=ma_4.Result)  # -> Target0, Target1
gate_9 = StreamGate(Stream=rep_12, Gate=or)  # -> Target0, Target1
null_13 = NullItem(Item=branch)  # -> NullFlags, InvalidFlags, Description; disabled
item_5 = ListItem(List=split_3, Index=1, Wrap=True)  # disabled
gate_10 = StreamGate(Stream=rep_13, Gate=null_12.NullFlags)  # -> Target0, Target1
join_8 = TextJoin(Text=flatten(item_5), Join=", ")  # disabled
rep_14 = ReplaceText(Text=panel_11, Find="*", Replace=join_8, RecursiveReplace=False)  # -> simplify(Result); disabled
rep_15 = ReplaceText(Text=panel_9, Find="*", Replace=panel_3, RecursiveReplace=False)  # -> simplify(Result); disabled
rep_16 = ReplaceText(Text=panel_6, Find="*", Replace=panel_2, RecursiveReplace=False)  # -> simplify(Result); disabled
rep_17 = ReplaceText(Text=panel_7, Find="*", Replace=panel_4, RecursiveReplace=False)  # -> simplify(Result); disabled
rep_18 = ReplaceText(Text=panel_8, Find="*", Replace=panel_5, RecursiveReplace=False)  # -> simplify(Result); disabled
gate_11 = StreamGate(Stream=rep_14, Gate=null_13.NullFlags)  # -> flatten(Target0), Target1; disabled
gate_12 = StreamGate(Stream=rep_15, Gate=null_13.NullFlags)  # -> flatten(Target0), Target1; disabled
gate_13 = StreamGate(Stream=rep_16, Gate=null_13.NullFlags)  # -> flatten(Target0), Target1; disabled
gate_14 = StreamGate(Stream=rep_17, Gate=null_13.NullFlags)  # -> flatten(Target0), Target1; disabled
gate_15 = StreamGate(Stream=rep_18, Gate=null_13.NullFlags)  # -> flatten(Target0), Target1; disabled
merge_3 = Merge(
    Data1=gate_8.Target0,
    Data2=gate_6.Target0,
    Data3=gate_9.Target0,
    Data4=gate_4.Target0,
    Data5=gate_5.Target0,
    Data6=gate_10.Target0,
    Data7=gate.Target0,
    Data8=gate_3.Target0,
    Data9=gate_2.Target0,
    Data10=gate_7.Target0)  # -> flatten(Result)
merge_4 = Merge(Data1=gate_11.Target0, Data2=gate_12.Target0, Data3=gate_13.Target0, Data4=gate_14.Target0, Data5=gate_15.Target0)  # -> flatten(Result); disabled
merge_5 = Merge(Data1=filter, Data2=merge_3, Data3=merge_4, Data4=trim)
join_9 = TextJoin(Text=merge_5)
merge_6 = Merge(Data1=flatten(item_3), Data2=flatten(join_9))
rep_19 = ReplaceText(Text=merge_6, Find="mm", RecursiveReplace=False)
css = Data(rep_19)
css_2 = ClusterOutput(css)

# ==== cluster POLYGON
stroke_width = ClusterInput()
rule = ClusterInput()
fill_opacity = ClusterInput()
filter = ClusterInput()
stroke = ClusterInput()
fill = ClusterInput()
stroke_width_2 = Number(stroke_width)
fill_opacity_2 = Number(fill_opacity)
opacity = ClusterInput()

# ---- group: Stroke
stroke_2 = Colour(stroke)

# ----
fill_2 = Colour(fill)
opacity_2 = Number(opacity)
rule_2 = Data(rule)
filter_2 = Data(filter)
class = ClusterInput()
rep = ReplaceText(Text="rgb(█)", Find="█", Replace=stroke_2, RecursiveReplace=False)
null = NullItem(Item=fill_2)  # -> NullFlags, InvalidFlags, Description
class_2 = Data(class)
rep_2 = ReplaceText(Text="rgb(█)", Find="█", Replace=fill_2, RecursiveReplace=False)
rep_3 = ReplaceText(Text="rgb(█)", Find="█", Replace="none", RecursiveReplace=False)
merge = Merge(Data1="stroke", Data2=rep)
null_2 = NullItem(Item=stroke_2)  # -> NullFlags, InvalidFlags, Description
join = TextJoin(Text=merge, Join=":")
merge_2 = Merge(Data1="fill", Data2=rep_2)
merge_3 = Merge(Data1="fill", Data2=rep_3)
join_2 = TextJoin(Text=merge_2, Join=":")
rep_4 = ReplaceText(Text=".█ ", Find="█", Replace=class_2, RecursiveReplace=False)
join_3 = TextJoin(Text=merge_3, Join=":")
null_3 = NullItem(Item=stroke_width_2)  # -> NullFlags, InvalidFlags, Description
filter_3 = StreamFilter(Gate=null_2.NullFlags, Stream0=join)
filter_4 = StreamFilter(Gate=null.NullFlags, Stream0=join_2, Stream1=join_3)
null_4 = NullItem(Item=fill_opacity_2)  # -> NullFlags, InvalidFlags, Description
rep_5 = ReplaceText(Text="stroke-width:█mm", Find="█", Replace=stroke_width_2, RecursiveReplace=False)
null_5 = NullItem(Item=opacity_2)  # -> NullFlags, InvalidFlags, Description
panel = Panel("filter:\"url(#█)\"")
rep_6 = ReplaceText(Text="fill-opacity:█", Find="█", Replace=fill_opacity_2, RecursiveReplace=False)
null_6 = NullItem(Item=rule_2)  # -> NullFlags, InvalidFlags, Description
null_7 = NullItem(Item=filter_2)  # -> NullFlags, InvalidFlags, Description
rep_7 = ReplaceText(Text="fill-opacity:█", Find="█", Replace="0", RecursiveReplace=False)
rep_8 = ReplaceText(Text="opacity:█", Find="█", Replace=opacity_2, RecursiveReplace=False)
rep_9 = ReplaceText(Text="fill-rule:█", Find="█", Replace=rule_2, RecursiveReplace=False)
rep_10 = ReplaceText(Text="filter:url(#█)", Find="█", Replace=filter_2, RecursiveReplace=False)
filter_5 = StreamFilter(Gate=null_3.NullFlags, Stream0=rep_5)
filter_6 = StreamFilter(Gate=null_4.NullFlags, Stream0=rep_6, Stream1=rep_7)
filter_7 = StreamFilter(Gate=null_5.NullFlags, Stream0=rep_8)
filter_8 = StreamFilter(Gate=null_7.NullFlags, Stream0=rep_10)
filter_9 = StreamFilter(Gate=null_6.NullFlags, Stream0=rep_9)
merge_4 = Merge(
    Data1=" ",
    Data2=filter_3,
    Data3=filter_5,
    Data4=filter_4,
    Data5=filter_6,
    Data6=filter_7,
    Data7=filter_9,
    Data8=filter_8)  # -> reverse(Result)
join_4 = TextJoin(Text=merge_4, Join=";")
rep_11 = ReplaceText(Text="{█}", Find="█", Replace=join_4, RecursiveReplace=False)
merge_5 = Merge(Data1=rep_4, Data2=rep_11)
join_5 = TextJoin(Text=merge_5)
css = Data(join_5)
css_2 = ClusterOutput(css)

# ==== cluster SVGPolyline_2
crv = ClusterInput()
layout = ClusterInput()
attributes = ClusterInput()
z_index = ClusterInput()
D = ClusterInput()
text = ClusterInput()  # "---------"
layout_2 = Data(layout)
lng = ListLength(List=crv)
text_2 = Text(text)  # "---------"
repeat = RepeatData(Data=D, Length=lng)
laysplit_new = LAYSPLITNEW(T=layout_2)  # -> pl_2, data_3, data_4
compile_props = COMPILEPROPS(class=repeat, attributes=attributes, z_index=z_index)
data = Data(laysplit_new.data_3)
item = ListItem(List=data, Index=0, Wrap=True)  # -> Item, Item1
null = NullItem(Item=laysplit_new.data_4)  # -> NullFlags, InvalidFlags, Description
dom²num = ConstructDomain²(UMin=0, UMax=item.Item1, VMin=0, VMax=item.Item)
dispatch = Dispatch(List="1", DispatchPattern=null.NullFlags)  # -> ListA, ListB
merge = Merge(Data1=laysplit_new.data_4, Data2=dispatch.ListA)
crv_2 = Curve(simplify(crv))
num = Number(merge)
lng_2 = ListLength(List=laysplit_new.pl_2)
cls = Closed(Curve=crv_2)  # -> Closed, Periodic
repeat_2 = RepeatData(Data=num, Length=lng_2)  # -> flatten(Data)
dispatch_2 = Dispatch(List=graft(crv_2), DispatchPattern=graft(cls.Closed))  # -> ListA, ListB
explode = Explode(Curve=dispatch_2.ListA, Recursive=True)  # -> Segments, Vertices
eval = EvaluateLength(Curve=explode.Segments, Length=0, Normalized=True)  # -> simplify(Point), Tangent, Parameter
item_2 = ListItem(List=eval.Point, Index=0, Wrap=True)
merge_2 = Merge(Data1=eval.Point, Data2=item_2)  # -> simplify(Result)
explode_2 = Explode(Curve=dispatch_2.ListB, Recursive=True)  # -> Segments, simplify(Vertices)
weave = Weave(Pattern=graft(cls.Closed), Stream0=explode_2.Vertices, Stream1=merge_2, NullGaps=False)  # -> simplify(Weave)
lng_3 = ListLength(List=crv_2)
repeat_3 = RepeatData(Data=repeat_2, Length=lng_3)  # -> simplify(graft(Data))
plcoord = PlaneCoordinates(Point=simplify(weave), System=simplify(laysplit_new.pl_2))  # -> XCoordinate, YCoordinate, ZCoordinate
clean = CleanTree(RemoveNulls=True, RemoveInvalid=True, RemoveEmpty=True, Tree=plcoord.YCoordinate)
clean_2 = CleanTree(RemoveNulls=True, RemoveInvalid=True, RemoveEmpty=True, Tree=repeat_3)
clean_3 = CleanTree(RemoveNulls=True, RemoveInvalid=True, RemoveEmpty=True, Tree=compile_props)
clean_4 = CleanTree(RemoveNulls=True, RemoveInvalid=True, RemoveEmpty=True, Tree=plcoord.XCoordinate)
utrim = UberTrim(data=clean_3)
expression = Expression(x=clean, Expression="-(x)")
expression_2 = Expression(x=clean_4, y=clean_2, Expression="x/y")
expression_3 = Expression(x=expression, y=clean_2, Expression="x/y")
expression_4 = Expression(x=expression_2, y=expression_3, Expression="Format(\"{0},{1}\", x, y)")
bool = Boolean(cls.Closed)
null_2 = NullItem(Item=expression_3)  # -> NullFlags, InvalidFlags, Description
long = LongestList(ListA=bool, ListB="<polygon ~/>", ListC="<polyline ~/>", PaddingMode=2)  # -> ListA, ListB, ListC
bool_2 = Boolean(cls.Closed)
ma = MassAddition(Input=null_2.NullFlags)  # -> Result, PartialResults
weave_2 = Weave(Pattern=bool_2, Stream0="<polyline ` points=\"~\"/>", Stream1="<polygon ` points=\"~\"/>", NullGaps=False)
dispatch_3 = Dispatch(List=expression_4, DispatchPattern=ma.Result)  # -> ListA, ListB
weave_3 = Weave(Pattern=long.ListA, Stream0=long.ListC, Stream1=long.ListB, NullGaps=False)
join = TextJoin(Text=dispatch_3.ListB, Join=" ")
txt = Text("~")
cluster = Cluster(data=join)
rep = ReplaceText(Text="points=\"~\"", Find=txt, Replace=cluster, RecursiveReplace=False)  # -> simplify(Result)
merge_3 = Merge(Data1=rep, Data2=utrim)
txt_2 = Text("~")
join_2 = TextJoin(Text=merge_3, Join=" ")
rep_2 = ReplaceText(Text=graft(weave_3), Find=txt_2, Replace=join_2, RecursiveReplace=False)  # -> simplify(Result)
flatten = FlattenTree(Tree=rep_2, Path="{0}")
svg = Text(flatten)
crv_3 = Curve(crv_2)
svg_2 = ClusterOutput(svg)
crv_4 = ClusterOutput(crv_3)

# ==== cluster HTMLCompiler
data = Data("█")
panel = Panel("""<html>
<body>
<head>
</head>
<body>
<svg version="1.1" xmlns="http://www.w3.org/2000/svg" xmlns:xlink="http://www.w3.org/1999/xlink" x="0px" y="0px"
width="100%" height="100%" viewBox="0 0 420 297"
xml:space="preserve">
<style type="text/css">""")
svg_text = ClusterInput()
layout = ClusterInput()
css = ClusterInput()
layout_split = LAYSPLITNEW(T=layout)  # -> pl_2, data_3, data_4
svg_text_2 = Data(svg_text)
rep = ReplaceText(Text=svg_text_2, Find="zindex=\"", Replace=data, RecursiveReplace=False)
split = TextSplit(Text=rep, Separators=data)
item = ListItem(List=reverse(split), Index=0, Wrap=True)
split_2 = TextSplit(Text=item, Separators="\"")
css_2 = Data(css)
item_2 = ListItem(List=split_2, Index=0, Wrap=True)
flatten = FlattenTree(Tree=item_2, Path="{0}")
num = Number(flatten)
nullrep = ReplaceNulls(Items=num, Replacements=0)  # -> Items, Count
dispatch = Dispatch(List=layout_split.data_3, DispatchPattern=[True, False])  # -> ListA, ListB
rep_2 = ReplaceText(Text="width=\"100%\" height=\"100%\" viewBox=\"0 0 ` ~\"", Find="`", Replace=dispatch.ListA, RecursiveReplace=False)
sort = SortList(Keys=nullrep.Items, ValuesA=svg_text_2)  # -> Keys, ValuesA
tstat = TreeStatistics(Tree=flatten(sort.ValuesA))  # -> Paths, Length, Count
panel_2 = Panel(nullrep.Items)
rep_3 = ReplaceText(Text=rep_2, Find="~", Replace=dispatch.ListB, RecursiveReplace=False)  # -> simplify(Result)
panel_3 = Panel(rep_3)
viewer = ParamViewer("</svg>")
int = Integer(tstat.Count)
merge = Merge(Data2=panel, Data3=css_2, Data4="</style>")
repeat = RepeatData(Data=viewer, Length=int)
panel_4 = Panel("""</body>
</html>""")
branch = TreeBranch(Tree="</svg>", Path=repeat, MaintainPaths=False)
tmatch = MatchText(Text=merge, RegEx="viewBox", Case=True)
mindex = MemberIndex(Set=tmatch, Member=Toggle(True))  # -> Index, Count
replace = ReplaceItems(List=merge, Item=rep_3, Indices=mindex.Index, Wrap=False)  # -> simplify(List)
merge_2 = Merge(Data1=flatten(replace), Data2=flatten(sort.ValuesA), Data3=flatten(branch), Data4=flatten(panel_4))
svg_text_3 = Text(merge_2)
rep_4 = ReplaceText(Text=svg_text_3, Find=" =\"\" ", Replace=" ", RecursiveReplace=False)
join = TextJoin(Text=rep_4)
html_content = Text(join)
html_content_2 = ClusterOutput(html_content)

# ==== cluster COX_SVGDonut
crv = ClusterInput()
layout = ClusterInput()
z_index = ClusterInput()
class = ClusterInput()
attributes = ClusterInput()
text = ClusterInput()  # "---------"
layout_2 = Data(layout)
text_2 = Text(text)  # "---------"
laysplit_new = LAYSPLITNEW(T=layout_2)  # -> pl_2, data_3, data_4
compile_props = COMPILEPROPS(class=class, attributes=attributes, z_index=z_index)
data = Data(laysplit_new.data_3)
item = ListItem(List=data, Index=0, Wrap=True)  # -> Item, Item1
null = NullItem(Item=laysplit_new.data_4)  # -> NullFlags, InvalidFlags, Description
dom²num = ConstructDomain²(UMin=0, UMax=item.Item1, VMin=0, VMax=item.Item)
dispatch = Dispatch(List="1", DispatchPattern=null.NullFlags)  # -> ListA, ListB
crv_2 = Curve(simplify(crv))
merge = Merge(Data1=laysplit_new.data_4, Data2=dispatch.ListA)
num = Number(merge)
lng = ListLength(List=laysplit_new.pl_2)
cls = Closed(Curve=crv_2)  # -> Closed, Periodic
panel = Panel(crv_2)
repeat = RepeatData(Data=num, Length=lng)
dispatch_2 = Dispatch(List=graft(crv_2), DispatchPattern=graft(cls.Closed))  # -> ListA, ListB
explode = Explode(Curve=dispatch_2.ListA, Recursive=True)  # -> Segments, Vertices
eval = EvaluateLength(Curve=explode.Segments, Length=0, Normalized=True)  # -> simplify(Point), Tangent, Parameter
item_2 = ListItem(List=eval.Point, Index=0, Wrap=True)
merge_2 = Merge(Data1=eval.Point, Data2=item_2)  # -> simplify(Result)
explode_2 = Explode(Curve=dispatch_2.ListB, Recursive=True)  # -> Segments, simplify(Vertices)
weave = Weave(Pattern=graft(cls.Closed), Stream0=explode_2.Vertices, Stream1=merge_2, NullGaps=False)  # -> simplify(Weave)
lng_2 = ListLength(List=crv_2)
repeat_2 = RepeatData(Data=repeat, Length=lng_2)  # -> simplify(graft(Data))
plcoord = PlaneCoordinates(Point=simplify(weave), System=simplify(laysplit_new.pl_2))  # -> XCoordinate, YCoordinate, ZCoordinate
clean = CleanTree(RemoveNulls=True, RemoveInvalid=True, RemoveEmpty=True, Tree=plcoord.YCoordinate)
clean_2 = CleanTree(RemoveNulls=True, RemoveInvalid=True, RemoveEmpty=True, Tree=repeat_2)
clean_3 = CleanTree(RemoveNulls=True, RemoveInvalid=True, RemoveEmpty=True, Tree=plcoord.XCoordinate)
clean_4 = CleanTree(RemoveNulls=True, RemoveInvalid=True, RemoveEmpty=True, Tree=compile_props)
expression = Expression(x=clean, Expression="-(x)")
expression_2 = Expression(x=clean_3, y=clean_2, Expression="x/y")
expression_3 = Expression(x=expression, y=clean_2, Expression="x/y")
expression_4 = Expression(x=expression_2, Expression="(int(x*1000000))/1000000")
expression_5 = Expression(x=expression_3, Expression="(int(x*1000000))/1000000")
expression_6 = Expression(x=expression_5, Expression="round(x,2)")
expression_7 = Expression(x=expression_4, Expression="round(x,2)")
expression_8 = Expression(x=expression_7, y=expression_6, Expression="Format(\"{0} {1}\", x, y)")
null_2 = NullItem(Item=expression_6)  # -> NullFlags, InvalidFlags, Description
txt = Text("~")
ma = MassAddition(Input=null_2.NullFlags)  # -> Result, PartialResults
dispatch_3 = Dispatch(List=expression_8, DispatchPattern=ma.Result)  # -> ListA, ListB
join = TextJoin(Text=dispatch_3.ListB, Join=" L")
cluster = Cluster(data=join)
expression_9 = Expression(x=cluster, Expression="Format(\"M{0}Z\", x)")
txt_2 = Text("  ")
txt_3 = Text(" ")
txt_4 = Text("`")
join_2 = TextJoin(Text=expression_9, Join=" ")  # -> flatten(Result)
join_3 = TextJoin(Text=join_2, Join=" ")  # -> flatten(Result)
rep = ReplaceText(Text="<path ` d=\"~\"/>", Find=txt, Replace=join_3, RecursiveReplace=False)  # -> simplify(Result)
rep_2 = ReplaceText(Text=rep, Find=txt_4, Replace=clean_4, RecursiveReplace=False)  # -> simplify(Result)
rep_3 = ReplaceText(Text=rep_2, Find=txt_2, Replace=txt_3, RecursiveReplace=False)  # -> simplify(Result)
panel_2 = Panel(join_3)
flatten = FlattenTree(Tree=rep_3, Path="{0}")
svg = Text(flatten)
crv_3 = Curve(crv_2)
svg_2 = ClusterOutput(svg)
crv_4 = ClusterOutput(crv_3)

# ==== cluster RDB_SVGPlaneByPage: Makes a layout json for svg
plane = ClusterInput()  # Orientation and Location of Page
page_size = ClusterInput()  # Size of Page. Input a page size from A5-A0 followed by the orientation (P) or (L), Example: 'A1 (P)'. Alternatively, input dimensions, eg. '500,500'
scale = ClusterInput()  # Scale of Page
position = ClusterInput()  # Position of Plane relative to the page. True = Plane at Centre, False = Plane at Top Left
preset_standard_page_sizes = Panel("""A5 (L),210,148
A5 (P),148,210
A4 (L),297,210
A4 (P),210,297
A3 (L),420,297
A3 (P),297,420
A2 (L),594,420
A2 (P),420,594
A1 (L),841,594
A1 (P),594,841
A0 (L),1189,841
A0 (P),841,1189""")
split = TextSplit(Text=preset_standard_page_sizes, Separators=",")
item = ListItem(List=split, Index=0, Wrap=True)  # -> flatten(Item)

# ---- group: Find which Page Size is being called and pick it from list
mindex = MemberIndex(Set=item, Member=simplify(page_size))  # -> simplify(flatten(Index)), Count
item_2 = ListItem(List=preset_standard_page_sizes, Index=mindex.Index, Wrap=True)  # -> simplify(Item)
merge = Merge(Data1=simplify(item_2), Data2=simplify(page_size))
item_3 = ListItem(List=merge, Index=0, Wrap=True)

# ----
split_2 = TextSplit(Text=scale, Separators=":")
item_4 = ListItem(List=split_2, Index=0, Wrap=True)  # -> Item, Item1
unit_checker = PythonScript()  # -> out, a
# ---------- unit_checker: Python ----------
import rhinoscriptsyntax as rs
import scriptcontext as sc

a=sc.doc.ModelUnitSystem
a = str(a)
if a == "Millimeters":
    print 1
elif a == "Meters":
    print 1000
else:
    print "Use the metric system"
# ---------- end unit_checker ----------
pos = Boolean(position)
division = Division(A=item_4.Item1, B=unit_checker.out)

# ---- group: Choose location of centre
panel = Panel("""1,1
0.5,0.5""")
item_5 = ListItem(List=panel, Index=pos, Wrap=True)

# ----
num = Number(division)

# ---- group: Extract Dimensions
split_3 = TextSplit(Text=item_3, Separators=",")
item_6 = ListItem(List=reverse(split_3), Index=[0, 1], Wrap=True)  # -> reverse(Item)
num_2 = Number(item_6)

# ----
split_4 = TextSplit(Text=item_5, Separators=",")
plane_2 = Data(plane)
dispatch = Dispatch(List=split_4, DispatchPattern=[True, False])  # -> ListA, ListB

# ---- group: Convert to Scale
expression = Expression(x=num_2, y=num, Expression="x*y")

# ----
dispatch_2 = Dispatch(List=expression, DispatchPattern=[True, False])  # -> ListA, ListB

# ---- group: Create domains
dom = ConstructDomain(DomainStart=expr("-x", dispatch_2.ListB), DomainEnd=0)
dom_2 = ConstructDomain(DomainStart=expr("-x", dispatch_2.ListA), DomainEnd=0)

# ---- group: Remap to match centre pt location
remap = RemapNumbers(Value=dispatch.ListB, Source=Domain(0, 1), Target=dom)  # -> Mapped, Clipped
remap_2 = RemapNumbers(Value=dispatch.ListA, Source=Domain(0, 1), Target=dom_2)  # -> Mapped, Clipped

# ---- group: Adjust Centre Plane
pt = PointOriented(BasePlane=plane_2, UComponent=remap_2.Mapped, VComponent=expr("-x", remap.Mapped), WComponent=0)
pl_origin = PlaneOrigin(Base=plane_2, Origin=pt)

# ----
expression_2 = Expression(x=remap_2.Mapped, y=dispatch_2.ListA, Expression="x+y")
expression_3 = Expression(x=remap.Mapped, y=dispatch_2.ListB, Expression="x+y")

# ---- group: Create Adjusted Domain
dom_3 = ConstructDomain(DomainStart=remap_2.Mapped, DomainEnd=expression_2)
dom_4 = ConstructDomain(DomainStart=remap.Mapped, DomainEnd=expression_3)

# ----
x_dim = Domain(dom_4)
y_dim = Domain(dom_3)
plane_3 = Plane(flatten(pl_origin))
scale_2 = Number(flatten(num))
dims = Number(flatten(num_2))
neg = Negative(Value=x_dim)
python = PythonScript(PLANE=plane_3, PAGE=dims, SCALE=scale_2)  # -> JSON; inputs PAGE: list
# ---------- python: Python ----------
import Rhino as r
import rhinoscriptsyntax as rs
import json
p = PLANE
o = {"plane":[[p.Origin[0],p.Origin[1],p.Origin[2]],[p.XAxis[0],p.XAxis[1],p.XAxis[2]],[p.YAxis[0],p.YAxis[1],p.YAxis[2]]], "page":PAGE, "scale":SCALE}
JSON = json.dumps(o)
# ---------- end python ----------

# ---- group: Construct Crv
rectangle = Rectangle(Plane=plane_2, XSize=y_dim, YSize=neg, Radius=0)  # -> Rectangle, Length

# ----
json = Data(python)
preview = ClusterOutput(rectangle.Rectangle)  # Previews the page curve
json_layout = ClusterOutput(json)  # Layout JSON containing Plane, Page, Scale

# ==== cluster DIS_Colours: Contains a variety of swatches
colours = ClusterInput()  # Variety of swatches, double click to open, copy all then paste into your script!

# ---- group: Masterplan Greys
swatch = ColourSwatch(SwatchColor=RGBA(13, 13, 13, 0))
swatch_2 = ColourSwatch(SwatchColor=RGB(255, 255, 255))
swatch_3 = ColourSwatch(SwatchColor=RGB(230, 230, 230))
swatch_4 = ColourSwatch(SwatchColor=RGB(199, 200, 201))
swatch_5 = ColourSwatch(SwatchColor=RGB(147, 149, 152))
swatch_6 = ColourSwatch(SwatchColor=RGB(241, 242, 242))
swatch_7 = ColourSwatch(SwatchColor=RGB(210, 215, 210))
swatch_8 = ColourSwatch(SwatchColor=RGB(209, 211, 212))
swatch_9 = ColourSwatch(SwatchColor=RGB(13, 13, 13))

# ---- group: Diagram Colours
swatch_10 = ColourSwatch(SwatchColor=RGB(130, 54, 140))
swatch_11 = ColourSwatch(SwatchColor=RGB(226, 6, 38))
swatch_12 = ColourSwatch(SwatchColor=RGB(250, 162, 27))
swatch_13 = ColourSwatch(SwatchColor=RGB(44, 58, 150))
swatch_14 = ColourSwatch(SwatchColor=RGB(109, 162, 27))
swatch_15 = ColourSwatch(SwatchColor=RGB(199, 103, 89))
swatch_16 = ColourSwatch(SwatchColor=RGB(88, 89, 91))
swatch_17 = ColourSwatch(SwatchColor=RGB(180, 62, 128))
swatch_18 = ColourSwatch(SwatchColor=RGB(236, 11, 139))
swatch_19 = ColourSwatch(SwatchColor=RGB(236, 65, 54))
swatch_20 = ColourSwatch(SwatchColor=RGB(255, 222, 23))
swatch_21 = ColourSwatch(SwatchColor=RGB(109, 207, 246))
swatch_22 = ColourSwatch(SwatchColor=RGB(166, 206, 57))
swatch_23 = ColourSwatch(SwatchColor=RGB(81, 173, 113))
swatch_24 = ColourSwatch(SwatchColor=RGB(189, 140, 191))

# ---- group: Base Plan
swatch_25 = ColourSwatch(SwatchColor=RGB(110, 198, 217))
swatch_26 = ColourSwatch(SwatchColor=RGB(120, 186, 78))
swatch_27 = ColourSwatch(SwatchColor=RGB(230, 231, 232))
swatch_28 = ColourSwatch(SwatchColor=RGB(174, 174, 174))

# ---- group: Masterplan Water
swatch_29 = ColourSwatch(SwatchColor=RGB(197, 232, 241))
swatch_30 = ColourSwatch(SwatchColor=RGB(134, 205, 227))
swatch_31 = ColourSwatch(SwatchColor=RGB(110, 198, 217))
swatch_32 = ColourSwatch(SwatchColor=RGB(173, 225, 250))
swatch_33 = ColourSwatch(SwatchColor=RGB(150, 206, 240))
swatch_34 = ColourSwatch(SwatchColor=RGB(110, 179, 227))
swatch_35 = ColourSwatch(SwatchColor=RGB(0, 106, 181))

# ---- group: Masterplan Paving
swatch_36 = ColourSwatch(SwatchColor=RGB(255, 228, 183))
swatch_37 = ColourSwatch(SwatchColor=RGB(227, 182, 157))
swatch_38 = ColourSwatch(SwatchColor=RGB(248, 208, 181))
swatch_39 = ColourSwatch(SwatchColor=RGB(243, 177, 136))
swatch_40 = ColourSwatch(SwatchColor=RGB(248, 183, 23))
swatch_41 = ColourSwatch(SwatchColor=RGB(247, 146, 30))
swatch_42 = ColourSwatch(SwatchColor=RGB(248, 228, 175))
swatch_43 = ColourSwatch(SwatchColor=RGB(237, 194, 69))
swatch_44 = ColourSwatch(SwatchColor=RGB(248, 219, 69))
swatch_45 = ColourSwatch(SwatchColor=RGB(172, 148, 145))
swatch_46 = ColourSwatch(SwatchColor=RGB(130, 85, 43))
swatch_47 = ColourSwatch(SwatchColor=RGB(221, 160, 104))
swatch_48 = ColourSwatch(SwatchColor=RGB(253, 203, 146))
swatch_49 = ColourSwatch(SwatchColor=RGB(170, 134, 59))
swatch_50 = ColourSwatch(SwatchColor=RGB(233, 203, 134))

# ---- group: Masterplan Grass
swatch_51 = ColourSwatch(SwatchColor=RGB(204, 222, 145))
swatch_52 = ColourSwatch(SwatchColor=RGB(188, 209, 124))
swatch_53 = ColourSwatch(SwatchColor=RGB(171, 198, 102))
swatch_54 = ColourSwatch(SwatchColor=RGB(164, 192, 91))
swatch_55 = ColourSwatch(SwatchColor=RGB(140, 170, 69))

# ---- group: Masterplan Trees
swatch_56 = ColourSwatch(SwatchColor=RGB(163, 170, 69))
swatch_57 = ColourSwatch(SwatchColor=RGB(173, 197, 82))
swatch_58 = ColourSwatch(SwatchColor=RGB(128, 195, 79))
swatch_59 = ColourSwatch(SwatchColor=RGB(204, 178, 61))
swatch_60 = ColourSwatch(SwatchColor=RGB(110, 194, 126))
swatch_61 = ColourSwatch(SwatchColor=RGB(69, 184, 63))
swatch_62 = ColourSwatch(SwatchColor=RGB(14, 153, 72))
swatch_63 = ColourSwatch(SwatchColor=RGB(72, 99, 68))
swatch_64 = ColourSwatch(SwatchColor=RGB(153, 175, 59))
swatch_65 = ColourSwatch(SwatchColor=RGB(123, 152, 74))
swatch_66 = ColourSwatch(SwatchColor=RGB(96, 127, 63))
swatch_67 = ColourSwatch(SwatchColor=RGB(176, 146, 59))
swatch_68 = ColourSwatch(SwatchColor=RGB(189, 161, 90))
swatch_69 = ColourSwatch(SwatchColor=RGB(122, 158, 72))

# ==== cluster DrawSVG: Creates SVG output from ArchiJSON objects.
objects = ClusterInput()  # ArchiJSON obects
layout = ClusterInput()  # Layout Object
flatten = FlattenTree(Tree=objects, Path="{0}")
python = PythonScript(OBJECTS=flatten, LAYOUT=layout)  # -> SVG; inputs OBJECTS: list
# ---------- python: Python ----------
import rhinoscriptsyntax as rs
import sys
import json
import inspect
import Rhino as r

log = []
#The inputs to this node will be stored as a list in the IN variables.
in1 = OBJECTS
array = []
def point(o,w=True):
    pt = r.Geometry.Point3d(o[0],o[1],o[2])
    remap = r.Geometry.Plane.RemapToPlaneSpace(lPlane, pt)
    pt = str(remap[1][0]/layout['scale'])+","+str(remap[1][1]/layout['scale']*-1)
    if w:
        return pt
    else:
        return remap[1]


def line(o):
    #<polyline points="118.85,155.3 118.85,180.7" class="FOPActual" zindex="10"/>
    pts = map(lambda i: point(i,False), o['coordinates'])
    props = i['properties']
    propString = []
    for k in props:
        print(k)
        print(props[k])
        propString.append(str(k)+'=\"'+str(props[k])+'\"')
    pString = " ".join(propString)
    pline = '<line x1="'+str(pts[0][0])+'" y1="'+str(pts[0][1])+'" x2="'+str(pts[1][0])+'" y2="'+str(pts[1][1])+'" '+pString+'/>'
    #pline = NurbsCurve.ByControlPoints(polarray,1,o['properties']['closed'])
    return pline


def polyline(o):
    #<polyline points="118.85,155.3 118.85,180.7" class="FOPActual" zindex="10"/>
    polarray = []
    for p in o['coordinates']:
        pt = point(p)
        polarray.append(pt)
    pts = " ".join(polarray)
    props = i['properties']
    propString = []
    for k in props:

        propString.append(str(k)+'=\"'+str(props[k])+'\"')
    pString = " ".join(propString)
    pline = '<polyline points=\"'+pts+'\" '+pString+'/>'
    #pline = NurbsCurve.ByControlPoints(polarray,1,o['properties']['closed'])
    return pline

function_mappings = {
        'polyline': polyline,
        'line': line,
}
obarray = []
layout = json.loads(LAYOUT)
lPlane = layout['plane']
lOrigin = r.Geometry.Point3d(lPlane[0][0],lPlane[0][1],lPlane[0][2])
lXAx = r.Geometry.Vector3d(lPlane[1][0],lPlane[1][1],lPlane[1][2])
lYAx = r.Geometry.Vector3d(lPlane[2][0],lPlane[2][1],lPlane[2][2])
lPlane = r.Geometry.Plane(lOrigin,lXAx,lYAx)
for i in in1:
    print(i['geometry']['type'])
    fCall = function_mappings[i['geometry']['type']]
    obarray.append(fCall(i['geometry']))

#OUT = log
SVG = obarray
# ---------- end python ----------
svg = ClusterOutput(python)  # SVG output

# ==== cluster Geo2ArchiJSON: Converts Geometry to ArchiJSON
geometry = ClusterInput()  # Geometry to convert to ArchiJSON
output_type = ClusterInput()  # Output Type: 0 = PythonDictionary; 1=JSON String
properties = ClusterInput()  # Properties as a JSON to sync with Geometry
int = Integer(output_type)
geo = Geometry(geometry)
long = LongestList(ListA=geo, ListB=properties, PaddingMode=2)  # -> ListA, ListB
python = PythonScript(G=long.ListA, P=long.ListB, T=int)  # -> O; inputs G: list, P: list
# ---------- python: Python ----------
import rhinoscriptsyntax as rs
import json

def Point(geom,prop=None):
    pt = rs.coerce3dpoint(geom)
    pt = [pt[0],pt[1],pt[2]]
    return pt
def Curve(geom,prop=None):
    t = rs.CurvePoints(geom)
    tc = bool(rs.ClosedCurveOrientation(geom))
    pts = map(lambda g: Point(g), t)
    crv = {"geometry":{'coordinates':pts, 'type': 'polyline','closed':tc}}
    if prop:
        crv['properties'] = json.loads(prop)
    print(crv)
    return crv
otype = {"0": "Unknown object", "1": Point, "2": "PointCloud", "4": Curve, "8": "Surface", "16": "Polysurface", "32": "Mesh", "256": "Light", "512": "Annotation", "4096": "Instance reference", "8192": "Text dot", "16384": "Grip", "32768": "Detail", "65536": "Hatch", "131072": "Morph control", "134217728": "Cage", "268435456": "Phantom", "536870912": "Clipping plane", "1073741824": "Extrusion"}
def Convert(geom,prop):
    ot = otype[str(rs.ObjectType(geom))]
    print(ot)
    print(geom)
    if T == 0:
        return(ot(geom,prop))
    if T == 1:
        return(json.dumps((ot(geom,prop))))
O = map(lambda g,p: Convert(g,p), G,P)
# ---------- end python ----------
output = ClusterOutput(python)  # ArchiJSON Output

# ==== cluster RDB_SVGCompiler
svg_text = ClusterInput()  # SVG Text
json_layouy = ClusterInput()  # JSON Layout
css_text = ClusterInput()  # CSS Text
css = Data(css_text)
svg_text_2 = Data(svg_text)
python = PythonScript(j=json_layouy)  # -> PLANE, PAGE, SCALE
# ---------- python: Python ----------
import json
import Rhino as r
ob = json.loads(j)
PLANE = [item for sublist in ob['plane'] for item in sublist]
PAGE = ob['page']
SCALE = ob['scale']


lPlane = ob['plane']
lOrigin = r.Geometry.Point3d(lPlane[0][0],lPlane[0][1],lPlane[0][2])
lXAx = r.Geometry.Vector3d(lPlane[1][0],lPlane[1][1],lPlane[1][2])
lYAx = r.Geometry.Vector3d(lPlane[2][0],lPlane[2][1],lPlane[2][2])
PLANE = r.Geometry.Plane(lOrigin,lXAx,lYAx)
# ---------- end python ----------
data = Data("█")
rep = ReplaceText(Text=svg_text_2, Find="zindex=\"", Replace=data, RecursiveReplace=False)
panel = Panel("""<?xml version="1.0" encoding="utf-8"?>
<!-- Generator: Adobe Illustrator 16.0.0, SVG Export Plug-In . SVG Version: 6.00 Build 0)  -->
<!DOCTYPE svg PUBLIC "-//W3C//DTD SVG 1.1//EN" "http://www.w3.org/Graphics/SVG/1.1/DTD/svg11.dtd">
<svg version="1.1" xmlns="http://www.w3.org/2000/svg" xmlns:xlink="http://www.w3.org/1999/xlink" x="0px" y="0px"
width="100%" height="100%" viewBox="0 0 420 297"
xml:space="preserve">
<style type="text/css">""")
panel_2 = Panel(python.PAGE)
split = TextSplit(Text=rep, Separators=data)
dispatch = Dispatch(List=python.PAGE, DispatchPattern=[True, False])  # -> ListA, ListB
item = ListItem(List=reverse(split), Index=0, Wrap=True)
rep_2 = ReplaceText(Text="width=\"`mm\" height=\"~mm\" viewBox=\"0 0 ` ~\"", Find="`", Replace=dispatch.ListA, RecursiveReplace=False)
split_2 = TextSplit(Text=item, Separators="\"")
rep_3 = ReplaceText(Text=rep_2, Find="~", Replace=dispatch.ListB, RecursiveReplace=False)  # -> simplify(Result)
item_2 = ListItem(List=split_2, Index=0, Wrap=True)
merge = Merge(Data1=panel, Data2=css, Data3="</style>")
flatten = FlattenTree(Tree=item_2, Path="{0}")
tmatch = MatchText(Text=merge, RegEx="viewBox", Case=True)
num = Number(flatten)
mindex = MemberIndex(Set=tmatch, Member=Toggle(True))  # -> Index, Count
nullrep = ReplaceNulls(Items=num, Replacements=0)  # -> Items, Count
replace = ReplaceItems(List=merge, Item=rep_3, Indices=mindex.Index, Wrap=False)  # -> simplify(List)
sort = SortList(Keys=nullrep.Items, ValuesA=svg_text_2)  # -> Keys, ValuesA
tstat = TreeStatistics(Tree=flatten(sort.ValuesA))  # -> Paths, Length, Count
viewer = ParamViewer("</svg>")
int = Integer(tstat.Count)
repeat = RepeatData(Data=viewer, Length=int)
branch = TreeBranch(Tree="</svg>", Path=repeat, MaintainPaths=False)
merge_2 = Merge(Data1=flatten(replace), Data2=flatten(sort.ValuesA), Data3=flatten(branch))
svg_text_3 = Text(merge_2)
rep_4 = ReplaceText(Text=svg_text_3, Find=" =\"\" ", Replace=" ", RecursiveReplace=False)
join = TextJoin(Text=rep_4)
svg_content = Text(join)
svg_content_2 = ClusterOutput(svg_content)

# ==== cluster Cluster_4
layer = ClusterInput()
offsets = ClusterInput()
turning_diameter = Data()
layer_2 = Data(layer)
dpipeline = DynamicGeometryPipeline(
    LayerFilter=layer_2,
    TypeFilter="curve",
    NameFilter="*",
    enableFullPath=True,
    GroupByLayer=False,
    GroupByType=False,
    IncludeHidden=True,
    IncludeLocked=True,
    listenToAttributes=True)
panel = Panel(dpipeline)
m_mm = ClusterInput()
cluster = Cluster_3(layer=layer, diameter=turning_diameter)  # -> pt_2, inner_2, outer_2
centre_line = Data(dpipeline)
m_mm_2 = Data(m_mm)
offsets_2 = Data(offsets)
crv_cp = CurveClosestPoint(Point=flatten(cluster.pt_2), Curve=graft(centre_line))  # -> Point, Parameter, Distance
item = ListItem(List=offsets_2, Index=0, Wrap=False)  # -> Item, Item1, Item2, Item3, Item4, Item5
sort = SortList(Keys=crv_cp.Distance, ValuesA=crv_cp.Point, ValuesB=crv_cp.Parameter)  # -> Keys, ValuesA, ValuesB
division = Division(A=item.Item, B=2)
graft = GraftTree(Tree=centre_line, IncludeEmptyLists=True, IncludeNullItems=True)  # -> simplify(Tree)
division_2 = Division(A=turning_diameter, B=2)
smaller = SmallerThan(FirstNumber=sort.Keys, SecondNumber=Slider(1, range=0..1))  # -> SmallerThan, OrEqualTo
dispatch = Dispatch(List=sort.ValuesA, DispatchPattern=smaller.SmallerThan)  # -> ListA, ListB
item_2 = ListItem(List=dispatch.ListA, Index=0, Wrap=True)
circle = CircleCNR(Center=item_2, Normal=Vector(0, 0, 1), Radius=division_2)  # -> simplify(Circle)
clean = CleanTree(RemoveNulls=True, RemoveInvalid=True, RemoveEmpty=True, Tree=circle)
number_slider = Slider(2, range=0..10)
number_slider_2 = Slider(0, range=0..100)
number_slider_3 = Slider(2, range=0..10)
multiplication = Multiplication(A=item.Item3, _1000=1000)
multiplication_2 = Multiplication(A=item.Item5, _1000=1000)
multiplication_3 = Multiplication(A=division, _1000=1000)
multiplication_4 = Multiplication(A=item.Item1, _1000=1000)
multiplication_5 = Multiplication(A=item.Item2, _1000=1000)
multiplication_6 = Multiplication(A=item.Item4, _1000=1000)
merge = Merge(Data1=division, Data2=item.Item1, Data3=item.Item2, Data4=item.Item3, Data5=item.Item4, Data6=item.Item5)
filter = StreamFilter(Gate=m_mm_2, Stream0=item.Item3, Stream1=multiplication)
filter_2 = StreamFilter(Gate=m_mm_2, Stream0=item.Item5, Stream1=multiplication_2)
filter_3 = StreamFilter(Gate=m_mm_2, Stream0=division, Stream1=multiplication_3)
filter_4 = StreamFilter(Gate=m_mm_2, Stream0=item.Item1, Stream1=multiplication_4)
filter_5 = StreamFilter(Gate=m_mm_2, Stream0=item.Item2, Stream1=multiplication_5)
filter_6 = StreamFilter(Gate=m_mm_2, Stream0=item.Item4, Stream1=multiplication_6)
clean_2 = CleanTree(RemoveNulls=True, RemoveInvalid=True, RemoveEmpty=False, Tree=merge)
ma = MassAddition(Input=clean_2)  # -> Result, PartialResults
polyoffset = PolylineOffset(
    Polylines=graft,
    Distance=filter_3,
    Plane=Plane(origin=(0, 0, 0), x=(0, 0, 0), y=(0, 0, 0)),
    Tolerance=0.01,
    ClosedFillet=number_slider_3,
    OpenFillet=number_slider,
    Miter=number_slider_2)  # -> Contour, Holes
multiplication_7 = Multiplication(A=ma.Result, B=2)
crv = Curve([polyoffset.Contour, clean])
polyoffset_2 = PolylineOffset(
    Polylines=crv,
    Distance=filter_4,
    Plane=Plane(origin=(0, 0, 0), x=(0, 0, 0), y=(0, 0, 0)),
    Tolerance=0.01,
    ClosedFillet=number_slider_3,
    OpenFillet=number_slider,
    Miter=number_slider_2)  # -> Contour, Holes
crv_2 = Curve(polyoffset_2.Contour)
polyoffset_3 = PolylineOffset(
    Polylines=crv_2,
    Distance=filter_5,
    Plane=Plane(origin=(0, 0, 0), x=(0, 0, 0), y=(0, 0, 0)),
    Tolerance=0.01,
    ClosedFillet=number_slider_3,
    OpenFillet=number_slider,
    Miter=number_slider_2)  # -> Contour, Holes
crv_3 = Curve(polyoffset_3.Contour)
polyoffset_4 = PolylineOffset(
    Polylines=crv_3,
    Distance=filter,
    Plane=Plane(origin=(0, 0, 0), x=(0, 0, 0), y=(0, 0, 0)),
    Tolerance=0.01,
    ClosedFillet=number_slider_3,
    OpenFillet=number_slider,
    Miter=number_slider_2)  # -> Contour, Holes
crv_4 = Curve(polyoffset_4.Contour)
polyoffset_5 = PolylineOffset(
    Polylines=crv_4,
    Distance=filter_6,
    Plane=Plane(origin=(0, 0, 0), x=(0, 0, 0), y=(0, 0, 0)),
    Tolerance=0.01,
    ClosedFillet=number_slider_3,
    OpenFillet=number_slider,
    Miter=number_slider_2)  # -> Contour, Holes
crv_5 = Curve(polyoffset_5.Contour)
polyoffset_6 = PolylineOffset(
    Polylines=crv_5,
    Distance=filter_2,
    Plane=Plane(origin=(0, 0, 0), x=(0, 0, 0), y=(0, 0, 0)),
    Tolerance=0.01,
    ClosedFillet=number_slider_3,
    OpenFillet=number_slider,
    Miter=number_slider_2)  # -> Contour, Holes
crv_6 = Curve(polyoffset_6.Contour)
group = Group(Objects=flatten(crv_6))
group_2 = Group(Objects=flatten(crv_5))
group_3 = Group(Objects=flatten(crv_4))
group_4 = Group(Objects=flatten(crv_3))
group_5 = Group(Objects=flatten(crv_2))
group_6 = Group(Objects=flatten(crv))
_3 = Data(flatten(group_3))
_5 = Data(flatten(group))
_1 = Data(flatten(group_5))
_2 = Data(flatten(group_4))
_4 = Data(flatten(group_2))
total_width = Data(multiplication_7)
_0 = Data(group_6)
panel_2 = Panel(_0)
_2_2 = ClusterOutput(_2)
_3_2 = ClusterOutput(_3)
_5_2 = ClusterOutput(_5)
total_width_2 = ClusterOutput(total_width)
_0_2 = ClusterOutput(_0)
_1_2 = ClusterOutput(_1)
_4_2 = ClusterOutput(_4)

# ==== cluster Cluster_5
number_slider = Slider(0.3, range=0..1)
G = ClusterInput()
number_slider_2 = Slider(0.01, range=0..0.01)
radius = ClusterInput()
geo = ClusterInput()
distances = ClusterInput()
ungroup = Ungroup(Group=G)
m_mm = ClusterInput()
fillet_f_chamfer_t = ClusterInput()
distances_2 = Data(distances)
radius_2 = Data(radius)
m_mm_2 = Data(m_mm)
curve = Data(flatten(ungroup))
multiplication = Multiplication(A=number_slider_2, _1000=1000)
null = NullItem(Item=radius_2)  # -> NullFlags, InvalidFlags, Description
fillet_f_chamfer_t_2 = Data(fillet_f_chamfer_t)
radius_3 = Data(fillet_f_chamfer_t_2)
filter = StreamFilter(Gate=m_mm_2, Stream0=number_slider_2, Stream1=multiplication)
filter_2 = StreamFilter(Gate=null.NullFlags, Stream0=radius_2, Stream1=Slider(0, range=0..100))
null_2 = NullItem(Item=radius_3)  # -> NullFlags, InvalidFlags, Description
sort = SortList(Keys=distances_2)  # -> Keys, ValuesA
filter_3 = StreamFilter(Gate=null_2.NullFlags, Stream0=fillet_f_chamfer_t_2, Stream1=Toggle(False))
multiplication_2 = Multiplication(A=number_slider, _1000=1000)
mesh = Mesh(curve)
multiplication_3 = Multiplication(A=sort.Keys, B=Slider(5, range=0..10))
polyoffset = PolylineOffset(
    Polylines=flatten(curve),
    Distance=filter,
    Plane=Plane(origin=(0, 0, 0), x=(0, 0, 0), y=(0, 0, 0)),
    Tolerance=0.01,
    ClosedFillet=Slider(1, range=0..10),
    OpenFillet=Slider(1, range=0..1),
    Miter=Slider(0, range=0..100))  # -> Contour, Holes
mjoin = MeshJoin(Meshes=mesh)
item = ListItem(List=multiplication_3, Index=0, Wrap=True)  # -> Item1, Item
filter_4 = StreamFilter(Gate=m_mm_2, Stream0=number_slider, Stream1=multiplication_2)
panel = Panel(filter_3)
crv = Curve(simplify(graft(polyoffset.Holes)))
polyoffset_2 = PolylineOffsetSETTINGS(
    Polylines=crv,
    Distance=filter_4,
    Plane=Plane(origin=(0, 0, 0), x=(0, 0, 0), y=(0, 0, 0)),
    Tolerance=0.001,
    ClosedFillet=2,
    OpenFillet=2,
    Miter=0)  # -> Contour, simplify(Holes)
subtraction = Subtraction(A=item.Item, B=0.5)
crv_2 = Curve(polyoffset_2.Holes)
eval = EvaluateCurve(Curve=reparameterize(crv_2), Parameter=0)  # -> Point, Tangent, Angle
flatten = FlattenTree(Tree=crv, Path="{0}")
number_slider_3 = Slider(999, range=0..1000)
neg = Negative(Value=number_slider_3)
Z = UnitZ(Factor=number_slider_3)
Z_2 = UnitZ(Factor=neg)
move = Move(Geometry=eval.Point, Motion=Z)  # -> Geometry, Transform
meshray = MeshRay(Mesh=mjoin, Point=move.Geometry, Direction=Z_2)  # -> Point, Hit
null_3 = NullItem(Item=meshray.Point)  # -> NullFlags, InvalidFlags, Description
number_slider_4 = Slider(4, range=0..10)
item_2 = ListItem(List=null_3.NullFlags, Index=0, Wrap=True)  # -> flatten(Item)
dispatch = Dispatch(List=flatten, DispatchPattern=item_2)  # -> ListA, ListB
number_slider_5 = Slider(10, range=0..10)
crv_3 = Curve(dispatch.ListA)

# ---- group: outer curve
crv_4 = Curve(polyoffset.Contour)

# ----
explode = Explode(Curve=crv_4, Recursive=True)  # -> Segments, Vertices
len = Length(Curve=explode.Segments)
larger = LargerThan(FirstNumber=len, SecondNumber=subtraction)  # -> LargerThan, OrEqualTo
dispatch_2 = Dispatch(List=explode.Segments, DispatchPattern=larger.OrEqualTo)  # -> ListA, ListB
crv_5 = Curve(dispatch_2.ListA)
end = EndPoints(Curve=crv_5)  # -> Start, End
ext = ExtendCurve(Curve=crv_5, Type=0, Start=number_slider_5, End=number_slider_5)
pt = Point(simplify(graft(end.Start)))
mcx = MultipleCurves(Curves=ext)  # -> Points, IndexA, IndexB, ParamA, ParamB
pull = PullPoint(Point=pt, Geometry=mcx.Points, ClosestOnly=True)  # -> ClosestPoint, Distance
sort_2 = SortList(Keys=pull.Distance, ValuesA=pull.ClosestPoint)  # -> simplify(Keys), simplify(ValuesA)
graft = GraftTree(Tree=end.End, IncludeEmptyLists=True, IncludeNullItems=True)  # -> simplify(Tree)
item_3 = ListItem(List=sort_2.ValuesA, Index=0, Wrap=True)
ln = Line(StartPoint=item_3, EndPoint=graft)  # -> flatten(Line)
merge = Merge(Data1=flatten(crv_4), Data2=flatten(crv_3))
end_2 = EndPoints(Curve=ln)  # -> Start, End
pt_2 = Point(simplify(graft(end_2.End)))
pull_2 = PullPoint(Point=pt_2, Geometry=mcx.Points, ClosestOnly=True)  # -> ClosestPoint, Distance
simplify = SimplifyCurve(Curve=merge)  # -> Curve, Simplified
sort_3 = SortList(Keys=pull_2.Distance, ValuesA=pull_2.ClosestPoint)  # -> simplify(Keys), simplify(ValuesA)
graft_2 = GraftTree(Tree=end_2.Start, IncludeEmptyLists=True, IncludeNullItems=True)  # -> simplify(Tree)
redpline = Reduce(Polyline=simplify.Curve, Tolerance=Slider(0.01, range=0..0.01))  # -> Polyline, Reduction
geo_2 = Geometry(geo)
item_4 = ListItem(List=sort_3.ValuesA, Index=0, Wrap=True)
ln_2 = Line(StartPoint=item_4, EndPoint=graft_2)  # -> flatten(Line)
ungroup_2 = Ungroup(Group=geo_2)
join = JoinCurves(Curves=ln_2, Preserve=False)
brep = Brep(ungroup_2)
crv_6 = Curve(ungroup_2)
clean = CleanTree(RemoveNulls=True, RemoveInvalid=True, RemoveEmpty=True, Tree=crv_6)  # -> simplify(graft(Tree))
clean_2 = CleanTree(RemoveNulls=True, RemoveInvalid=True, RemoveEmpty=True, Tree=brep)  # -> simplify(Tree)
debrep = DeconstructBrep(Brep=clean_2)  # -> simplify(Faces), Edges, Vertices
area = Area(Geometry=debrep.Faces)  # -> Area, Centroid
pdecon = Deconstruct(Point=area.Centroid)  # -> XComponent, YComponent, ZComponent
sort_4 = SortList(Keys=pdecon.ZComponent, ValuesA=debrep.Faces)  # -> Keys, ValuesA
item_5 = ListItem(List=sort_4.ValuesA, Index=0, Wrap=True)
debrep_2 = DeconstructBrep(Brep=item_5)  # -> Faces, Edges, Vertices
join_2 = JoinCurves(Curves=debrep_2.Edges, Preserve=False)  # -> simplify(flatten(Curves))
project = Project(Geometry=clean, Plane=PlaneXY(0, 0, 0))  # -> Geometry, Transform
trim = TrimWithRegions(Curve=redpline.Polyline, Regions=join_2)  # -> Inside, simplify(Outside)
crv_7 = Curve(flatten(trim.Outside))
ccx = CurveCurve(CurveA=simplify(project.Geometry), CurveB=simplify(crv_7))  # -> Points, ParamsA, ParamsB
crv_8 = Curve(trim.Inside)
trim_2 = TrimTree(Tree=ccx.ParamsA, Depth=1)
shatter = Shatter(Curve=project.Geometry, Parameters=trim_2)
trim_3 = TrimTree(Tree=shatter, Depth=1)
item_6 = ListItem(List=trim_3, Index=Slider(1, range=0..1), Wrap=True)  # -> flatten(Item)
join_3 = JoinCurves(Curves=[item_6, crv_7], Preserve=False)
null_4 = NullItem(Item=join_3)  # -> NullFlags, InvalidFlags, Description
group = Group(Objects=join_3)
multiplication_4 = Multiplication(A=filter_2, _1000=1000)
filter_5 = StreamFilter(Gate=null_4.NullFlags, Stream0=join_3, Stream1=redpline.Polyline)
multiplication_5 = Multiplication(A=filter_2, _1000=1000)
filter_6 = StreamFilter(Gate=m_mm_2, Stream0=filter_2, Stream1=multiplication_4)
explode_2 = Explode(Curve=filter_5, Recursive=True)  # -> Segments, Vertices
clean_curve = Data(filter_5)
filter_7 = StreamFilter(Gate=m_mm_2, Stream0=filter_2, Stream1=multiplication_5)
clean_curve_2 = ClusterOutput(clean_curve)
fillet = Fillet(Curve=filter_5, Radius=filter_6)
neg_2 = Negative(Value=filter_7)
group_2 = Group(Objects=fillet)
ext_2 = ExtendCurve(Curve=explode_2.Segments, Type=0, Start=neg_2, End=neg_2)
end_3 = EndPoints(Curve=ext_2)  # -> simplify(graft(Start)), End
pt_3 = Point(flatten(end_3.End))
pt_4 = Point(simplify(end_3.Start))
pull_3 = PullPoint(Point=pt_4, Geometry=pt_3, ClosestOnly=True)  # -> ClosestPoint, Distance
sort_5 = SortList(Keys=pull_3.Distance, ValuesA=pull_3.ClosestPoint)  # -> Keys, ValuesA
item_7 = ListItem(List=sort_5.ValuesA, Index=0, Wrap=True)  # -> simplify(Item)
ln_3 = Line(StartPoint=pt_4, EndPoint=item_7)
merge_2 = Merge(Data1=flatten(ln_3), Data2=flatten(ext_2))
join_4 = JoinCurves(Curves=merge_2, Preserve=False)  # -> flatten(Curves)
group_3 = Group(Objects=join_4)
filter_8 = StreamFilter(Gate=filter_3, Stream0=group_2, Stream1=group_3)
curve_2 = Data(filter_8)
curve_3 = ClusterOutput(curve_2)

# ==== cluster Cluster_6
number_slider = Slider(0.2, range=0..1)
G = ClusterInput()
number_slider_2 = Slider(0.01, range=0..0.01)
radius = ClusterInput()
ungroup = Ungroup(Group=G)
m_mm = ClusterInput()
fillet_f_chamfer_t = ClusterInput()
radius_2 = Data(radius)
curve = Data(flatten(ungroup))
m_mm_2 = Data(m_mm)
multiplication = Multiplication(A=number_slider_2, _1000=1000)
null = NullItem(Item=radius_2)  # -> NullFlags, InvalidFlags, Description
fillet_f_chamfer_t_2 = Data(fillet_f_chamfer_t)
radius_3 = Data(fillet_f_chamfer_t_2)
filter = StreamFilter(Gate=m_mm_2, Stream0=number_slider_2, Stream1=multiplication)
filter_2 = StreamFilter(Gate=null.NullFlags, Stream0=radius_2, Stream1=Slider(0, range=0..100))
null_2 = NullItem(Item=radius_3)  # -> NullFlags, InvalidFlags, Description
filter_3 = StreamFilter(Gate=null_2.NullFlags, Stream0=fillet_f_chamfer_t_2, Stream1=Toggle(False))
multiplication_2 = Multiplication(A=number_slider, _1000=1000)
mesh = Mesh(curve)
polyoffset = PolylineOffset(
    Polylines=flatten(curve),
    Distance=filter,
    Plane=Plane(origin=(0, 0, 0), x=(0, 0, 0), y=(0, 0, 0)),
    Tolerance=0.01,
    ClosedFillet=Slider(1, range=0..10),
    OpenFillet=Slider(1, range=0..1),
    Miter=Slider(0, range=0..100))  # -> Contour, Holes
mjoin = MeshJoin(Meshes=mesh)
filter_4 = StreamFilter(Gate=m_mm_2, Stream0=number_slider, Stream1=multiplication_2)
panel = Panel(filter_3)
crv = Curve(simplify(graft(polyoffset.Holes)))
polyoffset_2 = PolylineOffsetSETTINGS(
    Polylines=crv,
    Distance=filter_4,
    Plane=Plane(origin=(0, 0, 0), x=(0, 0, 0), y=(0, 0, 0)),
    Tolerance=0.001,
    ClosedFillet=2,
    OpenFillet=2,
    Miter=0)  # -> Contour, simplify(Holes)
crv_2 = Curve(polyoffset_2.Holes)
eval = EvaluateCurve(Curve=reparameterize(crv_2), Parameter=0)  # -> Point, Tangent, Angle
flatten = FlattenTree(Tree=crv, Path="{0}")
number_slider_3 = Slider(999, range=0..1000)
neg = Negative(Value=number_slider_3)
Z = UnitZ(Factor=number_slider_3)
Z_2 = UnitZ(Factor=neg)
move = Move(Geometry=eval.Point, Motion=Z)  # -> Geometry, Transform
meshray = MeshRay(Mesh=mjoin, Point=move.Geometry, Direction=Z_2)  # -> Point, Hit
null_3 = NullItem(Item=meshray.Point)  # -> NullFlags, InvalidFlags, Description
item = ListItem(List=null_3.NullFlags, Index=0, Wrap=True)  # -> flatten(Item)
dispatch = Dispatch(List=flatten, DispatchPattern=item)  # -> ListA, ListB

# ---- group: outer curve
crv_3 = Curve(polyoffset.Contour)

# ----
crv_4 = Curve(dispatch.ListA)
merge = Merge(Data1=flatten(crv_3), Data2=flatten(crv_4))
simplify = SimplifyCurve(Curve=merge)  # -> Curve, Simplified
multiplication_3 = Multiplication(A=filter_2, _1000=1000)
multiplication_4 = Multiplication(A=filter_2, _1000=1000)
filter_5 = StreamFilter(Gate=m_mm_2, Stream0=filter_2, Stream1=multiplication_3)
filter_6 = StreamFilter(Gate=m_mm_2, Stream0=filter_2, Stream1=multiplication_4)
fillet = Fillet(Curve=simplify.Curve, Radius=filter_5)
explode = Explode(Curve=simplify.Curve, Recursive=True)  # -> Segments, Vertices
neg_2 = Negative(Value=filter_6)
group = Group(Objects=fillet)
ext = ExtendCurve(Curve=explode.Segments, Type=0, Start=neg_2, End=neg_2)
group_2 = Group(Objects=simplify.Curve)
clean_curve = Data(group_2)
end = EndPoints(Curve=ext)  # -> simplify(graft(Start)), End
clean_curve_2 = ClusterOutput(clean_curve)
pt = Point(flatten(end.End))
pt_2 = Point(simplify(end.Start))
pull = PullPoint(Point=pt_2, Geometry=pt, ClosestOnly=True)  # -> ClosestPoint, Distance
sort = SortList(Keys=pull.Distance, ValuesA=pull.ClosestPoint)  # -> Keys, ValuesA
item_2 = ListItem(List=sort.ValuesA, Index=0, Wrap=True)  # -> simplify(Item)
ln = Line(StartPoint=pt_2, EndPoint=item_2)
merge_2 = Merge(Data1=flatten(ln), Data2=flatten(ext))
join = JoinCurves(Curves=merge_2, Preserve=False)  # -> flatten(Curves)
group_3 = Group(Objects=join)
filter_7 = StreamFilter(Gate=filter_3, Stream0=group, Stream1=group_3)
curve_2 = Data(filter_7)
curve_3 = ClusterOutput(curve_2)

# ==== cluster LAYSPLITNEW
T = ClusterInput()
split = TextSplit(Text=T, Separators=";")
split_2 = TextSplit(Text=split, Separators=",")
partition = PartitionList(List=split_2, Size=[9, 2, 1])  # -> simplify(Chunks)
branch = TreeBranch(Tree=partition, Path="{0}", MaintainPaths=True)
branch_2 = TreeBranch(Tree=partition, Path="{1}", MaintainPaths=True)
branch_3 = TreeBranch(Tree=partition, Path="{2}", MaintainPaths=True)
item = ListItem(List=branch, Index=0, Wrap=True)  # -> Item, Item1, Item2
item_2 = ListItem(List=branch, Index=3, Wrap=True)  # -> Item, Item1, Item2
item_3 = ListItem(List=branch, Index=6, Wrap=True)  # -> Item, Item1, Item2
pt = ConstructPoint(XCoordinate=item.Item, YCoordinate=item.Item1, ZCoordinate=item.Item2)
vec = VectorXYZ(XComponent=item_2.Item, YComponent=item_2.Item1, ZComponent=item_2.Item2)  # -> Vector, Length
vec_2 = VectorXYZ(XComponent=item_3.Item, YComponent=item_3.Item1, ZComponent=item_3.Item2)  # -> Vector, Length
pl = ConstructPlane(Origin=pt, XAxis=vec.Vector, YAxis=vec_2.Vector)
data = Data(branch_3)
data_2 = Data(branch_2)
data_3 = ClusterOutput(data_2)
data_4 = ClusterOutput(data)
pl_2 = ClusterOutput(pl)

# ==== cluster Cluster
data = ClusterInput()
data_2 = Data(data)
trim = TrimTree(Tree=data_2, Depth=1)
null = NullItem(Item=trim)  # -> NullFlags, InvalidFlags, Description
ma = MassAddition(Input=null.NullFlags)  # -> Result, PartialResults
bool = Boolean(invert(ma.Result))
trim_2 = TrimTree(Tree=data_2, Depth=bool)
data_3 = Data(trim_2)
data_4 = ClusterOutput(data_3)

# ==== cluster Duration
L = ClusterInput()
R = ClusterInput()
item = ListItem(List=L, Index=0, Wrap=True)
tmatch = MatchText(Text=item, RegEx=R, Case=True)
tstat = TreeStatistics(Tree=L)  # -> Paths, Length, Count
trim = TrimTree(Tree=tmatch, Depth=1)
dispatch = Dispatch(List=tstat.Paths, DispatchPattern=flatten(tmatch))  # -> ListA, ListB
ma = MassAddition(Input=trim)  # -> Result, PartialResults
equals = Equality(FirstNumber=ma.Result, SecondNumber=0)  # -> flatten(Equality), Inequality
branch = TreeBranch(Tree=L, Path=dispatch.ListA, MaintainPaths=True)  # -> simplify(Branch)
mindex = MemberIndex(Set=equals.Equality, Member=True)  # -> Index, Count
item_2 = ListItem(List=branch, Index=1, Wrap=True)  # -> simplify(flatten(Item))
lng = ListLength(List=mindex.Index)
lng_2 = ListLength(List=mindex.Index)  # -> expr("x-1", Length)
item_3 = ListItem(List=mindex.Index, Index=0, Wrap=True)
cull_i = CullIndex(List=mindex.Index, Indices=0, Wrap=True)
repeat = RepeatData(Data=" ", Length=lng)  # -> flatten(Data)
series = Series(Start=1, Step=1, Count=lng_2)
subtraction = Subtraction(A=cull_i, B=series)
merge = Merge(Data1=flatten(item_3), Data2=flatten(subtraction))
ins = InsertItems(List=item_2, Item=repeat, Indices=merge, Wrap=False)
clean = CleanTree(RemoveNulls=True, RemoveInvalid=True, RemoveEmpty=False, Tree=ins)
T = ClusterOutput(clean)

# ==== cluster COMPILEPROPS
attributes = ClusterInput()
z_index = ClusterInput()
class = ClusterInput()
attributes_2 = Data(attributes)
z_index_2 = Data(z_index)
class_2 = Text(class)
null = NullItem(Item=class_2)  # -> NullFlags, InvalidFlags, Description
rep = ReplaceText(Text="class=\"~\"", Find="~", Replace=class_2, RecursiveReplace=False)
rep_2 = ReplaceText(Text="zindex=\"~\"", Find="~", Replace=z_index_2, RecursiveReplace=False)
dispatch = Dispatch(List=rep, DispatchPattern=null.NullFlags)  # -> ListA, ListB
long = LongestList(ListA=dispatch.ListB, ListB=attributes_2, ListC=rep_2, PaddingMode=2)  # -> ListA, ListB, ListC
graft = GraftTree(Tree=long.ListA, IncludeEmptyLists=True, IncludeNullItems=True)
graft_2 = GraftTree(Tree=long.ListB, IncludeEmptyLists=True, IncludeNullItems=True)
graft_3 = GraftTree(Tree=long.ListC, IncludeEmptyLists=True, IncludeNullItems=True)
merge = Merge(Data1=graft, Data2=graft_2, Data3=graft_3)
join = TextJoin(Text=merge, Join=" ")  # -> simplify(Result)
R = ClusterOutput(join)

# ==== cluster UberTrim: Better version of Trim
data = ClusterInput()
data_2 = Data(data)
trim = TrimTree(Tree=data_2, Depth=1)
null = NullItem(Item=trim)  # -> NullFlags, InvalidFlags, Description
bool = Boolean(invert(null.NullFlags))
trim_2 = TrimTree(Tree=data_2, Depth=bool)
data_3 = Data(trim_2)
data_4 = ClusterOutput(data_3)

# ==== cluster Cluster_3
diameter = ClusterInput()
inner_diameter = ClusterInput()
layer = ClusterInput()
diameter_2 = Data(diameter)
inner_diameter_2 = Data(inner_diameter)
layer_2 = Data(layer)
split = TextSplit(Text=layer_2, Separators="::")
dispatch = Dispatch(List=split, DispatchPattern=[True, False])  # -> ListA, ListB
cull_i = CullIndex(List=dispatch.ListA, Indices="-1", Wrap=True)
dpipeline = DynamicGeometryPipeline(
    LayerFilter=layer_2,
    TypeFilter="curve",
    NameFilter="*",
    enableFullPath=True,
    GroupByLayer=False,
    GroupByType=False,
    IncludeHidden=True,
    IncludeLocked=True,
    listenToAttributes=True)
join = TextJoin(Text=cull_i, Join="::")
concat = Concatenate(FragmentA=join, FragmentB="::Roundabout")
division = Division(A=diameter_2, B=2)
dpipeline_2 = DynamicGeometryPipeline(
    LayerFilter=concat,
    TypeFilter="point",
    NameFilter="*",
    enableFullPath=True,
    GroupByLayer=False,
    GroupByType=False,
    IncludeHidden=True,
    IncludeLocked=True,
    listenToAttributes=True)
circle = CircleCNR(Center=dpipeline_2, Normal=Vector(0, 0, 1), Radius=inner_diameter_2)
circle_2 = CircleCNR(Center=dpipeline_2, Normal=Vector(0, 0, 1), Radius=division)
pt = Data(dpipeline_2)
outer = Data(circle)
inner = Data(circle_2)
inner_2 = ClusterOutput(inner)
pt_2 = ClusterOutput(pt)
outer_2 = ClusterOutput(outer)
